# Grasshopper definition Bending-GridShell.ghx (Grasshopper 0.9.76)
# plug-ins: Kangaroo Components, Kangaroo2 Components

mesh = Mesh(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)
medges = MeshEdges(Mesh=mesh)  # -> NakedEdges, InteriorEdges, NonManifoldEdges
warpweft = WarpWeft(Mesh=mesh)  # -> Warp, Weft, NakedA, NakedB
join = JoinCurves(Curves=warpweft.Warp, Preserve=False)
join_2 = JoinCurves(Curves=warpweft.Weft, Preserve=False)
pt = Point([Point(5, 17, 0), Point(6, 18, 0), Point(7, 19, 0), Point(8, 20, 0), Point(22, 20, 0), Point(23, 19, 0), Point(24, 18, 0), Point(25, 17, 0), Point(25, 8, 0), Point(24, 7, 0), Point(23, 6, 0), Point(22, 5, 0), Point(8, 5, 0), Point(7, 6, 0), Point(6, 7, 0), Point(5, 8, 0)])
crv = Curve(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)
explode = Explode(Curve=join, Recursive=True)  # -> Segments, Vertices
explode_2 = Explode(Curve=join_2, Recursive=True)  # -> Segments, Vertices
shift = ShiftList(List=explode.Segments, Shift=1, Wrap=False)
shift_2 = ShiftList(List=explode_2.Segments, Shift=1, Wrap=False)
demesh = DeconstructMesh(Mesh=mesh)  # -> Vertices, Faces, Colours, Normals
Z = UnitZ(Factor=0.001)
oncurve = OnCurve(Points=pt, Curve=crv, Strength=1)
short = ShortestList(ListA=explode.Segments, ListB=shift, TrimMode=2)  # -> ListA, ListB
short_2 = ShortestList(ListA=explode_2.Segments, ListB=shift_2, TrimMode=2)  # -> ListA, ListB
length_line = LengthLine(Line=[medges.NakedEdges, medges.InteriorEdges], Strength=Slider(10, range=10..1000))
angle = Angle(LineA=short.ListA, LineB=short.ListB, Strength=1)
angle_2 = Angle(LineA=short_2.ListA, LineB=short_2.ListB, Strength=1)
show = Show(G=mesh)
load = Load(Point=demesh.Vertices, ForceVector=Z)
merge = Merge(Data1=show, Data2=angle, Data3=angle_2, Data4=load, Data5=length_line, Data6=oncurve)  # -> flatten(Result)
panel = Panel(oncurve)
solver = Solver(GoalObjects=merge, Reset=Button(), Threshold=1e-15, Tolerance=0.01, On=Toggle(False))  # -> I, V, O
crv_2 = Curve(solver.O)
mesh_2 = Mesh(solver.O)
clean = CleanTree(RemoveNulls=True, RemoveInvalid=True, RemoveEmpty=False, Tree=crv_2)
clean_2 = CleanTree(RemoveNulls=True, RemoveInvalid=True, RemoveEmpty=False, Tree=mesh_2)
crv_3 = Curve(clean)
mesh_3 = Mesh(clean_2)
