# Grasshopper definition Catenary-Galapagos.ghx (Grasshopper 0.9.76)
# plug-ins: Kangaroo2 Components

mplane = MeshPlane(Boundary={Plane=PlaneXY(0, 0, 0), Size=Domain2(u=-10..10, v=-10..10)}, WidthCount=10, HeightCount=10)  # -> Mesh, Area
# This definition shows how the 'Zombie' solver
# can be used in conjunction with Galapagos to
# optimize the Kangaroo Goal input parameters
# to achieve a certain geometry. In this case the
# tensile strength of an inverted hanging net to
# achieve a particular height.
number_slider = Slider(12.858, range=1..100)
corners = Corners(mesh=mplane.Mesh)
medges = MeshEdges(Mesh=mplane.Mesh)  # -> NakedEdges, InteriorEdges, NonManifoldEdges
demesh = DeconstructMesh(Mesh=mplane.Mesh)  # -> Vertices, Faces, Colours, Normals
load = Load(Point=demesh.Vertices, ForceVector=Vector(0, 0, 1))
anchor = Anchor(Point=corners, Strength=1000)
# The zombie solver does not show
# intermediate iterations like the normal
# Kangaroo solver - it only outputs the end
# result, which is more suitable in this case,
# as the iterative version would interfere
# with Galapagos' own iterations.
length_line = LengthLine(Line=[medges.NakedEdges, medges.InteriorEdges], Strength=number_slider)
zombiesolver = ZombieSolver(GoalObjects=[anchor, length_line, load], Threshold=1e-10, Tolerance=0.01, MaxIterations=50000)  # -> I, V, O
pdecon = Deconstruct(Point=zombiesolver.V)  # -> XComponent, YComponent, ZComponent
data = Data(zombiesolver.O)
sort = SortList(Keys=pdecon.ZComponent)  # -> reverse(Keys), ValuesA
# Sorting the output points by height
# and finding the absolute value of
# the difference between the highest
# one and the target height of 15.
item = ListItem(List=sort.Keys, Index=0, Wrap=True)
panel = Panel(item)
subtraction = Subtraction(A=item, B="15")
abs = Absolute(Value=subtraction)
# To run this optimization, double click
# the pink Galapagos component, then
# the 'Solvers' tab and 'Start Solver'.
galapagos = Galapagos(fitness=num, gene=number_slider)
num = Number(abs)
panel_2 = Panel(num)

# ==== cluster Corners: Find the boundary corner points of a quad mesh
mesh = ClusterInput()
mesh_2 = Mesh(mesh)
nv = NakedVertices(Mesh=mesh_2)  # -> ClothedIndex, NakedIndex, ClothedPts, NakedPts
vn = VertexNeighbours(Mesh=mesh_2, VertexNumber=nv.NakedIndex)  # -> graft(Vertex), Neighbours, Normal
lng = ListLength(List=vn.Neighbours)
equals = Equality(FirstNumber=lng, SecondNumber=3)  # -> Equality, Inequality
cull = CullPattern(List=vn.Vertex, CullPattern=equals.Inequality)
pshift = ShiftPaths(Data=cull, Offset=-1)
D = ClusterOutput(pshift)
