# Grasshopper definition Collidion-Rigid-Mesh-X10.ghx (Grasshopper 0.9.76)
# plug-ins: Kangaroo2 Components

number_slider = Slider(3, range=0..10)
number_slider_2 = Slider(3, range=0..10)
number_slider_3 = Slider(3, range=0..10)
brep = Brep([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])
msphereex = MeshSphereEx(Base="0,0,100", Radius=number_slider, Count=5)
msphereex_2 = MeshSphereEx(Base="0,4,4", Radius=number_slider, Count=5)
msphereex_3 = MeshSphereEx(Base="0,0,100", Radius=number_slider_2, Count=5)
msphereex_4 = MeshSphereEx(Base="0,4,4", Radius=number_slider_2, Count=5)
mesh = Mesh(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)
mesh_2 = Mesh(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)
scale_nu = ScaleNU(Geometry=msphereex_2, Plane=PlaneXY(0, 0, 0), ScaleX=Slider(2, range=0..10), ScaleY=1, ScaleZ=1)  # -> Geometry, Transform
msphereex_5 = MeshSphereEx(Base="0,0,100", Radius=number_slider_3, Count=5)
msphereex_6 = MeshSphereEx(Base="0,4,4", Radius=number_slider_3, Count=5)
scale_nu_2 = ScaleNU(Geometry=msphereex_4, Plane=PlaneXY(0, 0, 0), ScaleX=Slider(2, range=0..10), ScaleY=1, ScaleZ=1)  # -> Geometry, Transform
mesh_3 = Mesh(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)
mesh_4 = Mesh(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)
mesh_5 = MeshBrep(
    Brep=brep,
    Settings={GridMaxCount=0, GridMinCount=16, JaggedSeams=False, MaxEdgeLength=0, MinEdgeLength=0.0001, MinTolerance=0, Refine=True, RefineAngle=0, RelativeTolerance=0.65, SimplePlanes=True, Tolerance=0})
mesh_6 = MeshBrep(
    Brep=brep,
    Settings={GridMaxCount=0, GridMinCount=16, JaggedSeams=False, MaxEdgeLength=0, MinEdgeLength=0.0001, MinTolerance=0, Refine=True, RefineAngle=0, RelativeTolerance=0.65, SimplePlanes=True, Tolerance=0})
area = Area(Geometry=mesh_6)  # -> Area, Centroid
scale_nu_3 = ScaleNU(Geometry=msphereex_6, Plane=PlaneXY(0, 0, 0), ScaleX=Slider(2, range=0..10), ScaleY=1, ScaleZ=1)  # -> Geometry, Transform
area_2 = Area(Geometry=scale_nu.Geometry)  # -> Area, Centroid
vec2pt = Vector2Pt(PointA=area.Centroid, PointB="20,20,0", Unitize=False)  # -> Vector, Length
rotate = Rotate(Geometry=scale_nu.Geometry, Angle=area_2.Centroid, Plane=PlaneXY(0, 0, 0))  # -> Geometry, Transform
area_3 = Area(Geometry=scale_nu_3.Geometry)  # -> Area, Centroid
panel = Panel(mesh_5)
devec = DeconstructVector(Vector=vec2pt.Vector)  # -> XComponent, YComponent, ZComponent
merge = Merge(Data1=rotate.Geometry, Data2=msphereex, Data4=mesh_2)  # -> flatten(Result)
rotate_2 = Rotate(Geometry=scale_nu_3.Geometry, Angle=area_3.Centroid, Plane=PlaneXY(0, 0, 0))  # -> Geometry, Transform
area_4 = Area(Geometry=scale_nu_2.Geometry)  # -> Area, Centroid
rotate_3 = Rotate(Geometry=scale_nu_2.Geometry, Angle=area_4.Centroid, Plane=PlaneXY(0, 0, 0))  # -> Geometry, Transform
mesh_7 = Mesh([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])
mesh_8 = Mesh([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])
vec = VectorXYZ(XComponent=devec.XComponent, YComponent=devec.YComponent, ZComponent=0)  # -> Vector, Length
merge_2 = Merge(Data1=rotate_2.Geometry, Data2=msphereex_5, Data3=mesh_3, Data4=mesh_4)  # -> flatten(Result)
mesh_9 = Mesh(merge)
move = Move(Geometry=mesh_6, Motion=vec.Vector)  # -> Geometry, Transform
merge_3 = Merge(Data1=mesh_5, Data2=move.Geometry, Data3=mesh_7, Data4=mesh_8)  # -> flatten(Result)
merge_4 = Merge(Data1=rotate_3.Geometry, Data2=msphereex_3)  # -> flatten(Result)
viewer = ParamViewer(merge_3)
mesh_10 = Mesh(merge_2)
mesh_11 = Mesh(merge_3)
demesh = DeconstructMesh(Mesh=mesh_9)  # -> Vertices, Faces, Colours, Normals
crossref = CrossReference(ListA=mesh_9, ListB=mesh_9, CrossMode=5)  # -> graft(ListA), graft(ListB)
viewer_2 = ParamViewer(demesh.Vertices)
mesh_12 = Mesh(merge_4)
demesh_2 = DeconstructMesh(Mesh=mesh_10)  # -> Vertices, Faces, Colours, Normals
crossref_2 = CrossReference(ListA=mesh_10, ListB=mesh_10, CrossMode=5)  # -> graft(ListA), graft(ListB)
mesh_13 = Mesh([crossref.ListA, crossref.ListB])
cullpt = CullDuplicates(Points=demesh.Vertices, Tolerance=0.1, CullMode=3)  # -> Points, Indices, Valence
viewer_3 = ParamViewer(cullpt.Points)
viewer_4 = ParamViewer(demesh_2.Vertices)
demesh_3 = DeconstructMesh(Mesh=mesh_11)  # -> Vertices, Faces, Colours, Normals
crossref_3 = CrossReference(ListA=mesh_11, ListB=mesh_11, CrossMode=5)  # -> graft(ListA), graft(ListB)
viewer_5 = ParamViewer(demesh_3.Vertices)
item = ListItem(List=mesh_13, Index=0, Wrap=True)  # -> Item, Item1
mesh_14 = Mesh([crossref_2.ListA, crossref_2.ListB])
viewer_6 = ParamViewer(mesh_14)
mesh_15 = Mesh([crossref_3.ListA, crossref_3.ListB])
viewer_7 = ParamViewer(mesh_15)
cullpt_2 = CullDuplicates(Points=demesh_2.Vertices, Tolerance=0.1, CullMode=3)  # -> Points, Indices, Valence
viewer_8 = ParamViewer(cullpt_2.Points)
solidplanecollide = SolidPlaneCollide(Solid=mesh_9, CollisionPlane=PlaneXY(0, 0, 0), Strength=3)
crossref_4 = CrossReference(ListA=mesh_12, ListB=mesh_12, CrossMode=5)  # -> graft(ListA), graft(ListB)
rigidbody = RigidBody(Part=graft(mesh_9), Points=cullpt.Points, Strength=6)  # -> RigidBody, Planes
grab = Grab(On=True, Strength=100, Range=3)  # -> Grab, Anchors
item_2 = ListItem(List=mesh_14, Index=0, Wrap=True)  # -> Item, Item1
demesh_4 = DeconstructMesh(Mesh=mesh_12)  # -> Vertices, Faces, Colours, Normals
solidcollide = SolidCollide(MeshA=item.Item, MeshB=item.Item1, Strength=1)
cullpt_3 = CullDuplicates(Points=demesh_3.Vertices, Tolerance=0.1, CullMode=3)  # -> Points, Indices, Valence
viewer_9 = ParamViewer(cullpt_3.Points)
item_3 = ListItem(List=mesh_15, Index=0, Wrap=True)  # -> Item, Item1
panel_2 = Panel(item_2.Item)
mesh_16 = Mesh([crossref_4.ListA, crossref_4.ListB])
solidplanecollide_2 = SolidPlaneCollide(Solid=mesh_10, CollisionPlane=PlaneXY(0, 0, 0), Strength=3)
rigidbody_2 = RigidBody(Part=graft(mesh_10), Points=cullpt_2.Points, Strength=6)  # -> RigidBody, Planes
grab_2 = Grab(On=True, Strength=100, Range=3)  # -> Grab, Anchors
floor = Floor(Strength=1)
cullpt_4 = CullDuplicates(Points=demesh_4.Vertices, Tolerance=0.1, CullMode=3)  # -> Points, Indices, Valence
item_4 = ListItem(List=mesh_16, Index=0, Wrap=True)  # -> Item, Item1
panel_3 = Panel(item_3.Item)
solidcollide_2 = SolidCollide(MeshA=item_2.Item, MeshB=item_2.Item1, Strength=1)
pt = Point(flatten(rigidbody.Planes))
Z = UnitZ(Factor=-0.03)
solidplanecollide_3 = SolidPlaneCollide(Solid=mesh_11, CollisionPlane=PlaneXY(0, 0, 0), Strength=3)
rigidbody_3 = RigidBody(Part=graft(mesh_11), Points=cullpt_3.Points, Strength=6)  # -> RigidBody, Planes
grab_3 = Grab(On=True, Strength=100, Range=3)  # -> Grab, Anchors
solidcollide_3 = SolidCollide(MeshA=item_3.Item, MeshB=item_3.Item1, Strength=1)
solidplanecollide_4 = SolidPlaneCollide(Solid=mesh_12, CollisionPlane=PlaneXY(0, 0, 0), Strength=3)
floor_2 = Floor(Strength=1)
load = Load(Point=pt, ForceVector=Z)
rigidbody_4 = RigidBody(Part=graft(mesh_12), Points=cullpt_4.Points, Strength=6)  # -> RigidBody, Planes
solidcollide_4 = SolidCollide(MeshA=item_4.Item, MeshB=item_4.Item1, Strength=1)
grab_4 = Grab(On=True, Strength=100, Range=3)  # -> Grab, Anchors
panel_4 = Panel(item_2.Item1)
pt_2 = Point(flatten(rigidbody_2.Planes))
Z_2 = UnitZ(Factor=-0.03)

reset = Button()
run = BooleanToggle(False)

floor_3 = Floor(Strength=1)
panel_5 = Panel(item_3.Item1)
pt_3 = Point(flatten(rigidbody_3.Planes))
Z_3 = UnitZ(Factor=-0.03)
load_2 = Load(Point=pt_2, ForceVector=Z_2)

reset_2 = Button()
run_2 = BooleanToggle(False)

load_3 = Load(Point=pt_3, ForceVector=Z_3)
pt_4 = Point(flatten(rigidbody_4.Planes))
Z_4 = UnitZ(Factor=-0.03)
merge_5 = Merge(Data1=grab.Grab, Data2=floor, Data3=rigidbody.RigidBody, Data4=solidcollide, Data5=load)  # -> flatten(Result)
load_4 = Load(Point=pt_4, ForceVector=Z_4)

reset_3 = Button()
run_3 = BooleanToggle(False)

reset_4 = Button()
run_4 = BooleanToggle(False)

merge_6 = Merge(Data1=grab_2.Grab, Data2=floor_2, Data3=rigidbody_2.RigidBody, Data4=solidcollide_2, Data5=load_2)  # -> flatten(Result)
solver_bouncy = SolverBouncy(GoalObjects=merge_5, Reset=reset, Threshold=1e-08, Tolerance=0.01, Damping=0.99, Iterations=25, On=run)  # -> I, V, O
merge_7 = Merge(Data1=grab_3.Grab, Data2=floor_3, Data3=rigidbody_3.RigidBody, Data4=solidcollide_3, Data5=load_3)  # -> flatten(Result)
solver_bouncy_2 = SolverBouncy(GoalObjects=merge_6, Reset=reset_2, Threshold=1e-08, Tolerance=0.01, Damping=0.99, Iterations=25, On=run_2)  # -> I, V, O
solver_bouncy_3 = SolverBouncy(GoalObjects=merge_7, Reset=reset_3, Threshold=1e-08, Tolerance=0.01, Damping=0.99, Iterations=25, On=run_3)  # -> I, V, O
solver_bouncy_4 = SolverBouncy(
    GoalObjects=[load_4, grab_4.Grab, solidplanecollide_4, rigidbody_4.RigidBody, solidcollide_4],
    Reset=reset_4,
    Threshold=1e-08,
    Tolerance=0.01,
    Damping=0.99,
    Iterations=25,
    On=run_4)  # -> I, V, O
medges = MeshEdges(Mesh=solver_bouncy.O)  # -> NakedEdges, InteriorEdges, NonManifoldEdges
mesh_17 = Mesh(solver_bouncy.O)
medges_2 = MeshEdges(Mesh=solver_bouncy_2.O)  # -> NakedEdges, InteriorEdges, NonManifoldEdges
mesh_18 = Mesh(solver_bouncy_2.O)
medges_3 = MeshEdges(Mesh=solver_bouncy_4.O)  # -> NakedEdges, InteriorEdges, NonManifoldEdges
geo = Geometry(mesh_17)
mesh_19 = Mesh(solver_bouncy_4.O)
medges_4 = MeshEdges(Mesh=solver_bouncy_3.O)  # -> NakedEdges, InteriorEdges, NonManifoldEdges
mesh_20 = Mesh(solver_bouncy_3.O)
clean = CleanTree(RemoveNulls=True, RemoveInvalid=True, RemoveEmpty=False, Tree=flatten(geo))
geo_2 = Geometry(mesh_18)
clean_2 = CleanTree(RemoveNulls=True, RemoveInvalid=True, RemoveEmpty=False, Tree=flatten(geo_2))
geo_3 = Geometry(mesh_20)
lng = ListLength(List=clean)
geo_4 = Geometry(mesh_19)
S = Shader([{ambient=RGB(128, 128, 128), diffuse=RGB(11, 125, 222), emission=RGB(3, 38, 67), shine=0.5, specular=RGB(255, 255, 255), transparency=0}, {ambient=RGB(128, 128, 128), diffuse=RGB(222, 37, 11), emission=RGB(67, 11, 3), shine=0.5, specular=RGB(255, 255, 255), transparency=0}, {ambient=RGB(128, 128, 128), diffuse=RGB(71, 222, 11), emission=RGB(21, 67, 3), shine=0.5, specular=RGB(255, 255, 255), transparency=0}, {ambient=RGB(128, 128, 128), diffuse=RGB(222, 194, 11), emission=RGB(67, 58, 3), shine=0.5, specular=RGB(255, 255, 255), transparency=0}])
clean_3 = CleanTree(RemoveNulls=True, RemoveInvalid=True, RemoveEmpty=False, Tree=flatten(geo_3))
clean_4 = CleanTree(RemoveNulls=True, RemoveInvalid=True, RemoveEmpty=False, Tree=flatten(geo_4))
repeat = RepeatData(Data=S, Length=lng)
lng_2 = ListLength(List=clean_2)
S_2 = Shader([{ambient=RGB(128, 128, 128), diffuse=RGB(11, 125, 222), emission=RGB(3, 38, 67), shine=0.5, specular=RGB(255, 255, 255), transparency=0}, {ambient=RGB(128, 128, 128), diffuse=RGB(222, 37, 11), emission=RGB(67, 11, 3), shine=0.5, specular=RGB(255, 255, 255), transparency=0}, {ambient=RGB(128, 128, 128), diffuse=RGB(71, 222, 11), emission=RGB(21, 67, 3), shine=0.5, specular=RGB(255, 255, 255), transparency=0}, {ambient=RGB(128, 128, 128), diffuse=RGB(222, 194, 11), emission=RGB(67, 58, 3), shine=0.5, specular=RGB(255, 255, 255), transparency=0}])
lng_3 = ListLength(List=clean_3)
S_3 = Shader([{ambient=RGB(128, 128, 128), diffuse=RGB(11, 125, 222), emission=RGB(3, 38, 67), shine=0.5, specular=RGB(255, 255, 255), transparency=0}, {ambient=RGB(128, 128, 128), diffuse=RGB(222, 37, 11), emission=RGB(67, 11, 3), shine=0.5, specular=RGB(255, 255, 255), transparency=0}, {ambient=RGB(128, 128, 128), diffuse=RGB(71, 222, 11), emission=RGB(21, 67, 3), shine=0.5, specular=RGB(255, 255, 255), transparency=0}, {ambient=RGB(128, 128, 128), diffuse=RGB(222, 194, 11), emission=RGB(67, 58, 3), shine=0.5, specular=RGB(255, 255, 255), transparency=0}])
repeat_2 = RepeatData(Data=S_2, Length=lng_2)
lng_4 = ListLength(List=clean_4)
S_4 = Shader([{ambient=RGB(128, 128, 128), diffuse=RGB(11, 125, 222), emission=RGB(3, 38, 67), shine=0.5, specular=RGB(255, 255, 255), transparency=0}, {ambient=RGB(128, 128, 128), diffuse=RGB(222, 37, 11), emission=RGB(67, 11, 3), shine=0.5, specular=RGB(255, 255, 255), transparency=0}, {ambient=RGB(128, 128, 128), diffuse=RGB(71, 222, 11), emission=RGB(21, 67, 3), shine=0.5, specular=RGB(255, 255, 255), transparency=0}, {ambient=RGB(128, 128, 128), diffuse=RGB(222, 194, 11), emission=RGB(67, 58, 3), shine=0.5, specular=RGB(255, 255, 255), transparency=0}])
preview = CustomPreview(Geometry=clean, Shader=repeat)
repeat_3 = RepeatData(Data=S_3, Length=lng_3)
repeat_4 = RepeatData(Data=S_4, Length=lng_4)
preview_2 = CustomPreview(Geometry=clean_2, Shader=repeat_2)
preview_3 = CustomPreview(Geometry=clean_3, Shader=repeat_3)
preview_4 = CustomPreview(Geometry=clean_4, Shader=repeat_4)
