# Grasshopper definition Collision-2D-Shapes.ghx (Grasshopper 0.9.76)
# plug-ins: Kangaroo2 Components

C = Curve([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])
cir = Circle(Plane=PlaneXY(11, 8, 0), Radius=3)
divide = DivideCurve(Curve=cir, Count=18, Kinks=False)  # -> Points, Tangents, Parameters
pline = PolyLine(Vertices=divide.Points, Closed=True)
crv = Curve(flatten([pline, C]))
area = Area(Geometry=pline)  # -> Area, Centroid
explode = Explode(Curve=C, Recursive=True)  # -> Segments, Vertices
explode_2 = Explode(Curve=crv, Recursive=True)  # -> Segments, Vertices
shift = ShiftList(List=explode.Segments, Shift=1, Wrap=True)
multiplication = Multiplication(A=area.Area, B=Slider(1, range=0..1))
end = EndPoints(Curve=explode_2.Segments)  # -> Start, End
angle = Angle(LineA=explode.Segments, LineB=shift, Strength=1)  # -> flatten(Angle)
length_line = LengthLine(Line=explode_2.Segments, Strength=10)  # -> flatten(Spring)
c2d = Collide2d(Polylines=crv, Plane=PlaneXY(0, 0, 0), Strength=1)
polygonarea = PolygonArea(Polyline=pline, Area=multiplication, Strength=1)
onplane = OnPlane(Points=end.End, Plane=PlaneXY(0, 0, 0), Strength=1)  # -> flatten(P)
grab = Grab(On=True, Strength=1, Range=3)  # -> Grab, Anchors
solver = Solver(
    GoalObjects=[angle, length_line, c2d, grab.Grab, polygonarea, onplane],
    Reset=Button(),
    Threshold=1e-15,
    Tolerance=0.01,
    On=Toggle(False))  # -> I, V, O
join = JoinCurves(Curves=solver.O, Preserve=False)
item = ListItem(List=join, Index=0, Wrap=True)  # -> Item, Item1, Item2, Item3
boundary = BoundarySurfaces(Edges=item.Item3)
