# Grasshopper definition Collision-Chain.ghx (Grasshopper 0.9.76)
# plug-ins: Kangaroo2 Components

crv = Curve([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])
explode = Explode(Curve=crv, Recursive=True)  # -> Segments, Vertices
end = EndPoints(Curve=explode.Segments)  # -> Start, End
line = Line(explode.Segments)
grab = Grab(On=True, Strength=1, Range=3)  # -> Grab, Anchors
collider = Collider(Objects=flatten(line), Radii=Slider(0.722, range=0..10), Strength=1)
rigidpointset = RigidPointSet(Points=end.Start, Strength=10)  # -> RigidBody, Planes
show = Show(G=crv)
entwine = Entwine(Branch00=[rigidpointset.RigidBody, collider, grab.Grab], Branch01=show, FlattenInputs=True)
solver = Solver(GoalObjects=entwine, Reset=Button(), Threshold=1e-15, Tolerance=0.01, On=Toggle(False))  # -> I, V, O
crv_2 = Curve(flatten(solver.O))
# To display the output, this definition uses the mesh pipe component from here:
# http://www.grasshopper3d.com/forum/topics/mesh-pipe
# 
# and Weaverbird:
# http://www.grasshopper3d.com/group/weaverbird
bang = ExplodeTree(Data=solver.O)  # -> Branch0, Branch1
clean = CleanTree(RemoveNulls=True, RemoveInvalid=True, RemoveEmpty=False, Tree=crv_2)
join = JoinCurves(Curves=clean, Preserve=False)  # -> simplify(graft(Curves))
area = Area(Geometry=join)  # -> Area, Centroid
scale = Scale(Geometry=join, Center=area.Centroid, Factor=Slider(0.79, range=0..1))  # -> Geometry, Transform
disc = Discontinuity(Curve=join, Level=1)  # -> Points, Parameters
viewer = ParamViewer(disc.Points)
merge = Merge(Data1=join, Data2=scale.Geometry)
viewer_2 = ParamViewer(merge)
loft = Loft(Curves=merge, Options={Adjust=False, Closed=False, LoftEnds=0, LoftSimp=0, LoftType=0, Rebuild=10, Refit=0.01})  # disabled
