# Grasshopper definition Collision-Cloth-Drape-XXX-4.ghx (Grasshopper 0.9.76)
# plug-ins: Kangaroo2 Components

rectangle = Rectangle(Plane=PlaneXY(0, 0, 0), XSize="-15 to 35", YSize="-15 to 35", Radius=0)  # -> Rectangle, Length
W = WidthCount(30)
Z = UnitZ(Factor=Slider(20, range=0..20))
move = Move(Geometry=rectangle.Rectangle, Motion=Z)  # -> Geometry, Transform
mplane = MeshPlane(Boundary=move.Geometry, WidthCount=W, HeightCount=W)  # -> Mesh, Area
brep = Brep(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)
demesh = DeconstructMesh(Mesh=mplane.Mesh)  # -> Vertices, Faces, Colours, Normals
medges = MeshEdges(Mesh=mplane.Mesh)  # -> NakedEdges, InteriorEdges, NonManifoldEdges
Z_2 = UnitZ(Factor=-0.1)
crv = Curve([medges.NakedEdges, medges.InteriorEdges])
smooth = Smooth(M=mplane.Mesh, Strength=1)
floor = Floor(Strength=1)
length_line = LengthLine(Line=crv, Strength=10)
spc = SolidPointCollide(Points=demesh.Vertices, Solid=brep, Interior=False, Unidirectional="True", Strength=1)
show = Show(G=mplane.Mesh)
load = Load(Point=demesh.Vertices, ForceVector=Z_2)
merge = Merge(Data1=show, Data2=smooth, Data3=floor, Data4=length_line, Data5=spc, Data6=load)
solver = Solver(GoalObjects=merge, Reset=Button(), Threshold=1e-15, Tolerance=0.01, On=Toggle(False))  # -> I, V, O
data = Data(solver.O)
mesh = Mesh(data)
clean = CleanTree(RemoveNulls=True, RemoveInvalid=True, RemoveEmpty=False, Tree=mesh)
preview = CustomPreview(
    Geometry=clean,
    Shader={ambient=RGB(0, 0, 0), diffuse=RGB(255, 105, 180), emission=RGB(76, 32, 54), shine=0.5, specular=RGB(255, 255, 255), transparency=0})
