# Grasshopper definition Collision-Multi-Radius-Spheres-Lines.ghx (Grasshopper 0.9.76)
# plug-ins: Kangaroo2 Components

crv = Curve([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])
line_radii = Panel("""1
2""")
sphere_radii = Panel("""1
2
3""")
pt = Point([Point(7, 9, 0), Point(13, 8, 0), Point(21, 7, 0)])
line = Line(crv)
merge = Merge(Data1=pt, Data2=line)
merge_2 = Merge(Data1=sphere_radii, Data2=line_radii)
grab = Grab(On=True, Strength=1, Range=3)  # -> Grab, Anchors
collider = Collider(Objects=merge, Radii=merge_2, Strength=1)
length_line = LengthLine(Line=line, Strength=10)
show = Show(G=pt)
entwine = Entwine(Branch00=[collider, grab.Grab], Branch01=show, Branch02=length_line, FlattenInputs=True)
solver = Solver(GoalObjects=entwine, Reset=Button(), Threshold=1e-15, Tolerance=0.01, On=True)  # -> I, V, O
bang = ExplodeTree(Data=solver.O)  # -> Branch0, Branch1, Branch2
pipe = Pipe(Curve=bang.Branch2, Radius=line_radii, Caps=2)
sph = Sphere(Base=bang.Branch1, Radius=sphere_radii)
