# Grasshopper definition Custom-Goal-2.ghx (Grasshopper 0.9.76)
# plug-ins: Kangaroo2 Components

crv = Curve(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)
grab = Grab(On=True, Strength=1, Range=3)  # -> Grab, Anchors
constanttension = CSharpScript(L=crv, k="1", Reference="C:\USERS\YOSHIOCA\APPDATA\ROAMING\GRASSHOPPER\LIBRARIES\KangarooSolver.dll")  # -> out, A; inputs L: Line, k: Double
# ---------- constanttension: C# ----------
    A = new NewSpring(L.From, L.To, k);
# ---------- constanttension: C# additional code ----------
  public class NewSpring : GoalObject
  {
    public NewSpring(Point3d s, Point3d e, double k)
    {
      PPos = new Point3d[2] { s, e }; //initial positions
      Move = new Vector3d[2];
      Weighting = new double[2]{k,k};
    }

    public override void Calculate(List<KangarooSolver.Particle> p)
    {
      var Positions = this.GetCurrentPositions(p);
      var StartPt = Positions[0];
      var EndPt = Positions[1];

      Vector3d CurrentVector = EndPt - StartPt;

      double CurrentLength = CurrentVector.Length;

      double RestLength = 3.0;

      double Stretch = CurrentLength - RestLength;

      CurrentVector.Unitize();

      Move[0] = 0.5 * CurrentVector * Stretch;
      Move[1] = -Move[0];
    }

    public override object Output(List<KangarooSolver.Particle> p)
    {
      return new Line(p[PIndex[0]].Position, p[PIndex[1]].Position);
    }
  }
# ---------- end constanttension ----------
solver = Solver(GoalObjects=[constanttension.A, grab.Grab], Reset=Button(), Threshold=1e-15, Tolerance=0.01, On=Toggle(False))  # -> I, V, O
