# Grasshopper definition Custom-Goal-PointCreation.ghx (Grasshopper 0.9.76)

brep = Brep(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)
pt = Point([Point(17, 17, 0), Point(21, 4, 0), Point(31, 16, 0)])
timer = Timer(TimerInterval=1, Target=customiteration)  # disabled
customiteration = CSharpScript(
    StartPoints=pt,
    TargetMesh=brep,
    Reset=Button(),
    Reference="C:\USERS\YOSHIOCA\APPDATA\ROAMING\GRASSHOPPER\LIBRARIES\KangarooSolver.dll")  # -> out, A, B; inputs StartPoints: list of Point3d, TargetMesh: Mesh, Reset: Boolean
# ---------- customiteration: C# ----------
    if(Reset || Points == null)
    {
      Points = StartPoints;
    }

    else
    {
      var AveragePoint = new Point3d();
      foreach (Point3d P in Points)
      {
        AveragePoint = AveragePoint + P;
      }
      AveragePoint *= 1.0 / Points.Count;
      Points.Add(AveragePoint);

      var PS = new KangarooSolver.PhysicalSystem();

      List<IGoal> MyGoals = new List<IGoal>();

      var CollideGoal = new KangarooSolver.Goals.SphereCollide(Points, 1, 1);
      MyGoals.Add(CollideGoal);
      var OnMeshGoal = new KangarooSolver.Goals.OnMesh(Points, TargetMesh, 1);
      MyGoals.Add(OnMeshGoal);

      foreach(IGoal G in MyGoals)
      {
        PS.AssignPIndex(G, 0.01);
      }

      PS.Step(MyGoals, true, 0.00001);
      Points = PS.GetPositions().ToList();
    }

    A = Points;
# ---------- customiteration: C# additional code ----------
  List<Point3d> Points;
# ---------- end customiteration ----------
srf_cp = SurfaceClosestPoint(Point=customiteration.A, Surface=brep)  # -> Point, UVPoint, Distance
evalsrf = EvaluateSurface(Surface=brep, Point=srf_cp.UVPoint)  # -> Point, Normal, Frame
pl = PlaneNormal(Origin=evalsrf.Point, ZAxis=evalsrf.Normal)
panel = Panel(customiteration.A)
cir = Circle(Plane=pl, Radius=1)
panel_2 = Panel(customiteration.out)
