# Grasshopper definition Custom-GoalDebugger.ghx (Grasshopper 0.9.76)
# plug-ins: Kangaroo2 Components

crv = Curve(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)
explode = Explode(Curve=crv, Recursive=True)  # -> Segments, Vertices
pt = Point(Point(28.57683276, 8.147694793, 0))
length_line = LengthLine(Line=explode.Segments, Length=5, Strength=1)
anchor = Anchor(Point=Point(5.80202585, 7.003942027, 0), Strength=1000)
load = Load(Point=pt, ForceVector=Vector(0, -4, 0))
reset = Button(ExpressionPressed="true")
step = Button(ExpressionPressed="true")
customiteration = CSharpScript(
    Goals=flatten([length_line, load, anchor]),
    Reset=reset,
    Step=step,
    Reference="C:\USERS\YOSHIOCA\APPDATA\ROAMING\GRASSHOPPER\LIBRARIES\KangarooSolver.dll")  # -> out, A, B, C, D, E, F; inputs Goals: list, Reset: Boolean, Step: Boolean
# ---------- customiteration: C# ----------
    if(Reset)
    {
      PS = new KangarooSolver.PhysicalSystem();
      counter = 0;
      GoalList.Clear();
      foreach(IGoal G in Goals) //Assign indexes to the particles in each Goal:
      {
        PS.AssignPIndex(G, 0.0001); // the second argument is the tolerance distance below which points combine into a single particle
        GoalList.Add(G);
      }
    }
    if(Step)
    {
      PS.SimpleStep(GoalList);
      counter++;
    }


    A = PS.GetOutput(GoalList);
    B = counter;
    C = PS.GetAllMoves(GoalList);
    D = PS.GetAllWeightings(GoalList);
    E = PS.GetPositionArray();

    var Names = new List<String>[PS.ParticleCount()];

    for(int i = 0; i < PS.ParticleCount();i++)
    {
      Names[i] = new List<String>();
    }

    for(int i = 0;i < GoalList.Count;i++)
    {
      var FullName = GoalList[i].ToString();
      Char splitter = '.';
      var Name = FullName.Split(splitter);
      var G = GoalList[i] as IGoal;

      for(int j = 0; j < G.PIndex.Count();j++)
      {
        Names[G.PIndex[j]].Add(Name[2]);
      }
    }


    F = Names;
# ---------- customiteration: C# additional code ----------
  KangarooSolver.PhysicalSystem PS = new KangarooSolver.PhysicalSystem();
  List<IGoal> GoalList = new List<IGoal>();
  int counter = 0;
# ---------- end customiteration ----------
c_script = CSharpScript(x=customiteration.F)  # -> A
# ---------- c_script: C# ----------
    A = x as List<string>;
# ---------- end c_script ----------
panel = Panel(customiteration.B)
c_script_2 = CSharpScript(x=customiteration.D)  # -> A
# ---------- c_script_2: C# ----------
    A = x as List<double>;
# ---------- end c_script_2 ----------
c_script_3 = CSharpScript(x=customiteration.C)  # -> A
# ---------- c_script_3: C# ----------
    A = x as List<Vector3d>;
# ---------- end c_script_3 ----------
concat = Concatenate(FragmentA=c_script, FragmentC="  ", FragmentB=c_script_2)
addition = Addition(A=graft(customiteration.E), B=c_script_3)
vdis = VectorDisplay(Anchor=graft(customiteration.E), Vector=c_script_3)
tag = TextTag(Location=addition, Text=concat)
