# Grasshopper definition Custom-Solver.ghx (Grasshopper 0.9.76)
# plug-ins: Kangaroo2 Components

crv = Curve(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)
crv_2 = Curve(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)
explode = Explode(Curve=crv_2, Recursive=True)  # -> Segments, Vertices
explode_2 = Explode(Curve=crv, Recursive=True)  # -> Segments, Vertices
direction = Direction(Line=explode_2.Segments, Strength=1)
direction_2 = Direction(Line=explode.Segments, Strength=1)
show = Show(G=crv)
show_2 = Show(G=crv_2)
# Custom iteration script using the solver library without the timer. Also note this creates separate solver instances for each branch of the data tree.
# 
# (You will need to update the reference assembly location to your copy of the dll)
entwine = Entwine(Branch00=[direction_2, show_2], Branch01=[direction, show], FlattenInputs=True)
customiteration = CSharpScript(x=entwine, Reference="C:\USERS\YOSHIOCA\APPDATA\ROAMING\GRASSHOPPER\LIBRARIES\KangarooSolver.dll")  # -> out, A, B; inputs x: list
# ---------- customiteration: C# ----------
    var PS = new KangarooSolver.PhysicalSystem();
    double tol = 0.0001; // points closer than this will get combined into a single particle
    var GoalList = new List<IGoal>();

    //Assign indexes to the particles in each Goal:
    foreach(IGoal G in x)
    {
      PS.AssignPIndex(G, tol);
      GoalList.Add(G);
    }

    int counter = 0;
    double threshold = 1e-10;
    do
    {
      PS.Step(GoalList, false, threshold); // The step will iterate until either reaching 15ms or the energy threshold
      counter++;
    }while(PS.GetvSum() > threshold && counter < 100); //GetvSum returns the current kinetic energy
    // always include a counter to prevent it getting stuck forever in case it cannot reach the given threshold

    A = PS.GetOutput(GoalList);
    B = counter;
# ---------- end customiteration ----------
panel = Panel(customiteration.B)
panel_2 = Panel(customiteration.A)
