# Grasshopper definition Flag-Wind-4.ghx (Grasshopper 0.9.76)
# plug-ins: MeshEdit Components, Kangaroo Components, PlanktonGh, Weaverbird, Kangaroo2 Components

mesh = Mesh(<mesh referenced from the Rhino model>)  # disabled

# ---- group: ok
mesh_2 = Mesh(<mesh referenced from the Rhino model>)  # disabled

# ----
srf = Surface([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])  # disabled

# ---- group: cloth-modify-wb
mesh_3 = Mesh(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)  # disabled

# ---- group: cloth-modify
mesh_4 = Mesh(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)  # disabled

# ---- group: cloth
mesh_5 = Mesh(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)  # disabled

# ---- group: cloth-wb
mesh_6 = Mesh(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)  # disabled

# ---- group: cloth-modify
mesh_7 = Mesh(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)  # disabled

# ---- group: cloth
mesh_8 = Mesh(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)  # disabled

# ---- group: cloth-modify-wb
mesh_9 = Mesh(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)  # disabled

# ---- group: cloth-wb
mesh_10 = Mesh(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)  # disabled

# ----
number_slider = Slider(1.7, range=0..10)  # disabled
refine = Refine(Mesh=mesh, Level=1)  # disabled
number_slider_2 = Slider(1.7, range=0..10)  # disabled
debrep = DeconstructBrep(Brep=srf)  # -> Faces, Edges, Vertices; disabled
bbox = BoundingBox(Content=mesh_5, Plane=PlaneXY(0, 0, 0))  # -> Box, Box_2; disabled
medges = MeshEdges(Mesh=mesh_3)  # -> NakedEdges, InteriorEdges, NonManifoldEdges; disabled
bbox_2 = BoundingBox(Content=mesh_8, Plane=PlaneXY(0, 0, 0))  # -> Box, Box_2; disabled
medges_2 = MeshEdges(Mesh=mesh_9)  # -> NakedEdges, InteriorEdges, NonManifoldEdges; disabled
wbloop = WeaverbirdsLoopSubdivision(MeshCurves=mesh_3, Level=1, SmoothNakedEdges=1)  # disabled
area = Area(Geometry=bbox.Box)  # -> Area, Centroid; disabled

# ---- group: ok
mesh_11 = Mesh(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)  # disabled

# ----
conmesh = ConstructMesh(Vertices=debrep.Vertices, Faces={A=0, B=1, C=2, D=3})  # disabled
wbloop_2 = WeaverbirdsLoopSubdivision(MeshCurves=mesh_9, Level=1, SmoothNakedEdges=1)  # disabled
area_2 = Area(Geometry=bbox_2.Box)  # -> Area, Centroid; disabled
scale_nu = ScaleNU(Geometry=mesh_5, Plane=area.Centroid, ScaleX=1, ScaleY=number_slider, ScaleZ=1)  # -> Geometry, Transform; disabled
scale_nu_2 = ScaleNU(Geometry=mesh_8, Plane=area_2.Centroid, ScaleX=1, ScaleY=number_slider_2, ScaleZ=1)  # -> Geometry, Transform; disabled
panel = Panel(conmesh)  # disabled
mesh_12 = Mesh()  # disabled

# ---- group: Quat-Size
mesh_13 = Mesh(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)  # disabled

# ---- group: cloth-modify-1.7
mesh_14 = Mesh(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)  # disabled

# ---- group: cloth-1.7
mesh_15 = Mesh(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)  # disabled

# ---- group: cloth-wb-1.7
mesh_16 = Mesh(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)  # disabled

# ---- group: cloth-modify-wb-1.7
mesh_17 = Mesh(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)  # disabled

# ---- group: cloth-modify-1.7-Refine
mesh_18 = Mesh(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)  # disabled

# ---- group: cloth-1.7
mesh_19 = Mesh(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)  # disabled

# ---- group: cloth-modify-1.7
mesh_20 = Mesh(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)  # disabled

# ---- group: cloth-wb-1.7
mesh_21 = Mesh(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)  # disabled

# ---- group: cloth-modify-wb-1.7
mesh_22 = Mesh(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)  # disabled

# ----
mesh_23 = Mesh(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)
line = Line(Line((0, -551, 442.5), (-285.6067505, -551, 83.01858521)))  # disabled
line_2 = Line(Line((0, -551, 585), (-335, -551, 124.25)))  # disabled
mesh_24 = Mesh(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)
mesh_25 = Mesh(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)
refine_2 = Refine(Mesh=mesh_23, Level=Slider(1, range=0..10))
flip = FlipCurve(Curve=line)  # -> Curve, Flag; disabled
refine_3 = Refine(Mesh=mesh_14, Level=1)  # disabled
vec = Vector(Vector(19, 17, 0))  # disabled
panel_2 = Panel(vec)  # disabled
mesh_26 = Mesh([<mesh referenced from the Rhino model> x14])  # disabled
merge = Merge(Data1=line_2, Data2=line)  # disabled

# ---- group: ok
mesh_27 = Mesh(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)  # disabled

# ----
mesh_28 = Mesh(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)  # disabled
number_slider_3 = Slider(1, range=0..1)  # disabled
number_slider_4 = Slider(4, range=0..10)  # disabled
number_slider_5 = Slider(2, range=0..10)  # disabled
mplane = MeshPlane(Boundary={Plane=PlaneXZ(5, 0, 5), Size=Domain2(u=0..15, v=0..10)}, WidthCount=15, HeightCount=10)  # -> Mesh, Area
panel_3 = Panel("20.0, 12, 0")  # disabled
panel_4 = Panel(mesh_26)  # disabled
number_slider_6 = Slider(0.003, range=0..1)  # disabled
pt = Point([Point(42.13157654, 7, 35.99999619), Point(41.10526276, 7, 35.99999619), Point(32.89473724, 7, 35.99999619), Point(31.86841965, 7, 35.99999619)])  # disabled
mesh_29 = Mesh(mesh_23)
panel_5 = Panel("20.0, 10, 0")  # disabled
mesh_30 = Mesh(mesh_25)
mbox = MeshBox(Base={Plane=PlaneXY(0, 0, 0), X=Domain(-10, 10), Y=Domain(-10, 10), Z=Domain(-10, 10)}, XCount=10, YCount=10, ZCount=10)  # disabled
loft = Loft(Curves=merge, Options={Adjust=False, Closed=False, LoftEnds=0, LoftSimp=0, LoftType=0, Rebuild=10, Refit=0.01})  # disabled
number_slider_7 = Slider(0.003, range=0..1)  # disabled
pt_2 = Point([Point(13.15002632, 4.440023422, 16.70902824), Point(12.6817646, 4.440023422, 16.74728584), Point(8.804867744, 4.440023422, 16.74728584), Point(8.336606026, 4.440023422, 16.70902824)])  # disabled
pt_3 = Point([Point(0, 0, 60), Point(0, 0, 40), Point(0, 0, 20), Point(0, 0, 0)])
mbox_2 = MeshBox(Base={Plane=PlaneXY(0, 0, 0), X=Domain(-10, 10), Y=Domain(-10, 10), Z=Domain(-10, 10)}, XCount=10, YCount=10, ZCount=10)  # disabled
mplane_2 = MeshPlane(Boundary={Plane=PlaneXZ(5, 0, 5), Size=Domain2(u=0..15, v=0..10)}, WidthCount=15, HeightCount=10)  # -> Mesh, Area; disabled
medges_3 = MeshEdges(Mesh=mesh_29)  # -> NakedEdges, InteriorEdges, NonManifoldEdges
weld = WeldMesh(Mesh=mesh_26, Angle=3.141592654)  # disabled
mplane_3 = MeshPlane(Boundary={Plane=PlaneXZ(5, 0, 5), Size=Domain2(u=0..15, v=0..10)}, WidthCount=15, HeightCount=10)  # -> Mesh, Area; disabled
geo = Geometry(mesh_27)  # disabled
vec_2 = Vector(Vector(19, 17, 0))  # disabled
panel_6 = Panel(vec_2)  # disabled
vec_3 = Vector(Vector(19, 17, 0))
devec = DeconstructVector(Vector=vec_3)  # -> XComponent, YComponent, ZComponent
addition = Addition(A=number_slider_5, B=number_slider_3)  # disabled
geo_2 = Geometry(mesh_22)  # disabled
addition_2 = Addition(A=number_slider_4, B=number_slider_3)  # disabled
mjoin = MeshJoin(Meshes=weld)  # disabled
sdivide = DivideSurface(Surface=loft, UCount=number_slider_5, VCount=number_slider_4)  # -> flatten(Points), Normals, Parameters; disabled
panel_7 = Panel("0")  # disabled
medges_4 = MeshEdges()  # -> NakedEdges, InteriorEdges, NonManifoldEdges
vec_4 = Vector(panel_3)  # disabled
medges_5 = MeshEdges(Mesh=mesh_29)  # -> NakedEdges, InteriorEdges, NonManifoldEdges
panel_8 = Panel(devec.XComponent)
panel_9 = Panel("0")  # disabled
number_slider_8 = Slider(0.001, range=0..0.05)  # disabled
vec_5 = VectorXYZ(XComponent=devec.XComponent, YComponent=0, ZComponent=devec.ZComponent)  # -> Vector, Length
vec_6 = Vector(panel_5)  # disabled
tri = Triangulate(Mesh=geo_2)  # -> Mesh, Count; disabled
number_slider_9 = Slider(0.005, range=0..0.05)  # disabled
tri_2 = Triangulate(Mesh=mesh_30)  # -> Mesh, Count
viewer = ParamViewer(medges_5.NakedEdges)
crv = Curve(medges_5.NakedEdges)
join = JoinCurves(Curves=medges_5.NakedEdges, Preserve=False)
demesh = DeconstructMesh(Mesh=geo)  # -> Vertices, Faces, Colours, Normals; disabled
multiplication = Multiplication(A=vec_4, B=number_slider_6)  # disabled
move = Move(Geometry=[medges_4.NakedEdges, medges_4.InteriorEdges, medges_4.NonManifoldEdges], Motion="0,200,0")  # -> Geometry, Transform
frompoints = MeshFromPoints(Points=sdivide.Points, UDirection=addition, VDirection=addition_2)  # disabled
demesh_2 = DeconstructMesh(Mesh=tri.Mesh)  # -> Vertices, Faces, Colours, Normals; disabled
multiplication_2 = Multiplication(A=vec_6, B=number_slider_7)  # disabled
item = ListItem(List=pt, Index=panel_7, Wrap=True)  # -> Item, Item1; disabled
medges_6 = MeshEdges(Mesh=geo)  # -> NakedEdges, InteriorEdges, NonManifoldEdges; disabled
cp = ControlPoints(Curve=join)  # -> Points, Weights, Knots
demesh_3 = DeconstructMesh(Mesh=mesh_30)  # -> Vertices, Faces, Colours, Normals
item_2 = ListItem(List=pt_2, Index=panel_9, Wrap=True)  # -> Item, Item1; disabled
medges_7 = MeshEdges(Mesh=tri.Mesh)  # -> NakedEdges, InteriorEdges, NonManifoldEdges; disabled
neg = Negative(Value=number_slider_8)  # disabled
viewer_2 = ParamViewer(cp.Points)
panel_10 = Panel(mjoin)  # disabled
len = Length(Curve=medges_6.InteriorEdges)  # disabled
medges_8 = MeshEdges(Mesh=mesh_30)  # -> NakedEdges, InteriorEdges, NonManifoldEdges
panel_11 = Panel("0")  # disabled
neg_2 = Negative(Value=number_slider_9)  # disabled
number_slider_10 = Slider(2, range=0..10)  # disabled
pt_4 = Point(cp.Points)
len_2 = Length(Curve=medges_7.InteriorEdges)  # disabled
multiplication_3 = Multiplication(A=Slider(0, range=0..10), B=Slider(2.16, range=1..4))
vdis = VectorDisplay(Vector=vec_3)
panel_12 = Panel("0")  # disabled
devec_2 = DeconstructVector(Vector=item.Item1)  # -> XComponent, YComponent, ZComponent; disabled
avr = Average(Input=len)  # disabled
devec_3 = DeconstructVector(Vector=item_2.Item1)  # -> XComponent, YComponent, ZComponent; disabled
Z = UnitZ(Factor=neg)  # disabled
avr_2 = Average(Input=len_2)  # disabled
duppt = RemoveDuplicatePts(Points=cp.Points, Tolerance=0.01)  # -> flatten(UniquePoints)
Z_2 = UnitZ(Factor=neg_2)  # disabled
load = Load(Point=demesh_3.Vertices, ForceVector="0,0,-0.001")
division = Division(A=avr, B=number_slider_10)  # disabled
pt_5 = ConstructPoint(XCoordinate=devec_2.XComponent, YCoordinate=devec_2.YComponent, ZCoordinate=panel_11)  # disabled
length_line = LengthLine(Line=[medges_6.NakedEdges, medges_6.InteriorEdges], Strength=10)  # disabled
anchor = Anchor(Point=pt, Strength=10000)  # disabled
smooth = Smooth(M=geo, Strength=1)  # disabled
viewer_3 = ParamViewer(duppt)
wind = Wind(Mesh=geo, WindVector=multiplication)  # disabled
show = Show(G=geo)  # disabled
division_2 = Division(A=avr_2, B=3)  # disabled
sequence = Sequence(Frames=Slider(10, range=0..10))
load_2 = Load(Point=demesh.Vertices, ForceVector=Z)  # disabled
pt_6 = ConstructPoint(XCoordinate=devec_3.XComponent, YCoordinate=devec_3.YComponent, ZCoordinate=panel_12)  # disabled
length_line_2 = LengthLine(Line=[medges_7.NakedEdges, medges_7.InteriorEdges], Strength=10)  # disabled
anchor_2 = Anchor(Point=pt_2, Strength=10000)  # disabled
smooth_2 = Smooth(M=tri.Mesh, Strength=1)  # disabled
wind_2 = Wind(Mesh=tri.Mesh, WindVector=multiplication_2)  # disabled
show_2 = Show(G=geo_2)  # disabled
load_3 = Load(Point=demesh_2.Vertices, ForceVector=Z_2)  # disabled
sc = SphereCollide(Points=demesh.Vertices, Radius=division, Strength=1)  # disabled
ln = Line(StartPoint=item.Item, EndPoint=pt_5)  # disabled
sc_2 = SphereCollide(Points=demesh_2.Vertices, Radius=division_2, Strength=1)  # disabled
ln_2 = Line(StartPoint=item_2.Item, EndPoint=pt_6)  # disabled
anchor_3 = Anchor(Point=pt_3, Strength=10000)
sc_3 = SphereCollide(Points=demesh_3.Vertices, Radius=Slider(1, range=0..1), Strength=Slider(10, range=0..10))
meshmachine = MeshMachine(
    Geometry=mesh_29,
    Length=Slider(4.5, range=0.1..5),
    FixVertices=duppt,
    Flip=1,
    PullStrength=0.8,
    CurvatureAdaptivity=0,
    BoundaryScale=1,
    BoundaryDistance=5,
    Exponent=2,
    Background=0.5,
    Iterations=Slider(1, range=0..10),
    Reset=sequence)
length_line_3 = LengthLine(Line=[medges_8.NakedEdges, medges_8.InteriorEdges], Strength=10)
grab = Grab(On=True, Strength=1, Range=3)  # -> Grab, Anchors
smooth_3 = Smooth(M=mesh_30, Strength=1)
merge_2 = Merge(Data1=sc, Data2=length_line, Data3=show, Data4=anchor, Data5=wind, Data6=smooth, Data7=load_2)  # -> flatten(Result); disabled
show_3 = Show(G=mesh_30)
merge_3 = Merge(Data1=sc_2, Data2=length_line_2, Data3=show_2, Data4=anchor_2, Data5=wind_2, Data6=smooth_2, Data7=load_3)  # -> flatten(Result); disabled
multiplication_4 = Multiplication(A=vec_3, B=Slider(0.008, range=0..0.01))
wind_3 = Wind(Mesh=mesh_30, WindVector=multiplication_4)
button = Button()  # disabled
toggle = BooleanToggle(False)  # disabled
toggle_2 = BooleanToggle(False)  # disabled
button_2 = Button()  # disabled
pmesh = PlanktonMesh(flatten(meshmachine))
bouncysolver = BouncySolver(
    GoalObjects=[length_line_3, show_3, anchor_3, wind_3, smooth_3, load, grab.Grab, sc_3],
    Reset=Button(),
    Threshold=1e-15,
    Tolerance=0.01,
    Damping=0.99,
    Iterations=2,
    On=Toggle(False))  # -> I, V, O
bouncysolver_2 = BouncySolver(GoalObjects=merge_2, Reset=button, Threshold=1e-15, Tolerance=0.01, Damping=0.99, Iterations=10, On=toggle)  # -> I, V, O; disabled
bouncysolver_3 = BouncySolver(GoalObjects=merge_2, Reset=button, Threshold=1e-15, Tolerance=0.01, Damping=0.99, Iterations=2, On=toggle)  # -> I, V, O; disabled
rev = ReverseList(List=pmesh)
panel_13 = Panel(bouncysolver_2.I)  # disabled
bouncysolver_4 = BouncySolver(GoalObjects=merge_3, Reset=button_2, Threshold=1e-15, Tolerance=0.01, Damping=0.99, Iterations=10, On=toggle_2)  # -> I, V, O; disabled
bouncysolver_5 = BouncySolver(GoalObjects=merge_3, Reset=button_2, Threshold=1e-15, Tolerance=0.01, Damping=0.99, Iterations=2, On=toggle_2)  # -> I, V, O; disabled
viewer_4 = ParamViewer(pmesh)
panel_14 = Panel(pmesh)
item_3 = ListItem(List=rev, Index=0, Wrap=True)
mesh_31 = Mesh(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)
panel_15 = Panel(bouncysolver.I)
data = Data(bouncysolver.O)
mesh_32 = Mesh(data)
mesh_33 = Mesh(mesh_32)
data_2 = Data(bouncysolver_2.O)  # disabled
mesh_34 = Mesh(item_3)
panel_16 = Panel(bouncysolver.V)
panel_17 = Panel(bouncysolver_2.V)  # disabled
panel_18 = Panel(bouncysolver_4.I)  # disabled
data_3 = Data(bouncysolver_4.O)  # disabled
vdis_2 = VectorDisplay(Anchor=item.Item, Vector=vec_4)  # disabled
panel_19 = Panel(bouncysolver_4.V)  # disabled
vdis_3 = VectorDisplay(Anchor=item_2.Item, Vector=vec_6)  # disabled
merge_4 = Merge(Data1=mesh_33, Data2=pt_3)
wbsplitquads = WeaverbirdsConstantQuadsSplitSubdivision(MeshCurves=mesh_34, Level=1, SmoothNakedEdges=1)
panel_20 = Panel(mesh_32)
panel_21 = Panel(data_2)  # disabled

# ---- group: 2
mesh_35 = Mesh(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)  # disabled

# ---- group: 1
mesh_36 = Mesh(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)  # disabled

# ---- group: 0
mesh_37 = Mesh(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)  # disabled

# ----
wbloop_3 = WeaverbirdsLoopSubdivision(MeshCurves=mesh_33, Level=1, SmoothNakedEdges=1)  # disabled
panel_22 = Panel(data_3)  # disabled
xz = XZPlane(Origin="0,0,60")
pi = Pi(Factor="-0.5")
rotate = Rotate(Geometry=merge_4, Angle=pi, Plane=xz)  # -> Geometry, Transform
yz = YZPlane(Origin="0,0,60")
pi_2 = Pi(Factor="-0.25")
rotate_2 = Rotate(Geometry=rotate.Geometry, Angle=pi_2, Plane=yz)  # -> flatten(Geometry), Transform
number_slider_11 = Slider(3, range=0..10)
mesh_38 = Mesh(rotate_2.Geometry)
clean = CleanTree(RemoveNulls=True, RemoveInvalid=True, RemoveEmpty=False, Tree=mesh_38)
wbtriangles = WeaverbirdsSplitTrianglesSubdivision(MeshCurves=clean, Level=number_slider_11)
wbblur = WeaverbirdsBlurMesh(MeshCurves=wbtriangles, Level=number_slider_11, Thin=1)
pt_7 = Point(rotate_2.Geometry)
flip_2 = MeshFlip(Mesh=wbblur)
mesh_39 = Mesh(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)
colour = ColourPicker(PickedColour=RGB(74, 184, 255))
shader = Shader(colour)
mesh_40 = Mesh(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)
colour_2 = ColourPicker(PickedColour=RGB(42, 69, 255))

# ---- group: 1180
mesh_41 = Mesh(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)

# ---- group: 630
mesh_42 = Mesh(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)

# ----
medges_9 = MeshEdges(Mesh=[mesh_42, mesh_41])  # -> NakedEdges, InteriorEdges, NonManifoldEdges
wbloop_4 = WeaverbirdsLoopSubdivision(MeshCurves=[mesh_41, mesh_42], Level=1, SmoothNakedEdges=1)
panel_23 = Panel(wbloop_4)
material = CreateMaterial(
    Diffuse=colour,
    Specular=RGB(255, 255, 255),
    Emission=colour_2,
    Transparency=Slider(0.31, range=0..1),
    Shine=Slider(0, range=0..1))
preview = CustomPreview(Geometry=flip_2, Shader=material)
