# Grasshopper definition MeshMachine-3.ghx (Grasshopper 0.9.76)
# plug-ins: Kangaroo Components, PlanktonGh

brep = Brep(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)

# ---- group: box
brep_2 = Brep(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)

# ---- group: v
brep_3 = Brep(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)

# ---- group: v fillet
brep_4 = Brep(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)

# ----
number_slider = Slider(4, range=0..10)
mesh = MeshBrep(
    Brep=brep,
    Settings={GridMaxCount=0, GridMinCount=16, JaggedSeams=False, MaxEdgeLength=0, MinEdgeLength=0.0001, MinTolerance=0, Refine=True, RefineAngle=0, RelativeTolerance=0.65, SimplePlanes=True, Tolerance=0})
brep_5 = Brep(brep_4)
custom_mesh_settings = SettingsCustom(
    StitchSeams=True,
    SimplePlanes=False,
    Refine=True,
    MinCount=16,
    MaxCount=400,
    AspectRatio=20,
    MaxDistance=0,
    MaxAngle=20,
    MinEdge=number_slider,
    MaxEdge=number_slider)
mesh_2 = MeshBrep(Brep=brep_5, Settings=custom_mesh_settings)

# ---- group: cloth
mesh_3 = Mesh(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)

# ----
tri = Triangulate(Mesh=mesh_2)  # -> Mesh, Count
panel = Panel(mesh_3)
medges = MeshEdges(Mesh=mesh_2)  # -> NakedEdges, InteriorEdges, NonManifoldEdges
panel_2 = Panel(mesh_2)
mesh_4 = Mesh(mesh_3)
debrep = DeconstructBrep(Brep=brep_5)  # -> Faces, Edges, Vertices
mesh_5 = Mesh(mesh_4)
medges_2 = MeshEdges(Mesh=mesh_5)  # -> NakedEdges, InteriorEdges, NonManifoldEdges
medges_3 = MeshEdges(Mesh=mesh_5)  # -> NakedEdges, InteriorEdges, NonManifoldEdges
crv = Curve(medges_3.InteriorEdges)
crv_2 = Curve(medges_3.NakedEdges)
join = JoinCurves(Curves=crv_2, Preserve=False)
viewer = ParamViewer(medges_3.NakedEdges)
cp = ControlPoints(Curve=join)  # -> Points, Weights, Knots
divide = DivideCurve(Curve=debrep.Edges, Count=Slider(20, range=0..100), Kinks=False)  # -> Points, Tangents, Parameters
pt = Point(cp.Points)
viewer_2 = ParamViewer(cp.Points)
viewer_3 = ParamViewer(pt)
bang = ExplodeTree(Data=pt)  # -> _0000, _0001, _0002, _0003
dispatch = Dispatch(List=bang._0001, DispatchPattern=[True, False])  # -> ListA, ListB
dispatch_2 = Dispatch(List=bang._0002, DispatchPattern=[True, False])  # -> ListA, ListB
entwine = Entwine(Branch00=bang._0000, Branch01=dispatch.ListA, Branch02=dispatch_2.ListA, Branch03=bang._0003, FlattenInputs=True)
viewer_4 = ParamViewer(entwine)
pt_2 = Point(bang._0001)
duppt = RemoveDuplicatePts(Points=entwine, Tolerance=0.01)  # -> flatten(UniquePoints)
viewer_5 = ParamViewer(duppt)
sequence = Sequence(Frames=Slider(10, range=0..10))
meshmachine = MeshMachine(
    Geometry=mesh_5,
    Length=Slider(6, range=0..10),
    FixVertices=duppt,
    Flip=1,
    PullStrength=0.8,
    CurvatureAdaptivity=0,
    BoundaryScale=1,
    BoundaryDistance=5,
    Exponent=2,
    Background=0.5,
    Iterations=Slider(1, range=0..10),
    Reset=sequence)
pmesh = PlanktonMesh(flatten(meshmachine))
rev = ReverseList(List=pmesh)
viewer_6 = ParamViewer(pmesh)
panel_3 = Panel(pmesh)
item = ListItem(List=rev, Index=0, Wrap=True)
mesh_6 = Mesh(item)
panel_4 = Panel(mesh_6)
medges_4 = MeshEdges(Mesh=mesh_6)  # -> NakedEdges, InteriorEdges, NonManifoldEdges
