# Grasshopper definition Optimization-Grid-Relax-1.ghx (Grasshopper 0.9.76)
# plug-ins: Kangaroo Components, Weaverbird, Kangaroo2 Components

mesh = Mesh(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)
refine = Refine(Mesh=mesh, Level=3)
wbtriangles = WeaverbirdsSplitTrianglesSubdivision(MeshCurves=mesh, Level=6)
panel = Panel(wbtriangles)
clean = CombineClean(Meshes=refine)
panel_2 = Panel(clean)
wbjoin = WeaverbirdsJoinMeshesAndWeld(Mesh=wbtriangles, Weld=True)
medges = MeshEdges(Mesh=clean)  # -> NakedEdges, InteriorEdges, NonManifoldEdges
medges_2 = MeshEdges(Mesh=wbjoin)  # -> NakedEdges, InteriorEdges, NonManifoldEdges
panel_3 = Panel(wbjoin)
join = JoinCurves(Curves=medges.NakedEdges, Preserve=False)
join_2 = JoinCurves(Curves=medges_2.NakedEdges, Preserve=False)
item = ListItem(List=join, Index=0, Wrap=True)  # -> Item, Item1
item_2 = ListItem(List=join_2, Index=0, Wrap=True)  # -> Item, Item1
crv = Curve(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)
strength = Strength(1000)
pipe = Pipe(Curve=crv, Radius=Slider(0.1, range=0..0.1), Caps=0)
explode = Explode(Curve=item.Item, Recursive=True)  # -> Segments, Vertices
explode_2 = Explode(Curve=item_2.Item, Recursive=True)  # -> Segments, Vertices
strength_2 = Strength(1000)
end = EndPoints(Curve=explode.Segments)  # -> Start, End
end_2 = EndPoints(Curve=explode_2.Segments)  # -> Start, End
length_line = LengthLine(Line=[medges.InteriorEdges, medges.NakedEdges], Length=0, Strength=0.01)
oncurve = OnCurve(Points=end.Start, Curve=crv, Strength=strength)
show = Show(G=clean)
length_line_2 = LengthLine(Line=[medges_2.InteriorEdges, medges_2.NakedEdges], Length=0, Strength=0.01)
oncurve_2 = OnCurve(Points=end_2.Start, Curve=crv, Strength=strength)
show_2 = Show(G=wbjoin)
solver = Solver(GoalObjects=[show, oncurve, length_line], Reset=Button(), Threshold=1e-15, Tolerance=0.01, On=Toggle(False))  # -> I, V, O
solver_2 = Solver(GoalObjects=[show_2, oncurve_2, length_line_2], Reset=Button(), Threshold=1e-15, Tolerance=0.01, On=Toggle(False))  # -> I, V, O
item_3 = ListItem(List=solver.O, Index=0, Wrap=True)
item_4 = ListItem(List=solver_2.O, Index=0, Wrap=True)
medges_3 = MeshEdges(Mesh=item_4)  # -> NakedEdges, InteriorEdges, NonManifoldEdges
medges_4 = MeshEdges(Mesh=item_3)  # -> NakedEdges, InteriorEdges, NonManifoldEdges
