# Grasshopper definition Optimization-Planar-Qaud.ghx (Grasshopper 0.9.76)
# plug-ins: Kangaroo Components, Kangaroo2 Components

mesh = Mesh(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)
clean = CombineClean(Meshes=mesh)
medges = MeshEdges(Mesh=mesh)  # -> NakedEdges, InteriorEdges, NonManifoldEdges
# Start with this low while editing, then
# increase to ensure the final form is fully
# planarized
planarize = Slider(1.5, range=1.5..15)
pt = Point([Point(27.02140427, 37.3081131, 0), Point(27.45949936, 35.22163391, 0), Point(28.47501373, 33.37269211, 0), Point(18.56481171, 29.61532402, 0), Point(17.97564697, 31.92157173, 0), Point(16.89022446, 34.09225082, 0)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])
pt_2 = Point([Point(2.86096859, 11.99963951, 6.965034962), Point(6.308836937, 45.94126129, 6.74011898), Point(8.175953865, 48.13757324, 3.912028313), Point(5.413661957, 42.90090179, 4.901660919), Point(4.286456108, 9.592967033, 4.901660919), Point(2.59252739, 15.18432045, 4.901660919)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])

# ---- group: equalize diagonals
faceb = FaceBoundaries(Mesh=clean)
explode = Explode(Curve=faceb, Recursive=True)  # -> Segments, Vertices
item = ListItem(List=explode.Vertices, Index=0, Wrap=True)  # -> Item, Item1, Item2, Item3
ln = Line(StartPoint=item.Item, EndPoint=item.Item2)
ln_2 = Line(StartPoint=item.Item1, EndPoint=item.Item3)
equallength = EqualLength(Line=[ln, ln_2], Strength=0.2)

# ---- group: clamp edge lengths to stop any getting too short
medges_2 = MeshEdges(Mesh=clean)  # -> NakedEdges, InteriorEdges, NonManifoldEdges
clamplength = ClampLength(Line=medges_2.InteriorEdges, LowerLimit=1, UpperLimit=10, Strength=1)

# ----
_10º = PowerOf10(Value=planarize)

# ---- group: plastic anchors to prevent drift
demesh = DeconstructMesh(Mesh=clean)  # -> Vertices, Faces, Colours, Normals
plasticanchor = PlasticAnchor(Point=demesh.Vertices, Limit=0.03, Strength=0.4)

# ---- group: anchor boundaries
anchor = Anchor(Point=[pt_2, pt], Strength=1000)

# ----
grab = Grab(On=Toggle(True), Strength=1, Range=3)  # -> Grab, Anchors
show = Show(G=clean)

# ---- group: smooth
smooth = Smooth(M=clean, Strength=3)

# ---- group: planarize
planarize_2 = Planarize(M=clean, Strength=_10º)

# ----
panel = Panel(_10º)
pt_3 = Point(demesh.Vertices)
merge = Merge(
    Data1=flatten(show),
    Data2=flatten(planarize_2),
    Data3=flatten([anchor, smooth, equallength, plasticanchor, clamplength, grab.Grab]))
solver = Solver(GoalObjects=merge, Reset=Button(), Threshold=1e-15, Tolerance=0.01, On=Toggle(False))  # -> I, V, O
split = SplitList(List=solver.O, Index=1)  # -> ListA, ListB
panel_2 = Panel(split.ListB)
mesh_2 = Mesh(split.ListA)
split_2 = SplitList(List=split.ListB, Index=1400)  # -> ListA, ListB
demesh_2 = DeconstructMesh(Mesh=mesh_2)  # -> Vertices, Faces, Colours, Normals
gradient = Gradient(
    LowerLimit=0,
    UpperLimit=0.05,
    Parameter=split_2.ListA,
    stops=[0: RGB(0, 128, 0), 0.5: RGB(255, 255, 0), 1: RGB(255, 0, 0)])
deface = DeconstructFace(Face=graft(demesh_2.Faces))  # -> CornerA, CornerB, CornerC, CornerD
item_2 = ListItem(List=demesh_2.Vertices, Index=[deface.CornerA, deface.CornerB, deface.CornerC, deface.CornerD], Wrap=True)
conmesh = ConstructMesh(Vertices=item_2, Faces={A=0, B=1, C=2, D=3})  # -> flatten(Mesh)
material = CreateMaterial(Diffuse=gradient, Specular=RGB(255, 255, 255), Emission=RGB(0, 0, 0), Transparency=0, Shine=0)
preview = CustomPreview(Geometry=conmesh, Shader=material)
