# Grasshopper definition Origami-1.ghx (Grasshopper 0.9.76)
# plug-ins: Python Interpreter, Kangaroo2 Components

folding = Slider(0.449, range=0..0.99)

# ---- group: Mountain fold lines
crv = Curve([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])

# ----
angle = Panel("pi")
angle_2 = Panel("-pi")

# ---- group: mesh of flat folding pattern
# To start, Press the 'Reset' button below  then slowly change the 'Folding' slider.
# You can replace the mesh with a different
# pattern, and choose edges from it to assign
# to mountain or valley folds.
mesh = Mesh(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)

# ---- group: Valley fold lines
crv_2 = Curve([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])

# ----
multiplication = Multiplication(A=angle, B=folding)
hingepoints = HingePoints(Mesh=mesh)  # -> _1, _2, _3, _4
multiplication_2 = Multiplication(A=angle_2, B=folding)
ln = Line(StartPoint=hingepoints._1, EndPoint=hingepoints._2)
hinge = Hinge(
    FoldStart=hingepoints._1,
    FoldEnd=hingepoints._2,
    Tip1=hingepoints._3,
    Tip2=hingepoints._4,
    RestAngle=multiplication,
    Strength=0.1)
hinge_2 = Hinge(
    FoldStart=hingepoints._1,
    FoldEnd=hingepoints._2,
    Tip1=hingepoints._3,
    Tip2=hingepoints._4,
    RestAngle=multiplication_2,
    Strength=0.1)
show = Show(G=mesh)
eval = EvaluateCurve(Curve=reparameterize(crv_2), Parameter=0.5)  # -> Point, Tangent, Angle
eval_2 = EvaluateCurve(Curve=reparameterize(crv), Parameter=0.5)  # -> Point, Tangent, Angle
eval_3 = EvaluateCurve(Curve=ln, Parameter=0.5)  # -> graft(Point), Tangent, Angle
dist = Distance(PointA=eval.Point, PointB=eval_3.Point)
dist_2 = Distance(PointA=eval_2.Point, PointB=eval_3.Point)
sort = SortList(Keys=dist)  # -> Keys, ValuesA
sort_2 = SortList(Keys=dist_2)  # -> Keys, ValuesA
item = ListItem(List=sort.Keys, Index=0, Wrap=True)
item_2 = ListItem(List=sort_2.Keys, Index=0, Wrap=True)
smaller = SmallerThan(FirstNumber=item, SecondNumber=0.01)  # -> flatten(SmallerThan), OrEqualTo
smaller_2 = SmallerThan(FirstNumber=item_2, SecondNumber=0.01)  # -> flatten(SmallerThan), OrEqualTo
cull = CullPattern(List=hinge, CullPattern=smaller_2.SmallerThan)
cull_2 = CullPattern(List=hinge_2, CullPattern=smaller.SmallerThan)

# ---- group: maintain edge lengths
medges = MeshEdges(Mesh=mesh)  # -> NakedEdges, InteriorEdges, NonManifoldEdges
length_line = LengthLine(Line=[medges.NakedEdges, medges.InteriorEdges], Strength=1)

# ---- group: a weak plastic anchor on all points prevents drift
demesh = DeconstructMesh(Mesh=mesh)  # -> Vertices, Faces, Colours, Normals
plasticanchor = PlasticAnchor(Point=demesh.Vertices, Limit=0.01, Strength=0.001)

# ----
reset = Button()
solver = Solver(
    GoalObjects=[length_line, cull_2, cull, show, plasticanchor],
    Reset=reset,
    Threshold=1e-15,
    Tolerance=0.01,
    On=Toggle(True))  # -> I, V, O
mesh_2 = Mesh(flatten(solver.O))
xy = XYPlane(Origin=Point(0, 0, 0))
clean = CleanTree(RemoveNulls=True, RemoveInvalid=True, RemoveEmpty=False, Tree=mesh_2)
mesh_3 = Mesh(clean)
mirror = Mirror(Geometry=mesh_3, Plane=xy)  # -> Geometry, Transform
bbox = BoundingBox(Content=mirror.Geometry, Plane=PlaneXY(0, 0, 0))  # -> Box, Box_2
volume = Volume(Geometry=bbox.Box)  # -> Volume, Centroid
vec2pt = Vector2Pt(PointA=volume.Centroid, PointB="0,0,0", Unitize=False)  # -> Vector, Length
move = Move(Geometry=mirror.Geometry, Motion=vec2pt.Vector)  # -> Geometry, Transform
meshtonurb = MeshToNurb(m=move.Geometry)  # -> out, a
# ---------- meshtonurb: Python ----------
import rhinoscriptsyntax as rs

a = rs.MeshToNurb(m)
# ---------- end meshtonurb ----------
panel = Panel(meshtonurb.a)
preview = CustomPreview(Geometry=meshtonurb.a, Shader=ColourSwatch(SwatchColor=RGB(177, 194, 255)))
