# Grasshopper definition Origami-3.ghx (Grasshopper 0.9.76)
# plug-ins: Python Interpreter, Kangaroo2 Components

mesh = Mesh(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)

# ---- group: prevent foldthrough
tri = Triangulate(Mesh=mesh)  # -> Mesh, Count
hingepoints = HingePoints(Mesh=tri.Mesh)  # -> _1, _2, _3, _4
nofoldthrough = NoFoldThrough(FoldStart=hingepoints._1, FoldEnd=hingepoints._2, Tip1=hingepoints._3, Tip2=hingepoints._4, Strength=1)

# ---- group: maintain edge lengths
edgelengths = EdgeLengths(Mesh=tri.Mesh, LengthFactor=1, Strength=1)

# ---- group: keep the quads planar
planarize = Planarize(M=mesh, Strength=1)

# ----
show = Show(G=mesh)
grab = Grab(On=True, Strength=1, Range=3)  # -> Grab, Anchors
entwine = Entwine(Branch00=[nofoldthrough, planarize, edgelengths, grab.Grab], Branch01=show, FlattenInputs=True)
solver = Solver(GoalObjects=entwine, Reset=Button(), Threshold=1e-15, Tolerance=0.01, On=Toggle(True))  # -> I, V, O
mesh_2 = Mesh(flatten(solver.O))
xy = XYPlane(Origin=Point(0, 0, 0))
clean = CleanTree(RemoveNulls=True, RemoveInvalid=True, RemoveEmpty=False, Tree=mesh_2)
mesh_3 = Mesh(clean)
mirror = Mirror(Geometry=mesh_3, Plane=xy)  # -> Geometry, Transform
bbox = BoundingBox(Content=mirror.Geometry, Plane=PlaneXY(0, 0, 0))  # -> Box, Box_2
volume = Volume(Geometry=bbox.Box)  # -> Volume, Centroid
vec2pt = Vector2Pt(PointA=volume.Centroid, PointB="0,0,0", Unitize=False)  # -> Vector, Length
move = Move(Geometry=mirror.Geometry, Motion=vec2pt.Vector)  # -> Geometry, Transform
meshtonurb = MeshToNurb(m=move.Geometry)  # -> out, a
# ---------- meshtonurb: Python ----------
import rhinoscriptsyntax as rs

a = rs.MeshToNurb(m)
# ---------- end meshtonurb ----------
panel = Panel(meshtonurb.a)
preview = CustomPreview(Geometry=meshtonurb.a, Shader=ColourSwatch(SwatchColor=RGB(177, 194, 255)))
