# Grasshopper definition Polygon-MagnetSnap.ghx (Grasshopper 0.9.76)
# plug-ins: Kangaroo2 Components

mesh = Mesh([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])
panel = Panel("grab")
medges = MeshEdges(Mesh=mesh)  # -> NakedEdges, InteriorEdges, NonManifoldEdges
grab = Grab(On=True, Strength=1, Range=3)  # -> Grab, Anchors
show = Show(G=mesh)
demesh = DeconstructMesh(Mesh=mesh)  # -> Vertices, Faces, Colours, Normals
length_line = LengthLine(Line=medges.NakedEdges, Strength=100)
ms = MagnetSnap(Points=flatten(demesh.Vertices), Range=Slider(2.5, range=0..3), Strength=10)
solver = Solver(GoalObjects=[length_line, ms, show, grab.Grab], Reset=Button(), Threshold=1e-15, Tolerance=0.01, On=True)  # -> I, V, O
data = Data(solver.O)
pt = Point(data)
mesh_2 = Mesh(data)
clean = CleanTree(RemoveNulls=True, RemoveInvalid=True, RemoveEmpty=False, Tree=mesh_2)
clean_2 = CleanTree(RemoveNulls=True, RemoveInvalid=True, RemoveEmpty=False, Tree=pt)
pt_2 = Point(clean_2)
mesh_3 = Mesh(clean)
panel_2 = Panel(mesh_3)
panel_3 = Panel(clean)
lng = ListLength(List=mesh_3)
number_slider = Slider(1, range=0..1000)
integer_division = IntegerDivision(A=number_slider, B=lng)
division = Division(A=number_slider, B=lng)
panel_4 = Panel(lng)
viewer = ParamViewer(lng)
series = Series(Start=division, Step=division, Count=lng)
subtraction = Subtraction(A=number_slider, B=series)
hsl = ColourHSL(Alpha=1, Hue=series, Saturation=1, Luminance=0.5)
panel_5 = Panel(subtraction)
random = Random(Range=Domain(0, 1), Number=lng, Seed=Slider(2, range=0..10))
sort = SortList(Keys=random, ValuesA=hsl)  # -> Keys, ValuesA
preview = CustomPreview(Geometry=mesh_3, Shader=sort.ValuesA)
viewer_2 = ParamViewer(random)
