# Grasshopper definition Pull-Mesh-to-Surface.ghx (Grasshopper 0.9.76)
# plug-ins: Kangaroo2 Components

W = WidthCount(30)
mplane = MeshPlane(Boundary={Plane=PlaneXY(-21, -17, 0), Size=Domain2(u=0..71, v=0..44)}, WidthCount=W, HeightCount=W)  # -> Mesh, Area
medges = MeshEdges(Mesh=mplane.Mesh)  # -> NakedEdges, InteriorEdges, NonManifoldEdges
demesh = DeconstructMesh(Mesh=mplane.Mesh)  # -> Vertices, Faces, Colours, Normals
srf = Surface(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)
pt = Point(demesh.Vertices)
crv = Curve([medges.NakedEdges, medges.InteriorEdges])
length_line = LengthLine(Line=crv, Strength=10)
onmesh = OnMesh(Points=demesh.Vertices, Mesh=srf, Strength=1)
smooth = Smooth(M=mplane.Mesh, Strength=10)
solver = Solver(GoalObjects=[length_line, onmesh, smooth], Reset=Button(), Threshold=1e-15, Tolerance=0.01, On=Toggle(False))  # -> I, V, O
data = Data(solver.O)
