# Grasshopper definition RigidBody-Balance.ghx (Grasshopper 0.9.76)
# plug-ins: Kangaroo2 Components

# ---- group: dog?
brep = Brep(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)

# ---- group: box
brep_2 = Brep(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)

# ---- group: box2
brep_3 = Brep(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)

# ----
merge = Merge(Data1=brep_2, Data2=brep_3)
brep_4 = Brep(brep)
brep_5 = Brep(brep_2)
rigidbody = RigidBody(Part=brep_4, Strength=10)  # -> RigidBody, Planes
rigidbody_2 = RigidBody(Part=brep_5, Strength=10)  # -> RigidBody, Planes
xy = XYPlane(Origin=Point(0, 0, 0))
Z = UnitZ(Factor=-0.1)
pt = Point(rigidbody.Planes)
pt_2 = Point(rigidbody_2.Planes)
solidplanecollide = SolidPlaneCollide(Solid=brep_4, SolidPlane=rigidbody.Planes, CollisionPlane=xy, Strength=1)
solidplanecollide_2 = SolidPlaneCollide(Solid=brep_5, SolidPlane=rigidbody_2.Planes, CollisionPlane=xy, Strength=1)
load = Load(Point=pt, ForceVector=Z)
load_2 = Load(Point=pt_2, ForceVector=Z)
merge_2 = Merge(
    Data1=rigidbody.RigidBody,
    Data2=load,
    Data3=solidplanecollide,
    Data4=rigidbody_2.RigidBody,
    Data5=load_2,
    Data6=solidplanecollide_2)  # -> flatten(Result)
bouncysolver = BouncySolver(GoalObjects=merge_2, Reset=Button(), Threshold=1e-15, Tolerance=0.01, Damping=0.97, Iterations=20, On=Toggle(False))  # -> I, V, O
preview = CustomPreview(
    Geometry=bouncysolver.O,
    Shader={ambient=RGB(128, 128, 128), diffuse=RGB(0, 192, 192), emission=RGB(0, 0, 0), shine=0.5, specular=RGB(255, 255, 255), transparency=0})
