# Grasshopper definition Sculpt-Example.ghx (Grasshopper 0.9.76)
# plug-ins: Kangaroo2 Components

mesh = Mesh(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)
# Plastic anchors have a memory. If you need to reset this, one easy way is to select your entire Grasshopper definition using Ctrl-A, then cut and paste it back with Ctrl-X, Ctrl-V
medges = MeshEdges(Mesh=mesh)  # -> NakedEdges, InteriorEdges, NonManifoldEdges
mesh_2 = Mesh(mesh)
join = JoinCurves(Curves=medges.NakedEdges, Preserve=False)
explode = Explode(Curve=join, Recursive=True)  # -> Segments, Vertices
faceb = FaceBoundaries(Mesh=mesh_2)
demesh = DeconstructMesh(Mesh=mesh_2)  # -> Vertices, Faces, Colours, Normals
medges_2 = MeshEdges(Mesh=mesh_2)  # -> NakedEdges, InteriorEdges, NonManifoldEdges
explode_2 = Explode(Curve=faceb, Recursive=True)  # -> Segments, Vertices
shift = ShiftList(List=explode.Segments, Shift=1, Wrap=True)
clamplength = ClampLength(Line=medges_2.InteriorEdges, LowerLimit=1, UpperLimit=4, Strength=5)
angle = Angle(LineA=explode.Segments, LineB=shift, RestAngle=0, Strength=50)
plasticanchor = PlasticAnchor(Point=demesh.Vertices, Limit=0.05, Strength=3)
smooth = Smooth(M=mesh_2, Strength=8)
grab = Grab(On=True, Strength=10, Range=3)  # -> Grab, Anchors
equallength = EqualLength(Line=explode.Segments, Strength=3)
equallength_2 = EqualLength(Line=explode_2.Segments, Strength=2)
show = Show(G=mesh_2)
solver = Solver(
    GoalObjects=[plasticanchor, smooth, show, equallength_2, clamplength, equallength, angle, grab.Grab],
    Reset=Button(),
    Threshold=1e-15,
    Tolerance=0.01,
    On=True)  # -> I, V, O
preview = CustomPreview(
    Geometry=solver.O,
    Shader={ambient=RGB(128, 128, 128), diffuse=RGB(71, 222, 11), emission=RGB(0, 24, 0), shine=0.8, specular=RGB(255, 255, 255), transparency=0})
