# Grasshopper definition Tensegrity-2.ghx (Grasshopper 0.9.76)
# plug-ins: Kangaroo Components

struts = Curve([<curve referenced from the Rhino model> x6])
cables = Curve([<curve referenced from the Rhino model> x24])

# ---- group: Gravity
slider = Slider(-100, range=-100..0)

# ---- group: Cable pre-tension
slider_2 = Slider(0.9, range=0..1)

# ----
div = DivideDomain(Domain=Domain(0, 1), Count=10)
path_mapper = PathMapper(cables, source="{A}", target="{1}")
subcrv = SubCurve(BaseCurve=reparameterize(graft(cables)), Domain=div)
end = EndPoints(Curve=struts)  # -> Start, End
Z = UnitZ(Factor=slider)
path_mapper_2 = PathMapper(subcrv, source="{A;B}", target="{2}")
springs = SpringsFromLine(
    Connection=struts,
    Stiffness=10000,
    Damping=10,
    RestLength=struts,
    Cutoff=0,
    CompressionFail=0,
    TensileFail=0,
    Plasticity=0)
len = Length(Curve=subcrv)
kangaroo_settings = KangarooSettings(
    Tolerance=0.001,
    TimeStep=0.005,
    SubIterations=30,
    Floor=True,
    Drag=1,
    Restitution=0.7,
    StaticFriction=10,
    KineticFriction=10,
    Settle=2,
    Tumble=1,
    Sound=False,
    Solver=0)
uforce = UnaryForce(Point=[end.Start, end.End], Force=Z)
line = Line([struts, path_mapper, path_mapper_2])
multiplication = Multiplication(A=len, B=slider_2)
springs_2 = SpringsFromLine(
    Connection=subcrv,
    Stiffness=15000,
    Damping=10,
    RestLength=multiplication,
    Cutoff=0,
    CompressionFail=0,
    TensileFail=0,
    Plasticity=0)

timer = Timer(TimerInterval=1, Target=kangaroo)

kangaroo = KangarooPhysics(
    ForceObjects=flatten([springs_2, springs, uforce]),
    Settings=kangaroo_settings,
    Geometry=line,
    SimulationReset=Toggle(False))  # -> Out, Iterations, ParticlesOut, GeometryOut, KE
geo = Geometry(kangaroo.GeometryOut)

# ---- group: Output Struts
branch = TreeBranch(Tree=geo, Path="{0}", MaintainPaths=False)

# ---- group: Output Cables with Subdivision
branch_2 = TreeBranch(Tree=geo, Path="{2}", MaintainPaths=False)

# ---- group: Output Cables without subdivision
branch_3 = TreeBranch(Tree=geo, Path="{1}", MaintainPaths=False)

# ----
pipe = Pipe(Curve=branch, Radius=1, Caps=0)
preview = CustomPreview(
    Geometry=pipe,
    Shader={ambient=RGB(128, 128, 128), diffuse=RGB(255, 128, 0), emission=RGB(0, 0, 0), shine=0.5, specular=RGB(255, 255, 255), transparency=0})
