# Grasshopper definition Tensile-Cone.ghx (Grasshopper 0.9.76)
# plug-ins: Kangaroo Components, Kangaroo2 Components

mesh = Mesh(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)
combine_clean = CombineClean(Meshes=mesh)
panel = Panel(mesh)
panel_2 = Panel(combine_clean)
refine = Refine(Mesh=combine_clean, Level=Slider(3, range=0..11))
mesh_2 = Mesh(refine)
medges = MeshEdges(Mesh=mesh_2)  # -> NakedEdges, InteriorEdges, NonManifoldEdges
join_curves = JoinCurves(Curves=medges.NakedEdges, Preserve=False)
strength = Strength(10)
point = Point([Point(65, 20, 0), Point(65, 50, 0), Point(35, 50, 0), Point(35, 20, 0)])
list_item = ListItem(List=join_curves, Index=0, Wrap=True)  # -> Item, Item1
curve = Curve(list_item.Item1)
explode = Explode(Curve=curve, Recursive=True)  # -> Segments, Vertices
anchor = Anchor(Point=point, Strength=10000)
length_line = LengthLine(Line=medges.NakedEdges, Length=Slider(0, range=0..1), Strength=strength)
length_line_2 = LengthLine(Line=medges.InteriorEdges, Length=Slider(0.296, range=0..1), Strength=1)
show = Show(G=mesh_2)
end_points = EndPoints(Curve=explode.Segments)  # -> Start, End
curve_2 = Curve(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)
pt = Point(end_points.Start)
oncurve = OnCurve(Points=end_points.Start, Curve=curve_2, Strength=Slider(122.522, range=0..201))
pipe = Pipe(Curve=curve_2, Radius=Slider(0.3, range=0..1), Caps=0)
merge = Merge(Data1=show, Data2=anchor, Data3=length_line, Data4=length_line_2, Data5=oncurve)
solver = Solver(GoalObjects=merge, Reset=Button(), Threshold=1e-15, Tolerance=0.01, On=Toggle(False))  # -> I, V, O
mesh_3 = Mesh(solver.O)
data = Data(solver.O)
