# Grasshopper definition Tensile-Diagonalize.ghx (Grasshopper 0.9.76)
# plug-ins: Kangaroo2 Components

mplane = MeshPlane(Boundary={Plane=PlaneXY(0, 0, 0), Size=Domain2(u=-10..10, v=-10..10)}, WidthCount=10, HeightCount=10)  # -> Mesh, Area
mesh = Mesh(mplane.Mesh)
medges = MeshEdges(Mesh=mplane.Mesh)  # -> NakedEdges, InteriorEdges, NonManifoldEdges
diag = Diagonalize(Mesh=mesh)
pt = Point([Point(-12.27991863, 12.10183007, 11.43864474), Point(24.70124942, 29.19337735, 0), Point(11.69300283, -12.87602776, 13.77366866), Point(-11.30649839, -11.92899048, 0)])
mc = MeshCorners(Mesh=diag, Angle=2.35619449)
medges_2 = MeshEdges(Mesh=diag)  # -> NakedEdges, InteriorEdges, NonManifoldEdges
anchor = Anchor(Point=mc, Target=pt, Strength=10000)
length_line = LengthLine(Line=medges_2.InteriorEdges, Length=0, Strength=1)
length_line_2 = LengthLine(Line=medges_2.NakedEdges, Length=Slider(1, range=0..1), Strength=50)
show = Show(G=diag)
merge = Merge(Data1=show, Data2=anchor, Data3=length_line_2, Data4=length_line)
solver = Solver(GoalObjects=merge, Reset=Button(), Threshold=1e-15, Tolerance=0.01, On=Toggle(True))  # -> I, V, O
mesh_2 = Mesh(solver.O)
medges_3 = MeshEdges(Mesh=mesh_2)  # -> NakedEdges, InteriorEdges, NonManifoldEdges
