# Grasshopper definition Tensile-Simple.ghx (Grasshopper 0.9.76)
# plug-ins: Kangaroo2 Components

mplane = MeshPlane(Boundary={Plane=PlaneXY(0, 0, 0), Size=Domain2(u=-10..10, v=-10..10)}, WidthCount=10, HeightCount=10)  # -> Mesh, Area
# The 'P' input of the Anchor identifies
# which points to move, and the 'T'
# input tells it where to move them to.
medges = MeshEdges(Mesh=mplane.Mesh)  # -> NakedEdges, InteriorEdges, NonManifoldEdges
pt = Point([Point(-10, 10, -5.246426965), Point(10, 10, 0), Point(10, -10, -13.71146558), Point(-10, -10, -0.6311152357)])
mc = MeshCorners(Mesh=mplane.Mesh, Angle=2.35619449)
edgelengths = EdgeLengths(Mesh=mplane.Mesh, LengthFactor=Slider(0.642, range=0..1), Strength=1)
show = Show(G=mplane.Mesh)
# If you have the 'gumball' option on in the
# Grasshopper display menu, when you
# select these points you should be able to
# move them in the Rhino display port.
anchor = Anchor(Point=mc, Target=pt, Strength=10000)
panel = Panel(mc)
merge = Merge(Data1=show, Data2=edgelengths, Data3=anchor)
solver = Solver(GoalObjects=merge, Reset=Button(), Threshold=1e-15, Tolerance=0.01, On=Toggle(False))  # -> I, V, O
mesh = Mesh(solver.O)
