# Grasshopper definition Tensile-Tunnels-WarpWeft.ghx (Grasshopper 0.9.76)
# plug-ins: Kangaroo Components, Kangaroo2 Components

mesh = Mesh(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)
refine = Refine(Mesh=mesh, Level=3)
medges = MeshEdges(Mesh=refine)  # -> NakedEdges, InteriorEdges, NonManifoldEdges
clean = CombineClean(Meshes=refine)
medges_2 = MeshEdges(Mesh=clean)  # -> NakedEdges, InteriorEdges, NonManifoldEdges
join = JoinCurves(Curves=medges_2.NakedEdges, Preserve=False)
warpweft = WarpWeft(Mesh=clean)  # -> Warp, Weft, NakedA, NakedB
item = ListItem(List=join, Index=0, Wrap=True)  # -> Item, Item1, Item2
explode = Explode(Curve=item.Item, Recursive=True)  # -> Segments, Vertices
explode_2 = Explode(Curve=item.Item1, Recursive=True)  # -> Segments, Vertices
explode_3 = Explode(Curve=item.Item2, Recursive=True)  # -> Segments, Vertices
length_line = LengthLine(Line=warpweft.Warp, Length="0", Strength=Slider(0.471, range=0..1))
length_line_2 = LengthLine(Line=warpweft.Weft, Length="0", Strength=Slider(0.462, range=0..1))
end = EndPoints(Curve=explode.Segments)  # -> Start, End
end_2 = EndPoints(Curve=explode_2.Segments)  # -> Start, End
end_3 = EndPoints(Curve=explode_3.Segments)  # -> Start, End
preview = CustomPreview(Geometry=warpweft.Warp, Shader="0,255,0")
preview_2 = CustomPreview(Geometry=warpweft.Weft, Shader="0,0,255")
crv = Curve(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)
crv_2 = Curve(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)
crv_3 = Curve(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)
show = Show(G=clean)
oncurve = OnCurve(Points=end.End, Curve=crv, Strength="100")
oncurve_2 = OnCurve(Points=end_2.End, Curve=crv_2, Strength="100")
oncurve_3 = OnCurve(Points=end_3.End, Curve=crv_3, Strength="100")
merge = Merge(Data1=show, Data2=length_line, Data3=length_line_2, Data4=oncurve, Data5=oncurve_2, Data6=oncurve_3)  # -> flatten(Result)
solver = Solver(GoalObjects=merge, Reset=Button(), Threshold=1e-15, Tolerance=0.01, On=Toggle(False))  # -> I, V, O
item_2 = ListItem(List=solver.O, Index=0, Wrap=True)
mesh_2 = Mesh(item_2)
medges_3 = MeshEdges(Mesh=mesh_2)  # -> NakedEdges, InteriorEdges, NonManifoldEdges
