# Grasshopper definition Bending-Mesh-Angle.ghx (Grasshopper 0.9.76)
# plug-ins: Kangaroo2 Components

mesh_plane = MeshPlane(Boundary={Plane=PlaneXY(0, 0, 0), Size=Domain2(u=-10..10, v=-10..10)}, WidthCount=10, HeightCount=10)  # -> Mesh, Area
triangulate = Triangulate(Mesh=mesh_plane.Mesh)  # -> Mesh, Count
mesh_edges = MeshEdges(Mesh=triangulate.Mesh)  # -> NakedEdges, InteriorEdges, NonManifoldEdges
join_curves = JoinCurves(Curves=mesh_edges.NakedEdges, Preserve=False)
explode = Explode(Curve=join_curves, Recursive=True)  # -> Segments, Vertices
panel = Panel(explode.Segments)
shift_list = ShiftList(List=explode.Segments, Shift=1, Wrap=True)
grab = Grab(On=True, Strength=1, Range=3)  # -> Grab, Anchors
length_line = LengthLine(Line=mesh_edges.NakedEdges, Strength=100)
length_line_2 = LengthLine(Line=mesh_edges.InteriorEdges, Length="1", Strength=0.01)
angle = Angle(LineA=explode.Segments, LineB=shift_list, RestAngle="0", Strength=2)
show = Show(G=mesh_plane.Mesh)
merge = Merge(Data1=show, Data2=grab.Grab, Data3=angle, Data4=length_line, Data5=length_line_2)
solver = Solver(GoalObjects=merge, Reset=Button(), Threshold=1e-15, Tolerance=0.01, On=Toggle(False))  # -> I, V, O
mesh = Mesh(solver.O)
