# Grasshopper definition Bending.ghx (Grasshopper 0.9.76)
# plug-ins: Kangaroo2 Components

crv = Curve(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)
crv_2 = Curve(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)
divide = DivideCurve(Curve=crv, Count=25, Kinks=False)  # -> Points, Tangents, Parameters
crv_3 = Curve(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)
len = Length(Curve=crv_3)
divide_2 = DivideCurve(Curve=crv_2, Count=25, Kinks=False)  # -> Points, Tangents, Parameters
divide_3 = DivideCurve(Curve=crv_3, Count=25, Kinks=False)  # -> Points, Tangents, Parameters
pline = PolyLine(Vertices=divide.Points, Closed=False)
panel = Panel(len)
pline_2 = PolyLine(Vertices=divide_2.Points, Closed=False)
explode = Explode(Curve=pline, Recursive=True)  # -> Segments, Vertices
panel_2 = Panel(explode.Segments)
pline_3 = PolyLine(Vertices=divide_3.Points, Closed=False)
explode_2 = Explode(Curve=pline_2, Recursive=True)  # -> Segments, Vertices
panel_3 = Panel(explode_2.Segments)
explode_3 = Explode(Curve=pline_3, Recursive=True)  # -> Segments, Vertices
panel_4 = Panel(explode_3.Segments)
shift = ShiftList(List=explode.Segments, Shift=1, Wrap=False)

len_2 = Length(Curve=explode_3.Segments)
item = ListItem(List=len_2, Index=0, Wrap=True)

panel_5 = Panel("2")
shift_2 = ShiftList(List=explode_3.Segments, Shift=1, Wrap=False)
shift_3 = ShiftList(List=explode_2.Segments, Shift=1, Wrap=False)
# Hold the left Control key and use the left mouse button to drag in the Rhino viewports. Right click while holding left mouse + left Control
# to add or remove Anchors
toggle = BooleanToggle(True)
button = Button()
panel_6 = Panel("pi")
short = ShortestList(ListA=explode.Segments, ListB=shift, TrimMode=2)  # -> ListA, ListB
short_2 = ShortestList(ListA=explode_3.Segments, ListB=shift_2, TrimMode=2)  # -> ListA, ListB
panel_7 = Panel("pi *0.5")
button_2 = Button()
short_3 = ShortestList(ListA=explode_2.Segments, ListB=shift_3, TrimMode=2)  # -> ListA, ListB
grab = Grab(On=toggle, Strength=10, Range=3)  # -> Grab, Anchors
length_line = LengthLine(Line=explode.Segments, Length="2", Strength=10)
angle = Angle(LineA=short.ListA, LineB=short.ListB, RestAngle="0", Strength=1)
length_line_2 = LengthLine(Line=explode_2.Segments, Length="2", Strength=10)
angle_2 = Angle(LineA=short_3.ListA, LineB=short_3.ListB, RestAngle="0", Strength=1)
grab_2 = Grab(On=Toggle(True), Strength=10, Range=3)  # -> Grab, Anchors
length_line_3 = LengthLine(Line=explode_3.Segments, Length=item, Strength=10)
angle_3 = Angle(LineA=short_2.ListA, LineB=short_2.ListB, RestAngle="0", Strength=1)
button_3 = Button()
bouncysolver = BouncySolver(
    GoalObjects=[grab.Grab, length_line, angle],
    Reset=button,
    Threshold=1e-15,
    Tolerance=0.01,
    Damping=0.99,
    Iterations=10,
    On=True)  # -> I, V, O
solver = Solver(
    GoalObjects=[angle, grab.Grab, length_line],
    Reset=button,
    Restart=False,
    Parallel=True,
    Threshold=1e-15,
    Tolerance=0.01,
    AddCurrent=False,
    On=True)  # -> V, O
bouncysolver_2 = BouncySolver(
    GoalObjects=[length_line_2, angle_2],
    Reset=button_2,
    Threshold=1e-15,
    Tolerance=0.01,
    Damping=0.99,
    Iterations=10,
    On=True)  # -> I, V, O
solver_2 = Solver(
    GoalObjects=[angle_2, length_line_2],
    Reset=button_2,
    Restart=False,
    Parallel=True,
    Threshold=1e-15,
    Tolerance=0.01,
    AddCurrent=False,
    On=True)  # -> V, O
bouncysolver_3 = BouncySolver(
    GoalObjects=[grab_2.Grab, length_line_3, angle_3],
    Reset=button_3,
    Threshold=1e-15,
    Tolerance=0.01,
    Damping=0.99,
    Iterations=10,
    On=True)  # -> I, V, O
solver_3 = Solver(
    GoalObjects=[angle_3, grab_2.Grab, length_line_3],
    Reset=button_3,
    Restart=False,
    Parallel=True,
    Threshold=1e-15,
    Tolerance=0.01,
    AddCurrent=False,
    On=True)  # -> V, O
data = Data(solver.O)
data_2 = Data(bouncysolver.O)
data_3 = Data(solver_2.O)
data_4 = Data(bouncysolver_2.O)
panel_8 = Panel(data_2)
data_5 = Data(bouncysolver_3.O)
data_6 = Data(solver_3.O)
panel_9 = Panel(data_5)
join = JoinCurves(Curves=data_6, Preserve=False)
len_3 = Length(Curve=join)
panel_10 = Panel(len_3)
