# Grasshopper definition Bomb.ghx (Grasshopper 0.9.76)
# plug-ins: Kangaroo2 Components

panel = Panel("""100
200
300""")
R = Radius(2)
pop3d = Populate3D(Region={Plane=PlaneXY(-50, -191, 0), X=Domain(0, 93), Y=Domain(0, 391), Z=Domain(0, 35)}, Count=5000, Seed=1)
location = Location([Point(0, -137, -2.257632363), Point(-8, 7.620723518, -1.513751096), Point(-8, 156.7507605, -2.854196122)])
mesh = Mesh(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)

button = Button()

panel_2 = Panel(mesh)
Z = UnitZ(Factor=-0.01)
B = Bomb(Location=location, Points=pop3d, DetonationTime=panel, Strength=1, Reset=button)
floor = Floor(Strength=10)
anchor = Anchor(Point=location, Strength=10000)
spc = SolidPointCollide(Points=pop3d, Solid=mesh, Interior=False, Unidirectional=True, Strength=6)
sc = SphereCollide(Points=pop3d, Radius=R, Strength=1)
load = Load(Point=pop3d, ForceVector=Z)
show = Show(G=pop3d)
merge = Merge(Data1=show, Data2=spc, Data3=load, Data4=sc, Data5=anchor, Data6=floor, Data7=B)  # -> flatten(Result)
colour = ColourPicker(PickedColour=RGBA(0, 255, 255, 68))
bouncysolver = BouncySolver(GoalObjects=merge, Reset=button, Threshold=1e-15, Tolerance=0.01, Damping=0.9996, Iterations=2, On=Toggle(False))  # -> I, V, O
lng = ListLength(List=bouncysolver.V)
preview = CustomPreview(Geometry=mesh, Shader=colour)
range = Range(Domain=Domain(0, 1), Steps=expr("x-1", lng))
gradient = Gradient(
    LowerLimit=0,
    UpperLimit=1,
    Parameter=range,
    stops=[0: RGB(243, 57, 0), 0.1: RGB(236, 27, 60), 0.2: RGB(210, 0, 118), 0.3: RGB(103, 0, 120), 0.4: RGB(39, 72, 161), 0.5: RGB(1, 192, 229), 0.6: RGB(18, 178, 90), 0.7: RGB(79, 186, 8), 0.8: RGB(220, 237, 32), 0.9: RGB(247, 159, 20), 1: RGB(243, 57, 0)])
cloud = CloudDisplay(Points=bouncysolver.V, Colours=gradient, Size=R, SpriteType=1)
