# Grasshopper definition Catenary-slide.ghx (Grasshopper 0.9.76)
# plug-ins: Kangaroo2 Components

panel = Panel("True")
panel_2 = Panel("False")
panel_7 = Panel("Load / vertexLoad")

# ---- group: here some vertices along the edges have been selected and fixed only in the Z direction, so they are free to slide on the XY plane
pt = Point([Point(10, 10, 0), Point(-10, 10, 0), Point(10, 9, 0), Point(-10, 9, 0), Point(10, 8, 0), Point(-10, 8, 0), Point(10, 7, 0), Point(-10, 7, 0), Point(10, 6, 0), Point(-10, 6, 0)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])
anchorxyz = AnchorXYZ(Point=pt, X=Toggle(False), Y=Toggle(True), Z=Toggle(True), Strength=1000)

# ----
W = WidthCount(20)

# ---- group: here some vertices along the edges have been selected and fixed only in the Z direction, so they are free to slide on the XY plane
pt_2 = Point([Point(10, 10, 0), Point(-10, 10, 0), Point(10, 9, 0), Point(-10, 9, 0), Point(10, 8, 0), Point(-10, 8, 0), Point(10, 7, 0), Point(-10, 7, 0), Point(10, 6, 0), Point(-10, 6, 0)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])
anchorxyz_2 = AnchorXYZ(Point=pt_2, X=Toggle(False), Y=Toggle(True), Z=Toggle(True), Strength=1000)

# ----
mplane = MeshPlane(Boundary={Plane=PlaneXY(0, 0, 0), Size=Domain2(u=-10..10, v=-10..10)}, WidthCount=W, HeightCount=W)  # -> Mesh, Area
W_2 = WidthCount(20)
mplane_2 = MeshPlane(Boundary={Plane=PlaneXY(0, 0, 0), Size=Domain2(u=-10..10, v=-10..10)}, WidthCount=W_2, HeightCount=W_2)  # -> Mesh, Area

# ---- group: XXX
corners = Corners(mesh=mplane.Mesh)

# ----
demesh = DeconstructMesh(Mesh=mplane_2.Mesh)  # -> Vertices, Faces, Colours, Normals
Z = UnitZ(Factor=1)
load = Load(Point=demesh.Vertices, ForceVector=Z)

mc = MeshCorners(Mesh=mplane.Mesh, Angle=2.35619449)
grab = Grab(On=True, Strength=1, Range=3)  # -> Grab, Anchors
edgelengths = EdgeLengths(Mesh=mplane.Mesh, LengthFactor=Slider(0.467, range=0..1), Strength=10)
vertexloads = VertexLoads(Mesh=mplane.Mesh, Strength=Slider(1, range=0..1))
anchor = Anchor(Point=mc, Strength=1000)
mc_2 = MeshCorners(Mesh=mplane_2.Mesh, Angle=2.35619449)
reset = Button()
grab_2 = Grab(On=True, Strength=1, Range=3)  # -> Grab, Anchors
edgelengths_2 = EdgeLengths(Mesh=mplane_2.Mesh, LengthFactor=Slider(0.467, range=0..1), Strength=10)
anchor_2 = Anchor(Point=mc_2, Strength=1000)
reset_2 = Button()
bouncysolver = BouncySolver(
    GoalObjects=[edgelengths, anchor, vertexloads, anchorxyz],
    Reset=reset,
    Threshold=1e-15,
    Tolerance=0.01,
    Damping=0.99,
    Iterations=10,
    On=True)  # -> I, V, O
solver = Solver(
    GoalObjects=[anchor, grab.Grab, anchorxyz, edgelengths, vertexloads],
    Reset=reset,
    Threshold=1e-15,
    Tolerance=0.01,
    On=True)  # -> I, V, O
bouncysolver_2 = BouncySolver(
    GoalObjects=[edgelengths_2, anchor_2, anchorxyz_2, load],
    Reset=reset_2,
    Threshold=1e-15,
    Tolerance=0.01,
    Damping=0.99,
    Iterations=10,
    On=True)  # -> I, V, O
solver_2 = Solver(
    GoalObjects=[anchor_2, grab_2.Grab, anchorxyz_2, edgelengths_2, load],
    Reset=reset_2,
    Threshold=1e-15,
    Tolerance=0.01,
    On=True)  # -> I, V, O
data = Data(bouncysolver.O)
data_2 = Data(solver.O)
data_3 = Data(bouncysolver_2.O)
data_4 = Data(solver_2.O)

# ==== cluster Corners: Find the boundary corner points of a quad mesh
mesh = ClusterInput()
mesh_2 = Mesh(mesh)
nv = NakedVertices(Mesh=mesh_2)  # -> ClothedIndex, NakedIndex, ClothedPts, NakedPts
vn = VertexNeighbours(Mesh=mesh_2, VertexNumber=nv.NakedIndex)  # -> graft(Vertex), Neighbours, Normal
lng = ListLength(List=vn.Neighbours)
equals = Equality(FirstNumber=lng, SecondNumber=3)  # -> Equality, Inequality
cull = CullPattern(List=vn.Vertex, CullPattern=equals.Inequality)
pshift = ShiftPaths(Data=cull, Offset=-1)
D = ClusterOutput(pshift)
