# Grasshopper definition Catenary.ghx (Grasshopper 0.9.76)
# plug-ins: Kangaroo2 Components

mplane = MeshPlane(Boundary={Plane=PlaneXY(0, 0, 0), Size=Domain2(u=-10..10, v=-10..10)}, WidthCount=10, HeightCount=10)  # -> Mesh, Area
mplane_2 = MeshPlane(Boundary={Plane=PlaneXY(0, 0, 0), Size=Domain2(u=-10..10, v=-10..10)}, WidthCount=10, HeightCount=10)  # -> Mesh, Area
mplane_3 = MeshPlane(Boundary={Plane=PlaneXY(0, 0, 0), Size=Domain2(u=-10..10, v=-10..10)}, WidthCount=10, HeightCount=10)  # -> Mesh, Area
Z = UnitZ(Factor=1)
Z_2 = UnitZ(Factor=1)
Z_3 = UnitZ(Factor=1)
corners = Corners(mesh=mplane.Mesh)
corners_2 = Corners(mesh=mplane_2.Mesh)
neg = Negative(Value=Z)
medges = MeshEdges(Mesh=mplane.Mesh)  # -> NakedEdges, InteriorEdges, NonManifoldEdges
demesh = DeconstructMesh(Mesh=mplane.Mesh)  # -> Vertices, Faces, Colours, Normals
corners_3 = Corners(mesh=mplane_3.Mesh)
medges_2 = MeshEdges(Mesh=mplane_2.Mesh)  # -> NakedEdges, InteriorEdges, NonManifoldEdges
demesh_2 = DeconstructMesh(Mesh=mplane_2.Mesh)  # -> Vertices, Faces, Colours, Normals
neg_2 = Negative(Value=Z_2)
neg_3 = Negative(Value=Z_3)
medges_3 = MeshEdges(Mesh=mplane_3.Mesh)  # -> NakedEdges, InteriorEdges, NonManifoldEdges
demesh_3 = DeconstructMesh(Mesh=mplane_3.Mesh)  # -> Vertices, Faces, Colours, Normals
grab = Grab(On=True, Strength=10, Range=3)  # -> Grab, Anchors
length_line = LengthLine(Line=[medges.NakedEdges, medges.InteriorEdges], Strength=10)
anchor = Anchor(Point=corners, Strength=1000)
grab_2 = Grab(On=True, Strength=10, Range=3)  # -> Grab, Anchors
length_line_2 = LengthLine(Line=[medges_2.NakedEdges, medges_2.InteriorEdges], Strength=10)
anchor_2 = Anchor(Point=corners_2, Strength=1000)
load = Load(Point=demesh.Vertices, ForceVector=Z_3)
load_2 = Load(Point=demesh_2.Vertices, ForceVector=neg)
grab_3 = Grab(On=True, Strength=10, Range=3)  # -> Grab, Anchors
length_line_3 = LengthLine(Line=[medges_3.NakedEdges, medges_3.InteriorEdges], Strength=10)
anchor_3 = Anchor(Point=corners_3, Strength=1000)
load_3 = Load(Point=demesh_3.Vertices, ForceVector=neg_2)
reset = Button()
reset_2 = Button()
reset_3 = Button()
solver = Solver(
    GoalObjects=[anchor, length_line, load, grab.Grab],
    Reset=reset,
    Restart=False,
    Parallel=True,
    Threshold=1e-15,
    Tolerance=0.01,
    AddCurrent=False,
    On=True)  # -> V, O
bouncysolver = BouncySolver(
    GoalObjects=[length_line, anchor, load, grab.Grab],
    Reset=reset,
    Threshold=1e-15,
    Tolerance=0.01,
    Damping=0.99,
    Iterations=10,
    On=True)  # -> I, V, O
solver_2 = Solver(
    GoalObjects=[anchor_2, length_line_2, load_2, grab_2.Grab],
    Reset=reset_2,
    Restart=False,
    Parallel=True,
    Threshold=1e-15,
    Tolerance=0.01,
    AddCurrent=False,
    On=True)  # -> V, O
bouncysolver_2 = BouncySolver(
    GoalObjects=[length_line_2, anchor_2, load_2, grab_2.Grab],
    Reset=reset_2,
    Threshold=1e-15,
    Tolerance=0.01,
    Damping=0.99,
    Iterations=10,
    On=True)  # -> I, V, O
solver_3 = Solver(
    GoalObjects=[anchor_3, length_line_3, load_3, grab_3.Grab],
    Reset=reset_3,
    Restart=False,
    Parallel=True,
    Threshold=1e-15,
    Tolerance=0.01,
    AddCurrent=False,
    On=True)  # -> V, O
bouncysolver_3 = BouncySolver(
    GoalObjects=[length_line_3, anchor_3, load_3, grab_3.Grab],
    Reset=reset_3,
    Threshold=1e-15,
    Tolerance=0.01,
    Damping=0.99,
    Iterations=10,
    On=True)  # -> I, V, O
data = Data(solver.O)
data_2 = Data(bouncysolver.O)
data_3 = Data(solver_2.O)
data_4 = Data(bouncysolver_2.O)
data_5 = Data(solver_3.O)
data_6 = Data(bouncysolver_3.O)

# ==== cluster Corners: Find the boundary corner points of a quad mesh
mesh = ClusterInput()
mesh_2 = Mesh(mesh)
nv = NakedVertices(Mesh=mesh_2)  # -> ClothedIndex, NakedIndex, ClothedPts, NakedPts
vn = VertexNeighbours(Mesh=mesh_2, VertexNumber=nv.NakedIndex)  # -> graft(Vertex), Neighbours, Normal
lng = ListLength(List=vn.Neighbours)
equals = Equality(FirstNumber=lng, SecondNumber=3)  # -> Equality, Inequality
cull = CullPattern(List=vn.Vertex, CullPattern=equals.Inequality)
pshift = ShiftPaths(Data=cull, Offset=-1)
D = ClusterOutput(pshift)
