# Grasshopper definition Catenary_slide.ghx (Grasshopper 0.9.76)
# plug-ins: Kangaroo2 Components

# ---- group: here some vertices along the edges have been selected and fixed only in the Z direction, so they are free to slide on the XY plane
pt = Point([Point(10, 10, 0), Point(-10, 10, 0), Point(10, 9, 0), Point(-10, 9, 0), Point(10, 8, 0), Point(-10, 8, 0), Point(10, 7, 0), Point(-10, 7, 0), Point(10, 6, 0), Point(-10, 6, 0)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])
anchorxyz = AnchorXYZ(Point=pt, X="False", Y="False", Z="True", Strength=1000)

# ----
W = WidthCount(20)
mplane = MeshPlane(Boundary={Plane=PlaneXY(0, 0, 0), Size=Domain2(u=-10..10, v=-10..10)}, WidthCount=W, HeightCount=W)  # -> Mesh, Area
mc = MeshCorners(Mesh=mplane.Mesh, Angle=2.35619449)
edgelengths = EdgeLengths(Mesh=mplane.Mesh, LengthFactor=Slider(0.66, range=0..1), Strength=10)
vertexloads = VertexLoads(Mesh=mplane.Mesh, Strength=1)
anchor = Anchor(Point=mc, Strength=1000)
grab = Grab(On=True, Strength=1, Range=3)  # -> Grab, Anchors
reset = Button()
solver = Solver(
    GoalObjects=[anchor, grab.Grab, anchorxyz, edgelengths, vertexloads],
    Reset=reset,
    Threshold=1e-15,
    Tolerance=0.01,
    On=True)  # -> I, V, O
data = Data(solver.O)
