# Grasshopper definition CirclePacking-Fill.ghx (Grasshopper 0.9.76)
# plug-ins: Kangaroo2 Components

# ---- group: Number of circles
number_slider = Slider(210, range=10..1000)

# ---- group: Range for radii
number_slider_2 = Slider(0.5, range=0..10)
number_slider_3 = Slider(5.3, range=0..10)

# ---- group: Multiplier (adjust to fill surface)
number_slider_4 = Slider(0.291, range=0..1)

# ----
# This example shows circle packing on a dome, with circles of random radii, keeping them tangent to the boundary.
# It uses a custom goal - you will need to set the assembly reference location to wherever you have KangarooSolver.dll installed - typically C:\Users\YourName\AppData\Roaming\Grasshopper\Libraries
brep = Brep(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)
edges = BrepEdges(Brep=brep)  # -> Naked, Interior, NonManifold
N = Count(number_slider)
dom = ConstructDomain(DomainStart=number_slider_2, DomainEnd=number_slider_3)
popgeo = PopulateGeometry(Geometry=brep, Count=N, Seed=3)
random = Random(Range=dom, Number=N, Seed=2)
multiplication = Multiplication(A=random, B=number_slider_4)
spherecurvecollide = CSharpScript(
    C=edges.Naked,
    Pts=popgeo,
    Radii=multiplication,
    Strength="1",
    Reference="C:\USERS\YOSHIOCA\APPDATA\ROAMING\GRASSHOPPER\LIBRARIES\KangarooSolver.dll")  # -> out, A; inputs C: Curve, Pts: list of Point3d, Radii: list of Double, Strength: Double
# ---------- spherecurvecollide: C# ----------
    A = new SphereCurveCollide(C, Pts, Radii, Strength);
# ---------- spherecurvecollide: C# additional code ----------
  public class SphereCurveCollide : GoalObject
  {
    Curve C;
    double strength;
    double[] radii;

    public SphereCurveCollide(Curve Crv, List<Point3d> Pts, List<double> Radii, double k)
    {
      C = Crv;
      int L = Pts.Count;
      PPos = Pts.ToArray();
      Move = new Vector3d[L];
      Weighting = new double[L];
      radii = Radii.ToArray();
      strength = k;
    }

    public override void Calculate(List<KangarooSolver.Particle> p)
    {
      for (int i = 0; i < PIndex.Length; i++)
      {
        Point3d Pt = p[PIndex[i]].Position;
        double t;
        if(C.ClosestPoint(Pt, out t, radii[i]))
        {
          Point3d Closest = C.PointAt(t);
          Vector3d Push = Pt - Closest;
          Push.Unitize();
          Push *= radii[i];
          Point3d Target = Closest + Push;
          Move[i] = Target - Pt;
          Weighting[i] = strength;
        }
        else
        {
          Move[i] = Vector3d.Zero;
          Weighting[i] = 0;
        }
      }
    }
  }
# ---------- end spherecurvecollide ----------
collider = Collider(Objects=popgeo, Radii=multiplication, Strength=1)
onmesh = OnMesh(Points=popgeo, Mesh=brep, Strength="1")
grab = Grab(On=True, Strength=1, Range=3)  # -> Grab, Anchors
reset = Button()
solver = Solver(
    GoalObjects=[collider, onmesh, spherecurvecollide.A, grab.Grab],
    Reset=reset,
    Threshold=1e-15,
    Tolerance=0.01,
    On=Toggle(False))  # -> I, V, O
srf_cp = SurfaceClosestPoint(Point=solver.V, Surface=brep)  # -> Point, UVPoint, Distance
evalsrf = EvaluateSurface(Surface=brep, Point=srf_cp.UVPoint)  # -> Point, Normal, Frame
cir = Circle(Plane=evalsrf.Frame, Radius=multiplication)
boundary = BoundarySurfaces(Edges=cir)
