# Grasshopper definition CirclePacking-OnSurface-Pull.ghx (Grasshopper 0.9.76)
# plug-ins: Kangaroo2 Components

# ---- group: try increasing either until the circles fill the surface
number_slider = Slider(0.713, range=0..2)
number_slider_2 = Slider(200, range=1..1000)

# ----
srf = Surface(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)
popgeo = PopulateGeometry(Geometry=srf, Count=number_slider_2, Seed=1)
pt = Point(Point(17.39031869, 0, 20.44634771))
ln = Line(StartPoint=popgeo, EndPoint=pt)
onmesh = OnMesh(Points=popgeo, Mesh=srf, Strength=1)
sc = SphereCollide(Points=popgeo, Radius=number_slider, Strength=2)
show = Show(G=popgeo)
anchor = Anchor(Point=pt, Strength=10000)
length_line = LengthLine(Line=ln, Length=0, Strength=0.001)
grab = Grab(On=True, Strength=1, Range=3)  # -> Grab, Anchors
merge = Merge(Data1=grab.Grab, Data2=show, Data3=onmesh, Data4=sc, Data5=length_line, Data6=anchor)
solver = Solver(GoalObjects=merge, Reset=Button(), Threshold=1e-15, Tolerance=0.01, On=Toggle(False))  # -> I, V, O
srf_cp = SurfaceClosestPoint(Point=solver.V, Surface=srf)  # -> Point, UVPoint, Distance
evalsrf = EvaluateSurface(Surface=srf, Point=srf_cp.UVPoint)  # -> Point, Normal, Frame
cir = Circle(Plane=evalsrf.Frame, Radius=number_slider)
