# Grasshopper definition CirclePacking-OnSurface.ghx (Grasshopper 0.9.76)
# plug-ins: Kangaroo2 Components

number_slider = Slider(0.687, range=0..2)
srf = Surface(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)
popgeo = PopulateGeometry(Geometry=srf, Count=Slider(613, range=1..1000), Seed=1)
onmesh = OnMesh(Points=popgeo, Mesh=srf, Strength=1)
sc = SphereCollide(Points=popgeo, Radius=number_slider, Strength=1)
show = Show(G=popgeo)
solver = Solver(
    GoalObjects=[onmesh, sc, show],
    Reset=Button(),
    Restart=False,
    Parallel=True,
    Threshold=1e-15,
    Tolerance=0.01,
    AddCurrent=False,
    On=Toggle(False))  # -> V, O
srf_cp = SurfaceClosestPoint(Point=solver.O, Surface=srf)  # -> Point, UVPoint, Distance
panel = Panel(solver.O)
evalsrf = EvaluateSurface(Surface=srf, Point=srf_cp.UVPoint)  # -> Point, Normal, Frame
cir = Circle(Plane=evalsrf.Frame, Radius=number_slider)
