# Grasshopper definition ClampLength.ghx (Grasshopper 0.9.76)
# plug-ins: Kangaroo2 Components

crv = Curve(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)
crv_2 = Curve(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)
len = Length(Curve=crv)
len_2 = Length(Curve=crv_2)
number_slider = Slider(3, range=0..20)
# This stops any of the edges becoming
# longer than the UpperLimit, or shorter
# than the LowerLimit. Try dragging the
# points in Rhino with LeftCtrl+LMB to see
# the effect
number_slider_2 = Slider(10, range=0..20)
panel = Panel(len)
explode = Explode(Curve=crv, Recursive=True)  # -> Segments, Vertices
panel_2 = Panel(len_2)
explode_2 = Explode(Curve=crv_2, Recursive=True)  # -> Segments, Vertices
end = EndPoints(Curve=explode.Segments)  # -> Start, End
end_2 = EndPoints(Curve=explode_2.Segments)  # -> Start, End
# This stops any of the edges becoming
# longer than the UpperLimit, or shorter
# than the LowerLimit. Try dragging the
# points in Rhino with LeftCtrl+LMB to see
# the effect
clamplength = ClampLength(Line=explode.Segments, LowerLimit=Slider(3, range=0..20), UpperLimit=Slider(10, range=0..20), Strength=1)
direction = Direction(Line=explode.Segments, Strength=1)
onplane = OnPlane(Points=end.End, Plane=PlaneXY(0, 0, 0), Strength=1)
direction_2 = Direction(Line=explode_2.Segments, Strength=1)
onplane_2 = OnPlane(Points=end_2.End, Plane=PlaneXY(0, 0, 0), Strength=1)
show = Show(G=explode.Segments)
show_2 = Show(G=explode_2.Segments)
reset = Button()
grab = Grab(On=Toggle(True), Strength=1, Range=3)  # -> Grab, Anchors
reset_2 = Button()
grab_2 = Grab(On=Toggle(True), Strength=1, Range=3)  # -> Grab, Anchors
solver = Solver(
    GoalObjects=[onplane, clamplength, direction, show, grab.Grab],
    Reset=reset,
    Restart=False,
    Parallel=True,
    Threshold=1e-15,
    Tolerance=0.01,
    AddCurrent=False,
    On=True)  # -> V, O
bouncysolver = BouncySolver(
    GoalObjects=[grab.Grab, direction, onplane, show, clamplength],
    Reset=reset,
    Threshold=1e-15,
    Tolerance=0.01,
    Damping=0.99,
    Iterations=10,
    On=True)  # -> I, V, O
solver_2 = Solver(
    GoalObjects=[onplane_2, direction_2, show_2, grab_2.Grab],
    Reset=reset_2,
    Restart=False,
    Parallel=True,
    Threshold=1e-15,
    Tolerance=0.01,
    AddCurrent=False,
    On=True)  # -> V, O
bouncysolver_2 = BouncySolver(
    GoalObjects=[grab_2.Grab, direction_2, onplane_2, show_2],
    Reset=reset_2,
    Threshold=1e-15,
    Tolerance=0.01,
    Damping=0.99,
    Iterations=10,
    On=True)  # -> I, V, O
join = JoinCurves(Curves=bouncysolver.O, Preserve=False)
join_2 = JoinCurves(Curves=solver.O, Preserve=False)
join_3 = JoinCurves(Curves=bouncysolver_2.O, Preserve=False)
join_4 = JoinCurves(Curves=solver_2.O, Preserve=False)
len_3 = Length(Curve=join)
len_4 = Length(Curve=join_2)
len_5 = Length(Curve=join_3)
len_6 = Length(Curve=join_4)
panel_3 = Panel(len_3)
panel_4 = Panel(len_4)
panel_5 = Panel(len_5)
panel_6 = Panel(len_6)
