# Grasshopper definition Collidion-Rigid-Mesh-X3.ghx (Grasshopper 0.9.76)
# plug-ins: Kangaroo2 Components

number_slider = Slider(3, range=0..10)
number_slider_2 = Slider(3, range=0..10)
number_slider_3 = Slider(3, range=0..10)
msphereex = MeshSphereEx(Base="0,0,100", Radius=number_slider, Count=5)
msphereex_2 = MeshSphereEx(Base="0,4,4", Radius=number_slider, Count=5)
msphereex_3 = MeshSphereEx(Base="0,0,100", Radius=number_slider_2, Count=5)
msphereex_4 = MeshSphereEx(Base="0,4,4", Radius=number_slider_2, Count=5)
mesh = Mesh(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)
mesh_2 = Mesh(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)
scale_nu = ScaleNU(Geometry=msphereex_2, Plane=PlaneXY(0, 0, 0), ScaleX=Slider(2, range=0..10), ScaleY=1, ScaleZ=1)  # -> Geometry, Transform
msphereex_5 = MeshSphereEx(Base="0,0,100", Radius=number_slider_3, Count=5)
msphereex_6 = MeshSphereEx(Base="0,4,4", Radius=number_slider_3, Count=5)
scale_nu_2 = ScaleNU(Geometry=msphereex_4, Plane=PlaneXY(0, 0, 0), ScaleX=Slider(2, range=0..10), ScaleY=1, ScaleZ=1)  # -> Geometry, Transform
mesh_3 = Mesh(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)
mesh_4 = Mesh(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)
scale_nu_3 = ScaleNU(Geometry=msphereex_6, Plane=PlaneXY(0, 0, 0), ScaleX=Slider(2, range=0..10), ScaleY=1, ScaleZ=1)  # -> Geometry, Transform
area = Area(Geometry=scale_nu.Geometry)  # -> Area, Centroid
rotate = Rotate(Geometry=scale_nu.Geometry, Angle=area.Centroid, Plane=PlaneXY(0, 0, 0))  # -> Geometry, Transform
area_2 = Area(Geometry=scale_nu_3.Geometry)  # -> Area, Centroid
merge = Merge(Data1=rotate.Geometry, Data2=msphereex, Data4=mesh_2)
rotate_2 = Rotate(Geometry=scale_nu_3.Geometry, Angle=area_2.Centroid, Plane=PlaneXY(0, 0, 0))  # -> Geometry, Transform
area_3 = Area(Geometry=scale_nu_2.Geometry)  # -> Area, Centroid
rotate_3 = Rotate(Geometry=scale_nu_2.Geometry, Angle=area_3.Centroid, Plane=PlaneXY(0, 0, 0))  # -> Geometry, Transform
merge_2 = Merge(Data1=rotate_2.Geometry, Data2=msphereex_5, Data3=mesh_3, Data4=mesh_4)
mesh_5 = Mesh(merge)
merge_3 = Merge(Data1=rotate_3.Geometry, Data2=msphereex_3)
mesh_6 = Mesh(merge_2)
demesh = DeconstructMesh(Mesh=mesh_5)  # -> Vertices, Faces, Colours, Normals
crossref = CrossReference(ListA=mesh_5, ListB=mesh_5, CrossMode=5)  # -> graft(ListA), graft(ListB)
viewer = ParamViewer(demesh.Vertices)
mesh_7 = Mesh(merge_3)
demesh_2 = DeconstructMesh(Mesh=mesh_6)  # -> Vertices, Faces, Colours, Normals
crossref_2 = CrossReference(ListA=mesh_6, ListB=mesh_6, CrossMode=5)  # -> graft(ListA), graft(ListB)
mesh_8 = Mesh([crossref.ListA, crossref.ListB])
cullpt = CullDuplicates(Points=demesh.Vertices, Tolerance=0.1, CullMode=3)  # -> Points, Indices, Valence
viewer_2 = ParamViewer(cullpt.Points)
viewer_3 = ParamViewer(demesh_2.Vertices)
item = ListItem(List=mesh_8, Index=0, Wrap=True)  # -> Item, Item1
mesh_9 = Mesh([crossref_2.ListA, crossref_2.ListB])
viewer_4 = ParamViewer(mesh_9)
cullpt_2 = CullDuplicates(Points=demesh_2.Vertices, Tolerance=0.1, CullMode=3)  # -> Points, Indices, Valence
viewer_5 = ParamViewer(cullpt_2.Points)
solidplanecollide = SolidPlaneCollide(Solid=mesh_5, CollisionPlane=PlaneXY(0, 0, 0), Strength=3)
crossref_3 = CrossReference(ListA=mesh_7, ListB=mesh_7, CrossMode=5)  # -> graft(ListA), graft(ListB)
rigidbody = RigidBody(Part=graft(mesh_5), Points=cullpt.Points, Strength=6)  # -> RigidBody, Planes
grab = Grab(On=True, Strength=100, Range=3)  # -> Grab, Anchors
item_2 = ListItem(List=mesh_9, Index=0, Wrap=True)  # -> Item, Item1
demesh_3 = DeconstructMesh(Mesh=mesh_7)  # -> Vertices, Faces, Colours, Normals
solidcollide = SolidCollide(MeshA=item.Item, MeshB=item.Item1, Strength=1)
panel = Panel(item_2.Item)
mesh_10 = Mesh([crossref_3.ListA, crossref_3.ListB])
solidplanecollide_2 = SolidPlaneCollide(Solid=mesh_6, CollisionPlane=PlaneXY(0, 0, 0), Strength=3)
rigidbody_2 = RigidBody(Part=graft(mesh_6), Points=cullpt_2.Points, Strength=6)  # -> RigidBody, Planes
grab_2 = Grab(On=True, Strength=100, Range=3)  # -> Grab, Anchors
floor = Floor(Strength=1)
cullpt_3 = CullDuplicates(Points=demesh_3.Vertices, Tolerance=0.1, CullMode=3)  # -> Points, Indices, Valence
item_3 = ListItem(List=mesh_10, Index=0, Wrap=True)  # -> Item, Item1
pt = Point(flatten(rigidbody.Planes))
Z = UnitZ(Factor=-0.03)
solidcollide_2 = SolidCollide(MeshA=item_2.Item, MeshB=item_2.Item1, Strength=1)
solidplanecollide_3 = SolidPlaneCollide(Solid=mesh_7, CollisionPlane=PlaneXY(0, 0, 0), Strength=3)
floor_2 = Floor(Strength=1)
load = Load(Point=pt, ForceVector=Z)
rigidbody_3 = RigidBody(Part=graft(mesh_7), Points=cullpt_3.Points, Strength=6)  # -> RigidBody, Planes
solidcollide_3 = SolidCollide(MeshA=item_3.Item, MeshB=item_3.Item1, Strength=1)
grab_3 = Grab(On=True, Strength=100, Range=3)  # -> Grab, Anchors
panel_2 = Panel(item_2.Item1)
pt_2 = Point(flatten(rigidbody_2.Planes))
Z_2 = UnitZ(Factor=-0.03)

reset = Button()
run = BooleanToggle(False)

load_2 = Load(Point=pt_2, ForceVector=Z_2)

reset_2 = Button()
run_2 = BooleanToggle(False)

pt_3 = Point(flatten(rigidbody_3.Planes))
Z_3 = UnitZ(Factor=-0.03)
merge_4 = Merge(Data1=grab.Grab, Data2=floor, Data3=rigidbody.RigidBody, Data4=solidcollide, Data5=load)  # -> flatten(Result)
load_3 = Load(Point=pt_3, ForceVector=Z_3)

reset_3 = Button()
run_3 = BooleanToggle(False)

merge_5 = Merge(Data1=grab_2.Grab, Data2=floor_2, Data3=rigidbody_2.RigidBody, Data4=solidcollide_2, Data5=load_2)  # -> flatten(Result)
solver_bouncy = SolverBouncy(GoalObjects=merge_4, Reset=reset, Threshold=1e-08, Tolerance=0.01, Damping=0.99, Iterations=25, On=run)  # -> I, V, O
solver_bouncy_2 = SolverBouncy(GoalObjects=merge_5, Reset=reset_2, Threshold=1e-08, Tolerance=0.01, Damping=0.99, Iterations=25, On=run_2)  # -> I, V, O
solver_bouncy_3 = SolverBouncy(
    GoalObjects=[load_3, grab_3.Grab, solidplanecollide_3, rigidbody_3.RigidBody, solidcollide_3],
    Reset=reset_3,
    Threshold=1e-08,
    Tolerance=0.01,
    Damping=0.99,
    Iterations=25,
    On=run_3)  # -> I, V, O
medges = MeshEdges(Mesh=solver_bouncy.O)  # -> NakedEdges, InteriorEdges, NonManifoldEdges
mesh_11 = Mesh(solver_bouncy.O)
medges_2 = MeshEdges(Mesh=solver_bouncy_2.O)  # -> NakedEdges, InteriorEdges, NonManifoldEdges
mesh_12 = Mesh(solver_bouncy_2.O)
medges_3 = MeshEdges(Mesh=solver_bouncy_3.O)  # -> NakedEdges, InteriorEdges, NonManifoldEdges
geo = Geometry(mesh_11)
mesh_13 = Mesh(solver_bouncy_3.O)
clean = CleanTree(RemoveNulls=True, RemoveInvalid=True, RemoveEmpty=False, Tree=flatten(geo))
geo_2 = Geometry(mesh_12)
clean_2 = CleanTree(RemoveNulls=True, RemoveInvalid=True, RemoveEmpty=False, Tree=flatten(geo_2))
lng = ListLength(List=clean)
geo_3 = Geometry(mesh_13)
S = Shader([{ambient=RGB(128, 128, 128), diffuse=RGB(11, 125, 222), emission=RGB(3, 38, 67), shine=0.5, specular=RGB(255, 255, 255), transparency=0}, {ambient=RGB(128, 128, 128), diffuse=RGB(222, 37, 11), emission=RGB(67, 11, 3), shine=0.5, specular=RGB(255, 255, 255), transparency=0}, {ambient=RGB(128, 128, 128), diffuse=RGB(71, 222, 11), emission=RGB(21, 67, 3), shine=0.5, specular=RGB(255, 255, 255), transparency=0}, {ambient=RGB(128, 128, 128), diffuse=RGB(222, 194, 11), emission=RGB(67, 58, 3), shine=0.5, specular=RGB(255, 255, 255), transparency=0}])
clean_3 = CleanTree(RemoveNulls=True, RemoveInvalid=True, RemoveEmpty=False, Tree=flatten(geo_3))
repeat = RepeatData(Data=S, Length=lng)
lng_2 = ListLength(List=clean_2)
S_2 = Shader([{ambient=RGB(128, 128, 128), diffuse=RGB(11, 125, 222), emission=RGB(3, 38, 67), shine=0.5, specular=RGB(255, 255, 255), transparency=0}, {ambient=RGB(128, 128, 128), diffuse=RGB(222, 37, 11), emission=RGB(67, 11, 3), shine=0.5, specular=RGB(255, 255, 255), transparency=0}, {ambient=RGB(128, 128, 128), diffuse=RGB(71, 222, 11), emission=RGB(21, 67, 3), shine=0.5, specular=RGB(255, 255, 255), transparency=0}, {ambient=RGB(128, 128, 128), diffuse=RGB(222, 194, 11), emission=RGB(67, 58, 3), shine=0.5, specular=RGB(255, 255, 255), transparency=0}])
repeat_2 = RepeatData(Data=S_2, Length=lng_2)
lng_3 = ListLength(List=clean_3)
S_3 = Shader([{ambient=RGB(128, 128, 128), diffuse=RGB(11, 125, 222), emission=RGB(3, 38, 67), shine=0.5, specular=RGB(255, 255, 255), transparency=0}, {ambient=RGB(128, 128, 128), diffuse=RGB(222, 37, 11), emission=RGB(67, 11, 3), shine=0.5, specular=RGB(255, 255, 255), transparency=0}, {ambient=RGB(128, 128, 128), diffuse=RGB(71, 222, 11), emission=RGB(21, 67, 3), shine=0.5, specular=RGB(255, 255, 255), transparency=0}, {ambient=RGB(128, 128, 128), diffuse=RGB(222, 194, 11), emission=RGB(67, 58, 3), shine=0.5, specular=RGB(255, 255, 255), transparency=0}])
preview = CustomPreview(Geometry=clean, Shader=repeat)
repeat_3 = RepeatData(Data=S_3, Length=lng_3)
preview_2 = CustomPreview(Geometry=clean_2, Shader=repeat_2)
preview_3 = CustomPreview(Geometry=clean_3, Shader=repeat_3)
