# Grasshopper definition Collidion-Rigid-Solid.ghx (Grasshopper 0.9.76)
# plug-ins: Kangaroo2 Components

brep = Brep([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])
Z = UnitZ(Factor=Slider(82, range=0..100))
move = Move(Geometry=brep, Motion=Z)  # -> Geometry, Transform
lng = ListLength(List=move.Geometry)
area = Area(Geometry=move.Geometry)  # -> Area, Centroid
random = Random(Range=Domain(0, 1), Number=lng, Seed=2)
xy = XYPlane(Origin=area.Centroid)
pi = Pi(Factor=random)
rotate = Rotate(Geometry=move.Geometry, Angle=pi, Plane=xy)  # -> Geometry, Transform
merge = Merge(Data1=brep, Data2=rotate.Geometry)  # -> flatten(Result)
brep_2 = Brep(merge)
viewer = ParamViewer(brep_2)
crossref = CrossReference(ListA=brep_2, ListB=brep_2, CrossMode=5)  # -> graft(ListA), graft(ListB)
panel = Panel(crossref.ListB)
mesh = MeshBrep(
    Brep=[crossref.ListA, crossref.ListB],
    Settings={GridMaxCount=0, GridMinCount=16, JaggedSeams=False, MaxEdgeLength=0, MinEdgeLength=0.0001, MinTolerance=0, Refine=True, RefineAngle=0, RelativeTolerance=0.65, SimplePlanes=True, Tolerance=0})
mesh_2 = Mesh([crossref.ListA, crossref.ListB])
debrep = DeconstructBrep(Brep=brep_2)  # -> Faces, Edges, Vertices
panel_2 = Panel(mesh)
item = ListItem(List=mesh, Index=0, Wrap=True)  # -> Item, Item1
solidplanecollide = SolidPlaneCollide(Solid=brep_2, CollisionPlane=PlaneXY(0, 0, 0), Strength=3)
rigidbody = RigidBody(Part=graft(brep_2), Points=debrep.Vertices, Strength=3)  # -> RigidBody, Planes
solidcollide = SolidCollide(MeshA=item.Item, MeshB=item.Item1, Strength=1)
grab = Grab(On=True, Strength=100, Range=3)  # -> Grab, Anchors
pt = Point(flatten(rigidbody.Planes))
Z_2 = UnitZ(Factor=-0.05)
load = Load(Point=pt, ForceVector=Z_2)

reset = Button()
run = BooleanToggle(False)

solver_bouncy = SolverBouncy(
    GoalObjects=[load, grab.Grab, solidplanecollide, rigidbody.RigidBody, solidcollide],
    Reset=reset,
    Threshold=1e-08,
    Tolerance=0.01,
    Damping=0.98,
    Iterations=15,
    On=run)  # -> I, V, O
mesh_3 = Mesh(solver_bouncy.O)
edges = BrepEdges(Brep=solver_bouncy.O)  # -> Naked, Interior, NonManifold
geo = Geometry(mesh_3)
clean = CleanTree(RemoveNulls=True, RemoveInvalid=True, RemoveEmpty=False, Tree=flatten(geo))
lng_2 = ListLength(List=clean)
S = Shader([{ambient=RGB(128, 128, 128), diffuse=RGB(11, 125, 222), emission=RGB(3, 38, 67), shine=0.5, specular=RGB(255, 255, 255), transparency=0}, {ambient=RGB(128, 128, 128), diffuse=RGB(222, 37, 11), emission=RGB(67, 11, 3), shine=0.5, specular=RGB(255, 255, 255), transparency=0}, {ambient=RGB(128, 128, 128), diffuse=RGB(71, 222, 11), emission=RGB(21, 67, 3), shine=0.5, specular=RGB(255, 255, 255), transparency=0}, {ambient=RGB(128, 128, 128), diffuse=RGB(222, 194, 11), emission=RGB(67, 58, 3), shine=0.5, specular=RGB(255, 255, 255), transparency=0}])
repeat = RepeatData(Data=S, Length=lng_2)
preview = CustomPreview(Geometry=clean, Shader=repeat)
