# Grasshopper definition Collision-Balloon.ghx (Grasshopper 0.9.76)
# plug-ins: Weaverbird, Kangaroo2 Components

pt = Point([Point(4, 1.838160609, 8), Point(-4, 0, 10), Point(4, -2.318583528, 15)])
pt_2 = Point([Point(4, 1.838160609, 8), Point(-4, 0, 10), Point(4, -2.318583528, 15)])
wbicosahedron = WeaverbirdsMeshMeshIcosahedron(Plane=pt, Radius=4)
series = Series(Start=0, Step=1, Count=10)
wbloop = WeaverbirdsLoopSubdivision(MeshCurves=wbicosahedron, Level=1, SmoothNakedEdges=1)  # -> flatten(OutputMeshCurves)
viewer = ParamViewer(wbloop)
mesh = Mesh(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)
graft = GraftTree(Tree=series, IncludeEmptyLists=True, IncludeNullItems=True)
pt_3 = Point([Point(4, 1.838160609, 8), Point(-4, 0, 10), Point(4, -2.318583528, 15)])
wbicosahedron_2 = WeaverbirdsMeshMeshIcosahedron(Plane=pt_3, Radius=4)
panel = Panel("Remove Floor")
int = Integer("1")
wbicosahedron_3 = WeaverbirdsMeshMeshIcosahedron(Plane=pt_2, Radius=4)
wbloop_2 = WeaverbirdsLoopSubdivision(MeshCurves=wbicosahedron_2, Level=1, SmoothNakedEdges=1)  # -> flatten(OutputMeshCurves)
crossref = CrossReference(ListA=wbloop, ListB=wbloop, CrossMode=5)  # -> ListA, ListB
panel_2 = Panel(crossref.ListB)
panel_3 = Panel(crossref.ListA)
wbloop_3 = WeaverbirdsLoopSubdivision(MeshCurves=wbicosahedron_3, Level=1, SmoothNakedEdges=1)  # -> flatten(OutputMeshCurves)
demesh = DeconstructMesh(Mesh=wbloop)  # -> flatten(Vertices), Faces, Colours, Normals
entwine = Entwine(Branch00=[series, int], Branch01=int, FlattenInputs=True)
strength = Strength(100)
entwine_2 = Entwine(Branch00=graft, FlattenInputs=True)
demesh_2 = DeconstructMesh(Mesh=crossref.ListB)  # -> Vertices, Faces, Colours, Normals
viewer_2 = ParamViewer(series)
panel_4 = Panel(strength)
viewer_3 = ParamViewer(entwine)
viewer_4 = ParamViewer(demesh_2.Vertices)
crossref_2 = CrossReference(ListA=wbloop_2, ListB=wbloop_2, CrossMode=5)  # -> ListA, ListB
viewer_5 = ParamViewer(graft)
viewer_6 = ParamViewer(entwine_2)
crossref_3 = CrossReference(ListA=wbloop_3, ListB=wbloop_3, CrossMode=5)  # -> ListA, ListB
demesh_3 = DeconstructMesh(Mesh=wbloop_2)  # -> flatten(Vertices), Faces, Colours, Normals
mesh_2 = Mesh(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)
demesh_4 = DeconstructMesh(Mesh=wbloop_3)  # -> flatten(Vertices), Faces, Colours, Normals
strength_2 = Strength(100)
demesh_5 = DeconstructMesh(Mesh=crossref_2.ListB)  # -> Vertices, Faces, Colours, Normals
medges = MeshEdges(Mesh=wbloop)  # -> NakedEdges, InteriorEdges, NonManifoldEdges
mesh_3 = Mesh(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)
Z = UnitZ(Factor=-0.5)
strength_3 = Strength(100)
demesh_6 = DeconstructMesh(Mesh=crossref_3.ListB)  # -> Vertices, Faces, Colours, Normals
panel_5 = Panel(series)
length_line = LengthLine(Line=[medges.NakedEdges, medges.InteriorEdges], Strength=15)
floor = Floor(Strength=100)

# ---- group: Ball | Vase
spc = SolidPointCollide(Points=demesh.Vertices, Solid=mesh, Interior=False, Unidirectional=Toggle(True), Strength=strength)

# ----
panel_6 = Panel(graft)

# ---- group: Ball | Ball
spc_2 = SolidPointCollide(Points=demesh_2.Vertices, Solid=crossref.ListA, Interior=False, Unidirectional=False, Strength=strength)

# ----
panel_7 = Panel(entwine_2)
pressure = Pressure(M=wbloop, Strength=Slider(4, range=0..100))
load = Load(Point=demesh.Vertices, ForceVector=Z)
show = Show(G=[wbloop, mesh])
medges_2 = MeshEdges(Mesh=wbloop_2)  # -> NakedEdges, InteriorEdges, NonManifoldEdges
Z_2 = UnitZ(Factor=-0.5)
medges_3 = MeshEdges(Mesh=wbloop_3)  # -> NakedEdges, InteriorEdges, NonManifoldEdges
Z_3 = UnitZ(Factor=-0.5)
grab = Grab(On=True, Strength=10000, Range=3)  # -> Grab, Anchors
panel_8 = Panel(entwine)
spc_3 = SolidPointCollide(Points=demesh_5.Vertices, Solid=crossref_2.ListA, Interior=False, Unidirectional=False, Strength=strength_2)
length_line_2 = LengthLine(Line=[medges_2.NakedEdges, medges_2.InteriorEdges], Strength=15)
pressure_2 = Pressure(M=wbloop_2, Strength=3)
spc_4 = SolidPointCollide(Points=demesh_3.Vertices, Solid=mesh_2, Interior=False, Unidirectional=Toggle(True), Strength=strength_2)
floor_2 = Floor(Strength=Slider(0, range=0..500))
spc_5 = SolidPointCollide(Points=demesh_6.Vertices, Solid=crossref_3.ListA, Interior=False, Unidirectional=False, Strength=strength_3)
length_line_3 = LengthLine(Line=[medges_3.NakedEdges, medges_3.InteriorEdges], Strength=15)
show_2 = Show(G=[wbloop_2, mesh_2])
pressure_3 = Pressure(M=wbloop_3, Strength=3)
spc_6 = SolidPointCollide(Points=demesh_4.Vertices, Solid=mesh_3, Interior=False, Unidirectional=Toggle(True), Strength=strength_3)
load_2 = Load(Point=demesh_3.Vertices, ForceVector=Z_2)
show_3 = Show(G=[wbloop_3, mesh_3])
load_3 = Load(Point=demesh_4.Vertices, ForceVector=Z_3)
entwine_3 = Entwine(Branch00=show, Branch01=[length_line, pressure, floor, load, spc_2, spc], FlattenInputs=True)
entwine_4 = Entwine(Branch00=show_2, Branch01=[length_line_2, pressure_2, floor_2, load_2, spc_3, spc_4], FlattenInputs=True)
solver_bouncy = SolverBouncy(
    GoalObjects=[entwine_3, grab.Grab],
    Reset=Button(),
    Threshold=1e-15,
    Tolerance=0.01,
    Damping=0.996,
    Iterations=12,
    On=Toggle(False))  # -> I, V, O
entwine_5 = Entwine(Branch00=show_3, Branch01=[length_line_3, pressure_3, load_3, spc_5, spc_6], FlattenInputs=True)
viewer_7 = ParamViewer(entwine_4)
viewer_8 = ParamViewer(entwine_5)
split = SplitList(List=solver_bouncy.O, Index=3)  # -> ListA, ListB
solver_bouncy_2 = SolverBouncy(GoalObjects=entwine_4, Reset=Button(), Threshold=1e-15, Tolerance=0.01, Damping=0.996, Iterations=12, On=Toggle(False))  # -> I, V, O
panel_9 = Panel(entwine_4)
solver_bouncy_3 = SolverBouncy(GoalObjects=entwine_5, Reset=Button(), Threshold=1e-15, Tolerance=0.01, Damping=0.996, Iterations=12, On=Toggle(False))  # -> I, V, O
panel_10 = Panel(entwine_5)
wbloop_4 = WeaverbirdsLoopSubdivision(MeshCurves=split.ListA, Level=2, SmoothNakedEdges=1)
panel_11 = Panel(wbloop_4)
geo = Geometry(wbloop_4)
clean = CleanTree(RemoveNulls=True, RemoveInvalid=True, RemoveEmpty=False, Tree=flatten(geo))
material = CreateMaterial(
    Diffuse=ColourSwatch(SwatchColor=RGB(167, 164, 255)),
    Specular=ColourSwatch(SwatchColor=RGB(255, 255, 255)),
    Emission=ColourSwatch(SwatchColor=RGB(200, 67, 255)),
    Transparency=Slider(0.5, range=0..1),
    Shine=0)
split_2 = SplitList(List=solver_bouncy_2.O, Index=3)  # -> ListA, ListB
split_3 = SplitList(List=solver_bouncy_3.O, Index=3)  # -> ListA, ListB
S = Shader([{ambient=RGB(128, 128, 128), diffuse=RGB(11, 125, 222), emission=RGB(3, 38, 67), shine=0.5, specular=RGB(255, 255, 255), transparency=0}, {ambient=RGB(128, 128, 128), diffuse=RGB(222, 37, 11), emission=RGB(67, 11, 3), shine=0.5, specular=RGB(255, 255, 255), transparency=0}, {ambient=RGB(128, 128, 128), diffuse=RGB(71, 222, 11), emission=RGB(21, 67, 3), shine=0.5, specular=RGB(255, 255, 255), transparency=0}, {ambient=RGB(128, 128, 128), diffuse=RGB(222, 194, 11), emission=RGB(67, 58, 3), shine=0.5, specular=RGB(255, 255, 255), transparency=0}])
wbloop_5 = WeaverbirdsLoopSubdivision(MeshCurves=split_2.ListA, Level=2, SmoothNakedEdges=1)
wbloop_6 = WeaverbirdsLoopSubdivision(MeshCurves=split_3.ListA, Level=2, SmoothNakedEdges=1)
lng = ListLength(List=clean)
shader = Shader(material)
repeat = RepeatData(Data=S, Length=lng)
panel_12 = Panel(S)
geo_2 = Geometry(wbloop_5)
geo_3 = Geometry(wbloop_6)
panel_13 = Panel(repeat)
clean_2 = CleanTree(RemoveNulls=True, RemoveInvalid=True, RemoveEmpty=False, Tree=flatten(geo_2))
preview = CustomPreview(Geometry=clean, Shader=repeat)
clean_3 = CleanTree(RemoveNulls=True, RemoveInvalid=True, RemoveEmpty=False, Tree=flatten(geo_3))
preview_2 = CustomPreview(Geometry=mesh, Shader=shader)
S_2 = Shader([{ambient=RGB(128, 128, 128), diffuse=RGB(11, 125, 222), emission=RGB(3, 38, 67), shine=0.5, specular=RGB(255, 255, 255), transparency=0}, {ambient=RGB(128, 128, 128), diffuse=RGB(222, 37, 11), emission=RGB(67, 11, 3), shine=0.5, specular=RGB(255, 255, 255), transparency=0}, {ambient=RGB(128, 128, 128), diffuse=RGB(71, 222, 11), emission=RGB(21, 67, 3), shine=0.5, specular=RGB(255, 255, 255), transparency=0}, {ambient=RGB(128, 128, 128), diffuse=RGB(222, 194, 11), emission=RGB(67, 58, 3), shine=0.5, specular=RGB(255, 255, 255), transparency=0}])
S_3 = Shader([{ambient=RGB(128, 128, 128), diffuse=RGB(11, 125, 222), emission=RGB(3, 38, 67), shine=0.5, specular=RGB(255, 255, 255), transparency=0}, {ambient=RGB(128, 128, 128), diffuse=RGB(222, 37, 11), emission=RGB(67, 11, 3), shine=0.5, specular=RGB(255, 255, 255), transparency=0}, {ambient=RGB(128, 128, 128), diffuse=RGB(71, 222, 11), emission=RGB(21, 67, 3), shine=0.5, specular=RGB(255, 255, 255), transparency=0}, {ambient=RGB(128, 128, 128), diffuse=RGB(222, 194, 11), emission=RGB(67, 58, 3), shine=0.5, specular=RGB(255, 255, 255), transparency=0}])
lng_2 = ListLength(List=clean_2)
lng_3 = ListLength(List=clean_3)
repeat_2 = RepeatData(Data=S_2, Length=lng_2)
repeat_3 = RepeatData(Data=S_3, Length=lng_3)
panel_14 = Panel(S_2)
panel_15 = Panel(S_3)
panel_16 = Panel(repeat_2)
preview_3 = CustomPreview(Geometry=clean_2, Shader=repeat_2)
panel_17 = Panel(repeat_3)
preview_4 = CustomPreview(Geometry=clean_2, Shader=S_2)
preview_5 = CustomPreview(Geometry=clean_3, Shader=repeat_3)
preview_6 = CustomPreview(Geometry=clean_3, Shader=S_3)
