# Grasshopper definition Collision-Cable.ghx (Grasshopper 0.9.76)
# plug-ins: Kangaroo2 Components

crv = Curve([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])
divide = DivideCurve(Curve=crv, Count=10, Kinks=False)  # -> Points, Tangents, Parameters
shatter = Shatter(Curve=graft(crv), Parameters=divide.Parameters)  # -> flatten(Segments)
line = Line(shatter)
grab = Grab(On=True, Strength=1, Range=3)  # -> Grab, Anchors
collider = Collider(Objects=line, Radii=0.2, Strength=1)
length_line = LengthLine(Line=line, Strength=10)
solver = Solver(GoalObjects=[collider, grab.Grab, length_line], Reset=Button(), Threshold=1e-15, Tolerance=0.01, On=Toggle(False))  # -> I, V, O
panel = Panel(solver.O)
crv_2 = Curve(solver.O)
