# Grasshopper definition Collision-Cloth-Drape-XXX-2.ghx (Grasshopper 0.9.76)
# plug-ins: MeshEdit Components, Kangaroo Components, PlanktonGh, Weaverbird, Kangaroo2 Components

number_slider = Slider(48, range=0..100)
number_slider_2 = Slider(30, range=0..100)

# ---- group: cloth
brep = Brep(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)

# ---- group: Cylinder
brep_2 = Brep(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)

# ----
sdivide = DivideSurface(Surface=brep, UCount=number_slider, VCount=number_slider_2)  # -> flatten(Points), Normals, Parameters
addition = Addition(A=number_slider, B=1)
addition_2 = Addition(A=number_slider_2, B=1)
frompoints = MeshFromPoints(Points=sdivide.Points, UDirection=addition, VDirection=addition_2)
rectangle = Rectangle(Plane=PlaneXY(0, 0, 0), XSize="-15 to 35", YSize="-15 to 35", Radius=0)  # -> Rectangle, Length
clean = CombineClean(Meshes=frompoints)
Z = UnitZ(Factor=Slider(20, range=0..20))
triangulate = MeshTriangulate(Mesh=clean, ShortDiagonal=True)
W = WidthCount(30)
move = Move(Geometry=rectangle.Rectangle, Motion=Z)  # -> Geometry, Transform
clean_2 = CombineClean(Meshes=triangulate)

# ---- group: torus
brep_3 = Brep(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)

# ---- group: Box
brep_4 = Brep(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)

# ----
mplane = MeshPlane(Boundary=move.Geometry, WidthCount=W, HeightCount=W)  # -> Mesh, Area

# ---- group: T
brep_5 = Brep(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)

# ----
brep_6 = Brep(brep_5)
mesh = Mesh(clean)
mesh_2 = MeshBrep(
    Brep=brep_6,
    Settings={GridMaxCount=0, GridMinCount=16, JaggedSeams=False, MaxEdgeLength=0, MinEdgeLength=0.0001, MinTolerance=0, Refine=True, RefineAngle=0, RelativeTolerance=0.65, SimplePlanes=True, Tolerance=0})
demesh = DeconstructMesh(Mesh=mesh)  # -> Vertices, Faces, Colours, Normals
medges = MeshEdges(Mesh=mesh)  # -> NakedEdges, InteriorEdges, NonManifoldEdges
panel = Panel(mesh_2)
len = Length(Curve=medges.InteriorEdges)
rec = Rectangle({Plane=PlaneXY(-79, -67, 0), Size=Domain2(u=0..152, v=0..138)})
avr = Average(Input=len)
boundary = BoundarySurfaces(Edges=rec)
Z_2 = UnitZ(Factor=-0.1)
multiplication = Multiplication(A=avr, B=0.5)
crv = Curve([medges.NakedEdges, medges.InteriorEdges])
smooth = Smooth(M=mesh, Strength=1)
floor = Floor(Strength=1)
spc = SolidPointCollide(Points=demesh.Vertices, Solid=mesh_2, Interior=Toggle(False), Unidirectional="True", Strength=1)
show = Show(G=mesh)
length_line = LengthLine(Line=crv, Strength=10)
sc = SphereCollide(Points=demesh.Vertices, Radius=multiplication, Strength=10)
load = Load(Point=demesh.Vertices, ForceVector=Z_2)
merge = Merge(Data1=show, Data2=smooth, Data3=floor, Data4=length_line, Data5=spc, Data6=load, Data7=sc)
solver = Solver(GoalObjects=merge, Reset=Button(), Threshold=1e-15, Tolerance=0.01, On=Toggle(False))  # -> I, V, O
data = Data(solver.O)
brep_7 = Brep(data)
Z_3 = UnitZ(Factor=Slider(0.5, range=0..1))
mesh_3 = Mesh(data)
clean_3 = CleanTree(RemoveNulls=True, RemoveInvalid=True, RemoveEmpty=False, Tree=brep_7)
clean_4 = CleanTree(RemoveNulls=True, RemoveInvalid=True, RemoveEmpty=False, Tree=mesh_3)
mesh_4 = Mesh(clean_4)
move_2 = Move(Geometry=mesh_4, Motion=Z_3)  # -> Geometry, Transform
preview = CustomPreview(Geometry=boundary, Shader=ColourSwatch(SwatchColor=RGBA(255, 188, 255, 150)))
preview_2 = CustomPreview(Geometry=brep_6, Shader=ColourSwatch(SwatchColor=RGBA(181, 255, 255, 150)))
wbloop = WeaverbirdsLoopSubdivision(MeshCurves=move_2.Geometry, Level=Slider(3, range=0..10), SmoothNakedEdges=1)
preview_3 = CustomPreview(
    Geometry=wbloop,
    Shader={ambient=RGB(0, 0, 0), diffuse=RGB(255, 105, 180), emission=RGB(76, 32, 54), shine=0.5, specular=RGB(255, 255, 255), transparency=0})
mesh_5 = Mesh(wbloop)
medges_2 = MeshEdges(Mesh=mesh_5)  # -> NakedEdges, InteriorEdges, NonManifoldEdges
medges_3 = MeshEdges(Mesh=mesh_5)  # -> NakedEdges, InteriorEdges, NonManifoldEdges
viewer = ParamViewer(medges_3.NakedEdges)
crv_2 = Curve(medges_3.NakedEdges)
join = JoinCurves(Curves=medges_3.NakedEdges, Preserve=False)
cp = ControlPoints(Curve=join)  # -> Points, Weights, Knots
viewer_2 = ParamViewer(cp.Points)
duppt = RemoveDuplicatePts(Points=cp.Points, Tolerance=0.01)
multiplication_2 = Multiplication(A=Slider(10, range=0..10), B=Slider(3.97, range=1..4))
viewer_3 = ParamViewer(duppt)
sequence = Sequence(Frames=Slider(10, range=0..10))
num = Number(Slider(2, range=0..300))
meshmachine = MeshMachine(
    Geometry=mesh_5,
    Length=num,
    FixVertices=duppt,
    Flip=1,
    PullStrength=0.8,
    CurvatureAdaptivity=0,
    BoundaryScale=1,
    BoundaryDistance=5,
    Exponent=2,
    Background=0.5,
    Iterations=Slider(1, range=0..10),
    Reset=sequence)
pmesh = PlanktonMesh(flatten(meshmachine))
rev = ReverseList(List=pmesh)
viewer_4 = ParamViewer(pmesh)
panel_2 = Panel(pmesh)
item = ListItem(List=rev, Index=0, Wrap=True)
mesh_6 = Mesh(item)
medges_4 = MeshEdges(Mesh=mesh_6)  # -> NakedEdges, InteriorEdges, NonManifoldEdges
