# Grasshopper definition Collision-Cloth-Drape-XXX-3-Quest.ghx (Grasshopper 0.9.76)
# plug-ins: Kangaroo Components, PlanktonGh, Weaverbird, Kangaroo2 Components

list = ValueList({"Box": 0, "Chiar": 1, "Bunny": 2}, selected="Bunny")

# ---- group: Cloth
mesh = Mesh(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)

# ---- group: Box
brep = Brep(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)

# ---- group: chair volume
brep_2 = Brep(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)

# ---- group: chair
brep_3 = Brep(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)

# ----
rev = Reverse(Vector="0,60,0")

# ---- group: Bunny
brep_4 = Brep(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)
move = Move(Geometry=brep_4, Motion=rev)  # -> Geometry, Transform

# ----
panel = Panel(list)
filter = StreamFilter(Gate=list, Stream0=brep, Stream1=brep_2, Stream2=move.Geometry)
mesh_2 = Mesh(mesh)
filter_2 = StreamFilter(Gate=list, Stream0=brep, Stream1=brep_3, Stream2=move.Geometry)
brep_5 = Brep(filter)
medges = MeshEdges(Mesh=mesh_2)  # -> NakedEdges, InteriorEdges, NonManifoldEdges
preview = CustomPreview(Geometry=filter_2, Shader=ColourSwatch(SwatchColor=RGB(255, 188, 255)))
demesh = DeconstructMesh(Mesh=mesh_2)  # -> Vertices, Faces, Colours, Normals
len = Length(Curve=medges.InteriorEdges)
avr = Average(Input=len)
Z = UnitZ(Factor="-0.05")
multiplication = Multiplication(A=avr, B=Slider(0.5, range=0..1))
crv = Curve([medges.NakedEdges, medges.InteriorEdges])
smooth = Smooth(M=mesh_2, Strength=1)
floor = Floor(Strength=1)
length_line = LengthLine(Line=crv, Strength=10)
sc = SphereCollide(Points=demesh.Vertices, Radius=multiplication, Strength=10)
spc = SolidPointCollide(Points=demesh.Vertices, Solid=brep_5, Interior=Toggle(False), Unidirectional="True", Strength=Slider(500, range=0..500))
load = Load(Point=demesh.Vertices, ForceVector=Z)
show = Show(G=mesh_2)
merge = Merge(Data1=show, Data2=smooth, Data3=floor, Data4=length_line, Data5=spc, Data6=load, Data7=sc)  # -> flatten(Result)
panel_2 = Panel(spc)
solver = Solver(GoalObjects=merge, Reset=Button(), Threshold=1e-15, Tolerance=0.01, On=Toggle(False))  # -> I, V, O
panel_3 = Panel(solver.I)
data = Data(solver.O)
brep_6 = Brep(data)
mesh_3 = Mesh(data)
clean = CleanTree(RemoveNulls=True, RemoveInvalid=True, RemoveEmpty=False, Tree=brep_6)
panel_4 = Panel(clean)
clean_2 = CleanTree(RemoveNulls=True, RemoveInvalid=True, RemoveEmpty=False, Tree=mesh_3)
mesh_4 = Mesh(clean_2)
Z_2 = UnitZ(Factor=Slider(0.5, range=0..1))
move_2 = Move(Geometry=mesh_4, Motion=Z_2)  # -> Geometry, Transform
wbsplitquads = WeaverbirdsConstantQuadsSplitSubdivision(MeshCurves=move_2.Geometry, Level=1, SmoothNakedEdges=1)
wbblur = WeaverbirdsBlurMesh(MeshCurves=wbsplitquads, Level=Slider(2, range=0..10), Thin=1)
preview_2 = CustomPreview(Geometry=wbblur, Shader=ColourSwatch(SwatchColor=RGBA(154, 247, 255, 216)))
brep_7 = Brep(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)  # disabled

# ---- group: on chair sim
mesh_5 = Mesh(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)  # disabled

# ----
wbloop = WeaverbirdsLoopSubdivision(MeshCurves=mesh_5, Level=1, SmoothNakedEdges=1)  # disabled
mesh_6 = Mesh(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)  # disabled

# ---- group: Smooth
mesh_7 = Mesh(wbloop)  # disabled

# ----
brep_8 = Brep(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)  # disabled
medges_2 = MeshEdges(Mesh=mesh_6)  # -> NakedEdges, InteriorEdges, NonManifoldEdges; disabled
number_slider = Slider(0, range=0..10)  # disabled
number_slider_2 = Slider(0.5, range=0..4)  # disabled
viewer = ParamViewer(medges_2.NakedEdges)  # disabled
crv_2 = Curve(medges_2.NakedEdges)  # disabled
join = JoinCurves(Curves=medges_2.NakedEdges, Preserve=False)  # disabled
number_slider_3 = Slider(10, range=0..10)  # disabled
cp = ControlPoints(Curve=join)  # -> Points, Weights, Knots; disabled
viewer_2 = ParamViewer(cp.Points)  # disabled
number_slider_4 = Slider(1, range=0..10)  # disabled
number_slider_5 = Slider(2, range=0..300)  # disabled
duppt = RemoveDuplicatePts(Points=cp.Points, Tolerance=0.01)  # disabled
multiplication_2 = Multiplication(A=number_slider, B=number_slider_2)  # disabled
viewer_3 = ParamViewer(duppt)  # disabled
sequence = Sequence(Frames=number_slider_3)  # disabled
num = Number(multiplication_2)  # disabled

# ---- group: mesh machine
meshmachine = MeshMachine(
    Geometry=mesh_6,
    Length=num,
    FixVertices=duppt,
    Flip=1,
    PullStrength=0.8,
    CurvatureAdaptivity=0,
    BoundaryScale=1,
    BoundaryDistance=5,
    Exponent=2,
    Background=0.5,
    Iterations=number_slider_4,
    Reset=sequence)  # disabled

# ----
pmesh = PlanktonMesh(flatten(meshmachine))  # disabled
rev_2 = ReverseList(List=pmesh)  # disabled
viewer_4 = ParamViewer(pmesh)  # disabled
panel_5 = Panel(pmesh)  # disabled
item = ListItem(List=rev_2, Index=0, Wrap=True)  # disabled
mesh_8 = Mesh(item)  # disabled
medges_3 = MeshEdges(Mesh=mesh_8)  # -> NakedEdges, InteriorEdges, NonManifoldEdges; disabled
