# Grasshopper definition Collision-Cloth-Drape-XXX-3-mov.ghx (Grasshopper 0.9.76)
# plug-ins: MeshEdit Components, Kangaroo Components, PlanktonGh, Weaverbird, Kangaroo2 Components

number_slider = Slider(20, range=0..100)
number_slider_2 = Slider(20, range=0..100)

# ---- group: cloth
brep = Brep(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)

# ---- group: Cylinder
brep_2 = Brep(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)

# ----
sdivide = DivideSurface(Surface=brep, UCount=number_slider, VCount=number_slider_2)  # -> flatten(Points), Normals, Parameters
addition = Addition(A=number_slider, B=1)
addition_2 = Addition(A=number_slider_2, B=1)
frompoints = MeshFromPoints(Points=sdivide.Points, UDirection=addition, VDirection=addition_2)

# ---- group: Cloth
mesh = Mesh(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)

# ----
move = Move(Geometry=mesh, Motion="0,60,-10")  # -> Geometry, Transform
rectangle = Rectangle(Plane=PlaneXY(0, 0, 0), XSize="-15 to 35", YSize="-15 to 35", Radius=0)  # -> Rectangle, Length
clean = CombineClean(Meshes=frompoints)
brep_3 = Brep(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)
merge = Merge(Data1=mesh, Data2=move.Geometry)
bbox = BoundingBox(Content=brep_3, Plane=PlaneXY(0, 0, 0))  # -> Box, Box_2
Z = UnitZ(Factor=Slider(20, range=0..20))
triangulate = MeshTriangulate(Mesh=clean, ShortDiagonal=True)
area = Area(Geometry=bbox.Box)  # -> Area, Centroid
W = WidthCount(30)
move_2 = Move(Geometry=rectangle.Rectangle, Motion=Z)  # -> Geometry, Transform
mesh_2 = Mesh(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)
clean_2 = CombineClean(Meshes=triangulate)
refine = Refine(Mesh=mesh, Level=1)

# ---- group: pipe add
brep_4 = Brep(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)

# ---- group: torus
brep_5 = Brep(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)

# ---- group: Box
brep_6 = Brep(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)

# ----
rotate = Rotate(Geometry=brep_3, Angle=1.570796327, Plane=area.Centroid)  # -> Geometry, Transform
brep_7 = Brep(rotate.Geometry)
mplane = MeshPlane(Boundary=move_2.Geometry, WidthCount=W, HeightCount=W)  # -> Mesh, Area

# ---- group: T
brep_8 = Brep(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)

# ----
wbloop = WeaverbirdsLoopSubdivision(MeshCurves=mesh_2, Level=1, SmoothNakedEdges=1)
refine_2 = Refine(Mesh=mesh_2, Level=Slider(2, range=0..10))

# ---- group: pipe add
brep_9 = Brep(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)

# ----
mesh_3 = Mesh(refine_2)
brep_10 = Brep([brep_4, brep_7])
mesh_4 = Mesh(merge)
brep_11 = Brep(brep_9)
mesh_5 = MeshBrep(
    Brep=brep_10,
    Settings={GridMaxCount=0, GridMinCount=16, JaggedSeams=False, MaxEdgeLength=0, MinEdgeLength=0.0001, MinTolerance=0, Refine=True, RefineAngle=0, RelativeTolerance=0.65, SimplePlanes=True, Tolerance=0})  # disabled
demesh = DeconstructMesh(Mesh=mesh_4)  # -> Vertices, Faces, Colours, Normals
medges = MeshEdges(Mesh=mesh_4)  # -> NakedEdges, InteriorEdges, NonManifoldEdges
mesh_6 = MeshBrep(
    Brep=brep_11,
    Settings={GridMaxCount=0, GridMinCount=16, JaggedSeams=False, MaxEdgeLength=0, MinEdgeLength=0.0001, MinTolerance=0, Refine=True, RefineAngle=0, RelativeTolerance=0.65, SimplePlanes=True, Tolerance=0})
panel = Panel(mesh_5)
demesh_2 = DeconstructMesh(Mesh=mesh_3)  # -> Vertices, Faces, Colours, Normals
medges_2 = MeshEdges(Mesh=mesh_3)  # -> NakedEdges, InteriorEdges, NonManifoldEdges
len = Length(Curve=medges_2.InteriorEdges)
len_2 = Length(Curve=medges.InteriorEdges)
panel_2 = Panel(mesh_6)
rec = Rectangle({Plane=PlaneXY(-79, -67, 0), Size=Domain2(u=0..152, v=0..138)})
avr = Average(Input=len)
avr_2 = Average(Input=len_2)
boundary = BoundarySurfaces(Edges=rec)
multiplication = Multiplication(A=avr, B=0.5)
multiplication_2 = Multiplication(A=avr_2, B=Slider(0.5, range=0..1))
swatch = ColourSwatch(SwatchColor=RGBA(255, 188, 255, 150))
Z_2 = UnitZ(Factor="-0.05")
crv = Curve([medges.NakedEdges, medges.InteriorEdges])
Z_3 = UnitZ(Factor=-0.1)
smooth = Smooth(M=mesh_4, Strength=1)
floor = Floor(Strength=1)
crv_2 = Curve([medges_2.NakedEdges, medges_2.InteriorEdges])
sc = SphereCollide(Points=demesh_2.Vertices, Radius=multiplication, Strength=10)  # disabled
show = Show(G=mesh_4)
length_line = LengthLine(Line=crv, Strength=10)
spc = SolidPointCollide(Points=demesh.Vertices, Solid=brep_10, Interior=Toggle(False), Unidirectional="True", Strength=Slider(30, range=0..30))
sc_2 = SphereCollide(Points=demesh.Vertices, Radius=multiplication_2, Strength=10)
load = Load(Point=demesh.Vertices, ForceVector=Z_2)
smooth_2 = Smooth(M=mesh_3, Strength=1)
floor_2 = Floor(Strength=1)
spc_2 = SolidPointCollide(Points=demesh_2.Vertices, Solid=mesh_6, Interior=Toggle(False), Unidirectional="True", Strength=1)
swatch_2 = ColourSwatch(SwatchColor=RGBA(181, 255, 255, 150))
show_2 = Show(G=mesh_3)
length_line_2 = LengthLine(Line=crv_2, Strength=10)
load_2 = Load(Point=demesh_2.Vertices, ForceVector=Z_3)
merge_2 = Merge(Data1=show, Data2=smooth, Data3=floor, Data4=length_line, Data5=spc, Data6=load, Data7=sc_2)  # -> flatten(Result)
merge_3 = Merge(Data1=show_2, Data2=smooth_2, Data3=floor_2, Data4=length_line_2, Data5=spc_2, Data6=load_2, Data7=sc)
panel_3 = Panel(spc)
solver = Solver(GoalObjects=merge_2, Reset=Button(), Threshold=1e-15, Tolerance=0.01, On=Toggle(False))  # -> I, V, O
panel_4 = Panel(solver.I)
solver_2 = Solver(GoalObjects=merge_3, Reset=Button(), Threshold=1e-15, Tolerance=0.01, On=Toggle(False))  # -> I, V, O
data = Data(solver.O)
panel_5 = Panel(solver_2.I)
data_2 = Data(solver_2.O)
brep_12 = Brep(data)
Z_4 = UnitZ(Factor=Slider(0.5, range=0..1))
mesh_7 = Mesh(data)
brep_13 = Brep(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)
brep_14 = Brep(data_2)
Z_5 = UnitZ(Factor=Slider(0.5, range=0..1))
mesh_8 = Mesh(data_2)
clean_3 = CleanTree(RemoveNulls=True, RemoveInvalid=True, RemoveEmpty=False, Tree=brep_12)
clean_4 = CleanTree(RemoveNulls=True, RemoveInvalid=True, RemoveEmpty=False, Tree=mesh_7)
clean_5 = CleanTree(RemoveNulls=True, RemoveInvalid=True, RemoveEmpty=False, Tree=brep_14)
clean_6 = CleanTree(RemoveNulls=True, RemoveInvalid=True, RemoveEmpty=False, Tree=mesh_8)
merge_4 = Merge(Data1=brep_7, Data2=brep_13)  # -> flatten(Result)
mesh_9 = Mesh(clean_4)
move_3 = Move(Geometry=mesh_9, Motion=Z_4)  # -> Geometry, Transform
mesh_10 = Mesh(clean_6)
move_4 = Move(Motion=Z_5)  # -> Geometry, Transform
preview = CustomPreview(Geometry=brep_11, Shader=ColourSwatch(SwatchColor=RGBA(181, 255, 255, 150)))
preview_2 = CustomPreview(
    Geometry=mesh_10,
    Shader={ambient=RGB(0, 0, 0), diffuse=RGB(255, 105, 180), emission=RGB(76, 32, 54), shine=0.5, specular=RGB(255, 255, 255), transparency=0})
wbsplitquads = WeaverbirdsConstantQuadsSplitSubdivision(MeshCurves=move_3.Geometry, Level=1, SmoothNakedEdges=1)
wbblur = WeaverbirdsBlurMesh(MeshCurves=wbsplitquads, Level=Slider(2, range=0..10), Thin=1)
merge_5 = Merge(Data1=ColourSwatch(SwatchColor=RGBA(255, 188, 255, 191)), Data2=ColourSwatch(SwatchColor=RGB(255, 188, 255)))  # -> flatten(Result)
wbloop_2 = WeaverbirdsLoopSubdivision(MeshCurves=move_4.Geometry, Level=Slider(3, range=0..10), SmoothNakedEdges=1)  # disabled
preview_3 = CustomPreview(Geometry=wbblur, Shader=ColourSwatch(SwatchColor=RGBA(154, 247, 255, 199)))
medges_3 = MeshEdges()  # -> NakedEdges, InteriorEdges, NonManifoldEdges
preview_4 = CustomPreview(Geometry=merge_4, Shader=merge_5)
brep_15 = Brep(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)  # disabled

# ---- group: on chair sim
mesh_11 = Mesh(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)  # disabled

# ----
wbloop_3 = WeaverbirdsLoopSubdivision(MeshCurves=mesh_11, Level=1, SmoothNakedEdges=1)  # disabled
mesh_12 = Mesh(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)  # disabled

# ---- group: Smooth
mesh_13 = Mesh(wbloop_3)  # disabled

# ----
brep_16 = Brep(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)  # disabled
medges_4 = MeshEdges(Mesh=mesh_12)  # -> NakedEdges, InteriorEdges, NonManifoldEdges; disabled
number_slider_3 = Slider(0.5, range=0..4)  # disabled
number_slider_4 = Slider(0, range=0..10)  # disabled
viewer = ParamViewer(medges_4.NakedEdges)  # disabled
crv_3 = Curve(medges_4.NakedEdges)  # disabled
join = JoinCurves(Curves=medges_4.NakedEdges, Preserve=False)  # disabled
number_slider_5 = Slider(10, range=0..10)  # disabled
cp = ControlPoints(Curve=join)  # -> Points, Weights, Knots; disabled
viewer_2 = ParamViewer(cp.Points)  # disabled
number_slider_6 = Slider(1, range=0..10)  # disabled
number_slider_7 = Slider(2, range=0..300)  # disabled
duppt = RemoveDuplicatePts(Points=cp.Points, Tolerance=0.01)  # disabled
multiplication_3 = Multiplication(A=number_slider_4, B=number_slider_3)  # disabled
viewer_3 = ParamViewer(duppt)  # disabled
sequence = Sequence(Frames=number_slider_5)  # disabled
num = Number(multiplication_3)  # disabled
meshmachine = MeshMachine(
    Geometry=mesh_12,
    Length=num,
    FixVertices=duppt,
    Flip=1,
    PullStrength=0.8,
    CurvatureAdaptivity=0,
    BoundaryScale=1,
    BoundaryDistance=5,
    Exponent=2,
    Background=0.5,
    Iterations=number_slider_6,
    Reset=sequence)  # disabled
pmesh = PlanktonMesh(flatten(meshmachine))  # disabled
rev = ReverseList(List=pmesh)  # disabled
viewer_4 = ParamViewer(pmesh)  # disabled
panel_6 = Panel(pmesh)  # disabled
item = ListItem(List=rev, Index=0, Wrap=True)  # disabled
mesh_14 = Mesh(item)  # disabled
medges_5 = MeshEdges(Mesh=mesh_14)  # -> NakedEdges, InteriorEdges, NonManifoldEdges; disabled
