# Grasshopper definition Collision-Cloth-Drape-XXX-5.ghx (Grasshopper 0.9.76)
# plug-ins: Kangaroo2 Components

panel = Panel("-15 to 35")
mesh = Mesh(<mesh referenced from the Rhino model>)
refine = Refine(Mesh=mesh, Level=Slider(1, range=0..10))
mesh_2 = Mesh(refine)
pt = Point([Point(0, 0, 180), Point(180, 0, 180)])
panel_2 = Panel("True")
demesh = DeconstructMesh(Mesh=mesh_2)  # -> Vertices, Faces, Colours, Normals
medges = MeshEdges(Mesh=mesh_2)  # -> NakedEdges, InteriorEdges, NonManifoldEdges
neg = Negative(Value=Slider(0.004, range=0..0.01))
Z = UnitZ(Factor=neg)
crv = Curve([medges.NakedEdges, medges.InteriorEdges])
anchor = Anchor(Point=pt, Strength=10000)
sc = SphereCollide(Points=demesh.Vertices, Radius=Slider(0.5, range=0..1), Strength=1)
length_line = LengthLine(Line=crv, Strength=10)
show = Show(G=mesh_2)
wind = Wind(Mesh=mesh_2, WindVector="10,10,0")
load = Load(Point=demesh.Vertices, ForceVector=Z)
merge = Merge(Data1=show, Data4=length_line, Data5=anchor, Data6=load, Data8=sc, Data9=wind)
solver = Solver(GoalObjects=merge, Reset=Button(), Threshold=1e-15, Tolerance=0.01, On=Toggle(True))  # -> I, V, O
data = Data(solver.O)
mesh_3 = Mesh(data)
clean = CleanTree(RemoveNulls=True, RemoveInvalid=True, RemoveEmpty=False, Tree=mesh_3)
medges_2 = MeshEdges(Mesh=clean)  # -> NakedEdges, InteriorEdges, NonManifoldEdges
preview = CustomPreview(
    Geometry=clean,
    Shader={ambient=RGB(0, 0, 0), diffuse=RGB(255, 105, 180), emission=RGB(76, 32, 54), shine=0.5, specular=RGB(255, 255, 255), transparency=0})
