# Grasshopper definition Collision-Cloth-inflatable-2.ghx (Grasshopper 0.9.76)
# plug-ins: MeshEdit Components, Kangaroo2 Components

number_slider = Slider(16, range=0..100)
brep = Brep(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)
sdivide = DivideSurface(Surface=brep, UCount=number_slider, VCount=number_slider)  # -> flatten(Points), Normals, Parameters
addition = Addition(A=number_slider, B=1)
frompoints = MeshFromPoints(Points=sdivide.Points, UDirection=addition, VDirection=addition)
mesh = Mesh(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)
clean = CombineClean(Meshes=frompoints)
mesh_2 = Mesh(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)
flip = MeshFlip(Mesh=clean)
medges = MeshEdges(Mesh=mesh)  # -> NakedEdges, InteriorEdges, NonManifoldEdges
mesh_3 = Mesh(flip)
tri = Triangulate(Mesh=mesh)  # -> Mesh, Count
panel = Panel(tri.Mesh)
tri_2 = Triangulate(Mesh=mesh_3)  # -> Mesh, Count
clean_2 = CombineClean(Meshes=tri.Mesh)
panel_2 = Panel(clean_2)
demesh = DeconstructMesh(Mesh=tri_2.Mesh)  # -> Vertices, Faces, Colours, Normals
medges_2 = MeshEdges(Mesh=tri_2.Mesh)  # -> NakedEdges, InteriorEdges, NonManifoldEdges

# ---- group: preserving volume, and decreasing edge lengths for balloon
medges_3 = MeshEdges(Mesh=clean_2)  # -> NakedEdges, InteriorEdges, NonManifoldEdges
volume = Volume(Mesh=clean_2, Strength=0.1)
length_line = LengthLine(Line=medges_3.InteriorEdges, Length=0, Strength=0.1)

# ----
Z = UnitZ(Factor=-0.1)
floor = Floor(Strength=1)

# ---- group: 2-way collision between balloon and cloth
spc = SolidPointCollide(Points=demesh.Vertices, Solid=clean_2, Interior=False, Unidirectional=False, Strength=1)

# ----
smooth = Smooth(M=mesh_3, Strength=1)
grab = Grab(On=True, Strength=1, Range=3)  # -> Grab, Anchors

# ---- group: cloth self-collision using spheres
sc = SphereCollide(Points=demesh.Vertices, Radius=1.7, Strength=1)

# ----
length_line_2 = LengthLine(Line=[medges_2.InteriorEdges, medges_2.NakedEdges], Strength=10)
load = Load(Point=demesh.Vertices, ForceVector=Z)
show = Show(G=clean_2)
show_2 = Show(G=tri_2.Mesh)
button = Button()
entwine = Entwine(
    Branch00=[length_line_2, load, floor, volume, spc, length_line, sc, grab.Grab],
    Branch01=show_2,
    Branch02=show,
    Branch03=smooth,
    FlattenInputs=True)
toggle = BooleanToggle(False)
solver = Solver(GoalObjects=entwine, Reset=button, Threshold=1e-15, Tolerance=0.01, On=toggle)  # -> I, V, O
bouncysolver = BouncySolver(GoalObjects=entwine, Reset=button, Threshold=1e-15, Tolerance=0.01, Damping=0.99, Iterations=10, On=toggle)  # -> I, V, O; disabled
bang = ExplodeTree(Data=solver.O)  # -> Branch0, Branch1, Branch2
bang_2 = ExplodeTree(Data=bouncysolver.O)  # -> Branch0, Branch1, Branch2
preview = CustomPreview(Geometry=bang.Branch2, Shader=ColourSwatch(SwatchColor=RGB(253, 160, 255)))
preview_2 = CustomPreview(Geometry=bang.Branch1, Shader=ColourSwatch(SwatchColor=RGB(173, 255, 255)))
preview_3 = CustomPreview(Geometry=bang_2.Branch0, Shader=ColourSwatch(SwatchColor=RGB(253, 160, 255)))
preview_4 = CustomPreview(Geometry=bang.Branch0, Shader=ColourSwatch(SwatchColor=RGB(255, 255, 255)))
