# Grasshopper definition Collision-Cloth-inflatable-3.ghx (Grasshopper 0.9.76)
# plug-ins: Kangaroo2 Components

brep = Brep(<brep referenced from the Rhino model>)
mesh = MeshBrep(
    Brep=brep,
    Settings={GridMaxCount=0, GridMinCount=16, JaggedSeams=False, MaxEdgeLength=0, MinEdgeLength=0.0001, MinTolerance=0, Refine=True, RefineAngle=0, RelativeTolerance=0.65, SimplePlanes=True, Tolerance=0})
panel = Panel(mesh)
mesh_2 = Mesh(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)
mesh_3 = Mesh(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)
tri = Triangulate(Mesh=mesh_3)  # -> Mesh, Count
panel_2 = Panel(tri.Mesh)
tri_2 = Triangulate(Mesh=mesh_2)  # -> Mesh, Count
clean = CombineClean(Meshes=tri.Mesh)
panel_3 = Panel(clean)
demesh = DeconstructMesh(Mesh=tri_2.Mesh)  # -> Vertices, Faces, Colours, Normals
medges = MeshEdges(Mesh=tri_2.Mesh)  # -> NakedEdges, InteriorEdges, NonManifoldEdges

# ---- group: preserving volume, and decreasing edge lengths for balloon
medges_2 = MeshEdges(Mesh=clean)  # -> NakedEdges, InteriorEdges, NonManifoldEdges
volume = Volume(Mesh=clean, Strength=0.1)
length_line = LengthLine(Line=medges_2.InteriorEdges, Length=0, Strength=0.1)

# ----
Z = UnitZ(Factor=-0.1)

# ---- group: cloth self-collision using spheres
sc = SphereCollide(Points=demesh.Vertices, Radius=1.7, Strength=1)

# ----
floor = Floor(Strength=1)

# ---- group: 2-way collision between balloon and cloth
spc = SolidPointCollide(Points=demesh.Vertices, Solid=clean, Interior=False, Unidirectional=False, Strength=1)

# ----
grab = Grab(On=True, Strength=1, Range=3)  # -> Grab, Anchors
length_line_2 = LengthLine(Line=[medges.InteriorEdges, medges.NakedEdges], Strength=10)
load = Load(Point=demesh.Vertices, ForceVector=Z)
show = Show(G=clean)
show_2 = Show(G=tri_2.Mesh)
button = Button()
entwine = Entwine(
    Branch00=[length_line_2, load, floor, volume, spc, length_line, sc, grab.Grab],
    Branch01=show_2,
    Branch02=show,
    FlattenInputs=True)
toggle = BooleanToggle(True)
solver = Solver(GoalObjects=entwine, Reset=button, Threshold=1e-15, Tolerance=0.01, On=toggle)  # -> I, V, O
bouncysolver = BouncySolver(GoalObjects=entwine, Reset=button, Threshold=1e-15, Tolerance=0.01, Damping=0.99, Iterations=10, On=toggle)  # -> I, V, O; disabled
bang = ExplodeTree(Data=solver.O)  # -> Branch0, Branch1, Branch2
bang_2 = ExplodeTree(Data=bouncysolver.O)  # -> Branch0, Branch1, Branch2
preview = CustomPreview(Geometry=bang.Branch0, Shader=ColourSwatch(SwatchColor=RGB(255, 255, 255)))
preview_2 = CustomPreview(Geometry=bang.Branch2, Shader=ColourSwatch(SwatchColor=RGB(253, 160, 255)))
preview_3 = CustomPreview(Geometry=bang_2.Branch0, Shader=ColourSwatch(SwatchColor=RGB(253, 160, 255)))
