# Grasshopper definition Collision-Curve-X-Particle-2d.ghx (Grasshopper 0.9.76)
# plug-ins: Kangaroo2 Components

number_slider = Slider(3, range=0..5)
pt = Point([Point(-8, 34.30562263, 0), Point(9.52496961, 20.01699977, 0), Point(24.76432048, 11.02350394, 0), Point(13.49169548, -3.478222673, 0), Point(45.96791286, -18.42056565, 0), Point(47.66656448, 2.624432507, 0), Point(79.40037141, 13.60921183, 0), Point(30.57912998, -45.58654341, 0)])
pop2d = Populate2D(Region={Plane=PlaneXY(-48, 110, 0), Size=Domain2(u=0..165, v=0..399)}, Count=Slider(300, range=0..1000), Seed=1)
Y = UnitY(Factor=-0.01)
intcrv = Interpolate(Vertices=pt, Degree=3, Periodic=True, KnotStyle=1)  # -> Curve, Length, Domain
boundary = BoundarySurfaces(Edges=intcrv.Curve)
neg = Negative(Value=number_slider)
offset = Offset(Curve=intcrv.Curve, Distance=neg, Plane=PlaneXY(0, 0, 0), Corners=1)
sc = SphereCollide(Points=pop2d, Radius=number_slider, Strength=10)
cpc = CurvePointCollide(Points=pop2d, Curve=offset, Plane=PlaneXY(0, 0, 0), Interior=Toggle(False), Strength=10)
onplane = OnPlane(Points=pop2d, Plane=PlaneXY(0, 0, 0), Strength=1)
load = Load(Point=pop2d, ForceVector=Y)
reset = Button()
on = BooleanToggle(False)
solver = Solver(GoalObjects=[sc, cpc, load, onplane], Reset=reset, Threshold=1e-15, Tolerance=0.01, On=on)  # -> I, V, O
pt_2 = Point(solver.V)
cloud = CloudDisplay(Points=solver.V, Colours=RGB(35, 55, 186), Size=1.1, SpriteType=1)
pdecon = Deconstruct(Point=pt_2)  # -> XComponent, YComponent, ZComponent
smaller = SmallerThan(FirstNumber="-200", SecondNumber=pdecon.YComponent)  # -> SmallerThan, OrEqualTo
dispatch = Dispatch(List=pt_2, DispatchPattern=smaller.SmallerThan)  # -> ListA, ListB
panel = Panel(solver.O)
del = DelaunayMesh(Points=dispatch.ListA, Plane=PlaneXY(0, 0, 0))
cir = Circle(Plane=dispatch.ListA, Radius=number_slider)
mesh = Mesh(del)
medges = MeshEdges(Mesh=mesh)  # -> NakedEdges, InteriorEdges, NonManifoldEdges
preview = CustomPreview(
    Geometry=[medges.NakedEdges, medges.InteriorEdges, medges.NonManifoldEdges],
    Shader={ambient=RGB(0, 0, 0), diffuse=RGB(255, 105, 180), emission=RGB(76, 32, 54), shine=0.5, specular=RGB(255, 255, 255), transparency=0})
