# Grasshopper definition Collision-Floor.ghx (Grasshopper 0.9.76)
# plug-ins: Kangaroo2 Components

pop3d = Populate3D(
    Region={Plane=Plane(origin=(5, 4, 0), x=(0, 1, 0), y=(1, 0, 0)), X=Domain(0, 17), Y=Domain(0, 18), Z=Domain(-16, 0)},
    Count=500,
    Seed=1)
Z = UnitZ(Factor=-0.1)
floor = Floor(Strength=1)
sc = SphereCollide(Points=pop3d, Radius="1", Strength=1)
grab = Grab(On=True, Strength=1, Range=3)  # -> Grab, Anchors
rectangle = Rectangle(Plane=PlaneXY(0, 0, 0), XSize="-100 to 145", YSize="-100 to 145", Radius=0)  # -> Rectangle, Length
load = Load(Point=pop3d, ForceVector=Z)
mplane = MeshPlane(Boundary=rectangle.Rectangle, WidthCount=10, HeightCount=10)  # -> Mesh, Area
button = Button()
toggle = BooleanToggle(True)
merge = Merge(Data1=grab.Grab, Data2=sc, Data3=floor, Data4=load)  # -> flatten(Result)
solver = Solver(GoalObjects=merge, Reset=button, Threshold=1e-15, Tolerance=0.01, On=toggle)  # -> I, V, O
bouncysolver = BouncySolver(GoalObjects=merge, Reset=button, Threshold=1e-15, Tolerance=0.01, Damping=1, Iterations=10, On=toggle)  # -> I, V, O
pt = Point(bouncysolver.V)
panel = Panel(bouncysolver.V)
preview = CustomPreview(Geometry=mplane.Mesh, Shader=ColourSwatch(SwatchColor=RGBA(147, 255, 255, 169)))
Z_2 = UnitZ(Factor=Slider(1.1, range=0..10))
move = Move(Geometry=pt, Motion=Z_2)  # -> Geometry, Transform
msphere = MeshSphere(Base=move.Geometry, Radius="1", UCount=4, VCount=8)
