# Grasshopper definition Collision-Mesh-Solid-MeshMachine-2.ghx (Grasshopper 0.9.76)
# plug-ins: MeshEdit Components, Python Interpreter, Kangaroo Components, PlanktonGh, Weaverbird, Kangaroo2 Components

number_slider = Slider(48, range=0..100)
number_slider_2 = Slider(24, range=0..100)

# ---- group: cloth
brep = Brep(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)

# ---- group: Cylinder
brep_2 = Brep(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)

# ----
number_slider_3 = Slider(30, range=0..100)

# ---- group: bunny
brep_3 = Brep(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)

# ---- group: teapot
brep_4 = Brep(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)

# ---- group: goat
brep_5 = Brep(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)

# ---- group: ob
mesh = Mesh(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)

# ----
preview = CustomPreview(
    Geometry=brep,
    Shader={ambient=RGB(0, 0, 0), diffuse=RGB(255, 105, 180), emission=RGB(76, 32, 54), shine=0.5, specular=RGB(255, 255, 255), transparency=0})
rectangle = Rectangle(Plane=PlaneXY(0, 0, 0), XSize="-15 to 35", YSize="-15 to 35", Radius=0)  # -> Rectangle, Length
move = Move(Geometry=brep_3, Motion="10,15,0")  # -> Geometry, Transform
sdivide = DivideSurface(Surface=brep, UCount=number_slider, VCount=number_slider_2)  # -> flatten(Points), Normals, Parameters
box = CenterBox(Base=PlaneXY(0, 0, 0), X=number_slider_3, Y=number_slider_3, Z=Slider(5, range=0..10))
addition = Addition(A=number_slider, B=1)
addition_2 = Addition(A=number_slider_2, B=1)
Z = UnitZ(Factor=Slider(20, range=0..20))
mesh_2 = MeshBrep(
    Brep=move.Geometry,
    Settings={GridMaxCount=0, GridMinCount=16, JaggedSeams=False, MaxEdgeLength=0, MinEdgeLength=0.0001, MinTolerance=0, Refine=True, RefineAngle=0, RelativeTolerance=0.65, SimplePlanes=True, Tolerance=0})
mbox = MeshBox(Base=box, XCount=10, YCount=10, ZCount=10)
W = WidthCount(30)
move_2 = Move(Geometry=rectangle.Rectangle, Motion=Z)  # -> Geometry, Transform
frompoints = MeshFromPoints(Points=sdivide.Points, UDirection=addition, VDirection=addition_2)
move_3 = Move(Geometry=mbox, Motion="0,0,80")  # -> Geometry, Transform
mplane = MeshPlane(Boundary=move_2.Geometry, WidthCount=W, HeightCount=W)  # -> Mesh, Area
xy = XYPlane(Origin=Point(0, 0, 0))
panel = Panel(move_3.Geometry)
panel_2 = Panel(mesh)
mesh_3 = Mesh(mesh_2)
clean = CombineClean(Meshes=mesh_3)
medges = MeshEdges(Mesh=clean)  # -> NakedEdges, InteriorEdges, NonManifoldEdges
mirror = Mirror(Geometry=clean, Plane=xy)  # -> Geometry, Transform
move_4 = Move(Geometry=mirror.Geometry, Motion="0,0,300")  # -> Geometry, Transform
panel_3 = Panel(clean)
mesh_4 = Mesh(move_4.Geometry)

# ---- group: torus
brep_6 = Brep(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)

# ---- group: Box
brep_7 = Brep(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)

# ---- group: l
brep_8 = Brep(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)

# ---- group: T
brep_9 = Brep(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)

# ----
mesh_5 = Mesh(mesh_4)
brep_10 = Brep(brep_8)
mesh_6 = MeshBrep(
    Brep=brep_10,
    Settings={GridMaxCount=0, GridMinCount=16, JaggedSeams=False, MaxEdgeLength=0, MinEdgeLength=0.0001, MinTolerance=0, Refine=True, RefineAngle=0, RelativeTolerance=0.65, SimplePlanes=True, Tolerance=0})
demesh = DeconstructMesh(Mesh=mesh_5)  # -> Vertices, Faces, Colours, Normals
medges_2 = MeshEdges(Mesh=mesh_5)  # -> NakedEdges, InteriorEdges, NonManifoldEdges
len = Length(Curve=medges_2.InteriorEdges)
panel_4 = Panel(mesh_6)
rec = Rectangle({Plane=PlaneXY(-117, -101.5, 0), Size=Domain2(u=0..228, v=0..207)})
avr = Average(Input=len)
multiplication = Multiplication(A=avr, B=0.5)
boundary = BoundarySurfaces(Edges=rec)
Z_2 = UnitZ(Factor=-0.1)
crv = Curve([medges_2.NakedEdges, medges_2.InteriorEdges])
smooth = Smooth(M=mesh_5, Strength=1)
floor = Floor(Strength=1)
spc = SolidPointCollide(Points=demesh.Vertices, Solid=mesh_6, Interior=Toggle(False), Unidirectional="True", Strength=1)
show = Show(G=mesh_5)
length_line = LengthLine(Line=crv, Strength=10)
sc = SphereCollide(Points=demesh.Vertices, Radius=multiplication, Strength=10)
load = Load(Point=demesh.Vertices, ForceVector=Z_2)
merge = Merge(Data1=show, Data2=smooth, Data3=floor, Data4=length_line, Data5=spc, Data6=load, Data7=sc)
solver = Solver(GoalObjects=merge, Reset=Button(), Threshold=1e-15, Tolerance=0.01, On=Toggle(False))  # -> I, V, O
data = Data(solver.O)
brep_11 = Brep(data)
mesh_7 = Mesh(data)
clean_2 = CleanTree(RemoveNulls=True, RemoveInvalid=True, RemoveEmpty=False, Tree=brep_11)
clean_3 = CleanTree(RemoveNulls=True, RemoveInvalid=True, RemoveEmpty=False, Tree=mesh_7)
merge_2 = Merge(Data1=brep_10, Data2=boundary)
mesh_8 = Mesh(clean_3)
preview_2 = CustomPreview(Geometry=merge_2, Shader=ColourSwatch(SwatchColor=RGBA(255, 188, 255, 150)))
xy_2 = XYPlane(Origin=Point(0, 0, 0))
mesh_9 = Mesh(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)
merge_3 = Merge(Data1=mesh_8, Data2=mesh_6)
mirror_2 = Mirror(Geometry=merge_3, Plane=xy_2)  # -> Geometry, Transform
mesh_10 = Mesh()
medges_3 = MeshEdges(Mesh=mesh_10)  # -> NakedEdges, InteriorEdges, NonManifoldEdges
move_5 = Move(Geometry=mirror_2.Geometry, Motion="100,0,100")  # -> flatten(Geometry), Transform
mesh_11 = Mesh(mesh_10)
Z_3 = UnitZ(Factor=Slider(0.5, range=0..1))
merge_4 = Merge(Data1=ColourSwatch(SwatchColor=RGBA(139, 97, 255, 150)), Data2=ColourSwatch(SwatchColor=RGBA(154, 247, 255, 150)))
preview_3 = CustomPreview(Geometry=move_5.Geometry, Shader=merge_4)
move_6 = Move(Geometry=mesh_11, Motion=Z_3)  # -> Geometry, Transform
wbloop = WeaverbirdsLoopSubdivision(MeshCurves=move_6.Geometry, Level=Slider(3, range=0..10), SmoothNakedEdges=1)
preview_4 = CustomPreview(
    Geometry=move_6.Geometry,
    Shader={ambient=RGB(0, 0, 0), diffuse=RGB(255, 105, 180), emission=RGB(76, 32, 54), shine=0.5, specular=RGB(255, 255, 255), transparency=0})
mesh_12 = Mesh(wbloop)
medges_4 = MeshEdges(Mesh=mesh_12)  # -> NakedEdges, InteriorEdges, NonManifoldEdges
medges_5 = MeshEdges(Mesh=mesh_12)  # -> NakedEdges, InteriorEdges, NonManifoldEdges
viewer = ParamViewer(medges_5.NakedEdges)
crv_2 = Curve(medges_5.NakedEdges)
join = JoinCurves(Curves=medges_5.NakedEdges, Preserve=False)
cp = ControlPoints(Curve=join)  # -> Points, Weights, Knots
viewer_2 = ParamViewer(cp.Points)
duppt = RemoveDuplicatePts(Points=cp.Points, Tolerance=0.01)
multiplication_2 = Multiplication(A=Slider(10, range=0..10), B=Slider(3.97, range=1..4))
viewer_3 = ParamViewer(duppt)
sequence = Sequence(Frames=Slider(10, range=0..10))
num = Number(Slider(4, range=0..300))
meshmachine = MeshMachine(
    Geometry=mesh_12,
    Length=num,
    FixVertices=duppt,
    Flip=1,
    PullStrength=0.8,
    CurvatureAdaptivity=0,
    BoundaryScale=1,
    BoundaryDistance=5,
    Exponent=2,
    Background=0.5,
    Iterations=Slider(1, range=0..10),
    Reset=sequence)
pmesh = PlanktonMesh(flatten(meshmachine))
rev = ReverseList(List=pmesh)
viewer_4 = ParamViewer(pmesh)
panel_5 = Panel(pmesh)
item = ListItem(List=rev, Index=0, Wrap=True)
mesh_13 = Mesh(item)
medges_6 = MeshEdges(Mesh=mesh_13)  # -> NakedEdges, InteriorEdges, NonManifoldEdges
panel_6 = Panel(mesh_13)
number_slider_4 = Slider(0.8, range=0..1)  # disabled
demesh_2 = DeconstructMesh(Mesh=mesh_13)  # -> Vertices, Faces, Colours, Normals; disabled
lng = ListLength(List=demesh_2.Faces)  # disabled
multiplication_3 = Multiplication(A=lng, B=number_slider_4)  # disabled
toggle = BooleanToggle(False)  # disabled
toggle_2 = BooleanToggle(False)  # disabled
int = Integer(multiplication_3)  # disabled
python = PythonScript(x=mesh_13, y=int, z=toggle, u=toggle_2)  # -> out, a, b, c, d; inputs x: Mesh, y: Int32, z: Boolean, u: Boolean; disabled
# ---------- python: Python ----------
import rhinoscriptsyntax as rs
import Rhino
import scriptcontext as sc

a = x
b = y

c = Rhino.Geometry.Mesh.Reduce(x,y,z,10,u)
d = rs.MeshFaceCount(x)
# ---------- end python ----------
panel_7 = Panel(python.a)
panel_8 = Panel(python.b)
panel_9 = Panel(python.c)
panel_10 = Panel(python.d)
