# Grasshopper definition Collision-Mesh-Solid-MeshMachine-3.ghx (Grasshopper 0.9.76)
# plug-ins: MeshEdit Components, Python Interpreter, Kangaroo Components, PlanktonGh, Weaverbird, Kangaroo2 Components

number_slider = Slider(2, range=0..10)
mesh = Mesh(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)

# ---- group: cloth
mesh_2 = Mesh(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)

# ----
mesh_3 = Mesh(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)
X = UnitX(Factor="-5")
mesh_4 = Mesh(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)
number_slider_2 = Slider(48, range=0..100)
mesh_5 = Mesh(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)
number_slider_3 = Slider(24, range=0..100)

# ---- group: cloth
brep = Brep(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)

# ---- group: Cylinder
brep_2 = Brep(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)

# ---- group: cloth
mesh_6 = Mesh(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)

# ----
number_slider_4 = Slider(30, range=0..100)

# ---- group: bunny
mesh_7 = Mesh(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)

brep_3 = Brep(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)

# ---- group: teapot
brep_4 = Brep(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)

# ---- group: goat
brep_5 = Brep(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)

# ----
scale_nu = ScaleNU(Geometry=mesh_4, Plane=PlaneXY(0, 0, 0), ScaleX=number_slider, ScaleY=number_slider, ScaleZ=number_slider)  # -> Geometry, Transform
mesh_8 = Mesh(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)
move = Move(Geometry=mesh_8, Motion=X)  # -> Geometry, Transform

# ---- group: ob
mesh_9 = Mesh(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)

# ---- group: bunny
mesh_10 = Mesh(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)

# ----
preview = CustomPreview(
    Geometry=brep,
    Shader={ambient=RGB(0, 0, 0), diffuse=RGB(255, 105, 180), emission=RGB(76, 32, 54), shine=0.5, specular=RGB(255, 255, 255), transparency=0})
tri = Triangulate(Mesh=mesh_5)  # -> Mesh, Count
rectangle = Rectangle(Plane=PlaneXY(0, 0, 0), XSize="-15 to 35", YSize="-15 to 35", Radius=0)  # -> Rectangle, Length
panel = Panel(tri.Mesh)
move_2 = Move(Geometry=brep_3, Motion="10,15,-85")  # -> Geometry, Transform
tri_2 = Triangulate(Mesh=mesh_3)  # -> Mesh, Count
sdivide = DivideSurface(Surface=brep, UCount=number_slider_2, VCount=number_slider_3)  # -> flatten(Points), Normals, Parameters
tri_3 = Triangulate(Mesh=scale_nu.Geometry)  # -> Mesh, Count
meshcorners = MeshCorners(M=tri_2.Mesh, A=0.5235987756)
box = CenterBox(Base=PlaneXY(0, 0, 0), X=number_slider_4, Y=number_slider_4, Z=Slider(5, range=0..10))
panel_2 = Panel(tri_3.Mesh)
tri_4 = Triangulate(Mesh=mesh_8)  # -> Mesh, Count
meshcorners_2 = MeshCorners(M=tri_4.Mesh, A=0.5235987756)
addition = Addition(A=number_slider_2, B=1)
addition_2 = Addition(A=number_slider_3, B=1)
clean = CombineClean(Meshes=tri.Mesh)
panel_3 = Panel(clean)
Z = UnitZ(Factor=Slider(20, range=0..20))
mesh_11 = MeshBrep(
    Brep=move_2.Geometry,
    Settings={GridMaxCount=0, GridMinCount=16, JaggedSeams=False, MaxEdgeLength=0, MinEdgeLength=0.0001, MinTolerance=0, Refine=True, RefineAngle=0, RelativeTolerance=0.65, SimplePlanes=True, Tolerance=0})
clean_2 = CombineClean(Meshes=tri_3.Mesh)
volume = Volume(Geometry=mesh_4)  # -> Volume, Centroid
panel_4 = Panel(volume.Volume)
mbox = MeshBox(Base=box, XCount=10, YCount=10, ZCount=10)
demesh = DeconstructMesh(Mesh=tri_2.Mesh)  # -> Vertices, Faces, Colours, Normals
W = WidthCount(30)
move_3 = Move(Geometry=rectangle.Rectangle, Motion=Z)  # -> Geometry, Transform
frompoints = MeshFromPoints(Points=sdivide.Points, UDirection=addition, VDirection=addition_2)
demesh_2 = DeconstructMesh(Mesh=tri_4.Mesh)  # -> Vertices, Faces, Colours, Normals
pt = Point(meshcorners)
move_4 = Move(Geometry=mbox, Motion="0,0,80")  # -> Geometry, Transform
mplane = MeshPlane(Boundary=move_3.Geometry, WidthCount=W, HeightCount=W)  # -> Mesh, Area
medges = MeshEdges(Mesh=tri_2.Mesh)  # -> NakedEdges, InteriorEdges, NonManifoldEdges
pt_2 = Point(meshcorners_2)
Z_2 = UnitZ(Factor=-0.1)

# ---- group: preserving volume, and decreasing edge lengths for balloon
medges_2 = MeshEdges(Mesh=clean)  # -> NakedEdges, InteriorEdges, NonManifoldEdges
volume_2 = Volume(Mesh=clean, Strength=0.1)
length_line = LengthLine(Line=medges_2.InteriorEdges, Length=0, Strength=0.1)

# ----
medges_3 = MeshEdges(Mesh=tri_4.Mesh)  # -> NakedEdges, InteriorEdges, NonManifoldEdges
floor = Floor(Strength=1)
grab = Grab(On=True, Strength=1, Range=3)  # -> Grab, Anchors
Z_3 = UnitZ(Factor=-0.1)

# ---- group: cloth self-collision using spheres
sc = SphereCollide(Points=demesh.Vertices, Radius=1.7, Strength=1)  # disabled

# ---- group: preserving volume, and decreasing edge lengths for balloon
medges_4 = MeshEdges(Mesh=clean_2)  # -> NakedEdges, InteriorEdges, NonManifoldEdges
volume_3 = Volume(Mesh=clean_2, Strength=0.1)
length_line_2 = LengthLine(Line=medges_4.InteriorEdges, Length=0, Strength=0.1)

# ---- group: 2-way collision between balloon and cloth
spc = SolidPointCollide(Points=demesh.Vertices, Solid=clean, Interior=False, Unidirectional=False, Strength=1)

# ----
mesh_12 = Mesh(mesh_11)
floor_2 = Floor(Strength=1)

# ---- group: 2-way collision between balloon and cloth
spc_2 = SolidPointCollide(Points=demesh_2.Vertices, Solid=clean_2, Interior=False, Unidirectional=False, Strength=1)

# ----
rigidbody = RigidBody(Part=mesh_8, Points=demesh_2.Vertices, Strength=10)  # -> RigidBody, Planes
clean_3 = CombineClean(Meshes=mesh_12)
length_line_3 = LengthLine(Line=[medges.InteriorEdges, medges.NakedEdges], Strength=10)
load = Load(Point=demesh.Vertices, ForceVector=Z_2)
number_slider_5 = Slider(0, range=0..1)
number_slider_6 = Slider(10, range=0..10)
length_line_4 = LengthLine(Line=[medges_3.InteriorEdges, medges_3.NakedEdges], Strength=10)
load_2 = Load(Point=demesh_2.Vertices, ForceVector=Z_3)
panel_5 = Panel(move_4.Geometry)
show = Show(G=clean)
show_2 = Show(G=tri_2.Mesh)
medges_5 = MeshEdges(Mesh=clean_3)  # -> NakedEdges, InteriorEdges, NonManifoldEdges
panel_6 = Panel(mesh_9)
panel_7 = Panel(clean_3)
show_3 = Show(G=clean_2)
show_4 = Show(G=tri_4.Mesh)
mesh_13 = Mesh(clean_3)

# ---- group: torus
brep_6 = Brep(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)

# ---- group: Box
brep_7 = Brep(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)

# ---- group: T
brep_8 = Brep(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)

# ----
merge = Merge(
    Data1=grab.Grab,
    Data2=length_line_3,
    Data3=load,
    Data4=sc,
    Data5=show_2,
    Data6=spc,
    Data7=show,
    Data8=length_line,
    Data9=volume_2,
    Data10=floor)  # -> flatten(Result)
mesh_14 = Mesh(mesh_13)
mesh_15 = Mesh(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)
entwine = Entwine(
    Branch00=[length_line_3, load, floor, volume_2, spc, length_line, sc, grab.Grab],
    Branch01=show_2,
    Branch02=show,
    FlattenInputs=True)
merge_2 = Merge(
    Data1=rigidbody.RigidBody,
    Data2=length_line_4,
    Data3=load_2,
    Data5=show_4,
    Data6=spc_2,
    Data7=show_3,
    Data8=length_line_2,
    Data9=volume_3,
    Data10=floor_2)  # -> flatten(Result)
entwine_2 = Entwine(
    Branch00=[length_line_4, load_2, floor_2, volume_3, spc_2, length_line_2],
    Branch01=show_4,
    Branch02=show_3,
    FlattenInputs=True)
brep_9 = Brep(brep_8)
demesh_3 = DeconstructMesh(Mesh=mesh_14)  # -> Vertices, Faces, Colours, Normals
mesh_16 = MeshBrep(
    Brep=brep_9,
    Settings={GridMaxCount=0, GridMinCount=16, JaggedSeams=False, MaxEdgeLength=0, MinEdgeLength=0.0001, MinTolerance=0, Refine=True, RefineAngle=0, RelativeTolerance=0.65, SimplePlanes=True, Tolerance=0})
medges_6 = MeshEdges(Mesh=mesh_14)  # -> NakedEdges, InteriorEdges, NonManifoldEdges
solver = Solver(GoalObjects=merge, Reset=Button(), Threshold=1e-15, Tolerance=0.01, On=Toggle(False))  # -> I, V, O
panel_8 = Panel(mesh_16)
solver_2 = Solver(GoalObjects=merge_2, Reset=Button(), Threshold=1e-15, Tolerance=0.01, On=Toggle(False))  # -> I, V, O
mesh_17 = Mesh(solver.O)
demesh_4 = DeconstructMesh(Mesh=mesh_15)  # -> Vertices, Faces, Colours, Normals
pt_3 = Point(demesh_3.Vertices)
len = Length(Curve=medges_6.InteriorEdges)
mesh_18 = Mesh(solver_2.O)
preview_2 = CustomPreview(
    Geometry=mesh_17,
    Shader={ambient=RGB(0, 0, 0), diffuse=RGB(255, 105, 180), emission=RGB(76, 32, 54), shine=0.5, specular=RGB(255, 255, 255), transparency=0})
pt_4 = Point(demesh_4.Vertices)
avr = Average(Input=len)
crv = Curve([medges_6.NakedEdges, medges_6.InteriorEdges])
preview_3 = CustomPreview(
    Geometry=mesh_18,
    Shader={ambient=RGB(0, 0, 0), diffuse=RGB(255, 105, 180), emission=RGB(76, 32, 54), shine=0.5, specular=RGB(255, 255, 255), transparency=0})
multiplication = Multiplication(A=avr, B=0.5)
Z_4 = UnitZ(Factor="-0.1")
spc_3 = SolidPointCollide(Points=pt_3, Solid=mesh_15, Interior=Toggle(False), Unidirectional=Toggle(False), Strength=1)
rigidbody_2 = RigidBody(Part=mesh_15, Points=demesh_4.Vertices, Strength=10)  # -> RigidBody, Planes
sc_2 = SphereCollide(Points=demesh_3.Vertices, Radius=multiplication, Strength=10)
smooth = Smooth(M=mesh_14, Strength=1)
floor_3 = Floor(Strength=1)
length_line_5 = LengthLine(Line=crv, Strength=10)
show_5 = Show(G=mesh_15)
show_6 = Show(G=mesh_14)
load_3 = Load(Point=demesh_4.Vertices, ForceVector=Z_4)
merge_3 = Merge(
    Data1=show_5,
    Data2=load_3,
    Data3=spc_3,
    Data4=sc_2,
    Data5=show_6,
    Data6=floor_3,
    Data7=length_line_5,
    Data8=rigidbody_2.RigidBody,
    Data9=smooth)  # -> flatten(Result)
rec = Rectangle({Plane=PlaneXY(-117, -101.5, 0), Size=Domain2(u=0..228, v=0..207)})
solver_3 = Solver(GoalObjects=merge_3, Reset=Button(), Threshold=1e-15, Tolerance=0.01, On=Toggle(False))  # -> I, V, O
boundary = BoundarySurfaces(Edges=rec)
data = Data(solver_3.O)
brep_10 = Brep(data)
mesh_19 = Mesh(data)
clean_4 = CleanTree(RemoveNulls=True, RemoveInvalid=True, RemoveEmpty=False, Tree=brep_10)
clean_5 = CleanTree(RemoveNulls=True, RemoveInvalid=True, RemoveEmpty=False, Tree=mesh_19)
merge_4 = Merge(Data1=boundary)
brep_11 = Brep(clean_4)
mesh_20 = Mesh(clean_5)
item = ListItem(List=mesh_20, Index=0, Wrap=True)  # -> Item, Item1
preview_4 = CustomPreview(Geometry=merge_4, Shader=ColourSwatch(SwatchColor=RGBA(255, 188, 255, 150)))
preview_5 = CustomPreview(Geometry=mesh_20, Shader=ColourSwatch(SwatchColor=RGBA(181, 255, 255, 150)))
mesh_21 = Mesh(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)
mesh_22 = Mesh()
medges_7 = MeshEdges(Mesh=mesh_22)  # -> NakedEdges, InteriorEdges, NonManifoldEdges
mesh_23 = Mesh(mesh_22)
Z_5 = UnitZ(Factor=Slider(0.5, range=0..1))
move_5 = Move(Geometry=mesh_23, Motion=Z_5)  # -> Geometry, Transform
wbloop = WeaverbirdsLoopSubdivision(MeshCurves=move_5.Geometry, Level=Slider(3, range=0..10), SmoothNakedEdges=1)
preview_6 = CustomPreview(
    Geometry=move_5.Geometry,
    Shader={ambient=RGB(0, 0, 0), diffuse=RGB(255, 105, 180), emission=RGB(76, 32, 54), shine=0.5, specular=RGB(255, 255, 255), transparency=0})
mesh_24 = Mesh(wbloop)
medges_8 = MeshEdges(Mesh=mesh_24)  # -> NakedEdges, InteriorEdges, NonManifoldEdges
medges_9 = MeshEdges(Mesh=mesh_24)  # -> NakedEdges, InteriorEdges, NonManifoldEdges
viewer = ParamViewer(medges_9.NakedEdges)
crv_2 = Curve(medges_9.NakedEdges)
join = JoinCurves(Curves=medges_9.NakedEdges, Preserve=False)
cp = ControlPoints(Curve=join)  # -> Points, Weights, Knots
viewer_2 = ParamViewer(cp.Points)
duppt = RemoveDuplicatePts(Points=cp.Points, Tolerance=0.01)
multiplication_2 = Multiplication(A=Slider(10, range=0..10), B=Slider(3.97, range=1..4))
viewer_3 = ParamViewer(duppt)
sequence = Sequence(Frames=Slider(10, range=0..10))
num = Number(Slider(4, range=0..300))
meshmachine = MeshMachine(
    Geometry=mesh_24,
    Length=num,
    FixVertices=duppt,
    Flip=1,
    PullStrength=0.8,
    CurvatureAdaptivity=0,
    BoundaryScale=1,
    BoundaryDistance=5,
    Exponent=2,
    Background=0.5,
    Iterations=Slider(1, range=0..10),
    Reset=sequence)
pmesh = PlanktonMesh(flatten(meshmachine))
rev = ReverseList(List=pmesh)
viewer_4 = ParamViewer(pmesh)
panel_9 = Panel(pmesh)
item_2 = ListItem(List=rev, Index=0, Wrap=True)
mesh_25 = Mesh(item_2)
medges_10 = MeshEdges(Mesh=mesh_25)  # -> NakedEdges, InteriorEdges, NonManifoldEdges
panel_10 = Panel(mesh_25)
number_slider_7 = Slider(0.8, range=0..1)  # disabled
demesh_5 = DeconstructMesh(Mesh=mesh_25)  # -> Vertices, Faces, Colours, Normals; disabled
lng = ListLength(List=demesh_5.Faces)  # disabled
multiplication_3 = Multiplication(A=lng, B=number_slider_7)  # disabled
toggle = BooleanToggle(False)  # disabled
toggle_2 = BooleanToggle(False)  # disabled
int = Integer(multiplication_3)  # disabled
python = PythonScript(x=mesh_25, y=int, z=toggle, u=toggle_2)  # -> out, a, b, c, d; inputs x: Mesh, y: Int32, z: Boolean, u: Boolean; disabled
# ---------- python: Python ----------
import rhinoscriptsyntax as rs
import Rhino
import scriptcontext as sc

a = x
b = y

c = Rhino.Geometry.Mesh.Reduce(x,y,z,10,u)
d = rs.MeshFaceCount(x)
# ---------- end python ----------
panel_11 = Panel(python.a)
panel_12 = Panel(python.b)
panel_13 = Panel(python.c)
panel_14 = Panel(python.d)

# ==== cluster MeshCorners: Finds the corners of the boundary of a mesh
M = ClusterInput()
medges = MeshEdges(Mesh=M)  # -> NakedEdges, InteriorEdges, NonManifoldEdges
join = JoinCurves(Curves=medges.NakedEdges, Preserve=False)
explode = Explode(Curve=join, Recursive=True)  # -> simplify(Segments), Vertices
shift = ShiftList(List=explode.Segments, Shift=1, Wrap=True)  # -> simplify(List)
end = EndPoints(Curve=explode.Segments)  # -> Start, End
angle = Angle(VectorA=explode.Segments, VectorB=shift)  # -> Angle, Reflex
A = ClusterInput()
smaller = SmallerThan(FirstNumber=A, SecondNumber=angle.Angle)  # -> SmallerThan, OrEqualTo
cull = CullPattern(List=end.End, CullPattern=smaller.SmallerThan)  # -> flatten(List)
L = ClusterOutput(cull)
