# Grasshopper definition Collision-Mesh-Solid-MeshMachine-5-mov.gh (Grasshopper 0.9.76)
# plug-ins: MeshEdit Components, Python Interpreter, Kangaroo Components, PlanktonGh, Weaverbird, Kangaroo2 Components

number_slider = Slider(1.05, range=0..10)
mesh = Mesh(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)

# ---- group: 1st Result
mesh_2 = Mesh(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)

# ---- group: ob
mesh_3 = Mesh(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)

# ---- group: bunny
brep = Brep(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)

# ---- group: goat
brep_2 = Brep(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)

# ---- group: teapot
brep_3 = Brep(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)

# ---- group: bunny
brep_4 = Brep(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)

# ----
area = MeshArea(Mesh=mesh_2)  # -> Area, Centroid
panel = Panel("0,10,0")
number_slider_2 = Slider(30, range=0..100)
panel_2 = Panel(mesh_3)

# ---- group: cloth
brep_5 = Brep(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)

# ---- group: Cylinder
brep_6 = Brep(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)

# ----
scale_nu = ScaleNU(Geometry=mesh_2, Plane=area.Centroid, ScaleX=number_slider, ScaleY=number_slider, ScaleZ=1)  # -> Geometry, Transform
move = Move(Geometry=brep_4, Motion="60,10,0")  # -> Geometry, Transform
number_slider_3 = Slider(48, range=0..100)
number_slider_4 = Slider(24, range=0..100)
move_2 = Move(Geometry=mesh, Motion="70,60, 95")  # -> Geometry, Transform
xy = XYPlane(Origin=Point(0, 0, 0))
rectangle = Rectangle(Plane=PlaneXY(0, 0, 0), XSize="-15 to 35", YSize="-15 to 35", Radius=0)  # -> Rectangle, Length
mesh_4 = MeshBrep(
    Brep=move.Geometry,
    Settings={GridMaxCount=0, GridMinCount=16, JaggedSeams=False, MaxEdgeLength=0, MinEdgeLength=0.0001, MinTolerance=0, Refine=True, RefineAngle=0, RelativeTolerance=0.65, SimplePlanes=True, Tolerance=0})
Z = UnitZ(Factor=Slider(20, range=0..20))
mirror = Mirror(Geometry=scale_nu.Geometry, Plane=xy)  # -> Geometry, Transform
box = CenterBox(Base=PlaneXY(0, 0, 0), X=number_slider_2, Y=number_slider_2, Z=Slider(5, range=0..10))
preview = CustomPreview(
    Geometry=brep_5,
    Shader={ambient=RGB(0, 0, 0), diffuse=RGB(255, 105, 180), emission=RGB(76, 32, 54), shine=0.5, specular=RGB(255, 255, 255), transparency=0})
mesh_5 = Mesh(mesh_4)
move_3 = Move(Geometry=mirror.Geometry, Motion="-50, -8.5, 95")  # -> Geometry, Transform
mbox = MeshBox(Base=box, XCount=10, YCount=10, ZCount=10)
wbloop = WeaverbirdsLoopSubdivision(MeshCurves=move_2.Geometry, Level=1, SmoothNakedEdges=1)
sdivide = DivideSurface(Surface=brep_5, UCount=number_slider_3, VCount=number_slider_4)  # -> flatten(Points), Normals, Parameters
move_4 = Move(Geometry=rectangle.Rectangle, Motion=Z)  # -> Geometry, Transform
W = WidthCount(30)
addition = Addition(A=number_slider_3, B=1)
addition_2 = Addition(A=number_slider_4, B=1)
move_5 = Move(Geometry=mbox, Motion="0,0,80")  # -> Geometry, Transform
mplane = MeshPlane(Boundary=move_4.Geometry, WidthCount=W, HeightCount=W)  # -> Mesh, Area
frompoints = MeshFromPoints(Points=sdivide.Points, UDirection=addition, VDirection=addition_2)
panel_3 = Panel(move_3.Geometry)
panel_4 = Panel(move_5.Geometry)

# ---- group: Chair-Boxes
brep_7 = Brep([<brep referenced from the Rhino model> x3])

# ---- group: torus
brep_8 = Brep(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)

# ---- group: Box
brep_9 = Brep(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)

# ---- group: T
brep_10 = Brep(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)

# ---- group: Chair-Box
brep_11 = Brep(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)

# ----
brep_12 = Brep(brep_7)
mesh_6 = MeshBrep(
    Brep=brep_12,
    Settings={GridMaxCount=0, GridMinCount=16, JaggedSeams=False, MaxEdgeLength=0, MinEdgeLength=0.0001, MinTolerance=0, Refine=True, RefineAngle=0, RelativeTolerance=0.65, SimplePlanes=True, Tolerance=0})
panel_5 = Panel(mesh_6)
rec = Rectangle({Plane=PlaneXY(-258.9456531, -288.3363841, 0), Size=Domain2(u=0..552.7765055, v=0..581.1150855)})
boundary = BoundarySurfaces(Edges=rec)
panel_6 = Panel("-0.1")
Z_2 = UnitZ(Factor="-0.075")
floor = Floor(Strength=1)
python = PythonScript(x=Toggle(True), y="0")  # -> out, a
# ---------- python: Python ----------
from datetime import datetime

if (x - True):
    a = datetime.now().strftime("%S")
# ---------- end python ----------
random = Random(Range="-30 to 30", Number=1, Seed=python.a)
random_2 = Random(Range="-30 to 30", Number=1, Seed=random)
neg = Negative(Value=random)
neg_2 = Negative(Value=random_2)
dom = ConstructDomain(DomainStart=neg, DomainEnd=random)
dom_2 = ConstructDomain(DomainStart=neg_2, DomainEnd=random_2)
vec = VectorXYZ(XComponent=dom, YComponent=dom_2, ZComponent=0)  # -> Vector, Length
move_6 = Move(Geometry=move_2.Geometry, Motion=vec.Vector)  # -> Geometry, Transform
clean = CombineClean(Meshes=move_6.Geometry)
medges = MeshEdges(Mesh=clean)  # -> NakedEdges, InteriorEdges, NonManifoldEdges
mesh_7 = Mesh(clean)
mesh_8 = Mesh(mesh_7)
demesh = DeconstructMesh(Mesh=mesh_8)  # -> Vertices, Faces, Colours, Normals
medges_2 = MeshEdges(Mesh=mesh_8)  # -> NakedEdges, InteriorEdges, NonManifoldEdges
len = Length(Curve=medges_2.InteriorEdges)
avr = Average(Input=len)
multiplication = Multiplication(A=avr, B=0.5)
crv = Curve([medges_2.NakedEdges, medges_2.InteriorEdges])
sc = SphereCollide(Points=demesh.Vertices, Radius=multiplication, Strength=10)
smooth = Smooth(M=mesh_8, Strength=1)
length_line = LengthLine(Line=crv, Strength=10)
spc = SolidPointCollide(Points=demesh.Vertices, Solid=mesh_6, Interior=Toggle(False), Unidirectional="True", Strength=Slider(10, range=0..1000))
load = Load(Point=demesh.Vertices, ForceVector=Z_2)
show = Show(G=mesh_8)
merge = Merge(Data1=show, Data2=smooth, Data3=floor, Data4=length_line, Data5=spc, Data6=load, Data7=sc)
panel_7 = Panel(vec.Vector)
solver = Solver(GoalObjects=merge, Reset=Button(), Threshold=1e-15, Tolerance=0.01, On=Toggle(False))  # -> I, V, O
panel_8 = Panel(solver.I)
panel_9 = Panel(python.a)
data = Data(solver.O)
brep_13 = Brep(data)
mesh_9 = Mesh(data)
clean_2 = CleanTree(RemoveNulls=True, RemoveInvalid=True, RemoveEmpty=False, Tree=brep_13)
clean_3 = CleanTree(RemoveNulls=True, RemoveInvalid=True, RemoveEmpty=False, Tree=mesh_9)
merge_2 = Merge(Data1=brep_12, Data2=boundary)
mesh_10 = Mesh(clean_3)
preview_2 = CustomPreview(Geometry=merge_2, Shader=ColourSwatch(SwatchColor=RGBA(255, 188, 255, 150)))
meshtonurb = MeshToNurb(m=mesh_10)  # -> out, a
# ---------- meshtonurb: Python ----------
import rhinoscriptsyntax as rs

a = rs.MeshToNurb(m)
# ---------- end meshtonurb ----------
preview_3 = CustomPreview(Geometry=mesh_10, Shader=ColourSwatch(SwatchColor=RGBA(154, 247, 255, 179)))

# ---- group: 2nd Result
mesh_11 = Mesh(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)

# ----
panel_10 = Panel(mesh_10)
panel_11 = Panel(meshtonurb.a)
mesh_12 = Mesh(mesh_11)
medges_3 = MeshEdges(Mesh=mesh_12)  # -> NakedEdges, InteriorEdges, NonManifoldEdges
msphereex = MeshSphereEx(Base=PlaneXY(0, 0, 0), Radius=Slider(25, range=0..100), Count=5)
mesh_13 = Mesh(msphereex)
Z_3 = UnitZ(Factor=Slider(0.5, range=0..1))
move_7 = Move(Geometry=mesh_13, Motion=Z_3)  # -> Geometry, Transform
preview_4 = CustomPreview(
    Geometry=move_7.Geometry,
    Shader={ambient=RGB(0, 0, 0), diffuse=RGB(255, 105, 180), emission=RGB(76, 32, 54), shine=0.5, specular=RGB(255, 255, 255), transparency=0})
mesh_14 = Mesh(move_7.Geometry)
mesh_15 = Mesh(move_7.Geometry)
medges_4 = MeshEdges(Mesh=mesh_14)  # -> NakedEdges, InteriorEdges, NonManifoldEdges
medges_5 = MeshEdges(Mesh=mesh_15)  # -> NakedEdges, InteriorEdges, NonManifoldEdges; disabled
number_slider_5 = Slider(3.97, range=1..4)  # disabled
number_slider_6 = Slider(10, range=0..10)  # disabled
viewer = ParamViewer(medges_5.NakedEdges)  # disabled
crv_2 = Curve(medges_5.NakedEdges)  # disabled
join = JoinCurves(Curves=medges_5.NakedEdges, Preserve=False)  # disabled
number_slider_7 = Slider(10, range=0..10)  # disabled
cp = ControlPoints(Curve=join)  # -> Points, Weights, Knots; disabled
viewer_2 = ParamViewer(cp.Points)  # disabled
number_slider_8 = Slider(1, range=0..10)  # disabled
number_slider_9 = Slider(5, range=0..300)  # disabled
duppt = RemoveDuplicatePts(Points=cp.Points, Tolerance=0.01)  # disabled
multiplication_2 = Multiplication(A=number_slider_6, B=number_slider_5)  # disabled
viewer_3 = ParamViewer(duppt)  # disabled
sequence = Sequence(Frames=number_slider_7)  # disabled
num = Number(number_slider_9)  # disabled
meshmachine = MeshMachine(
    Geometry=mesh_15,
    Length=num,
    FixVertices=duppt,
    Flip=1,
    PullStrength=0.8,
    CurvatureAdaptivity=0,
    BoundaryScale=1,
    BoundaryDistance=5,
    Exponent=2,
    Background=0.5,
    Iterations=number_slider_8,
    Reset=sequence)  # disabled
pmesh = PlanktonMesh(flatten(meshmachine))  # disabled
rev = ReverseList(List=pmesh)  # disabled
viewer_4 = ParamViewer(pmesh)  # disabled
panel_12 = Panel(pmesh)  # disabled
item = ListItem(List=rev, Index=0, Wrap=True)
mesh_16 = Mesh(item)
medges_6 = MeshEdges(Mesh=mesh_16)  # -> NakedEdges, InteriorEdges, NonManifoldEdges
panel_13 = Panel(mesh_16)
number_slider_10 = Slider(0.8, range=0..1)  # disabled
demesh_2 = DeconstructMesh(Mesh=mesh_16)  # -> Vertices, Faces, Colours, Normals; disabled
lng = ListLength(List=demesh_2.Faces)  # disabled
multiplication_3 = Multiplication(A=lng, B=number_slider_10)  # disabled
toggle = BooleanToggle(False)  # disabled
toggle_2 = BooleanToggle(False)  # disabled
int = Integer(multiplication_3)  # disabled
python_2 = PythonScript(x=mesh_16, y=int, z=toggle, u=toggle_2)  # -> out, a, b, c, d; inputs x: Mesh, y: Int32, z: Boolean, u: Boolean; disabled
# ---------- python_2: Python ----------
import rhinoscriptsyntax as rs
import Rhino
import scriptcontext as sc

a = x
b = y

c = Rhino.Geometry.Mesh.Reduce(x,y,z,10,u)
d = rs.MeshFaceCount(x)
# ---------- end python_2 ----------
panel_14 = Panel(python_2.a)
panel_15 = Panel(python_2.b)
panel_16 = Panel(python_2.c)
panel_17 = Panel(python_2.d)
