# Grasshopper definition Collision-Mesh-Solid-MeshMachine-5-mov.ghx (Grasshopper 0.9.76)
# plug-ins: MeshEdit Components, Python Interpreter, Kangaroo Components, PlanktonGh, Weaverbird, Kangaroo2 Components

# ---- group: center
mesh = Mesh(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)

# ---- group: left
mesh_2 = Mesh(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)

# ----
number_slider = Slider(1.15, range=0..10)
area = Area(Geometry=mesh)  # -> Area, Centroid
rotate = Rotate(Geometry=mesh, Angle="0.25*pi", Plane=area.Centroid)  # -> Geometry, Transform
number_slider_2 = Slider(1.05, range=0..10)

# ---- group: 1st Result
mesh_3 = Mesh(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)

# ---- group: ob
mesh_4 = Mesh(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)

# ---- group: bunny
brep = Brep(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)

# ---- group: goat
brep_2 = Brep(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)

# ---- group: teapot
brep_3 = Brep(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)

# ----
panel = Panel("-15 to 35")  # disabled

# ---- group: bunny
brep_4 = Brep(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)

# ----
area_2 = Area(Geometry=mesh_2)  # -> Area, Centroid
number_slider_3 = Slider(30, range=0..100)  # disabled
number_slider_4 = Slider(5, range=0..10)  # disabled
number_slider_5 = Slider(20, range=0..20)  # disabled

# ---- group: cloth
brep_5 = Brep(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)  # disabled

# ---- group: Cylinder
brep_6 = Brep(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)  # disabled

# ----
area_3 = MeshArea(Mesh=mesh_3)  # -> Area, Centroid
number_slider_6 = Slider(48, range=0..100)  # disabled
number_slider_7 = Slider(24, range=0..100)  # disabled
panel_2 = Panel("0,10,0")
scale = Scale(Geometry=mesh_2, Center=area_2.Centroid, Factor=number_slider)  # -> Geometry, Transform
scale_2 = Scale(Geometry=rotate.Geometry, Center=area.Centroid, Factor=number_slider)  # -> Geometry, Transform
panel_3 = Panel(mesh_4)
scale_nu = ScaleNU(Geometry=mesh_3, Plane=area_3.Centroid, ScaleX=number_slider_2, ScaleY=number_slider_2, ScaleZ=1)  # -> Geometry, Transform
rectangle = Rectangle(Plane=PlaneXY(0, 0, 0), XSize=panel, YSize=panel, Radius=0)  # -> Rectangle, Length; disabled
move = Move(Geometry=brep_4, Motion="60,10,0")  # -> Geometry, Transform
Z = UnitZ(Factor=number_slider_5)  # disabled
box = CenterBox(Base=PlaneXY(0, 0, 0), X=number_slider_3, Y=number_slider_3, Z=number_slider_4)  # disabled
move_2 = Move(Geometry=scale_2.Geometry, Motion="0, 0, 20")  # -> Geometry, Transform
preview = CustomPreview(
    Geometry=brep_5,
    Shader={ambient=RGB(0, 0, 0), diffuse=RGB(255, 105, 180), emission=RGB(76, 32, 54), shine=0.5, specular=RGB(255, 255, 255), transparency=0})  # disabled
panel_4 = Panel("0,0,80")  # disabled
xy = XYPlane(Origin=Point(0, 0, 0))
mesh_5 = MeshBrep(
    Brep=move.Geometry,
    Settings={GridMaxCount=0, GridMinCount=16, JaggedSeams=False, MaxEdgeLength=0, MinEdgeLength=0.0001, MinTolerance=0, Refine=True, RefineAngle=0, RelativeTolerance=0.65, SimplePlanes=True, Tolerance=0})
mirror = Mirror(Geometry=scale_nu.Geometry, Plane=xy)  # -> Geometry, Transform
mbox = MeshBox(Base=box, XCount=10, YCount=10, ZCount=10)  # disabled
sdivide = DivideSurface(Surface=brep_5, UCount=number_slider_6, VCount=number_slider_7)  # -> flatten(Points), Normals, Parameters; disabled
merge = Merge(Data1=scale.Geometry, Data2=move_2.Geometry)
move_3 = Move(Geometry=rectangle.Rectangle, Motion=Z)  # -> Geometry, Transform; disabled
W = WidthCount(30)  # disabled
addition = Addition(A=number_slider_6, B=1)  # disabled
addition_2 = Addition(A=number_slider_7, B=1)  # disabled
mesh_6 = Mesh(mesh_5)
move_4 = Move(Geometry=mbox, Motion=panel_4)  # -> Geometry, Transform; disabled
move_5 = Move(Geometry=mirror.Geometry, Motion="-50, -8.5, 95")  # -> Geometry, Transform
mplane = MeshPlane(Boundary=move_3.Geometry, WidthCount=W, HeightCount=W)  # -> Mesh, Area; disabled
frompoints = MeshFromPoints(Points=sdivide.Points, UDirection=addition, VDirection=addition_2)  # disabled
panel_5 = Panel(move_4.Geometry)  # disabled
move_6 = Move(Geometry=merge, Motion="0,0, -20")  # -> Geometry, Transform
panel_6 = Panel(move_5.Geometry)
panel_7 = Panel(move_6.Geometry)
mesh_7 = Mesh(move_6.Geometry)
wbloop = WeaverbirdsLoopSubdivision(MeshCurves=move_6.Geometry, Level=1, SmoothNakedEdges=1)  # -> flatten(OutputMeshCurves)
panel_8 = Panel(wbloop)
clean = CombineClean(Meshes=mesh_7)
medges = MeshEdges(Mesh=clean)  # -> NakedEdges, InteriorEdges, NonManifoldEdges
mesh_8 = Mesh(clean)

# ---- group: Chair-Boxes
brep_7 = Brep([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])

# ---- group: torus
brep_8 = Brep(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)

# ---- group: Box
brep_9 = Brep(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)

# ---- group: T
brep_10 = Brep(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)

# ---- group: Chair-Box
brep_11 = Brep(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)

# ----
mesh_9 = Mesh(mesh_8)
brep_12 = Brep(brep_7)
mesh_10 = MeshBrep(
    Brep=brep_12,
    Settings={GridMaxCount=0, GridMinCount=16, JaggedSeams=False, MaxEdgeLength=0, MinEdgeLength=0.0001, MinTolerance=0, Refine=True, RefineAngle=0, RelativeTolerance=0.65, SimplePlanes=True, Tolerance=0})
demesh = DeconstructMesh(Mesh=mesh_9)  # -> Vertices, Faces, Colours, Normals
medges_2 = MeshEdges(Mesh=mesh_9)  # -> NakedEdges, InteriorEdges, NonManifoldEdges
len = Length(Curve=medges_2.InteriorEdges)
panel_9 = Panel(mesh_10)
rec = Rectangle({Plane=PlaneXY(-157.6854766, -254.5054784, 0), Size=Domain2(u=0..548.2306871, v=0..568.3432922)})
avr = Average(Input=len)
multiplication = Multiplication(A=avr, B=0.5)
boundary = BoundarySurfaces(Edges=rec)
panel_10 = Panel("-0.1")
Z_2 = UnitZ(Factor="-0.04")
crv = Curve([medges_2.NakedEdges, medges_2.InteriorEdges])
sc = SphereCollide(Points=demesh.Vertices, Radius=multiplication, Strength=10)
smooth = Smooth(M=mesh_9, Strength=1)
floor = Floor(Strength=1)
length_line = LengthLine(Line=crv, Strength=10)
spc = SolidPointCollide(
    Points=demesh.Vertices,
    Solid=mesh_10,
    Interior=Toggle(False),
    Unidirectional="True",
    Strength=Slider(1000, range=0..1000))
load = Load(Point=demesh.Vertices, ForceVector=Z_2)
show = Show(G=mesh_9)
merge_2 = Merge(Data1=show, Data2=smooth, Data3=floor, Data4=length_line, Data5=spc, Data6=load, Data7=sc)
solver = Solver(GoalObjects=merge_2, Reset=Button(), Threshold=1e-15, Tolerance=0.01, On=Toggle(False))  # -> I, V, O
panel_11 = Panel(solver.I)
data = Data(solver.O)
brep_13 = Brep(data)
mesh_11 = Mesh(data)
clean_2 = CleanTree(RemoveNulls=True, RemoveInvalid=True, RemoveEmpty=False, Tree=brep_13)
clean_3 = CleanTree(RemoveNulls=True, RemoveInvalid=True, RemoveEmpty=False, Tree=mesh_11)
merge_3 = Merge(Data1=brep_12)
mesh_12 = Mesh(clean_3)
wbblur = WeaverbirdsBlurMesh(MeshCurves=mesh_12, Level=Slider(2, range=0..10), Thin=1)
wbcatmullclark = WeaverbirdsCatmullClarkSubdivision(MeshCurves=wbblur, Level=1, SmoothNakedEdges=1)
meshtonurb = MeshToNurb(m=mesh_12)  # -> out, a
# ---------- meshtonurb: Python ----------
import rhinoscriptsyntax as rs

a = rs.MeshToNurb(m)
# ---------- end meshtonurb ----------
preview_2 = CustomPreview(Geometry=wbblur, Shader=ColourSwatch(SwatchColor=RGBA(154, 247, 255, 179)))
panel_12 = Panel(mesh_12)
panel_13 = Panel(meshtonurb.a)
preview_3 = CustomPreview(Geometry=merge_3, Shader=ColourSwatch(SwatchColor=RGBA(255, 188, 255, 150)))

# ---- group: 2nd Result
mesh_13 = Mesh(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)

# ----
mesh_14 = Mesh(mesh_13)
medges_3 = MeshEdges(Mesh=mesh_14)  # -> NakedEdges, InteriorEdges, NonManifoldEdges
msphereex = MeshSphereEx(Base=PlaneXY(0, 0, 0), Radius=Slider(25, range=0..100), Count=5)
mesh_15 = Mesh(msphereex)
Z_3 = UnitZ(Factor=Slider(0.5, range=0..1))  # disabled
move_7 = Move(Geometry=mesh_15, Motion=Z_3)  # -> Geometry, Transform; disabled
preview_4 = CustomPreview(
    Geometry=move_7.Geometry,
    Shader={ambient=RGB(0, 0, 0), diffuse=RGB(255, 105, 180), emission=RGB(76, 32, 54), shine=0.5, specular=RGB(255, 255, 255), transparency=0})  # disabled
mesh_16 = Mesh(move_7.Geometry)  # disabled
mesh_17 = Mesh(move_7.Geometry)  # disabled
medges_4 = MeshEdges(Mesh=mesh_16)  # -> NakedEdges, InteriorEdges, NonManifoldEdges; disabled
medges_5 = MeshEdges(Mesh=mesh_17)  # -> NakedEdges, InteriorEdges, NonManifoldEdges; disabled
number_slider_8 = Slider(3.97, range=1..4)  # disabled
number_slider_9 = Slider(10, range=0..10)  # disabled
viewer = ParamViewer(medges_5.NakedEdges)  # disabled
crv_2 = Curve(medges_5.NakedEdges)  # disabled
join = JoinCurves(Curves=medges_5.NakedEdges, Preserve=False)  # disabled
number_slider_10 = Slider(10, range=0..10)  # disabled
cp = ControlPoints(Curve=join)  # -> Points, Weights, Knots; disabled
viewer_2 = ParamViewer(cp.Points)  # disabled
number_slider_11 = Slider(1, range=0..10)  # disabled
number_slider_12 = Slider(5, range=0..300)  # disabled
duppt = RemoveDuplicatePts(Points=cp.Points, Tolerance=0.01)  # disabled
multiplication_2 = Multiplication(A=number_slider_9, B=number_slider_8)  # disabled
viewer_3 = ParamViewer(duppt)  # disabled
sequence = Sequence(Frames=number_slider_10)  # disabled
num = Number(number_slider_12)  # disabled
meshmachine = MeshMachine(
    Geometry=mesh_17,
    Length=num,
    FixVertices=duppt,
    Flip=1,
    PullStrength=0.8,
    CurvatureAdaptivity=0,
    BoundaryScale=1,
    BoundaryDistance=5,
    Exponent=2,
    Background=0.5,
    Iterations=number_slider_11,
    Reset=sequence)  # disabled
pmesh = PlanktonMesh(flatten(meshmachine))  # disabled
rev = ReverseList(List=pmesh)  # disabled
viewer_4 = ParamViewer(pmesh)  # disabled
panel_14 = Panel(pmesh)  # disabled
item = ListItem(List=rev, Index=0, Wrap=True)  # disabled
mesh_18 = Mesh(item)  # disabled
medges_6 = MeshEdges(Mesh=mesh_18)  # -> NakedEdges, InteriorEdges, NonManifoldEdges; disabled
panel_15 = Panel(mesh_18)  # disabled
number_slider_13 = Slider(0.8, range=0..1)  # disabled
demesh_2 = DeconstructMesh(Mesh=mesh_18)  # -> Vertices, Faces, Colours, Normals; disabled
lng = ListLength(List=demesh_2.Faces)  # disabled
multiplication_3 = Multiplication(A=lng, B=number_slider_13)  # disabled
toggle = BooleanToggle(False)  # disabled
toggle_2 = BooleanToggle(False)  # disabled
int = Integer(multiplication_3)  # disabled
python = PythonScript(x=mesh_18, y=int, z=toggle, u=toggle_2)  # -> out, a, b, c, d; inputs x: Mesh, y: Int32, z: Boolean, u: Boolean; disabled
# ---------- python: Python ----------
import rhinoscriptsyntax as rs
import Rhino
import scriptcontext as sc

a = x
b = y

c = Rhino.Geometry.Mesh.Reduce(x,y,z,10,u)
d = rs.MeshFaceCount(x)
# ---------- end python ----------
panel_16 = Panel(python.a)  # disabled
panel_17 = Panel(python.b)  # disabled
panel_18 = Panel(python.c)  # disabled
panel_19 = Panel(python.d)  # disabled
