# Grasshopper definition Collision-Mesh-Solid-MeshMachine-5.ghx (Grasshopper 0.9.76)
# plug-ins: MeshEdit Components, Python Interpreter, Kangaroo Components, PlanktonGh, Weaverbird, Kangaroo2 Components

number_slider = Slider(1.05, range=0..10)

# ---- group: 1st Result
mesh = Mesh(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)

# ---- group: ob
mesh_2 = Mesh(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)

# ---- group: bunny
brep = Brep(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)

# ---- group: goat
brep_2 = Brep(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)

# ---- group: teapot
brep_3 = Brep(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)

# ---- group: bunny
brep_4 = Brep(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)

# ----
area = MeshArea(Mesh=mesh)  # -> Area, Centroid
panel = Panel("0,10,0")
number_slider_2 = Slider(30, range=0..100)
panel_2 = Panel(mesh_2)

# ---- group: cloth
brep_5 = Brep(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)

# ---- group: Cylinder
brep_6 = Brep(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)

# ----
scale_nu = ScaleNU(Geometry=mesh, Plane=area.Centroid, ScaleX=number_slider, ScaleY=number_slider, ScaleZ=1)  # -> Geometry, Transform
move = Move(Geometry=brep_4, Motion="60,10,0")  # -> Geometry, Transform
number_slider_3 = Slider(48, range=0..100)
number_slider_4 = Slider(24, range=0..100)
xy = XYPlane(Origin=Point(0, 0, 0))
rectangle = Rectangle(Plane=PlaneXY(0, 0, 0), XSize="-15 to 35", YSize="-15 to 35", Radius=0)  # -> Rectangle, Length
mesh_3 = MeshBrep(
    Brep=move.Geometry,
    Settings={GridMaxCount=0, GridMinCount=16, JaggedSeams=False, MaxEdgeLength=0, MinEdgeLength=0.0001, MinTolerance=0, Refine=True, RefineAngle=0, RelativeTolerance=0.65, SimplePlanes=True, Tolerance=0})
Z = UnitZ(Factor=Slider(20, range=0..20))
mirror = Mirror(Geometry=scale_nu.Geometry, Plane=xy)  # -> Geometry, Transform
box = CenterBox(Base=PlaneXY(0, 0, 0), X=number_slider_2, Y=number_slider_2, Z=Slider(5, range=0..10))
preview = CustomPreview(
    Geometry=brep_5,
    Shader={ambient=RGB(0, 0, 0), diffuse=RGB(255, 105, 180), emission=RGB(76, 32, 54), shine=0.5, specular=RGB(255, 255, 255), transparency=0})
mesh_4 = Mesh(mesh_3)
move_2 = Move(Geometry=mirror.Geometry, Motion="-50, -8.5, 95")  # -> Geometry, Transform
mbox = MeshBox(Base=box, XCount=10, YCount=10, ZCount=10)
wbloop = WeaverbirdsLoopSubdivision(MeshCurves=move_2.Geometry, Level=1, SmoothNakedEdges=1)
sdivide = DivideSurface(Surface=brep_5, UCount=number_slider_3, VCount=number_slider_4)  # -> flatten(Points), Normals, Parameters
move_3 = Move(Geometry=rectangle.Rectangle, Motion=Z)  # -> Geometry, Transform
W = WidthCount(30)
addition = Addition(A=number_slider_3, B=1)
addition_2 = Addition(A=number_slider_4, B=1)
move_4 = Move(Geometry=mbox, Motion="0,0,80")  # -> Geometry, Transform
clean = CombineClean(Meshes=wbloop)
mplane = MeshPlane(Boundary=move_3.Geometry, WidthCount=W, HeightCount=W)  # -> Mesh, Area
frompoints = MeshFromPoints(Points=sdivide.Points, UDirection=addition, VDirection=addition_2)
panel_3 = Panel(move_2.Geometry)
panel_4 = Panel(move_4.Geometry)
medges = MeshEdges(Mesh=clean)  # -> NakedEdges, InteriorEdges, NonManifoldEdges
mesh_5 = Mesh(clean)

# ---- group: torus
brep_7 = Brep(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)

# ---- group: Box
brep_8 = Brep(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)

# ---- group: T
brep_9 = Brep(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)

# ---- group: Chair-Box
brep_10 = Brep(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)

# ----
mesh_6 = Mesh(mesh_5)
brep_11 = Brep(brep_10)
mesh_7 = MeshBrep(
    Brep=brep_11,
    Settings={GridMaxCount=0, GridMinCount=16, JaggedSeams=False, MaxEdgeLength=0, MinEdgeLength=0.0001, MinTolerance=0, Refine=True, RefineAngle=0, RelativeTolerance=0.65, SimplePlanes=True, Tolerance=0})
demesh = DeconstructMesh(Mesh=mesh_6)  # -> Vertices, Faces, Colours, Normals
medges_2 = MeshEdges(Mesh=mesh_6)  # -> NakedEdges, InteriorEdges, NonManifoldEdges
len = Length(Curve=medges_2.InteriorEdges)
panel_5 = Panel(mesh_7)
rec = Rectangle({Plane=PlaneXY(-117, -101.5, 0), Size=Domain2(u=0..228, v=0..207)})
avr = Average(Input=len)
multiplication = Multiplication(A=avr, B=0.5)
boundary = BoundarySurfaces(Edges=rec)
panel_6 = Panel("-0.1")
Z_2 = UnitZ(Factor="-0.04")
crv = Curve([medges_2.NakedEdges, medges_2.InteriorEdges])
sc = SphereCollide(Points=demesh.Vertices, Radius=multiplication, Strength=10)
smooth = Smooth(M=mesh_6, Strength=1)
floor = Floor(Strength=1)
length_line = LengthLine(Line=crv, Strength=10)
spc = SolidPointCollide(Points=demesh.Vertices, Solid=mesh_7, Interior=Toggle(False), Unidirectional="True", Strength=Slider(20, range=0..100))
load = Load(Point=demesh.Vertices, ForceVector=Z_2)
show = Show(G=mesh_6)
merge = Merge(Data1=show, Data2=smooth, Data3=floor, Data4=length_line, Data5=spc, Data6=load, Data7=sc)
solver = Solver(GoalObjects=merge, Reset=Button(), Threshold=1e-15, Tolerance=0.01, On=Toggle(False))  # -> I, V, O
data = Data(solver.O)
brep_12 = Brep(data)
mesh_8 = Mesh(data)
clean_2 = CleanTree(RemoveNulls=True, RemoveInvalid=True, RemoveEmpty=False, Tree=brep_12)
clean_3 = CleanTree(RemoveNulls=True, RemoveInvalid=True, RemoveEmpty=False, Tree=mesh_8)
merge_2 = Merge(Data1=brep_11, Data2=boundary)
mesh_9 = Mesh(clean_3)
preview_2 = CustomPreview(Geometry=merge_2, Shader=ColourSwatch(SwatchColor=RGBA(255, 188, 255, 150)))
meshtonurb = MeshToNurb(m=mesh_9)  # -> out, a
# ---------- meshtonurb: Python ----------
import rhinoscriptsyntax as rs

a = rs.MeshToNurb(m)
# ---------- end meshtonurb ----------
preview_3 = CustomPreview(Geometry=mesh_9, Shader=ColourSwatch(SwatchColor=RGB(154, 247, 255)))

# ---- group: 2nd Result
mesh_10 = Mesh(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)

# ----
panel_7 = Panel(mesh_9)
panel_8 = Panel(meshtonurb.a)
mesh_11 = Mesh(mesh_10)
medges_3 = MeshEdges(Mesh=mesh_11)  # -> NakedEdges, InteriorEdges, NonManifoldEdges
mesh_12 = Mesh(mesh_11)
Z_3 = UnitZ(Factor=Slider(0.5, range=0..1))
move_5 = Move(Geometry=mesh_12, Motion=Z_3)  # -> Geometry, Transform
preview_4 = CustomPreview(
    Geometry=move_5.Geometry,
    Shader={ambient=RGB(0, 0, 0), diffuse=RGB(255, 105, 180), emission=RGB(76, 32, 54), shine=0.5, specular=RGB(255, 255, 255), transparency=0})
mesh_13 = Mesh(move_5.Geometry)
mesh_14 = Mesh(move_5.Geometry)
medges_4 = MeshEdges(Mesh=mesh_13)  # -> NakedEdges, InteriorEdges, NonManifoldEdges
medges_5 = MeshEdges(Mesh=mesh_14)  # -> NakedEdges, InteriorEdges, NonManifoldEdges
viewer = ParamViewer(medges_5.NakedEdges)
crv_2 = Curve(medges_5.NakedEdges)
join = JoinCurves(Curves=medges_5.NakedEdges, Preserve=False)
cp = ControlPoints(Curve=join)  # -> Points, Weights, Knots
viewer_2 = ParamViewer(cp.Points)
duppt = RemoveDuplicatePts(Points=cp.Points, Tolerance=0.01)
multiplication_2 = Multiplication(A=Slider(10, range=0..10), B=Slider(3.97, range=1..4))
viewer_3 = ParamViewer(duppt)
sequence = Sequence(Frames=Slider(10, range=0..10))
num = Number(Slider(8, range=0..300))
meshmachine = MeshMachine(
    Geometry=mesh_14,
    Length=num,
    FixVertices=duppt,
    Flip=1,
    PullStrength=0.8,
    CurvatureAdaptivity=0,
    BoundaryScale=1,
    BoundaryDistance=5,
    Exponent=2,
    Background=0.5,
    Iterations=Slider(1, range=0..10),
    Reset=sequence)
pmesh = PlanktonMesh(flatten(meshmachine))
rev = ReverseList(List=pmesh)
viewer_4 = ParamViewer(pmesh)
panel_9 = Panel(pmesh)
item = ListItem(List=rev, Index=0, Wrap=True)
mesh_15 = Mesh(item)
medges_6 = MeshEdges(Mesh=mesh_15)  # -> NakedEdges, InteriorEdges, NonManifoldEdges
panel_10 = Panel(mesh_15)
number_slider_5 = Slider(0.8, range=0..1)  # disabled
demesh_2 = DeconstructMesh(Mesh=mesh_15)  # -> Vertices, Faces, Colours, Normals; disabled
lng = ListLength(List=demesh_2.Faces)  # disabled
multiplication_3 = Multiplication(A=lng, B=number_slider_5)  # disabled
toggle = BooleanToggle(False)  # disabled
toggle_2 = BooleanToggle(False)  # disabled
int = Integer(multiplication_3)  # disabled
python = PythonScript(x=mesh_15, y=int, z=toggle, u=toggle_2)  # -> out, a, b, c, d; inputs x: Mesh, y: Int32, z: Boolean, u: Boolean; disabled
# ---------- python: Python ----------
import rhinoscriptsyntax as rs
import Rhino
import scriptcontext as sc

a = x
b = y

c = Rhino.Geometry.Mesh.Reduce(x,y,z,10,u)
d = rs.MeshFaceCount(x)
# ---------- end python ----------
panel_11 = Panel(python.a)
panel_12 = Panel(python.b)
panel_13 = Panel(python.c)
panel_14 = Panel(python.d)
