# Grasshopper definition Collision-Mesh-Solid-MeshMachine-6.ghx (Grasshopper 0.9.76)
# plug-ins: MeshEdit Components, Python Interpreter, Kangaroo Components, PlanktonGh, Weaverbird, Kangaroo2 Components

number_slider = Slider(1.05, range=0..10)

# ---- group: 1st Result
mesh = Mesh(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)

# ---- group: ob
mesh_2 = Mesh(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)

# ---- group: bunny
brep = Brep(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)

# ---- group: goat
brep_2 = Brep(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)

# ---- group: teapot
brep_3 = Brep(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)

# ---- group: bunny
brep_4 = Brep(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)

# ----
area = MeshArea(Mesh=mesh)  # -> Area, Centroid
panel = Panel("0,10,0")
number_slider_2 = Slider(30, range=0..100)
panel_2 = Panel(mesh_2)

# ---- group: cloth
brep_5 = Brep(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)

# ---- group: Cylinder
brep_6 = Brep(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)

# ----
scale_nu = ScaleNU(Geometry=mesh, Plane=area.Centroid, ScaleX=number_slider, ScaleY=number_slider, ScaleZ=1)  # -> Geometry, Transform
move = Move(Geometry=brep_4, Motion="60,10,0")  # -> Geometry, Transform
number_slider_3 = Slider(48, range=0..100)
number_slider_4 = Slider(24, range=0..100)

# ---- group: Paperbag
mesh_3 = Mesh(<mesh referenced from the Rhino model>)

# ----
xy = XYPlane(Origin=Point(0, 0, 0))
rectangle = Rectangle(Plane=PlaneXY(0, 0, 0), XSize="-15 to 35", YSize="-15 to 35", Radius=0)  # -> Rectangle, Length
mesh_4 = MeshBrep(
    Brep=move.Geometry,
    Settings={GridMaxCount=0, GridMinCount=16, JaggedSeams=False, MaxEdgeLength=0, MinEdgeLength=0.0001, MinTolerance=0, Refine=True, RefineAngle=0, RelativeTolerance=0.65, SimplePlanes=True, Tolerance=0})
Z = UnitZ(Factor=Slider(20, range=0..20))
mirror = Mirror(Geometry=scale_nu.Geometry, Plane=xy)  # -> Geometry, Transform
box = CenterBox(Base=PlaneXY(0, 0, 0), X=number_slider_2, Y=number_slider_2, Z=Slider(5, range=0..10))
preview = CustomPreview(
    Geometry=brep_5,
    Shader={ambient=RGB(0, 0, 0), diffuse=RGB(255, 105, 180), emission=RGB(76, 32, 54), shine=0.5, specular=RGB(255, 255, 255), transparency=0})
refine = Refine(Mesh=mesh_3, Level=Slider(1, range=0..10))
mesh_5 = Mesh(mesh_4)
move_2 = Move(Geometry=mirror.Geometry, Motion="-50, -8.5, 95")  # -> Geometry, Transform
mbox = MeshBox(Base=box, XCount=10, YCount=10, ZCount=10)
wbloop = WeaverbirdsLoopSubdivision(MeshCurves=move_2.Geometry, Level=1, SmoothNakedEdges=1)
sdivide = DivideSurface(Surface=brep_5, UCount=number_slider_3, VCount=number_slider_4)  # -> flatten(Points), Normals, Parameters
move_3 = Move(Geometry=rectangle.Rectangle, Motion=Z)  # -> Geometry, Transform
W = WidthCount(30)
addition = Addition(A=number_slider_3, B=1)
addition_2 = Addition(A=number_slider_4, B=1)
move_4 = Move(Geometry=mbox, Motion="0,0,80")  # -> Geometry, Transform
panel_3 = Panel(mesh_3)
clean = CombineClean(Meshes=mesh_3)
mplane = MeshPlane(Boundary=move_3.Geometry, WidthCount=W, HeightCount=W)  # -> Mesh, Area
frompoints = MeshFromPoints(Points=sdivide.Points, UDirection=addition, VDirection=addition_2)
panel_4 = Panel(refine)
panel_5 = Panel(clean)
panel_6 = Panel(move_4.Geometry)
medges = MeshEdges(Mesh=clean)  # -> NakedEdges, InteriorEdges, NonManifoldEdges
mesh_6 = Mesh(<mesh referenced from the Rhino model>)
mesh_7 = Mesh(clean)

# ---- group: Chair-Box
brep_7 = Brep(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)

# ---- group: torus
brep_8 = Brep(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)

# ---- group: Box
brep_9 = Brep(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)

# ---- group: T
brep_10 = Brep(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)

# ---- group: cylinder-X2
brep_11 = Brep(<brep referenced from the Rhino model>)

# ---- group: cylinder
brep_12 = Brep(<brep referenced from the Rhino model>)

# ---- group: cylinder-X2
brep_13 = Brep(<brep referenced from the Rhino model>)

# ----
mesh_8 = Mesh(mesh_7)
brep_14 = Brep(brep_11)
mesh_9 = MeshBrep(
    Brep=brep_14,
    Settings={GridMaxCount=0, GridMinCount=16, JaggedSeams=False, MaxEdgeLength=0, MinEdgeLength=0.0001, MinTolerance=0, Refine=True, RefineAngle=0, RelativeTolerance=0.65, SimplePlanes=True, Tolerance=0})
demesh = DeconstructMesh(Mesh=mesh_8)  # -> Vertices, Faces, Colours, Normals
medges_2 = MeshEdges(Mesh=mesh_8)  # -> NakedEdges, InteriorEdges, NonManifoldEdges
len = Length(Curve=medges_2.InteriorEdges)
panel_7 = Panel(mesh_9)
rec = Rectangle({Plane=PlaneXY(-117, -101.5, 0), Size=Domain2(u=0..228, v=0..207)})
avr = Average(Input=len)
multiplication = Multiplication(A=avr, B=Slider(0.3, range=0..1))
boundary = BoundarySurfaces(Edges=rec)
panel_8 = Panel("-0.1")
Z_2 = UnitZ(Factor="-0.001")
crv = Curve([medges_2.NakedEdges, medges_2.InteriorEdges])
toggle = BooleanToggle(True)
pt = Point([Point(-39.95162201, 25.94544411, 5.512869358), Point(-25.3203125, 25.94544411, 5.512869358)])
sc = SphereCollide(Points=demesh.Vertices, Radius=multiplication, Strength=10)  # disabled
smooth = Smooth(M=mesh_8, Strength=1)
floor = Floor(Strength=1)
length_line = LengthLine(Line=crv, Strength=10)
spc = SolidPointCollide(Points=demesh.Vertices, Solid=mesh_9, Interior=Toggle(False), Unidirectional="True", Strength=Slider(20, range=0..100))
load = Load(Point=demesh.Vertices, ForceVector=Z_2)
show = Show(G=mesh_8)
anchorxyz = AnchorXYZ(Point=pt, X=toggle, Y=toggle, Z=False, Strength=Slider(3000, range=0..10000))
merge = Merge(Data1=show, Data2=smooth, Data3=floor, Data4=length_line, Data5=spc, Data6=load, Data7=sc, Data8=anchorxyz)
solver = Solver(GoalObjects=merge, Reset=Button(), Threshold=1e-15, Tolerance=0.01, On=Toggle(False))  # -> I, V, O
panel_9 = Panel(solver.V)
data = Data(solver.O)
brep_15 = Brep(data)
mesh_10 = Mesh(data)
clean_2 = CleanTree(RemoveNulls=True, RemoveInvalid=True, RemoveEmpty=False, Tree=brep_15)
clean_3 = CleanTree(RemoveNulls=True, RemoveInvalid=True, RemoveEmpty=False, Tree=mesh_10)
merge_2 = Merge(Data1=brep_14, Data2=boundary)
mesh_11 = Mesh(clean_3)
mesh_12 = Mesh(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)
mesh_13 = Mesh(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)
preview_2 = CustomPreview(Geometry=merge_2, Shader=ColourSwatch(SwatchColor=RGBA(255, 188, 255, 150)))
meshtonurb = MeshToNurb(m=mesh_11)  # -> out, a
# ---------- meshtonurb: Python ----------
import rhinoscriptsyntax as rs

a = rs.MeshToNurb(m)
# ---------- end meshtonurb ----------
medges_3 = MeshEdges(Mesh=mesh_11)  # -> NakedEdges, InteriorEdges, NonManifoldEdges
preview_3 = CustomPreview(Geometry=mesh_11, Shader=ColourSwatch(SwatchColor=RGB(154, 247, 255)))

# ---- group: 2nd Result
mesh_14 = Mesh(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)

# ----
panel_10 = Panel(mesh_11)
panel_11 = Panel(meshtonurb.a)
mesh_15 = Mesh(mesh_14)
medges_4 = MeshEdges(Mesh=mesh_15)  # -> NakedEdges, InteriorEdges, NonManifoldEdges
tri = Triangulate(Mesh=mesh_15)  # -> Mesh, Count
Z_3 = UnitZ(Factor=Slider(0.5, range=0..1))
mesh_16 = Mesh(tri.Mesh)
move_5 = Move(Geometry=mesh_16, Motion=Z_3)  # -> Geometry, Transform
wbloop_2 = WeaverbirdsLoopSubdivision(MeshCurves=mesh_15, Level=1, SmoothNakedEdges=1)
preview_4 = CustomPreview(
    Geometry=move_5.Geometry,
    Shader={ambient=RGB(0, 0, 0), diffuse=RGB(255, 105, 180), emission=RGB(76, 32, 54), shine=0.5, specular=RGB(255, 255, 255), transparency=0})
mesh_17 = Mesh(move_5.Geometry)
mesh_18 = Mesh(move_5.Geometry)
medges_5 = MeshEdges(Mesh=mesh_17)  # -> NakedEdges, InteriorEdges, NonManifoldEdges
medges_6 = MeshEdges(Mesh=mesh_18)  # -> NakedEdges, InteriorEdges, NonManifoldEdges
viewer = ParamViewer(medges_6.NakedEdges)
crv_2 = Curve(medges_6.NakedEdges)
join = JoinCurves(Curves=medges_6.NakedEdges, Preserve=False)
cp = ControlPoints(Curve=join)  # -> Points, Weights, Knots
viewer_2 = ParamViewer(cp.Points)
duppt = RemoveDuplicatePts(Points=cp.Points, Tolerance=0.01)
multiplication_2 = Multiplication(A=Slider(10, range=0..10), B=Slider(3.97, range=1..4))
viewer_3 = ParamViewer(duppt)
sequence = Sequence(Frames=Slider(10, range=0..10))
num = Number(Slider(1, range=0..300))
meshmachine = MeshMachine(
    Geometry=mesh_18,
    Length=num,
    FixVertices=duppt,
    Flip=1,
    PullStrength=0.8,
    CurvatureAdaptivity=0,
    BoundaryScale=1,
    BoundaryDistance=5,
    Exponent=2,
    Background=0.5,
    Iterations=Slider(1, range=0..10),
    Reset=sequence)
pmesh = PlanktonMesh(flatten(meshmachine))
rev = ReverseList(List=pmesh)
viewer_4 = ParamViewer(pmesh)
panel_12 = Panel(pmesh)
item = ListItem(List=rev, Index=0, Wrap=True)
mesh_19 = Mesh(item)
medges_7 = MeshEdges(Mesh=mesh_19)  # -> NakedEdges, InteriorEdges, NonManifoldEdges
panel_13 = Panel(mesh_19)
number_slider_5 = Slider(0.8, range=0..1)  # disabled
demesh_2 = DeconstructMesh(Mesh=mesh_19)  # -> Vertices, Faces, Colours, Normals; disabled
lng = ListLength(List=demesh_2.Faces)  # disabled
multiplication_3 = Multiplication(A=lng, B=number_slider_5)  # disabled
toggle_2 = BooleanToggle(False)  # disabled
toggle_3 = BooleanToggle(False)  # disabled
int = Integer(multiplication_3)  # disabled
python = PythonScript(x=mesh_19, y=int, z=toggle_2, u=toggle_3)  # -> out, a, b, c, d; inputs x: Mesh, y: Int32, z: Boolean, u: Boolean; disabled
# ---------- python: Python ----------
import rhinoscriptsyntax as rs
import Rhino
import scriptcontext as sc

a = x
b = y

c = Rhino.Geometry.Mesh.Reduce(x,y,z,10,u)
d = rs.MeshFaceCount(x)
# ---------- end python ----------
panel_14 = Panel(python.a)
panel_15 = Panel(python.b)
panel_16 = Panel(python.c)
panel_17 = Panel(python.d)
