# Grasshopper definition Collision-Mesh-Solid-MeshMachine-7.ghx (Grasshopper 0.9.76)
# plug-ins: MeshEdit Components, Python Interpreter, Kangaroo Components, PlanktonGh, Weaverbird, Kangaroo2 Components

number_slider = Slider(50, range=0..100)
neg = Negative(Value=number_slider)

# ---- group: cloth
brep = Brep(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)

# ---- group: Cylinder
brep_2 = Brep(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)

# ----
panel = Panel("-60 to 60")
number_slider_2 = Slider(48, range=0..100)
dom = ConstructDomain(DomainStart=neg, DomainEnd=number_slider)
number_slider_3 = Slider(24, range=0..100)
preview = CustomPreview(
    Geometry=brep,
    Shader={ambient=RGB(0, 0, 0), diffuse=RGB(255, 105, 180), emission=RGB(76, 32, 54), shine=0.5, specular=RGB(255, 255, 255), transparency=0})
number_slider_4 = Slider(20, range=0..20)
rectangle = Rectangle(Plane=PlaneXY(0, 0, 0), XSize=dom, YSize=dom, Radius=0)  # -> Rectangle, Length
sdivide = DivideSurface(Surface=brep, UCount=number_slider_2, VCount=number_slider_3)  # -> flatten(Points), Normals, Parameters
Z = UnitZ(Factor=Slider(70, range=0..100))
W = WidthCount(30)
move = Move(Geometry=rectangle.Rectangle, Motion=Z)  # -> Geometry, Transform
addition = Addition(A=number_slider_2, B=1)
addition_2 = Addition(A=number_slider_3, B=1)
mplane = MeshPlane(Boundary=move.Geometry, WidthCount=W, HeightCount=W)  # -> Mesh, Area
frompoints = MeshFromPoints(Points=sdivide.Points, UDirection=addition, VDirection=addition_2)
clean = CombineClean(Meshes=mplane.Mesh)
medges = MeshEdges(Mesh=clean)  # -> NakedEdges, InteriorEdges, NonManifoldEdges
triangulate = MeshTriangulate(Mesh=clean, ShortDiagonal=True)
clean_2 = CombineClean(Meshes=triangulate)

# ---- group: torus
brep_3 = Brep(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)

# ---- group: Box
brep_4 = Brep(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)

# ----
rectangle_2 = Rectangle(Plane=PlaneXY(0, 0, 0), XSize="-18 to 18", YSize="-18 to 18", Radius=0)  # -> Rectangle, Length

# ---- group: T
brep_5 = Brep(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)

# ----
mesh = Mesh(clean)
boundary = BoundarySurfaces(Edges=rectangle_2.Rectangle)
Z_2 = UnitZ(Factor=Slider(43, range=0..100))
brep_6 = Brep(brep_5)
extr = Extrude(Base=boundary, Direction=Z_2)
number_slider_5 = Slider(0.5, range=0..1)
number_slider_6 = Slider(0.25, range=0..1)
neg_2 = Negative(Value="1/6")
medges_2 = MeshEdges(Mesh=mesh)  # -> NakedEdges, InteriorEdges, NonManifoldEdges
pi = Pi(Factor="1/6")
demesh = DeconstructMesh(Mesh=mesh)  # -> Vertices, Faces, Colours, Normals
rec = Rectangle({Plane=PlaneXY(-79, -67, 0), Size=Domain2(u=0..152, v=0..138)})
len = Length(Curve=medges_2.InteriorEdges)
rotate = Rotate(Geometry=extr, Angle=pi, Plane=PlaneXY(0, 0, 0))  # -> Geometry, Transform
mesh_2 = MeshBrep(
    Brep=rotate.Geometry,
    Settings={GridMaxCount=0, GridMinCount=16, JaggedSeams=False, MaxEdgeLength=0, MinEdgeLength=0.0001, MinTolerance=0, Refine=True, RefineAngle=0, RelativeTolerance=0.65, SimplePlanes=True, Tolerance=0})
panel_2 = Panel(mesh_2)
avr = Average(Input=len)
boundary_2 = BoundarySurfaces(Edges=rec)
number_slider_7 = Slider(0.1, range=0.1..10)
crv = Curve([medges_2.NakedEdges, medges_2.InteriorEdges])
crv_2 = Curve(medges_2.InteriorEdges)
multiplication = Multiplication(A=avr, B=0.5)
len_2 = Length(Curve=crv)
neg_3 = Negative(Value=Slider(0.03, range=0..0.1))
Z_3 = UnitZ(Factor=neg_3)
angle = Angle(LineA=medges_2.InteriorEdges, LineB=medges_2.InteriorEdges, Strength=1)
sc = SphereCollide(Points=demesh.Vertices, Radius=multiplication, Strength=10)
smooth = Smooth(M=mesh, Strength=1)
floor = Floor(Strength=1)
length_line = LengthLine(Line=crv, Length=len_2, Strength=10)
spc = SolidPointCollide(Points=demesh.Vertices, Solid=mesh_2, Interior=Toggle(False), Unidirectional="True", Strength=Slider(100, range=0..100))
grab = Grab(On=True, Strength=1, Range=3)  # -> Grab, Anchors
load = Load(Point=demesh.Vertices, ForceVector=Z_3)
show = Show(G=mesh)
merge = Merge(Data1=show, Data2=smooth, Data3=floor, Data4=length_line, Data5=spc, Data6=load, Data7=sc, Data8=angle, Data9=grab.Grab)
solver = Solver(GoalObjects=merge, Reset=Button(), Threshold=1e-15, Tolerance=0.01, On=Toggle(False))  # -> I, V, O
panel_3 = Panel(solver.I)
data = Data(solver.O)
brep_7 = Brep(data)
mesh_3 = Mesh(data)
panel_4 = Panel("0,0,0.5")  # disabled
clean_3 = CleanTree(RemoveNulls=True, RemoveInvalid=True, RemoveEmpty=False, Tree=brep_7)
clean_4 = CleanTree(RemoveNulls=True, RemoveInvalid=True, RemoveEmpty=False, Tree=mesh_3)
merge_2 = Merge(Data1=brep_6, Data2=boundary_2)  # disabled
mesh_4 = Mesh(clean_4)
move_2 = Move(Geometry=mesh_4, Motion=panel_4)  # -> Geometry, Transform; disabled
preview_2 = CustomPreview(Geometry=merge_2, Shader=ColourSwatch(SwatchColor=RGBA(255, 188, 255, 150)))  # disabled
wbloop = WeaverbirdsLoopSubdivision(MeshCurves=mesh_4, Level=1, SmoothNakedEdges=1)  # disabled
mesh_5 = Mesh(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)  # disabled
mesh_6 = Mesh(mesh_5)  # disabled
preview_3 = CustomPreview(Geometry=wbloop, Shader=ColourSwatch(SwatchColor=RGBA(181, 255, 255, 150)))  # disabled
medges_3 = MeshEdges(Mesh=mesh_6)  # -> NakedEdges, InteriorEdges, NonManifoldEdges; disabled
mesh_7 = Mesh(mesh_6)  # disabled
medges_4 = MeshEdges(Mesh=mesh_7)  # -> NakedEdges, InteriorEdges, NonManifoldEdges; disabled
medges_5 = MeshEdges(Mesh=mesh_7)  # -> NakedEdges, InteriorEdges, NonManifoldEdges; disabled
number_slider_8 = Slider(3.97, range=1..4)  # disabled
number_slider_9 = Slider(10, range=0..10)  # disabled
viewer = ParamViewer(medges_5.NakedEdges)  # disabled
crv_3 = Curve(medges_5.NakedEdges)  # disabled
join = JoinCurves(Curves=medges_5.NakedEdges, Preserve=False)  # disabled
number_slider_10 = Slider(10, range=0..10)  # disabled
cp = ControlPoints(Curve=join)  # -> Points, Weights, Knots; disabled
viewer_2 = ParamViewer(cp.Points)  # disabled
number_slider_11 = Slider(1, range=0..10)  # disabled
number_slider_12 = Slider(5, range=0..300)  # disabled
duppt = RemoveDuplicatePts(Points=cp.Points, Tolerance=0.01)  # disabled
multiplication_2 = Multiplication(A=number_slider_9, B=number_slider_8)  # disabled
viewer_3 = ParamViewer(duppt)  # disabled
sequence = Sequence(Frames=number_slider_10)  # disabled
num = Number(number_slider_12)  # disabled
meshmachine = MeshMachine(
    Geometry=mesh_7,
    Length=num,
    FixVertices=duppt,
    Flip=1,
    PullStrength=0.8,
    CurvatureAdaptivity=0,
    BoundaryScale=1,
    BoundaryDistance=5,
    Exponent=2,
    Background=0.5,
    Iterations=number_slider_11,
    Reset=sequence)  # disabled
pmesh = PlanktonMesh(flatten(meshmachine))  # disabled
rev = ReverseList(List=pmesh)  # disabled
viewer_4 = ParamViewer(pmesh)  # disabled
panel_5 = Panel(pmesh)  # disabled
item = ListItem(List=rev, Index=0, Wrap=True)  # disabled
mesh_8 = Mesh(item)  # disabled
medges_6 = MeshEdges(Mesh=mesh_8)  # -> NakedEdges, InteriorEdges, NonManifoldEdges; disabled
panel_6 = Panel(mesh_8)  # disabled
number_slider_13 = Slider(0.8, range=0..1)  # disabled
demesh_2 = DeconstructMesh(Mesh=mesh_8)  # -> Vertices, Faces, Colours, Normals; disabled
lng = ListLength(List=demesh_2.Faces)  # disabled
multiplication_3 = Multiplication(A=lng, B=number_slider_13)  # disabled
toggle = BooleanToggle(False)  # disabled
toggle_2 = BooleanToggle(False)  # disabled
int = Integer(multiplication_3)  # disabled
python = PythonScript(x=mesh_8, y=int, z=toggle, u=toggle_2)  # -> out, a, b, c, d; inputs x: Mesh, y: Int32, z: Boolean, u: Boolean; disabled
# ---------- python: Python ----------
import rhinoscriptsyntax as rs
import Rhino
import scriptcontext as sc

a = x
b = y

c = Rhino.Geometry.Mesh.Reduce(x,y,z,10,u)
d = rs.MeshFaceCount(x)
# ---------- end python ----------
panel_7 = Panel(python.a)  # disabled
panel_8 = Panel(python.b)  # disabled
panel_9 = Panel(python.c)  # disabled
panel_10 = Panel(python.d)  # disabled
