# Grasshopper definition Collision-Multi-Radius-Spheres.ghx (Grasshopper 0.9.76)
# plug-ins: Kangaroo2 Components

pt = Point([Point(12, 4.39666275, 0), Point(4, 10.84189327, 0), Point(4, -3.527030482, 0), Point(24, 9.874074962, 0), Point(17, -3.831695062, 0)])
lng = ListLength(List=pt)
random = Random(Range="1 to 6", Number=lng, Seed=2)
grab = Grab(On=True, Strength=1, Range=3)  # -> Grab, Anchors
collider = Collider(Objects=pt, Radii=random, Strength=1)
merge = Merge(Data1=grab.Grab, Data2=collider)
solver = Solver(GoalObjects=merge, Reset=Button(), Threshold=1e-15, Tolerance=0.01, On=True)  # -> I, V, O
sph = Sphere(Base=solver.V, Radius=random)
msphere = MeshSphere(Base=solver.V, Radius=random, UCount=10, VCount=20)
