# Grasshopper definition Collision-Solid-X-Particle.ghx (Grasshopper 0.9.76)
# plug-ins: Kangaroo2 Components

R = Region({Plane=PlaneXY(-6, -7, 0.7377762218), X=Domain(0, 23), Y=Domain(0, 30), Z=Domain(0, 37.52444756)})
pop3d = Populate3D(Region=R, Count=400, Seed=1)
brep = Brep(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)
Z = UnitZ(Factor=-0.01)
R_2 = Radius(1)
preview = CustomPreview(Geometry=brep, Shader=ColourSwatch(SwatchColor=RGBA(158, 255, 255, 147)))
spc = SolidPointCollide(Points=pop3d, Solid=brep, Interior=False, Unidirectional=Toggle(True), Strength=1)
sc = SphereCollide(Points=pop3d, Radius=R_2, Strength=10)
load = Load(Point=pop3d, ForceVector=Z)
solver = Solver(GoalObjects=[sc, load, spc], Reset=Button(), Threshold=1e-15, Tolerance=0.01, On=Toggle(False))  # -> I, V, O
swatch = ColourSwatch(SwatchColor=RGB(255, 255, 255))
swatch_2 = ColourSwatch(SwatchColor=RGBA(255, 181, 255, 157))
sph = Sphere(Base=solver.V, Radius=R_2)  # disabled
cloud = CloudDisplay(Points=solver.V, Colours=swatch_2, Size=R_2, SpriteType=1)
preview_2 = CustomPreview(Geometry=sph, Shader=swatch_2)  # disabled
