# Grasshopper definition Curve-to-Balloon-2.ghx (Grasshopper 0.9.76)
# plug-ins: MeshEdit Components, Kangaroo Components, PlanktonGh, Weaverbird, Kangaroo2 Components

crv = Curve(<curve referenced from the Rhino model>)
crv_2 = Curve(<curve referenced from the Rhino model>)
crv_3 = Curve(<curve referenced from the Rhino model>)
crv_4 = Curve(<curve referenced from the Rhino model>)
pt = ConstructPoint(XCoordinate=0, YCoordinate=0, ZCoordinate=0)
merge = Merge(Data1=crv, Data2=crv_2, Data3=crv_3, Data4=crv_4)
number_slider = Slider(20, range=0..100)
divide = DivideCurve(Curve=merge, Count=Slider(30, range=0..100), Kinks=False)  # -> Points, Tangents, Parameters
polygon = Polygon(Plane=pt, Radius=Slider(100, range=0..100), Segments=Slider(7, range=0..10), FilletRadius=0)  # -> Polygon, Length
boundary = BoundarySurfaces(Edges=merge)
intcrv = Interpolate(Vertices=divide.Points, Degree=3, Periodic=False, KnotStyle=1)  # -> flatten(Curve), Length, Domain
explode = Explode(Curve=polygon.Polygon, Recursive=True)  # -> simplify(graft(Segments)), Vertices
crv_5 = Curve(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)
crv_6 = Curve(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)
midpoint = MidPoint(crv=explode.Segments)
crv_7 = Curve(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)
item = ListItem(List=intcrv.Curve, Index=0, Wrap=True)  # -> Item, Item1, Item2, Item3
crv_8 = Curve(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)
end = EndPoints(Curve=explode.Segments)  # -> Start, End
scale = Scale(Geometry=midpoint, Center=pt, Factor=Slider(0.53, range=0..1))  # -> Geometry, Transform
merge_2 = Merge(
    Data1=item.Item,
    Data2=crv_5,
    Data3=item.Item2,
    Data4=crv_6,
    Data5=item.Item3,
    Data6=crv_7,
    Data7=item.Item1,
    Data8=crv_8)
merge_3 = Merge(Data1=end.Start, Data2=scale.Geometry, Data3=end.End)
intcrv_2 = Interpolate(Vertices=merge_3, Degree=3, Periodic=False, KnotStyle=1)  # -> Curve, Length, Domain
join = JoinCurves(Curves=flatten(intcrv_2.Curve), Preserve=False)

# ---- group: Fish
crv_9 = Curve(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)
boundary_2 = BoundarySurfaces(Edges=crv_9)

# ----
number_slider_2 = Slider(10, range=0..10)
pline = PolyLine(Vertices=merge_3, Closed=False)
join_2 = JoinCurves(Curves=merge_2, Preserve=False)
boundary_3 = BoundarySurfaces(Edges=join)
join_3 = JoinCurves(Curves=flatten(pline), Preserve=False)
boundary_4 = BoundarySurfaces(Edges=join_2)
custom_mesh_settings = SettingsCustom(
    StitchSeams=True,
    SimplePlanes=False,
    Refine=True,
    MinCount=16,
    MaxCount=400,
    AspectRatio=20,
    MaxDistance=0,
    MaxAngle=20,
    MinEdge=number_slider_2,
    MaxEdge=number_slider_2)
boundary_5 = BoundarySurfaces(Edges=join_3)
panel = Panel(boundary_5)
number_slider_3 = Slider(20, range=0..100)
mesh = MeshBrep(Brep=boundary_2, Settings=custom_mesh_settings)
mesh_2 = MeshBrep(Brep=boundary_5, Settings=custom_mesh_settings)
mesh_3 = MeshBrep(Brep=boundary_3, Settings=custom_mesh_settings)
custom_mesh_settings_2 = SettingsCustom(
    StitchSeams=True,
    SimplePlanes=False,
    Refine=True,
    MinCount=16,
    MaxCount=400,
    AspectRatio=20,
    MaxDistance=0,
    MaxAngle=20,
    MinEdge=number_slider_3,
    MaxEdge=number_slider_3)
brep = Brep(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)
mesh_4 = MeshBrep(Brep=boundary_4, Settings=custom_mesh_settings_2)
crv_10 = Curve(intcrv.Curve)
mesh_5 = MeshBrep(
    Brep=brep,
    Settings={GridMaxCount=0, GridMinCount=16, JaggedSeams=False, MaxEdgeLength=0, MinEdgeLength=0.0001, MinTolerance=0, Refine=True, RefineAngle=0, RelativeTolerance=0.65, SimplePlanes=True, Tolerance=0})
mesh_6 = Mesh(mesh_4)
wbloop = WeaverbirdsLoopSubdivision(MeshCurves=mesh_5, Level=Slider(2, range=0..10), SmoothNakedEdges=1)
medges = MeshEdges(Mesh=mesh_6)  # -> NakedEdges, InteriorEdges, NonManifoldEdges
mesh_7 = Mesh(wbloop)
join_4 = JoinCurves(Curves=medges.NakedEdges, Preserve=False)
number_slider_4 = Slider(10, range=0..10)
cp = ControlPoints(Curve=crv_10)  # -> Points, Weights, Knots
pt_2 = Point(cp.Points)
multiplication = Multiplication(A=Slider(6.56, range=0..10), B=Slider(1.29, range=1..2.5))
toggle = BooleanToggle(False)
flatten = FlattenTree(Tree=pt_2, Path="{0}")
sequence = Sequence(Frames=Slider(10, range=0..10))
duppt = RemoveDuplicatePts(Points=flatten, Tolerance=0.01)
meshmachine = MeshMachine(
    Geometry=mesh_6,
    Length=Slider(18, range=8..20),
    FixVertices=duppt,
    Flip=1,
    PullStrength=0.8,
    CurvatureAdaptivity=0,
    BoundaryScale=1,
    BoundaryDistance=5,
    Exponent=2,
    Background=0.5,
    Iterations=Slider(1, range=0..10),
    Reset=sequence)
pmesh = PlanktonMesh(meshmachine)
panel_2 = Panel(duppt)
pt_3 = Point(duppt)
rev = ReverseList(List=pmesh)
item_2 = ListItem(List=rev, Index=0, Wrap=True)
mesh_8 = Mesh(item_2)
number_slider_5 = Slider(1, range=0..1)
demesh = DeconstructMesh(Mesh=mesh_8)  # -> Vertices, Faces, Colours, Normals
cp_2 = ClosestPoint(Point=demesh.Vertices, Cloud=duppt)  # -> ClosestPoint, CPIndex, Distance
neg = Negative(Value=number_slider_5)
viewer = ParamViewer(demesh.Vertices)
larger = LargerThan(FirstNumber=cp_2.Distance, SecondNumber=0)  # -> LargerThan, OrEqualTo
merge_4 = Merge(Data1=neg, Data2=number_slider_5)  # -> graft(Result)
dispatch = Dispatch(List=demesh.Vertices, DispatchPattern=larger.LargerThan)  # -> ListA, ListB
Z = UnitZ(Factor=merge_4)  # -> simplify(UnitVector)
move = Move(Geometry=dispatch.ListA, Motion=Z)  # -> simplify(Geometry), Transform
viewer_2 = ParamViewer(dispatch.ListA)
weave = Weave(Pattern=larger.LargerThan, Stream0=dispatch.ListB, Stream1=move.Geometry, NullGaps=False)  # -> simplify(Weave)
viewer_3 = ParamViewer(weave)
conmesh = ConstructMesh(Vertices=weave, Faces=demesh.Faces)  # -> simplify(Mesh)
bang = ExplodeTree(Data=conmesh)  # -> Branch0, Branch1
flip = MeshFlip(Mesh=bang.Branch0)
merge_5 = Merge(Data1=flip, Data2=bang.Branch1)  # -> flatten(Result)

# ---- group: Closed Mesh
mjoin = MeshJoin(Meshes=merge_5)

# ----
panel_3 = Panel(mjoin)
medges_2 = MeshEdges(Mesh=mjoin)  # -> NakedEdges, InteriorEdges, NonManifoldEdges
weldvertices = MeshWeldVertices(Mesh=mjoin, Tolerance=0.01)  # -> RuntimeMessage, Mesh
merge_6 = Merge(Data1=medges_2.NakedEdges, Data2=medges_2.InteriorEdges)
pt_4 = Point(duppt)
dupln = RemoveDuplicateLines(Lines=merge_6, Tolerance=0.01)
pressure = Pressure(M=mjoin, Strength=Slider(0.155, range=0..0.3))
length_line = LengthLine(Line=dupln, Length=dupln, Strength=10)
anchor = Anchor(Point=pt_4, Strength=1000)
show = Show(G=weldvertices.Mesh)
merge_7 = Merge(Data1=flatten(show), Data2=flatten(anchor), Data3=flatten(length_line), Data4=flatten(pressure))
sequence_2 = Sequence(Frames=Slider(10, range=0..10))
toggle_2 = BooleanToggle(False)
bouncysolver = BouncySolver(GoalObjects=merge_7, Reset=Button(), Threshold=1e-15, Tolerance=0.01, Damping=0.99, Iterations=10, On=toggle_2)  # -> I, V, O
solver = Solver(GoalObjects=merge_7, Reset=sequence_2, Threshold=1e-15, Tolerance=0.01, On=toggle_2)  # -> I, V, O; disabled
item_3 = ListItem(List=bouncysolver.O, Index=0, Wrap=True)  # -> flatten(Item); disabled
rev_2 = ReverseList(List=item_3)  # disabled
item_4 = ListItem(List=rev_2, Index=0, Wrap=True)  # disabled
demesh_2 = DeconstructMesh(Mesh=item_4)  # -> Vertices, Faces, Colours, Normals; disabled
pdecon = Deconstruct(Point=demesh_2.Vertices)  # -> XComponent, YComponent, ZComponent; disabled
bnd = Bounds(Numbers=pdecon.ZComponent)  # disabled
remap = RemapNumbers(Value=pdecon.ZComponent, Source=bnd, Target=Domain(0, 1))  # -> Mapped, Clipped; disabled
gradient = Gradient(
    LowerLimit=0,
    UpperLimit=1,
    Parameter=remap.Mapped,
    stops=[0: RGB(234, 38, 0), 0.173: RGB(234, 126, 0), 0.512: RGB(254, 244, 84), 0.839: RGB(255, 116, 41), 1: RGB(255, 31, 31)])  # disabled
mcol = MeshColours(Mesh=item_4, Colours=gradient)  # disabled

# ==== cluster MidPoint: Middle Point of Curve
crv = ClusterInput()
num = Number(0.5)
eval = EvaluateLength(Curve=crv, Length=num, Normalized=True)  # -> Point, Tangent, Parameter
pt = ClusterOutput(eval.Point)
