# Grasshopper definition Custom-Goal-1.ghx (Grasshopper 0.9.76)
# plug-ins: Kangaroo2 Components

pop3d = Populate3D(Region={Plane=PlaneXY(0, 0, 0), X=Domain(0, 10), Y=Domain(0, 10), Z=Domain(0, 2)}, Count=100, Seed=1)
brep = Brep(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)
# You will need to set the assembly
# reference location to your copy of
# KangarooSolver.dll
# Do this by right-clicking and then
# Manage Assemblies
onsurf = CSharpScript(Pt=pop3d, S=brep, k=4, Reference="C:\Users\yoshioca\AppData\Roaming\Grasshopper\Libraries\KangarooSolver.dll")  # -> out, A; inputs Pt: Point3d, S: Brep, k: Double
# ---------- onsurf: C# ----------
    A = new OnSurf(Pt, k, S); //create an instance of your custom goal
# ---------- onsurf: C# additional code ----------
  public class OnSurf : GoalObject
  {
    public double Strength;
    public Brep TargetBrep;
    // add here any other objects you want your goal to use

    public OnSurf(Point3d P, double k, Brep Target)
    {
      PPos = new Point3d[1]{P};     // PPos must contain an array of the points this goal acts on
      Move = new Vector3d[1];       // Move is an array of vectors, one for each PPos
      Weighting = new double[1]{k}; // Weighting is an array of doubles for how strongly the goal affects each point
      TargetBrep = Target;          // Any other data you want your goal to have access to
    }

    public override void Calculate(List<KangarooSolver.Particle> p)
    {
      Point3d ThisPt = p[PIndex[0]].Position;             //get the current position of the particle
      Move[0] = TargetBrep.ClosestPoint(ThisPt) - ThisPt; //assign the goal vector moving this particle towards its target
    }
  }
# ---------- end onsurf ----------
panel = Panel(onsurf.out)
solver = Solver(
    GoalObjects=onsurf.A,
    Reset=Button(),
    Restart=False,
    Parallel=True,
    Threshold=1e-15,
    Tolerance=0.01,
    AddCurrent=False,
    On=Toggle(False))  # -> V, O
