# Grasshopper definition Custom-Solver-StepByStep.ghx (Grasshopper 0.9.76)
# plug-ins: Kangaroo Components, Kangaroo2 Components

# Another simple scripting example,
# showing how the simulation can
# be advanced one iteration at a time
mesh = Mesh(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)
medges = MeshEdges(Mesh=mesh)  # -> NakedEdges, InteriorEdges, NonManifoldEdges
nv = NakedVertices(Mesh=mesh)  # -> ClothedIndex, NakedIndex, ClothedPts, NakedPts
reset = Button(ExpressionPressed="true")
step = Button(ExpressionPressed="true")
length_line = LengthLine(Line=[medges.InteriorEdges, medges.NakedEdges], Length="0", Strength=10)
anchor = Anchor(Point=nv.NakedPts, Strength=1000)
pt = Point(nv.NakedPts)
# You will need to set the assembly
# reference location to your copy of
# KangarooSolver.dll
# Do this by right-clicking and then
# Manage Assemblies
customiteration = CSharpScript(
    Goals=[anchor, length_line],
    Reset=reset,
    Step=step,
    Reference="C:\USERS\YOSHIOCA\APPDATA\ROAMING\GRASSHOPPER\LIBRARIES\KangarooSolver.dll")  # -> out, A, B; inputs Goals: list, Reset: Boolean, Step: Boolean
# ---------- customiteration: C# ----------
    if(Reset)
    {
      PS = new KangarooSolver.PhysicalSystem();
      counter = 0;
      GoalList.Clear();
      foreach(IGoal G in Goals) //Assign indexes to the particles in each Goal:
      {
        PS.AssignPIndex(G, 0.0001); // the second argument is the tolerance distance below which points combine into a single particle
        GoalList.Add(G);
      }
    }
    if(Step)
    {
      PS.Step(GoalList, true, 1);
      counter++;
    }

    A = PS.GetOutput(GoalList);
    B = counter;
# ---------- customiteration: C# additional code ----------
  KangarooSolver.PhysicalSystem PS = new KangarooSolver.PhysicalSystem();
  List<IGoal> GoalList = new List<IGoal>();
  int counter = 0;
# ---------- end customiteration ----------
panel = Panel(customiteration.B)
