# Grasshopper definition Cyclic-Mesh-2.ghx (Grasshopper 0.9.76)
# plug-ins: Kangaroo2 Components

# ---- group: The planarity and circularity strength can be ramped up to enforce a hard constraint
_10º = PowerOf10(Value=Slider(0, range=0..10))

# ----
mesh = Mesh(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)
demesh = DeconstructMesh(Mesh=mesh)  # -> Vertices, Faces, Colours, Normals
srf = Surface(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)
edgelengths = EdgeLengths(Mesh=mesh, LengthFactor=1, Strength=0.01)
grab = Grab(On=True, Strength=1, Range=3)  # -> Grab, Anchors
planarize = Planarize(M=mesh, Strength=_10º)
cyclicquad = CyclicQuad(M=mesh, Strength=_10º)
smooth = Smooth(M=mesh, Strength=1)
onmesh = OnMesh(Points=demesh.Vertices, Mesh=srf, Strength=1)
show = Show(G=mesh)
solver = Solver(
    GoalObjects=flatten([grab.Grab, show, planarize, smooth, onmesh, cyclicquad, edgelengths]),
    Reset=Button(),
    Threshold=1e-15,
    Tolerance=0.01,
    On=Toggle(True))  # -> I, V, O
mesh_2 = Mesh(solver.O)
clean = CleanTree(RemoveNulls=True, RemoveInvalid=True, RemoveEmpty=False, Tree=mesh_2)
mesh_3 = Mesh(clean)
tri = Triangulate(Mesh=mesh_3)  # -> Mesh, Count
medges = MeshEdges(Mesh=tri.Mesh)  # -> NakedEdges, InteriorEdges, NonManifoldEdges
facec = FaceCircles(Mesh=tri.Mesh)  # -> Centers, Ratio
panel = Panel(facec.Centers)
