# Grasshopper definition Drape-Grid-2.ghx (Grasshopper 0.9.76)
# plug-ins: MeshEdit Components, Kangaroo2 Components

xy = XYPlane(Origin=Point(0, 0, 0))
Z = UnitZ(Factor=Slider(20, range=0..100))
sph = Sphere(Base=PlaneXY(0, 0, 0), Radius=10)
brep = Brep(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)

# ---- group: Block
brep_2 = Brep(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)

# ----
number_slider = Slider(20, range=0..100)
move = Move(Geometry=xy, Motion=Z)  # -> Geometry, Transform
rectangle = Rectangle(Plane=move.Geometry, XSize="-20 to 20", YSize="-20 to 20", Radius=0)  # -> Rectangle, Length
mesh = Mesh(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)
# Fixing a point in the middle of the mesh to
# only move vertically stops it from sliding of
# the side of the sphere.
# This sphere can be replaced with
# a closed solid of any shape
geo = Geometry(sph)
mplane = MeshPlane(Boundary=rectangle.Rectangle, WidthCount=number_slider, HeightCount=number_slider)  # -> Mesh, Area
# Increase this slider (after first running the
# relaxation with it set at 1) to enforce the
# length constraint more strongly.
number_slider_2 = Slider(1, range=1..10)
mesh_2 = Mesh(mesh)
area = MeshArea(Mesh=mesh_2)  # -> Area, Centroid
medges = MeshEdges(Mesh=mesh_2)  # -> NakedEdges, InteriorEdges, NonManifoldEdges
Z_2 = UnitZ(Factor=-0.01)
demesh = DeconstructMesh(Mesh=mesh_2)  # -> Vertices, Faces, Colours, Normals
_10º = PowerOf10(Value=number_slider_2)
panel = Panel(_10º)
length_line = LengthLine(Line=medges.InteriorEdges, Strength=_10º)
sc = SphereCollide(Points=demesh.Vertices, Radius=Slider(0.01, range=0..0.75), Strength=1)
spc = SolidPointCollide(Points=demesh.Vertices, Solid=geo, Interior=False, Unidirectional=True, Strength=1)
anchorxyz = AnchorXYZ(Point=area.Centroid, X=True, Y=True, Z=False, Strength=1000)
floor = Floor(Strength=1)
load = Load(Point=demesh.Vertices, ForceVector=Z_2)
show = Show(G=mesh_2)
merge = Merge(Data1=show, Data2=length_line, Data3=sc, Data4=load, Data5=spc, Data7=floor)  # -> flatten(Result)
button = Button()
toggle = BooleanToggle(False)
bouncysolver = BouncySolver(GoalObjects=merge, Reset=button, Threshold=1e-15, Tolerance=0.01, Damping=0.99, Iterations=10, On=toggle)  # -> I, V, O
solver = Solver(GoalObjects=merge, Reset=button, Threshold=1e-15, Tolerance=0.01, On=toggle)  # -> I, V, O
crv = Curve(bouncysolver.O)
mesh_3 = Mesh(bouncysolver.O)
clean = CleanTree(RemoveNulls=True, RemoveInvalid=True, RemoveEmpty=False, Tree=crv)
clean_2 = CleanTree(RemoveNulls=True, RemoveInvalid=True, RemoveEmpty=False, Tree=mesh_3)
crv_2 = Curve(clean)
mesh_4 = Mesh(clean_2)
len = Length(Curve=crv_2)
preview = CustomPreview(
    Geometry=mesh_4,
    Shader={ambient=RGB(0, 0, 0), diffuse=RGB(255, 105, 180), emission=RGB(76, 32, 54), shine=0.5, specular=RGB(255, 255, 255), transparency=0})
panel_2 = Panel(len)
