# Grasshopper definition Flag-Wind-3.ghx (Grasshopper 0.9.76)
# plug-ins: MeshEdit Components, Weaverbird, Kangaroo2 Components

mesh = Mesh(<mesh referenced from the Rhino model>)

# ---- group: ok
mesh_2 = Mesh(<mesh referenced from the Rhino model>)

# ----
srf = Surface([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])

# ---- group: cloth-modify
mesh_3 = Mesh(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)  # disabled

# ---- group: cloth
mesh_4 = Mesh(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)  # disabled

# ---- group: cloth-modify-wb
mesh_5 = Mesh(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)  # disabled

# ---- group: cloth-wb
mesh_6 = Mesh(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)  # disabled

# ----
refine = Refine(Mesh=mesh, Level=1)
number_slider = Slider(1.7, range=0..10)  # disabled
debrep = DeconstructBrep(Brep=srf)  # -> Faces, Edges, Vertices
bbox = BoundingBox(Content=mesh_4, Plane=PlaneXY(0, 0, 0))  # -> Box, Box_2; disabled
medges = MeshEdges(Mesh=mesh_5)  # -> NakedEdges, InteriorEdges, NonManifoldEdges; disabled
number_slider_2 = Slider(3, range=0..10)

# ---- group: ok
mesh_7 = Mesh(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)

# ----
conmesh = ConstructMesh(Vertices=debrep.Vertices, Faces={A=0, B=1, C=2, D=3})
wbloop = WeaverbirdsLoopSubdivision(MeshCurves=mesh_5, Level=1, SmoothNakedEdges=1)  # disabled
area = Area(Geometry=bbox.Box)  # -> Area, Centroid; disabled
rec = Rectangle({Plane=PlaneXZ(20, 0, 20), Size=Domain2(u=0..20, v=0..20)})
crv = Curve(<curve referenced from the Rhino model>)

# ---- group: ok
mesh_8 = Mesh(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)

# ----
mesh_9 = Mesh(<mesh referenced from the Rhino model>)

# ---- group: ok
mesh_10 = Mesh(<mesh referenced from the Rhino model>)

# ----
scale_nu = ScaleNU(Geometry=mesh_4, Plane=area.Centroid, ScaleX=1, ScaleY=number_slider, ScaleZ=1)  # -> Geometry, Transform; disabled
panel = Panel(conmesh)
sdivide = DivideSurface(Surface=rec, UCount=number_slider_2, VCount=number_slider_2)  # -> flatten(Points), Normals, Parameters
number_slider_3 = Slider(4, range=0..10)
pt = Point(sdivide.Points)
mesh_11 = Mesh()

# ---- group: ok
mesh_12 = Mesh(<mesh referenced from the Rhino model>)

# ----
mjoin = MeshJoin(Meshes=[mesh_9, mesh_8])
weld = WeldMesh(Mesh=mjoin, Angle=3.141592654)

# ---- group: cloth-1.7
mesh_13 = Mesh(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)  # disabled

# ---- group: cloth-modify-1.7
mesh_14 = Mesh(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)  # disabled

# ---- group: cloth-wb-1.7
mesh_15 = Mesh(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)  # disabled

# ---- group: cloth-modify-wb-1.7
mesh_16 = Mesh(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)  # disabled

# ----
line = Line(Line((0, -551, 442.5), (-285.6067505, -551, 83.01858521)))
line_2 = Line(Line((0, -551, 585), (-335, -551, 124.25)))
flip = FlipCurve(Curve=line)  # -> Curve, Flag
frompoints = MeshFromPoints(Points=sdivide.Points, UDirection=number_slider_3, VDirection=number_slider_3)
vec = Vector(Vector(19, 17, 0))
panel_2 = Panel(vec)
mesh_17 = Mesh([<mesh referenced from the Rhino model> x14])
merge = Merge(Data1=line_2, Data2=line)
mesh_18 = Mesh(mesh_12)
mesh_19 = Mesh(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)  # disabled
number_slider_4 = Slider(1, range=0..1)
number_slider_5 = Slider(4, range=0..10)
number_slider_6 = Slider(2, range=0..10)
panel_3 = Panel(mesh_17)

# ---- group: Anchor
pt_2 = Point([Point(0, 0, 60), Point(0, 0, 0)])

# ----
mbox = MeshBox(Base={Plane=PlaneXY(0, 0, 0), X=Domain(-10, 10), Y=Domain(-10, 10), Z=Domain(-10, 10)}, XCount=10, YCount=10, ZCount=10)
loft = Loft(Curves=merge, Options={Adjust=False, Closed=False, LoftEnds=0, LoftSimp=0, LoftType=0, Rebuild=10, Refit=0.01})
number_slider_7 = Slider(0.003, range=0..1)  # disabled
refine_2 = Refine(Level=1)
pt_3 = Point([Point(13.15002632, 4.440023422, 16.70902824), Point(12.6817646, 4.440023422, 16.74728584), Point(8.804867744, 4.440023422, 16.74728584), Point(8.336606026, 4.440023422, 16.70902824)])  # disabled
mbox_2 = MeshBox(Base={Plane=PlaneXY(0, 0, 0), X=Domain(-10, 10), Y=Domain(-10, 10), Z=Domain(-10, 10)}, XCount=10, YCount=10, ZCount=10)  # disabled
mplane = MeshPlane(Boundary={Plane=PlaneXZ(5, 0, 5), Size=Domain2(u=0..15, v=0..10)}, WidthCount=15, HeightCount=10)  # -> Mesh, Area
mplane_2 = MeshPlane(Boundary={Plane=PlaneXZ(5, 0, 5), Size=Domain2(u=0..15, v=0..10)}, WidthCount=15, HeightCount=10)  # -> Mesh, Area
weld_2 = WeldMesh(Mesh=mesh_17, Angle=3.141592654)
pt_4 = Point([Point(0, 0, 60), Point(0, 0, 20), Point(0, 0, 0)])
mplane_3 = MeshPlane(Boundary={Plane=PlaneXZ(5, 0, 5), Size=Domain2(u=0..15, v=0..10)}, WidthCount=15, HeightCount=10)  # -> Mesh, Area; disabled
geo = Geometry(mesh_10)
vec_2 = Vector(Vector(19, 17, 0))  # disabled
panel_4 = Panel(vec_2)  # disabled
vec_3 = Vector(Vector(19, 17, 0))
devec = DeconstructVector(Vector=vec_3)  # -> XComponent, YComponent, ZComponent
addition = Addition(A=number_slider_6, B=number_slider_4)
geo_2 = Geometry(mesh_16)  # disabled
addition_2 = Addition(A=number_slider_5, B=number_slider_4)
mjoin_2 = MeshJoin(Meshes=weld_2)
sdivide_2 = DivideSurface(Surface=loft, UCount=number_slider_6, VCount=number_slider_5)  # -> flatten(Points), Normals, Parameters
vec_4 = Vector("20.0, 12, 0")
panel_5 = Panel("0")  # disabled
vec_5 = Vector("20.0, 10, 0")  # disabled
vec_6 = VectorXYZ(XComponent=devec.XComponent, YComponent=0, ZComponent=devec.ZComponent)  # -> Vector, Length
tri = Triangulate(Mesh=geo_2)  # -> Mesh, Count; disabled
tri_2 = Triangulate(Mesh=mesh_18)  # -> Mesh, Count
demesh = DeconstructMesh(Mesh=geo)  # -> Vertices, Faces, Colours, Normals
multiplication = Multiplication(A=vec_4, B=Slider(0.001, range=0..1))
item = ListItem(List=pt_4, Index="0", Wrap=True)  # -> Item, Item1
frompoints_2 = MeshFromPoints(Points=sdivide_2.Points, UDirection=addition, VDirection=addition_2)
demesh_2 = DeconstructMesh(Mesh=tri.Mesh)  # -> Vertices, Faces, Colours, Normals; disabled
multiplication_2 = Multiplication(A=vec_5, B=number_slider_7)  # disabled
multiplication_3 = Multiplication(A=vec_6.Vector, B=Slider(0.046, range=0..1))
item_2 = ListItem(List=pt_2, Index="0", Wrap=True)  # -> Item, Item1
medges_2 = MeshEdges(Mesh=geo)  # -> NakedEdges, InteriorEdges, NonManifoldEdges
vdis = VectorDisplay(Anchor=item.Item, Vector=vec_3)
medges_3 = MeshEdges(Mesh=tri_2.Mesh)  # -> NakedEdges, InteriorEdges, NonManifoldEdges
item_3 = ListItem(List=pt_3, Index=panel_5, Wrap=True)  # -> Item, Item1; disabled
medges_4 = MeshEdges(Mesh=tri.Mesh)  # -> NakedEdges, InteriorEdges, NonManifoldEdges; disabled
neg = Negative(Value=Slider(0.001, range=0..0.05))
panel_6 = Panel(mjoin_2)
devec_2 = DeconstructVector(Vector=item.Item1)  # -> XComponent, YComponent, ZComponent
len = Length(Curve=medges_2.InteriorEdges)
neg_2 = Negative(Value=Slider(0.005, range=0..0.05))  # disabled
len_2 = Length(Curve=medges_4.InteriorEdges)  # disabled
wind = Wind(Mesh=tri_2.Mesh, WindVector=multiplication_3)
devec_3 = DeconstructVector(Vector=item_2.Item1)  # -> XComponent, YComponent, ZComponent
avr = Average(Input=len)
devec_4 = DeconstructVector(Vector=item_3.Item1)  # -> XComponent, YComponent, ZComponent; disabled
panel_7 = Panel(multiplication_3)
Z = UnitZ(Factor=neg)
avr_2 = Average(Input=len_2)  # disabled
pt_5 = ConstructPoint(XCoordinate=devec_2.XComponent, YCoordinate=devec_2.YComponent, ZCoordinate="0")
ln = Line(StartPoint=item.Item, EndPoint=item.Item1)
Z_2 = UnitZ(Factor=neg_2)  # disabled
division = Division(A=avr, B=Slider(2, range=0..10))
pt_6 = ConstructPoint(XCoordinate=devec_3.XComponent, YCoordinate=devec_3.YComponent, ZCoordinate="0")
length_line = LengthLine(Line=[medges_2.NakedEdges, medges_2.InteriorEdges], Strength=10)
anchor = Anchor(Point=pt_2, Strength=10000)
smooth = Smooth(M=geo, Strength=1)
wind_2 = Wind(Mesh=geo, WindVector=multiplication)
show = Show(G=geo)
division_2 = Division(A=avr_2, B=3)  # disabled
load = Load(Point=demesh.Vertices, ForceVector=Z)
curvepoint = PointOnCurve(ln, parameter=0.5)
ln_2 = Line(StartPoint=item.Item, EndPoint=pt_5)
pt_7 = ConstructPoint(XCoordinate=devec_4.XComponent, YCoordinate=devec_4.YComponent, ZCoordinate="0")  # disabled
length_line_2 = LengthLine(Line=[medges_4.NakedEdges, medges_4.InteriorEdges], Strength=10)  # disabled
anchor_2 = Anchor(Point=pt_3, Strength=10000)  # disabled
smooth_2 = Smooth(M=tri.Mesh, Strength=1)  # disabled
wind_3 = Wind(Mesh=tri.Mesh, WindVector=multiplication_2)  # disabled
show_2 = Show(G=geo_2)  # disabled
load_2 = Load(Point=demesh_2.Vertices, ForceVector=Z_2)  # disabled
sc = SphereCollide(Points=demesh.Vertices, Radius=division, Strength=1)
ln_3 = Line(StartPoint=item_2.Item, EndPoint=pt_6)
sc_2 = SphereCollide(Points=demesh_2.Vertices, Radius=division_2, Strength=1)  # disabled
ln_4 = Line(StartPoint=item_3.Item, EndPoint=pt_7)  # disabled
anchor_3 = Anchor(Point=[pt_4, curvepoint], Strength=10000)
smooth_3 = Smooth(M=tri_2.Mesh, Strength=1)
length_line_3 = LengthLine(Line=[medges_3.NakedEdges, medges_3.InteriorEdges], Strength=10)
show_3 = Show(G=mesh_18)
merge_2 = Merge(Data1=sc, Data2=length_line, Data3=show, Data4=anchor, Data5=wind_2, Data6=smooth, Data7=load)  # -> flatten(Result)
merge_3 = Merge(Data1=sc_2, Data2=length_line_2, Data3=show_2, Data4=anchor_2, Data5=wind_3, Data6=smooth_2, Data7=load_2)  # -> flatten(Result); disabled
button = Button()
toggle = BooleanToggle(True)
button_2 = Button()
toggle_2 = BooleanToggle(False)
toggle_3 = BooleanToggle(True)  # disabled
button_3 = Button()  # disabled
bouncysolver = BouncySolver(
    GoalObjects=[length_line_3, show_3, anchor_3, wind, smooth_3],
    Reset=button,
    Threshold=1e-15,
    Tolerance=0.01,
    Damping=0.99,
    Iterations=10,
    On=toggle)  # -> I, V, O
bouncysolver_2 = BouncySolver(
    GoalObjects=[length_line_3, show_3, anchor_3, wind, smooth_3],
    Reset=button,
    Threshold=1e-15,
    Tolerance=0.01,
    Damping=0.99,
    Iterations=2,
    On=toggle)  # -> I, V, O
bouncysolver_3 = BouncySolver(GoalObjects=merge_2, Reset=button_2, Threshold=1e-15, Tolerance=0.01, Damping=0.99, Iterations=10, On=toggle_2)  # -> I, V, O
bouncysolver_4 = BouncySolver(GoalObjects=merge_2, Reset=button_2, Threshold=1e-15, Tolerance=0.01, Damping=0.99, Iterations=2, On=toggle_2)  # -> I, V, O; disabled
panel_8 = Panel(bouncysolver_3.I)
bouncysolver_5 = BouncySolver(GoalObjects=merge_3, Reset=button_3, Threshold=1e-15, Tolerance=0.01, Damping=0.99, Iterations=10, On=toggle_3)  # -> I, V, O; disabled
bouncysolver_6 = BouncySolver(GoalObjects=merge_3, Reset=button_3, Threshold=1e-15, Tolerance=0.01, Damping=0.99, Iterations=2, On=toggle_3)  # -> I, V, O; disabled
panel_9 = Panel(bouncysolver.I)
data = Data(bouncysolver.O)
data_2 = Data(bouncysolver_3.O)
panel_10 = Panel(bouncysolver_2.V)
panel_11 = Panel(bouncysolver_3.V)
panel_12 = Panel(bouncysolver_5.I)  # disabled
data_3 = Data(bouncysolver_5.O)  # disabled
vdis_2 = VectorDisplay(Anchor=item_2.Item, Vector=vec_4)
panel_13 = Panel(bouncysolver_5.V)  # disabled
vdis_3 = VectorDisplay(Anchor=item_3.Item, Vector=vec_5)  # disabled
panel_14 = Panel(data_2)

# ---- group: 2
mesh_20 = Mesh(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)

# ---- group: 1
mesh_21 = Mesh(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)

# ---- group: 0
mesh_22 = Mesh(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)

# ----
panel_15 = Panel(data_3)  # disabled
panel_16 = Panel(data)
mesh_23 = Mesh(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)
mesh_24 = Mesh(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)

# ---- group: 1180
mesh_25 = Mesh(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)

# ---- group: 630
mesh_26 = Mesh(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)

# ----
medges_5 = MeshEdges(Mesh=[mesh_26, mesh_25])  # -> NakedEdges, InteriorEdges, NonManifoldEdges
wbloop_2 = WeaverbirdsLoopSubdivision(MeshCurves=[mesh_25, mesh_26], Level=1, SmoothNakedEdges=1)
panel_17 = Panel(wbloop_2)
