# Grasshopper definition Flag-Wind-4.ghx (Grasshopper 0.9.76)
# plug-ins: MeshEdit Components, Kangaroo Components, PlanktonGh, Weaverbird, Kangaroo2 Components

mesh = Mesh(<mesh referenced from the Rhino model>)

# ---- group: ok
mesh_2 = Mesh(<mesh referenced from the Rhino model>)

# ----
srf = Surface([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])

# ---- group: cloth-modify-wb
mesh_3 = Mesh(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)

# ---- group: cloth-modify
mesh_4 = Mesh(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)

# ---- group: cloth
mesh_5 = Mesh(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)

# ---- group: cloth-wb
mesh_6 = Mesh(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)

# ---- group: cloth-modify
mesh_7 = Mesh(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)

# ---- group: cloth
mesh_8 = Mesh(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)

# ---- group: cloth-modify-wb
mesh_9 = Mesh(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)

# ---- group: cloth-wb
mesh_10 = Mesh(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)

# ----
refine = Refine(Mesh=mesh, Level=1)
debrep = DeconstructBrep(Brep=srf)  # -> Faces, Edges, Vertices
bbox = BoundingBox(Content=mesh_5, Plane=PlaneXY(0, 0, 0))  # -> Box, Box_2
medges = MeshEdges(Mesh=mesh_3)  # -> NakedEdges, InteriorEdges, NonManifoldEdges
bbox_2 = BoundingBox(Content=mesh_8, Plane=PlaneXY(0, 0, 0))  # -> Box, Box_2
medges_2 = MeshEdges(Mesh=mesh_9)  # -> NakedEdges, InteriorEdges, NonManifoldEdges
wbloop = WeaverbirdsLoopSubdivision(MeshCurves=mesh_3, Level=1, SmoothNakedEdges=1)
area = Area(Geometry=bbox.Box)  # -> Area, Centroid

# ---- group: ok
mesh_11 = Mesh(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)

# ----
conmesh = ConstructMesh(Vertices=debrep.Vertices, Faces={A=0, B=1, C=2, D=3})
wbloop_2 = WeaverbirdsLoopSubdivision(MeshCurves=mesh_9, Level=1, SmoothNakedEdges=1)
area_2 = Area(Geometry=bbox_2.Box)  # -> Area, Centroid
scale_nu = ScaleNU(Geometry=mesh_5, Plane=area.Centroid, ScaleX=1, ScaleY=Slider(1.7, range=0..10), ScaleZ=1)  # -> Geometry, Transform
scale_nu_2 = ScaleNU(Geometry=mesh_8, Plane=area_2.Centroid, ScaleX=1, ScaleY=Slider(1.7, range=0..10), ScaleZ=1)  # -> Geometry, Transform
panel = Panel(conmesh)
mesh_12 = Mesh()

# ---- group: Quat-Size
mesh_13 = Mesh(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)

# ---- group: cloth-modify-1.7
mesh_14 = Mesh(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)

# ---- group: cloth-1.7
mesh_15 = Mesh(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)

# ---- group: cloth-wb-1.7
mesh_16 = Mesh(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)

# ---- group: cloth-modify-wb-1.7
mesh_17 = Mesh(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)

# ---- group: cloth-modify-1.7-Refine
mesh_18 = Mesh(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)

# ---- group: cloth-1.7
mesh_19 = Mesh(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)

# ---- group: cloth-modify-1.7
mesh_20 = Mesh(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)

# ---- group: cloth-wb-1.7
mesh_21 = Mesh(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)

# ---- group: cloth-modify-wb-1.7
mesh_22 = Mesh(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)

# ----
mesh_23 = Mesh(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)
line = Line(Line((0, -551, 442.5), (-285.6067505, -551, 83.01858521)))
line_2 = Line(Line((0, -551, 585), (-335, -551, 124.25)))
mesh_24 = Mesh(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)
mesh_25 = Mesh(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)
flip = FlipCurve(Curve=line)  # -> Curve, Flag
refine_2 = Refine(Mesh=mesh_14, Level=1)
vec = Vector(Vector(19, 17, 0))
panel_2 = Panel(vec)
mesh_26 = Mesh([<mesh referenced from the Rhino model> x14])
merge = Merge(Data1=line_2, Data2=line)
refine_3 = Refine(Mesh=mesh_23, Level=Slider(1, range=0..10))

# ---- group: ok
mesh_27 = Mesh(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)

# ----
mesh_28 = Mesh(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)
number_slider = Slider(1, range=0..1)
number_slider_2 = Slider(4, range=0..10)
number_slider_3 = Slider(2, range=0..10)
mplane = MeshPlane(Boundary={Plane=PlaneXZ(5, 0, 5), Size=Domain2(u=0..15, v=0..10)}, WidthCount=15, HeightCount=10)  # -> Mesh, Area
panel_3 = Panel(mesh_26)
pt = Point([Point(42.13157654, 7, 35.99999619), Point(41.10526276, 7, 35.99999619), Point(32.89473724, 7, 35.99999619), Point(31.86841965, 7, 35.99999619)])
mesh_29 = Mesh(mesh_23)
mesh_30 = Mesh(mesh_25)
mbox = MeshBox(Base={Plane=PlaneXY(0, 0, 0), X=Domain(-10, 10), Y=Domain(-10, 10), Z=Domain(-10, 10)}, XCount=10, YCount=10, ZCount=10)
loft = Loft(Curves=merge, Options={Adjust=False, Closed=False, LoftEnds=0, LoftSimp=0, LoftType=0, Rebuild=10, Refit=0.01})
pt_2 = Point([Point(13.15002632, 4.440023422, 16.70902824), Point(12.6817646, 4.440023422, 16.74728584), Point(8.804867744, 4.440023422, 16.74728584), Point(8.336606026, 4.440023422, 16.70902824)])
pt_3 = Point([Point(0, 0, 60), Point(0, 0, 40), Point(0, 0, 20), Point(0, 0, 0)])
mbox_2 = MeshBox(Base={Plane=PlaneXY(0, 0, 0), X=Domain(-10, 10), Y=Domain(-10, 10), Z=Domain(-10, 10)}, XCount=10, YCount=10, ZCount=10)
mplane_2 = MeshPlane(Boundary={Plane=PlaneXZ(5, 0, 5), Size=Domain2(u=0..15, v=0..10)}, WidthCount=15, HeightCount=10)  # -> Mesh, Area
medges_3 = MeshEdges(Mesh=mesh_29)  # -> NakedEdges, InteriorEdges, NonManifoldEdges
weld = WeldMesh(Mesh=mesh_26, Angle=3.141592654)
mplane_3 = MeshPlane(Boundary={Plane=PlaneXZ(5, 0, 5), Size=Domain2(u=0..15, v=0..10)}, WidthCount=15, HeightCount=10)  # -> Mesh, Area
geo = Geometry(mesh_27)
vec_2 = Vector(Vector(19, 17, 0))
panel_4 = Panel(vec_2)
vec_3 = Vector(Vector(19, 17, 0))
devec = DeconstructVector(Vector=vec_3)  # -> XComponent, YComponent, ZComponent
addition = Addition(A=number_slider_3, B=number_slider)
geo_2 = Geometry(mesh_22)
addition_2 = Addition(A=number_slider_2, B=number_slider)
mjoin = MeshJoin(Meshes=weld)
sdivide = DivideSurface(Surface=loft, UCount=number_slider_3, VCount=number_slider_2)  # -> flatten(Points), Normals, Parameters
medges_4 = MeshEdges()  # -> NakedEdges, InteriorEdges, NonManifoldEdges
vec_4 = Vector("20.0, 12, 0")
medges_5 = MeshEdges(Mesh=mesh_29)  # -> NakedEdges, InteriorEdges, NonManifoldEdges
panel_5 = Panel(devec.XComponent)
vec_5 = VectorXYZ(XComponent=devec.XComponent, YComponent=0, ZComponent=devec.ZComponent)  # -> Vector, Length
vec_6 = Vector("20.0, 10, 0")
tri = Triangulate(Mesh=geo_2)  # -> Mesh, Count
tri_2 = Triangulate(Mesh=mesh_30)  # -> Mesh, Count
viewer = ParamViewer(medges_5.NakedEdges)
crv = Curve(medges_5.NakedEdges)
join = JoinCurves(Curves=medges_5.NakedEdges, Preserve=False)
demesh = DeconstructMesh(Mesh=geo)  # -> Vertices, Faces, Colours, Normals
multiplication = Multiplication(A=vec_4, B=Slider(0.003, range=0..1))
move = Move(Geometry=[medges_4.NakedEdges, medges_4.InteriorEdges, medges_4.NonManifoldEdges], Motion="0,200,0")  # -> Geometry, Transform
frompoints = MeshFromPoints(Points=sdivide.Points, UDirection=addition, VDirection=addition_2)
demesh_2 = DeconstructMesh(Mesh=tri.Mesh)  # -> Vertices, Faces, Colours, Normals
multiplication_2 = Multiplication(A=vec_6, B=Slider(0.003, range=0..1))
multiplication_3 = Multiplication(A=vec_3, B=Slider(0.008, range=0..1))
item = ListItem(List=pt, Index="0", Wrap=True)  # -> Item, Item1
medges_6 = MeshEdges(Mesh=geo)  # -> NakedEdges, InteriorEdges, NonManifoldEdges
cp = ControlPoints(Curve=join)  # -> Points, Weights, Knots
demesh_3 = DeconstructMesh(Mesh=mesh_30)  # -> Vertices, Faces, Colours, Normals
item_2 = ListItem(List=pt_2, Index="0", Wrap=True)  # -> Item, Item1
medges_7 = MeshEdges(Mesh=tri.Mesh)  # -> NakedEdges, InteriorEdges, NonManifoldEdges
neg = Negative(Value=Slider(0.001, range=0..0.05))
viewer_2 = ParamViewer(cp.Points)
panel_6 = Panel(mjoin)
len = Length(Curve=medges_6.InteriorEdges)
medges_8 = MeshEdges(Mesh=mesh_30)  # -> NakedEdges, InteriorEdges, NonManifoldEdges
neg_2 = Negative(Value=Slider(0.005, range=0..0.05))
pt_4 = Point(cp.Points)
len_2 = Length(Curve=medges_7.InteriorEdges)
multiplication_4 = Multiplication(A=Slider(0, range=0..10), B=Slider(2.16, range=1..4))
vdis = VectorDisplay(Vector=vec_3)
devec_2 = DeconstructVector(Vector=item.Item1)  # -> XComponent, YComponent, ZComponent
avr = Average(Input=len)
devec_3 = DeconstructVector(Vector=item_2.Item1)  # -> XComponent, YComponent, ZComponent
Z = UnitZ(Factor=neg)
avr_2 = Average(Input=len_2)
duppt = RemoveDuplicatePts(Points=cp.Points, Tolerance=0.01)  # -> flatten(UniquePoints)
Z_2 = UnitZ(Factor=neg_2)
load = Load(Point=demesh_3.Vertices, ForceVector="0,0,-0.001")
division = Division(A=avr, B=Slider(2, range=0..10))
pt_5 = ConstructPoint(XCoordinate=devec_2.XComponent, YCoordinate=devec_2.YComponent, ZCoordinate="0")
length_line = LengthLine(Line=[medges_6.NakedEdges, medges_6.InteriorEdges], Strength=10)
anchor = Anchor(Point=pt, Strength=10000)
smooth = Smooth(M=geo, Strength=1)
viewer_3 = ParamViewer(duppt)
wind = Wind(Mesh=geo, WindVector=multiplication)
show = Show(G=geo)
division_2 = Division(A=avr_2, B=3)
sequence = Sequence(Frames=Slider(10, range=0..10))
load_2 = Load(Point=demesh.Vertices, ForceVector=Z)
pt_6 = ConstructPoint(XCoordinate=devec_3.XComponent, YCoordinate=devec_3.YComponent, ZCoordinate="0")
length_line_2 = LengthLine(Line=[medges_7.NakedEdges, medges_7.InteriorEdges], Strength=10)
anchor_2 = Anchor(Point=pt_2, Strength=10000)
smooth_2 = Smooth(M=tri.Mesh, Strength=1)
wind_2 = Wind(Mesh=tri.Mesh, WindVector=multiplication_2)
show_2 = Show(G=geo_2)
load_3 = Load(Point=demesh_2.Vertices, ForceVector=Z_2)
sc = SphereCollide(Points=demesh.Vertices, Radius=division, Strength=1)
ln = Line(StartPoint=item.Item, EndPoint=pt_5)
sc_2 = SphereCollide(Points=demesh_2.Vertices, Radius=division_2, Strength=1)
ln_2 = Line(StartPoint=item_2.Item, EndPoint=pt_6)
anchor_3 = Anchor(Point=pt_3, Strength=10000)
sc_3 = SphereCollide(Points=demesh_3.Vertices, Radius=Slider(1, range=0..1), Strength=Slider(10, range=0..10))
meshmachine = MeshMachine(
    Geometry=mesh_29,
    Length=Slider(4.5, range=0.1..5),
    FixVertices=duppt,
    Flip=1,
    PullStrength=0.8,
    CurvatureAdaptivity=0,
    BoundaryScale=1,
    BoundaryDistance=5,
    Exponent=2,
    Background=0.5,
    Iterations=Slider(1, range=0..10),
    Reset=sequence)
length_line_3 = LengthLine(Line=[medges_8.NakedEdges, medges_8.InteriorEdges], Strength=10)
wind_3 = Wind(Mesh=mesh_30, WindVector=multiplication_3)
grab = Grab(On=True, Strength=1, Range=3)  # -> Grab, Anchors
smooth_3 = Smooth(M=mesh_30, Strength=1)
merge_2 = Merge(Data1=sc, Data2=length_line, Data3=show, Data4=anchor, Data5=wind, Data6=smooth, Data7=load_2)  # -> flatten(Result)
show_3 = Show(G=mesh_30)
merge_3 = Merge(Data1=sc_2, Data2=length_line_2, Data3=show_2, Data4=anchor_2, Data5=wind_2, Data6=smooth_2, Data7=load_3)  # -> flatten(Result)
button = Button()
toggle = BooleanToggle(False)
toggle_2 = BooleanToggle(False)
button_2 = Button()
pmesh = PlanktonMesh(flatten(meshmachine))
bouncysolver = BouncySolver(
    GoalObjects=[length_line_3, show_3, anchor_3, wind_3, smooth_3, load, grab.Grab, sc_3],
    Reset=Button(),
    Threshold=1e-15,
    Tolerance=0.01,
    Damping=0.99,
    Iterations=2,
    On=Toggle(False))  # -> I, V, O
bouncysolver_2 = BouncySolver(GoalObjects=merge_2, Reset=button, Threshold=1e-15, Tolerance=0.01, Damping=0.99, Iterations=10, On=toggle)  # -> I, V, O
bouncysolver_3 = BouncySolver(GoalObjects=merge_2, Reset=button, Threshold=1e-15, Tolerance=0.01, Damping=0.99, Iterations=2, On=toggle)  # -> I, V, O; disabled
rev = ReverseList(List=pmesh)
panel_7 = Panel(bouncysolver_2.I)
bouncysolver_4 = BouncySolver(GoalObjects=merge_3, Reset=button_2, Threshold=1e-15, Tolerance=0.01, Damping=0.99, Iterations=10, On=toggle_2)  # -> I, V, O
bouncysolver_5 = BouncySolver(GoalObjects=merge_3, Reset=button_2, Threshold=1e-15, Tolerance=0.01, Damping=0.99, Iterations=2, On=toggle_2)  # -> I, V, O; disabled
viewer_4 = ParamViewer(pmesh)
panel_8 = Panel(pmesh)
item_3 = ListItem(List=rev, Index=0, Wrap=True)
mesh_31 = Mesh(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)
panel_9 = Panel(bouncysolver.I)
data = Data(bouncysolver.O)
mesh_32 = Mesh(data)
data_2 = Data(bouncysolver_2.O)
mesh_33 = Mesh(mesh_32)
wbloop_3 = WeaverbirdsLoopSubdivision(MeshCurves=mesh_33, Level=1, SmoothNakedEdges=1)
mesh_34 = Mesh(item_3)
panel_10 = Panel(bouncysolver.V)
panel_11 = Panel(bouncysolver_2.V)
panel_12 = Panel(bouncysolver_4.I)
data_3 = Data(bouncysolver_4.O)
vdis_2 = VectorDisplay(Anchor=item.Item, Vector=vec_4)
preview = CustomPreview(
    Geometry=mesh_32,
    Shader={ambient=RGB(0, 0, 0), diffuse=RGB(255, 105, 180), emission=RGB(76, 32, 54), shine=0.5, specular=RGB(255, 255, 255), transparency=0})
panel_13 = Panel(bouncysolver_4.V)
vdis_3 = VectorDisplay(Anchor=item_2.Item, Vector=vec_6)
wbsplitquads = WeaverbirdsConstantQuadsSplitSubdivision(MeshCurves=mesh_34, Level=1, SmoothNakedEdges=1)
panel_14 = Panel(mesh_32)
panel_15 = Panel(data_2)

# ---- group: 2
mesh_35 = Mesh(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)

# ---- group: 1
mesh_36 = Mesh(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)

# ---- group: 0
mesh_37 = Mesh(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)

# ----
panel_16 = Panel(data_3)
mesh_38 = Mesh(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)
mesh_39 = Mesh(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)

# ---- group: 1180
mesh_40 = Mesh(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)

# ---- group: 630
mesh_41 = Mesh(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)

# ----
medges_9 = MeshEdges(Mesh=[mesh_41, mesh_40])  # -> NakedEdges, InteriorEdges, NonManifoldEdges
wbloop_4 = WeaverbirdsLoopSubdivision(MeshCurves=[mesh_40, mesh_41], Level=1, SmoothNakedEdges=1)
panel_17 = Panel(wbloop_4)
