# Grasshopper definition G2-Curve.ghx (Grasshopper 0.9.76)
# plug-ins: Kangaroo2 Components

# The last 3 control points of one curve, and the 2nd and 3rd control points of the other
crv = Curve(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)
crv_2 = Curve(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)
cp = ControlPoints(Curve=crv_2)  # -> Points, Weights, Knots
cp_2 = ControlPoints(Curve=crv)  # -> Points, Weights, Knots
item = ListItem(List=cp.Points, Index=0, Wrap=True)  # -> Item, Item1, Item2, Item3
item_2 = ListItem(List=cp_2.Points, Index=0, Wrap=True)  # -> Item, Item1, Item2, Item3
pt = Point([item_2.Item1, item_2.Item2, item_2.Item3, item.Item1, item.Item2])
g2 = G2(Points=pt, Strength=1)
grab = Grab(On=True, Strength=1, Range=3)  # -> Grab, Anchors
coplanar = CoPlanar(Points=pt, Strength=1)
C = Coincident(Point0=item_2.Item3, Point1=item.Item, Strength=100)
show = Show(G=cp_2.Points)
show_2 = Show(G=cp.Points)
entwine = Entwine(Branch00=show, Branch01=show_2, Branch02=[coplanar, g2, grab.Grab, C], FlattenInputs=True)
solver = Solver(GoalObjects=entwine, Reset=Button(), Threshold=1e-15, Tolerance=0.01, On=Toggle(True))  # -> I, V, O
bang = ExplodeTree(Data=solver.O)  # -> Branch0, Branch1, Branch2
nurbs = NurbsCurve(Vertices=bang.Branch1, Degree=3, Periodic=False)  # -> Curve, Length, Domain
nurbs_2 = NurbsCurve(Vertices=bang.Branch0, Degree=3, Periodic=False)  # -> Curve, Length, Domain
crvgraph = CurvatureGraph(Curve=[nurbs.Curve, nurbs_2.Curve], Density=50, Scale=111)
