# Grasshopper definition Inflation.ghx (Grasshopper 0.9.76)
# plug-ins: Kangaroo2 Components

W = WidthCount(6)
mbox = MeshBox(Base={Plane=PlaneXY(0, 0, 0), X=Domain(-10, 10), Y=Domain(-10, 10), Z=Domain(-10, 10)}, XCount=W, YCount=W, ZCount=W)
tri = Triangulate(Mesh=mbox)  # -> Mesh, Count
mesh = Mesh(mbox)
medges = MeshEdges(Mesh=mesh)  # -> NakedEdges, InteriorEdges, NonManifoldEdges
clean = CombineClean(Meshes=mesh)
medges_2 = MeshEdges(Mesh=clean)  # -> NakedEdges, InteriorEdges, NonManifoldEdges
len = Length(Curve=medges_2.InteriorEdges)
multiplication = Multiplication(A=len, B=Slider(1, range=0..2))
pressure = Pressure(M=clean, Strength=Slider(0.14, range=0..0.2))
length_line = LengthLine(Line=medges_2.InteriorEdges, Length=multiplication, Strength=5)
grab = Grab(On=True, Strength=1, Range=3)  # -> Grab, Anchors
show = Show(G=clean)
toggle = BooleanToggle(False)
button = Button()
merge = Merge(Data1=pressure, Data2=show, Data3=length_line, Data4=grab.Grab)  # -> flatten(Result)
bouncysolver = BouncySolver(GoalObjects=merge, Reset=button, Threshold=1e-15, Tolerance=0.01, Damping=0.99, Iterations=10, On=toggle)  # -> I, V, O
solver = Solver(GoalObjects=merge, Reset=button, Threshold=1e-15, Tolerance=0.01, On=toggle)  # -> I, V, O
data = Data(bouncysolver.O)
material = CreateMaterial(
    Diffuse=ColourSwatch(SwatchColor=RGB(129, 255, 255)),
    Specular=ColourSwatch(SwatchColor=RGB(255, 255, 255)),
    Emission=RGB(0, 0, 0),
    Transparency=0,
    Shine=0)
preview = CustomPreview(Geometry=data, Shader=material)
