# Grasshopper definition Kangaroo1-vs-Kangaroo2.ghx (Grasshopper 0.9.76)
# plug-ins: Kangaroo Components, Weaverbird, Kangaroo2 Components

mplane = MeshPlane(Boundary={Plane=PlaneXY(0, 0, 0), Size=Domain2(u=-10..10, v=-10..10)}, WidthCount=10, HeightCount=10)  # -> Mesh, Area
mplane_2 = MeshPlane(Boundary={Plane=PlaneXY(0, 0, 0), Size=Domain2(u=-10..10, v=-10..10)}, WidthCount=10, HeightCount=10)  # -> Mesh, Area
meshcorners = MeshCorners(M=mplane.Mesh, A=0.5235987756)
wbedges = WeaverbirdsMeshEdges(MeshOrPolylines=mplane.Mesh)
len = Length(Curve=wbedges)
demesh = DeconstructMesh(Mesh=mplane.Mesh)  # -> Vertices, Faces, Colours, Normals
wbedges_2 = WeaverbirdsMeshEdges(MeshOrPolylines=mplane_2.Mesh)
Z = UnitZ(Factor=1)
multiplication = Multiplication(A=len, B=Slider(1, range=0..1))
len_2 = Length(Curve=wbedges_2)
show = Show(G=mplane.Mesh)
meshcorners_2 = MeshCorners(M=mplane_2.Mesh, A=0.5235987756)
Z_2 = UnitZ(Factor=Slider(100, range=0..100))
multiplication_2 = Multiplication(A=len_2, B=Slider(0.74, range=0..1))
demesh_2 = DeconstructMesh(Mesh=mplane_2.Mesh)  # -> Vertices, Faces, Colours, Normals
length_line = LengthLine(Line=wbedges, Length=multiplication, Strength=10)
load = Load(Point=demesh.Vertices, ForceVector=Z)
springs = SpringsFromLine(
    Connection=wbedges_2,
    Stiffness=1000,
    Damping=10,
    RestLength=multiplication_2,
    UpperCutoff=0,
    LowerCutoff=0,
    Plasticity=0)
grab = Grab(On=Toggle(False), Strength=1, Range=3)  # -> Grab, Anchors
uforce = UnaryForce(Point=demesh_2.Vertices, Force=Z_2)
anchor = Anchor(Point=meshcorners, Strength=10000)
timer = Timer(TimerInterval=50, Target=counter)  # disabled
button = Button()
toggle = BooleanToggle(False)
counter = Counter(Reset=Button())
number_slider = Slider(1, range=0..10)
toggle_2 = BooleanToggle(False)
merge = Merge(Data1=springs, Data2=uforce)  # -> flatten(Result)
merge_2 = Merge(Data1=length_line, Data2=load, Data3=anchor, Data4=show)
panel = Panel(counter)
timer_2 = Timer(TimerInterval=20, Target=kangaroo)  # disabled
kangaroo = KangarooPhysics(ForceObjects=merge, AnchorPoints=meshcorners_2, Settings=null, Geometry=mplane_2.Mesh, SimulationReset=Button())  # -> Out, Iterations, ParticlesOut, GeometryOut, KE
stepsolver = StepSolver(GoalObjects=merge_2, Tolerance=0.01, Momentum=False, Damping=0.99, SubIterations=10, Animate=counter)  # -> I, V, O
bouncysolver = BouncySolver(GoalObjects=merge_2, Reset=button, Threshold=1e-15, Tolerance=0.01, Damping=0.99, Iterations=10, On=toggle)  # -> I, V, O
solver = Solver(GoalObjects=merge_2, Reset=button, Threshold=1e-15, Tolerance=0.01, On=toggle)  # -> I, V, O
geo = Geometry(stepsolver.O)
geo_2 = Geometry(bouncysolver.O)
geo_3 = Geometry(kangaroo.GeometryOut)
geo_4 = Geometry(solver.O)

# ==== cluster MeshCorners: Finds the corners of the boundary of a mesh
M = ClusterInput()
medges = MeshEdges(Mesh=M)  # -> NakedEdges, InteriorEdges, NonManifoldEdges
join = JoinCurves(Curves=medges.NakedEdges, Preserve=False)
explode = Explode(Curve=join, Recursive=True)  # -> simplify(Segments), Vertices
shift = ShiftList(List=explode.Segments, Shift=1, Wrap=True)  # -> simplify(List)
end = EndPoints(Curve=explode.Segments)  # -> Start, End
angle = Angle(VectorA=explode.Segments, VectorB=shift)  # -> Angle, Reflex
A = ClusterInput()
smaller = SmallerThan(FirstNumber=A, SecondNumber=angle.Angle)  # -> SmallerThan, OrEqualTo
cull = CullPattern(List=end.End, CullPattern=smaller.SmallerThan)  # -> flatten(List)
L = ClusterOutput(cull)
