# Grasshopper definition Man.ghx (Grasshopper 0.9.76)
# plug-ins: Kangaroo2 Components

# ---- group: left leg
mesh = Mesh(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)
pt = Point([Point(-5.078857177, -0.1742060616, 17.89449148), Point(-3.161097328, -0.1828483227, 17.66560967), Point(-5.537550433, 1.016732794, 3.369991832)])
mesh_2 = Mesh(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)
pt_2 = Point([Point(-5.537550433, 1.016732794, 3.369991832), Point(-6.430589476, 2.465435661, 1.069568867), Point(-4.496441109, 2.454167531, 1.199176471), Point(-7.34786134, -5.521270483, 0.923281954)])
mesh_3 = Mesh(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)
pt_3 = Point([Point(-2.514880539, 0.1857714898, 31.21511437), Point(-5.078857177, -0.1742060616, 17.89449148), Point(-3.161097328, -0.1828483227, 17.66560967)])
rigidbody = RigidBody(Part=mesh, Points=pt, Strength=1)
rigidbody_2 = RigidBody(Part=mesh_2, Points=pt_2, Strength=1)
rigidbody_3 = RigidBody(Part=mesh_3, Points=pt_3, Strength=1)

# ---- group: left arm
mesh_4 = Mesh(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)
pt_4 = Point([Point(-10.12332007, 1.695257578, 39.43066433), Point(-8.884081302, 1.664429082, 38.80033952), Point(-5.100176623, 1.328126919, 47.79017328)])
mesh_5 = Mesh(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)
pt_5 = Point([Point(-12.94093364, -0.1124436933, 31.89736713), Point(-10.12332007, 1.695257578, 39.43066433), Point(-8.884081302, 1.664429082, 38.80033952)])
mesh_6 = Mesh(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)
pt_6 = Point([Point(-13.28579186, -0.7030850762, 25.66018832), Point(-12.04058676, -2.102610933, 27.84237988), Point(-12.4809525, 1.044177289, 26.93518269), Point(-12.94093364, -0.1124436933, 31.89736713)])
rigidbody_4 = RigidBody(Part=mesh_4, Points=pt_4, Strength=1)
rigidbody_5 = RigidBody(Part=mesh_5, Points=pt_5, Strength=1)
rigidbody_6 = RigidBody(Part=mesh_6, Points=pt_6, Strength=1)

# ---- group: lower torso
mesh_7 = Mesh(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)
pt_7 = Point([Point(0, 0, 41), Point(-3.450639567, 0, 38), Point(3.450639567, 0, 38), Point(0, 3.372300964, 35), Point(0, -3.372300964, 35), Point(-2.514880539, 0.1857714898, 31.21511437), Point(2.514880539, 0.1857714898, 31.21511437)])
rigidbody_7 = RigidBody(Part=mesh_7, Points=pt_7, Strength=1)

# ---- group: upper torso
mesh_8 = Mesh(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)
pt_8 = Point([Point(-5.100176623, 1.328126919, 47.79017328), Point(5.100176623, 1.328126919, 47.79017328), Point(0, -3.372300964, 44.71816813), Point(0, 3.372300964, 44.71816813), Point(-3.450639567, 0, 42.66893141), Point(3.450639567, 0, 42.66893141), Point(0, 0, 41), Point(0, 0.09506494604, 52.76109098)])
rigidbody_8 = RigidBody(Part=mesh_8, Points=pt_8, Strength=1)

# ---- group: head
mesh_9 = Mesh(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)
pt_9 = Point([Point(0, 0.09506494604, 52.76109098), Point(-2.44969063, 0.1196395586, 55.16254326), Point(0, -4, 53.80714939), Point(2.44969063, 0.1196395586, 55.16254326)])
rigidbody_9 = RigidBody(Part=mesh_9, Points=pt_9, Strength=1)

# ----
data = Data([rigidbody_3, rigidbody, rigidbody_2])
data_2 = Data([rigidbody_4, rigidbody_5, rigidbody_6])

# ---- group: right leg
mesh_10 = Mesh(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)
pt_10 = Point([Point(3.161097328, -0.1828483227, 17.66560967), Point(5.078857177, -0.1742060616, 17.89449148), Point(5.537550433, 1.016732794, 3.369991832)])
mesh_11 = Mesh(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)
pt_11 = Point([Point(4.496441109, 2.454167531, 1.199176471), Point(6.430589476, 2.465435661, 1.069568867), Point(5.537550433, 1.016732794, 3.369991832), Point(7.34786134, -5.521270483, 0.923281954)])
mesh_12 = Mesh(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)
pt_12 = Point([Point(2.514880539, 0.1857714898, 31.21511437), Point(3.161097328, -0.1828483227, 17.66560967), Point(5.078857177, -0.1742060616, 17.89449148)])
rigidbody_10 = RigidBody(Part=mesh_10, Points=pt_10, Strength=1)
rigidbody_11 = RigidBody(Part=mesh_11, Points=pt_11, Strength=1)
rigidbody_12 = RigidBody(Part=mesh_12, Points=pt_12, Strength=1)

# ---- group: right arm
mesh_13 = Mesh(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)
pt_13 = Point([Point(8.884081302, 1.664429082, 38.80033952), Point(10.12332007, 1.695257578, 39.43066433), Point(5.100176623, 1.328126919, 47.79017328)])
mesh_14 = Mesh(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)
pt_14 = Point([Point(12.94093364, -0.1124436933, 31.89736713), Point(8.884081302, 1.664429082, 38.80033952), Point(10.12332007, 1.695257578, 39.43066433)])
mesh_15 = Mesh(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)
pt_15 = Point([Point(12.04058676, -2.102610933, 27.84237988), Point(12.4809525, 1.044177289, 26.93518269), Point(13.28579186, -0.7030850762, 25.66018832), Point(12.94093364, -0.1124436933, 31.89736713)])
rigidbody_13 = RigidBody(Part=mesh_13, Points=pt_13, Strength=1)
rigidbody_14 = RigidBody(Part=mesh_14, Points=pt_14, Strength=1)
rigidbody_15 = RigidBody(Part=mesh_15, Points=pt_15, Strength=1)

# ----
data_3 = Data([rigidbody_9, rigidbody_8])
data_4 = Data(rigidbody_7)
data_5 = Data([rigidbody_12, rigidbody_10, rigidbody_11])
data_6 = Data([rigidbody_13, rigidbody_14, rigidbody_15])
grab = Grab(On=True, Strength=1, Range=3)  # -> Grab, Anchors
solver = Solver(
    GoalObjects=[data_3, data_2, data_6, data_4, data, data_5, grab.Grab],
    Reset=Button(),
    Threshold=1e-15,
    Tolerance=0.01,
    On=True)  # -> I, V, O
preview = CustomPreview(
    Geometry=solver.O,
    Shader={ambient=RGB(0, 0, 0), diffuse=RGB(255, 105, 180), emission=RGB(76, 32, 54), shine=0.5, specular=RGB(255, 255, 255), transparency=0})
