# Grasshopper definition Mesh-Shell-Hinge.ghx (Grasshopper 0.9.76)
# plug-ins: Kangaroo2 Components

mesh = Mesh(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)
mesh_2 = Mesh(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)
bbox = BoundingBox(Content=mesh, Plane=PlaneXY(0, 0, 0))  # -> Box, Box_2
bbox_2 = BoundingBox(Content=mesh_2, Plane=PlaneXY(0, 0, 0))  # -> Box, Box_2
area = Area(Geometry=bbox.Box)  # -> Area, Centroid
area_2 = Area(Geometry=bbox_2.Box)  # -> Area, Centroid
vec2pt = Vector2Pt(PointA=area.Centroid, PointB="0,0,0", Unitize=False)  # -> Vector, Length
vec2pt_2 = Vector2Pt(PointA=area_2.Centroid, PointB="0,0,0", Unitize=False)  # -> Vector, Length
move = Move(Geometry=mesh, Motion=vec2pt.Vector)  # -> Geometry, Transform
xz = XZPlane(Origin=Point(0, 0, 0))
move_2 = Move(Geometry=mesh_2, Motion=vec2pt_2.Vector)  # -> Geometry, Transform
xz_2 = XZPlane(Origin=Point(0, 0, 0))
rotate = Rotate(Geometry=move.Geometry, Angle="pi", Plane=xz)  # -> Geometry, Transform
rotate_2 = Rotate(Geometry=move_2.Geometry, Angle="pi", Plane=xz_2)  # -> Geometry, Transform
mesh_3 = Mesh(rotate.Geometry)
medges = MeshEdges(Mesh=rotate_2.Geometry)  # -> NakedEdges, InteriorEdges, NonManifoldEdges
mesh_4 = Mesh(rotate_2.Geometry)
hingepoints = HingePoints(Mesh=mesh_3)  # -> _1, _2, _3, _4
medges_2 = MeshEdges(Mesh=mesh_3)  # -> NakedEdges, InteriorEdges, NonManifoldEdges
hingepoints_2 = HingePoints(Mesh=mesh_4)  # -> _1, _2, _3, _4
medges_3 = MeshEdges(Mesh=mesh_4)  # -> NakedEdges, InteriorEdges, NonManifoldEdges
panel = Panel(hingepoints._1)
viewer = ParamViewer(hingepoints._1)
viewer_2 = ParamViewer(hingepoints._2)
hinge = Hinge(FoldStart=hingepoints._1, FoldEnd=hingepoints._2, Tip1=hingepoints._3, Tip2=hingepoints._4, Strength=1)
viewer_3 = ParamViewer(hingepoints._3)
grab = Grab(On=True, Strength=1, Range=3)  # -> Grab, Anchors
length_line = LengthLine(Line=[medges_2.NakedEdges, medges_2.InteriorEdges], Strength=1)
viewer_4 = ParamViewer(hingepoints._4)
show = Show(G=mesh_3)
hinge_2 = Hinge(FoldStart=hingepoints_2._2, FoldEnd=hingepoints_2._1, Tip1=hingepoints_2._4, Tip2=hingepoints_2._3, Strength=1)
grab_2 = Grab(On=True, Strength=1, Range=3)  # -> Grab, Anchors
length_line_2 = LengthLine(Line=[medges_3.NakedEdges, medges_3.InteriorEdges], Strength=1)
show_2 = Show(G=mesh_4)
button = Button()
toggle = BooleanToggle(False)
solver = Solver(GoalObjects=[length_line, hinge, show, grab.Grab], Reset=button, Threshold=1e-15, Tolerance=0.01, On=toggle)  # -> I, V, O
bouncysolver = BouncySolver(
    GoalObjects=[grab.Grab, length_line, show, hinge],
    Reset=button,
    Threshold=1e-15,
    Tolerance=0.01,
    Damping=0.99,
    Iterations=10,
    On=toggle)  # -> I, V, O
solver_2 = Solver(
    GoalObjects=[length_line_2, hinge_2, show_2, grab_2.Grab],
    Reset=Button(),
    Threshold=1e-15,
    Tolerance=0.01,
    On=Toggle(False))  # -> I, V, O
data = Data(bouncysolver.O)
data_2 = Data(solver_2.O)
preview = CustomPreview(
    Geometry=data,
    Shader={ambient=RGB(128, 128, 128), diffuse=RGB(0, 192, 0), emission=RGB(76, 32, 54), shine=0.5, specular=RGB(255, 255, 255), transparency=0})
preview_2 = CustomPreview(
    Geometry=data_2,
    Shader={ambient=RGB(128, 128, 128), diffuse=RGB(0, 192, 0), emission=RGB(76, 32, 54), shine=0.5, specular=RGB(255, 255, 255), transparency=0})
