# Grasshopper definition MeshMachine-1.ghx (Grasshopper 0.9.76)
# plug-ins: Kangaroo Components, PlanktonGh

pt = ConstructPoint(XCoordinate=0, YCoordinate=0, ZCoordinate=0)
crv = Curve([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])
polygon = Polygon(Plane=pt, Radius=Slider(100, range=0..100), Segments=Slider(7, range=0..10), FilletRadius=0)  # -> Polygon, Length
brep = Brep(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)
loft_opt = LoftOptions(Closed=False, Adjust=False, Rebuild=0, Refit=0, Type=Slider(2, range=0..5))
explode = Explode(Curve=polygon.Polygon, Recursive=True)  # -> simplify(graft(Segments)), Vertices
crv_2 = Curve(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)
midpoint = MidPoint(crv=explode.Segments)
loft = Loft(Curves=crv, Options=loft_opt)
boundary = BoundarySurfaces(Edges=crv_2)
number_slider = Slider(10, range=0..10)
end = EndPoints(Curve=explode.Segments)  # -> Start, End
scale = Scale(Geometry=midpoint, Center=pt, Factor=Slider(0.53, range=0..1))  # -> Geometry, Transform
merge = Merge(Data1=end.Start, Data2=scale.Geometry, Data3=end.End)
pline = PolyLine(Vertices=merge, Closed=False)
join = JoinCurves(Curves=flatten(pline), Preserve=False)
intcrv = Interpolate(Vertices=merge, Degree=3, Periodic=False, KnotStyle=1)  # -> Curve, Length, Domain
custom_mesh_settings = SettingsCustom(
    StitchSeams=True,
    SimplePlanes=False,
    Refine=True,
    MinCount=16,
    MaxCount=400,
    AspectRatio=20,
    MaxDistance=0,
    MaxAngle=20,
    MinEdge=number_slider,
    MaxEdge=number_slider)
boundary_2 = BoundarySurfaces(Edges=join)
join_2 = JoinCurves(Curves=flatten(intcrv.Curve), Preserve=False)
boundary_3 = BoundarySurfaces(Edges=join_2)
mesh = MeshBrep(Brep=loft, Settings=custom_mesh_settings)
panel = Panel(boundary_2)
mesh_2 = MeshBrep(Brep=brep, Settings=custom_mesh_settings)
mesh_3 = MeshBrep(Brep=boundary, Settings=custom_mesh_settings)
mesh_4 = MeshBrep(Brep=boundary_3, Settings=custom_mesh_settings)
panel_2 = Panel(boundary_3)
mesh_5 = MeshBrep(Brep=boundary_2, Settings=custom_mesh_settings)
medges = MeshEdges(Mesh=mesh_2)  # -> NakedEdges, InteriorEdges, NonManifoldEdges
mesh_6 = Mesh(mesh_2)
medges_2 = MeshEdges(Mesh=mesh_6)  # -> NakedEdges, InteriorEdges, NonManifoldEdges
medges_3 = MeshEdges(Mesh=mesh_3)  # -> NakedEdges, InteriorEdges, NonManifoldEdges
medges_4 = MeshEdges(Mesh=mesh_6)  # -> NakedEdges, InteriorEdges, NonManifoldEdges
viewer = ParamViewer(medges_4.NakedEdges)
crv_3 = Curve(medges_4.NakedEdges)
join_3 = JoinCurves(Curves=medges_4.NakedEdges, Preserve=False)
move = Move(Geometry=[medges_3.NakedEdges, medges_3.InteriorEdges, medges_3.NonManifoldEdges], Motion="0,200,0")  # -> Geometry, Transform
cp = ControlPoints(Curve=join_3)  # -> Points, Weights, Knots
viewer_2 = ParamViewer(cp.Points)
pt_2 = Point(cp.Points)
duppt = RemoveDuplicatePts(Points=cp.Points, Tolerance=0.01)
multiplication = Multiplication(A=Slider(3.52, range=0..10), B=Slider(2.16, range=1..4))
viewer_3 = ParamViewer(duppt)
sequence = Sequence(Frames=Slider(10, range=0..10))
meshmachine = MeshMachine(
    Geometry=mesh_6,
    Length=multiplication,
    FixVertices=duppt,
    Flip=1,
    PullStrength=0.8,
    CurvatureAdaptivity=0,
    BoundaryScale=1,
    BoundaryDistance=5,
    Exponent=2,
    Background=0.5,
    Iterations=Slider(1, range=0..10),
    Reset=sequence)
pmesh = PlanktonMesh(flatten(meshmachine))
rev = ReverseList(List=pmesh)
viewer_4 = ParamViewer(pmesh)
panel_3 = Panel(pmesh)
item = ListItem(List=rev, Index=0, Wrap=True)
mesh_7 = Mesh(item)
medges_5 = MeshEdges(Mesh=mesh_7)  # -> NakedEdges, InteriorEdges, NonManifoldEdges

# ==== cluster MidPoint: Middle Point of Curve
crv = ClusterInput()
num = Number(0.5)
eval = EvaluateLength(Curve=crv, Length=num, Normalized=True)  # -> Point, Tangent, Parameter
pt = ClusterOutput(eval.Point)
