# Grasshopper definition MeshMachine-2.ghx (Grasshopper 0.9.76)
# plug-ins: Kangaroo Components, PlanktonGh

brep = Brep(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)

# ---- group: box
brep_2 = Brep(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)

# ---- group: v
brep_3 = Brep(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)

# ---- group: v fillet
brep_4 = Brep(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)

# ----
number_slider = Slider(4, range=0..10)
mesh = MeshBrep(
    Brep=brep,
    Settings={GridMaxCount=0, GridMinCount=16, JaggedSeams=False, MaxEdgeLength=0, MinEdgeLength=0.0001, MinTolerance=0, Refine=True, RefineAngle=0, RelativeTolerance=0.65, SimplePlanes=True, Tolerance=0})
brep_5 = Brep(brep_4)
custom_mesh_settings = SettingsCustom(
    StitchSeams=True,
    SimplePlanes=False,
    Refine=True,
    MinCount=16,
    MaxCount=400,
    AspectRatio=20,
    MaxDistance=0,
    MaxAngle=20,
    MinEdge=number_slider,
    MaxEdge=number_slider)
mesh_2 = MeshBrep(Brep=brep_5, Settings=custom_mesh_settings)
tri = Triangulate(Mesh=mesh_2)  # -> Mesh, Count
medges = MeshEdges(Mesh=mesh_2)  # -> NakedEdges, InteriorEdges, NonManifoldEdges
panel = Panel(mesh_2)
mesh_3 = Mesh(mesh_2)
debrep = DeconstructBrep(Brep=brep_5)  # -> Faces, Edges, Vertices
mesh_4 = Mesh(mesh_3)
medges_2 = MeshEdges(Mesh=mesh_4)  # -> NakedEdges, InteriorEdges, NonManifoldEdges
medges_3 = MeshEdges(Mesh=mesh_4)  # -> NakedEdges, InteriorEdges, NonManifoldEdges
crv = Curve(medges_3.InteriorEdges)
crv_2 = Curve(medges_3.NakedEdges)
join = JoinCurves(Curves=debrep.Edges, Preserve=False)
viewer = ParamViewer(medges_3.NakedEdges)
divide = DivideCurve(Curve=debrep.Edges, Count=Slider(20, range=0..100), Kinks=False)  # -> Points, Tangents, Parameters
cp = ControlPoints(Curve=join)  # -> Points, Weights, Knots
viewer_2 = ParamViewer(cp.Points)
pt = Point(divide.Points)
duppt = RemoveDuplicatePts(Points=pt, Tolerance=0.01)  # -> flatten(UniquePoints)
viewer_3 = ParamViewer(duppt)
sequence = Sequence(Frames=Slider(10, range=0..10))
meshmachine = MeshMachine(
    Geometry=mesh_4,
    Length=Slider(1, range=0..10),
    FixVertices=duppt,
    Flip=1,
    PullStrength=0.8,
    CurvatureAdaptivity=0,
    BoundaryScale=1,
    BoundaryDistance=5,
    Exponent=2,
    Background=0.5,
    Iterations=Slider(1, range=0..10),
    Reset=sequence)
pmesh = PlanktonMesh(flatten(meshmachine))
rev = ReverseList(List=pmesh)
viewer_4 = ParamViewer(pmesh)
panel_2 = Panel(pmesh)
item = ListItem(List=rev, Index=0, Wrap=True)
mesh_5 = Mesh(item)
medges_4 = MeshEdges(Mesh=mesh_5)  # -> NakedEdges, InteriorEdges, NonManifoldEdges
