# Grasshopper definition MeshMap-Morphing.ghx (Grasshopper 0.9.76)
# plug-ins: Kangaroo2 Components

# ---- group: source rectangle
mesh = Mesh(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)

# ---- group: target rectangle
mesh_2 = Mesh(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)

# ---- group: mesh to transform
mesh_3 = Mesh(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)

# ---- group: source rectangle
mesh_4 = Mesh(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)

# ---- group: target rectangle
mesh_5 = Mesh(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)

# ---- group: mesh to transform
mesh_6 = Mesh(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)

# ----
preview = CustomPreview(
    Geometry=mesh_3,
    Shader={ambient=RGB(0, 0, 0), diffuse=RGB(255, 105, 180), emission=RGB(76, 32, 54), shine=0.5, specular=RGB(255, 255, 255), transparency=0})
preview_2 = CustomPreview(
    Geometry=mesh_6,
    Shader={ambient=RGB(0, 0, 0), diffuse=RGB(255, 105, 180), emission=RGB(76, 32, 54), shine=0.5, specular=RGB(255, 255, 255), transparency=0})
panel = Panel(mesh_4)
panel_2 = Panel(mesh_5)
demesh = DeconstructMesh(Mesh=mesh_3)  # -> Vertices, Faces, Colours, Normals
corners = Corners(mesh=mesh)
corners_2 = Corners(mesh=mesh_2)
demesh_2 = DeconstructMesh(Mesh=mesh_4)  # -> Vertices, Faces, Colours, Normals
corners_3 = Corners(mesh=mesh_4)
corners_4 = Corners(mesh=mesh_5)
meshmap = MeshMap(SourceMesh=mesh, TargetMesh=mesh_2, Point=demesh.Vertices, Distance=1)
meshmap_2 = MeshMap(SourceMesh=mesh_4, TargetMesh=mesh_5, Point=demesh_2.Vertices, Distance=1)
vec2pt = Vector2Pt(PointA=corners, PointB=corners_2, Unitize=False)  # -> Vector, Length
vec2pt_2 = Vector2Pt(PointA=corners_3, PointB=corners_4, Unitize=False)  # -> Vector, Length
vdis = VectorDisplay(Anchor=corners, Vector=vec2pt.Vector)
conmesh = ConstructMesh(Vertices=meshmap, Faces=demesh.Faces)
vdis_2 = VectorDisplay(Anchor=corners_3, Vector=vec2pt_2.Vector)
conmesh_2 = ConstructMesh(Vertices=meshmap_2, Faces=demesh_2.Faces)
mesh_7 = Mesh(conmesh)
mesh_8 = Mesh(conmesh_2)
preview_3 = CustomPreview(
    Geometry=mesh_7,
    Shader={ambient=RGB(0, 0, 0), diffuse=RGB(255, 105, 180), emission=RGB(76, 32, 54), shine=0.5, specular=RGB(255, 255, 255), transparency=0})
preview_4 = CustomPreview(
    Geometry=mesh_8,
    Shader={ambient=RGB(0, 0, 0), diffuse=RGB(255, 105, 180), emission=RGB(76, 32, 54), shine=0.5, specular=RGB(255, 255, 255), transparency=0})

# ==== cluster Corners: Find the boundary corner points of a quad mesh
mesh = ClusterInput()
mesh_2 = Mesh(mesh)
nv = NakedVertices(Mesh=mesh_2)  # -> ClothedIndex, NakedIndex, ClothedPts, NakedPts
vn = VertexNeighbours(Mesh=mesh_2, VertexNumber=nv.NakedIndex)  # -> graft(Vertex), Neighbours, Normal
lng = ListLength(List=vn.Neighbours)
equals = Equality(FirstNumber=lng, SecondNumber=3)  # -> Equality, Inequality
cull = CullPattern(List=vn.Vertex, CullPattern=equals.Inequality)
pshift = ShiftPaths(Data=cull, Offset=-1)
D = ClusterOutput(pshift)
