# Grasshopper definition OnMesh-British_Museum.ghx (Grasshopper 0.9.76)
# plug-ins: Kangaroo2 Components

mesh = Mesh(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)
medges = MeshEdges(Mesh=mesh)  # -> NakedEdges, InteriorEdges, NonManifoldEdges
join = JoinCurves(Curves=medges.NakedEdges, Preserve=False)
len = Length(Curve=join)
mesh_2 = Mesh(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)
crv = Curve(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)
crv_2 = Curve(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)
sort = SortList(Keys=len, ValuesA=join)  # -> Keys, ValuesA
area = Area(Geometry=mesh_2)  # -> Area, Centroid
demesh = DeconstructMesh(Mesh=mesh)  # -> Vertices, Faces, Colours, Normals
item = ListItem(List=sort.ValuesA, Index=0, Wrap=True)  # -> Item, Item1
mc = MeshCorners(Mesh=mesh, Angle=2.35619449)
merge = Merge(Data1=crv_2, Data2=crv)
pdecon = Deconstruct(Point=area.Centroid)  # -> XComponent, YComponent, ZComponent
pt = Point(mc)
pt_2 = ConstructPoint(XCoordinate=pdecon.XComponent, YCoordinate=pdecon.YComponent, ZCoordinate=0)
explode = Explode(Curve=item.Item, Recursive=True)  # -> Segments, Vertices
explode_2 = Explode(Curve=item.Item1, Recursive=True)  # -> Segments, Vertices
pt_3 = Point(demesh.Vertices)
pipe = Pipe(Curve=merge, Radius=Slider(0.1, range=0..1), Caps=0)
scale_nu = ScaleNU(Geometry=mesh_2, Plane=pt_2, ScaleX=1, ScaleY=1, ScaleZ=Slider(2.8, range=0..10))  # -> Geometry, Transform
end = EndPoints(Curve=explode_2.Segments)  # -> Start, End
end_2 = EndPoints(Curve=explode.Segments)  # -> Start, End
strength = Strength(1000)
oncurve = OnCurve(Points=end_2.Start, Curve=crv_2, Strength=strength)
oncurve_2 = OnCurve(Points=end.Start, Curve=crv, Strength=strength)
length_line = LengthLine(Line=[medges.InteriorEdges, medges.NakedEdges], Length=0, Strength=0.1)
anchor = Anchor(Point=mc, Strength=10000)
onmesh = OnMesh(Points=demesh.Vertices, Mesh=scale_nu.Geometry, Strength=1)
show = Show(G=mesh)
merge_2 = Merge(Data1=show, Data2=oncurve, Data3=oncurve_2, Data4=length_line, Data5=anchor, Data6=onmesh)  # -> flatten(Result)
solver = Solver(GoalObjects=merge_2, Reset=Button(), Threshold=1e-15, Tolerance=0.01, On=Toggle(False))  # -> I, V, flatten(O)
item_2 = ListItem(List=solver.O, Index=0, Wrap=True)
medges_2 = MeshEdges(Mesh=item_2)  # -> NakedEdges, InteriorEdges, NonManifoldEdges
