# Grasshopper definition Optimization-EdgeEqualize.ghx (Grasshopper 0.9.76)
# plug-ins: Kangaroo2 Components

mesh = Mesh(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)
tri = Triangulate(Mesh=mesh)  # -> Mesh, Count
demesh = DeconstructMesh(Mesh=mesh)  # -> Vertices, Faces, Colours, Normals
lng = ListLength(List=demesh.Vertices)
dom = ConstructDomain(DomainStart=Slider(0, range=0..100), DomainEnd=lng)
random = Random(Range=dom, Number=Slider(3, range=1..10), Seed=Slider(15, range=0..30))
medges = MeshEdges(Mesh=tri.Mesh)  # -> NakedEdges, InteriorEdges, NonManifoldEdges
faceb = FaceBoundaries(Mesh=tri.Mesh)
xz = XZPlane(Origin=Point(0, 0, 0))
int = Integer(random)
explode = Explode(Curve=faceb, Recursive=True)  # -> Segments, Vertices
crv = Curve([medges.NakedEdges, medges.InteriorEdges])
item = ListItem(List=demesh.Vertices, Index=int, Wrap=True)
grab = Grab(On=True, Strength=1, Range=3)  # -> Grab, Anchors
panel = Panel(item)
onplane = OnPlane(Points=demesh.Vertices, Plane=xz, Strength=1)
anchor = Anchor(Point=item, Strength=1000)
equallength = EqualLength(Line=explode.Segments, Strength=1)
show = Show(G=crv)
solver = Solver(
    GoalObjects=[grab.Grab, show, equallength, onplane, anchor],
    Reset=Button(),
    Threshold=1e-15,
    Tolerance=0.01,
    On=Toggle(True))  # -> I, V, O
data = Data(solver.O)
