# Grasshopper definition Optimization-Maintain-OriginalGrid.ghx (Grasshopper 0.9.76)
# plug-ins: Kangaroo2 Components

mesh = Mesh(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)
warpweft = WarpWeft(Mesh=mesh)  # -> Warp, Weft, NakedA, NakedB
demesh = DeconstructMesh(Mesh=mesh)  # -> Vertices, Faces, Colours, Normals
lng = ListLength(List=demesh.Vertices)
dom = ConstructDomain(DomainStart=Slider(0, range=0..100), DomainEnd=lng)
random = Random(Range=dom, Number=Slider(5, range=1..10), Seed=Slider(15, range=0..30))
int = Integer(random)
mc = MeshCorners(Mesh=mesh, Angle=2.35619449)
join = JoinCurves(Curves=warpweft.Weft, Preserve=False)
join_2 = JoinCurves(Curves=warpweft.Warp, Preserve=False)
item = ListItem(List=demesh.Vertices, Index=int, Wrap=True)
explode = Explode(Curve=join, Recursive=True)  # -> Segments, Vertices
explode_2 = Explode(Curve=join_2, Recursive=True)  # -> Segments, Vertices
medges = MeshEdges(Mesh=mesh)  # -> NakedEdges, InteriorEdges, NonManifoldEdges
shift = ShiftList(List=explode.Segments, Shift=1, Wrap=False)
shift_2 = ShiftList(List=explode_2.Segments, Shift=1, Wrap=False)
pt = Point(mc)
pt_2 = Point(mc)
smooth = Smooth(M=mesh, Strength=1)
short = ShortestList(ListA=explode.Segments, ListB=shift, TrimMode=2)  # -> ListA, ListB
anchor = Anchor(Point=pt, Strength=10000)
short_2 = ShortestList(ListA=explode_2.Segments, ListB=shift_2, TrimMode=2)  # -> ListA, ListB
length_line = LengthLine(Line=[medges.NakedEdges, medges.InteriorEdges], Strength=1)
onplane = OnPlane(Points=demesh.Vertices, Plane=PlaneXY(0, 0, 0), Strength=1)
show = Show(G=mesh)
angle = Angle(LineA=short.ListA, LineB=short.ListB, Strength=0.1)
angle_2 = Angle(LineA=short_2.ListA, LineB=short_2.ListB, Strength=1)
grab = Grab(On=True, Strength=1, Range=3)  # -> Grab, Anchors
solver = Solver(
    GoalObjects=[angle_2, angle, show, grab.Grab, onplane, length_line, smooth, anchor],
    Reset=Button(),
    Threshold=1e-15,
    Tolerance=0.01,
    On=Toggle(False))  # -> I, V, O
data = Data(solver.O)
