# Grasshopper definition Optimization-Tangent-InCircles.ghx (Grasshopper 0.9.76)
# plug-ins: Kangaroo2 Components

pop2d = Populate2D(Region={Plane=PlaneXY(0, 0, 0), Size=Domain2(u=0..20, v=0..10)}, Count=100, Seed=1)
del = DelaunayMesh(Points=pop2d, Plane=PlaneXY(0, 0, 0))
hingepoints = HingePoints(Mesh=del)  # -> _1, _2, _3, _4
onplane = OnPlane(Points=pop2d, Plane=PlaneXY(0, 0, 0), Strength=1)
grab = Grab(On=True, Strength=1, Range=3)  # -> Grab, Anchors
show = Show(G=del)
tangentincircles = TangentIncircles(EdgeStart=hingepoints._1, EdgeEnd=hingepoints._2, Tip1=hingepoints._3, Tip2=hingepoints._4, Strength=1)
solver = Solver(
    GoalObjects=[tangentincircles, show, onplane, grab.Grab],
    Reset=Button(),
    Restart=False,
    Parallel=True,
    Threshold=1e-15,
    Tolerance=0.01,
    AddCurrent=False,
    On=True)  # -> V, O
item = ListItem(List=solver.O, Index=0, Wrap=True)
faceb = FaceBoundaries(Mesh=item)
medges = MeshEdges(Mesh=item)  # -> NakedEdges, InteriorEdges, NonManifoldEdges
explode = Explode(Curve=faceb, Recursive=True)  # -> Segments, Vertices
item_2 = ListItem(List=explode.Vertices, Index=0, Wrap=True)  # -> Item, Item1, Item2
pt = Point(explode.Vertices)

# ---- group: circlepacking
tangentcircles = TangentCircles(mesh=item)

# ---- group: incircles
incircle = InCircle(CornerA=item_2.Item, CornerB=item_2.Item1, CornerC=item_2.Item2)  # -> Circle, Plane, Radius

# ----
boundary = BoundarySurfaces(Edges=incircle.Circle)  # disabled

# ==== cluster TangentCircles: A compact circle packing from a flat mesh
mesh = ClusterInput()
mesh_2 = Mesh(mesh)
nv = NakedVertices(Mesh=mesh_2)  # -> ClothedIndex, NakedIndex, ClothedPts, NakedPts
vn = VertexNeighbours(Mesh=mesh_2, VertexNumber=nv.ClothedIndex)  # -> graft(Vertex), Neighbours, Normal
item = ListItem(List=vn.Neighbours, Index=0, Wrap=True)  # -> Item, Item1
dist = Distance(PointA=item.Item, PointB=item.Item1)
dist_2 = Distance(PointA=vn.Vertex, PointB=[item.Item, item.Item1])
ma = MassAddition(Input=[dist_2, dist])  # -> Result, PartialResults
multiplication = Multiplication(A=ma.Result, B=0.5)
pl = PlaneNormal(Origin=vn.Vertex, ZAxis=graft(vn.Normal))
subtraction = Subtraction(A=multiplication, B=dist)
cir = Circle(Plane=pl, Radius=subtraction)  # -> flatten(Circle)
C = ClusterOutput(cir)
