# Grasshopper definition Raisin.ghx (Grasshopper 0.9.76)
# plug-ins: Weaverbird, Kangaroo2 Components

wbicosahedron = WeaverbirdsMeshMeshIcosahedron(Plane=PlaneXY(0, 0, 0), Radius=5)
wbloop = WeaverbirdsLoopSubdivision(MeshCurves=wbicosahedron, Level=3, SmoothNakedEdges=1)
medges = MeshEdges(Mesh=wbloop)  # -> NakedEdges, InteriorEdges, NonManifoldEdges
mesh = Mesh(wbloop)
medges_2 = MeshEdges(Mesh=mesh)  # -> NakedEdges, InteriorEdges, NonManifoldEdges
volume = Volume(Geometry=mesh)  # -> Volume, Centroid
multiplication = Multiplication(A=Slider(0, range=0..1), B=volume.Volume)
len = Length(Curve=medges_2.InteriorEdges)
avr = Average(Input=len)
demesh = DeconstructMesh(Mesh=mesh)  # -> Vertices, Faces, Colours, Normals
volume_2 = Volume(Mesh=mesh, Volume=multiplication, Strength=0.2)
length_line = LengthLine(Line=medges_2.InteriorEdges, Strength=1)
smooth = Smooth(M=mesh, Strength=0.1)
grab = Grab(On=True, Strength=1, Range=3)  # -> Grab, Anchors
multiplication_2 = Multiplication(A=avr, B=0.5)
show = Show(G=mesh)
sc = SphereCollide(Points=demesh.Vertices, Radius=multiplication_2, Strength=10)
toggle = BooleanToggle(False)
reset = Button()
merge = Merge(Data1=volume_2, Data2=show, Data3=length_line, Data4=smooth, Data5=sc, Data6=grab.Grab)  # -> flatten(Result)
bouncysolver = BouncySolver(GoalObjects=merge, Reset=reset, Threshold=1e-15, Tolerance=0.01, Damping=0.99, Iterations=10, On=toggle)  # -> I, V, O; disabled
solver = Solver(GoalObjects=merge, Reset=reset, Threshold=1e-15, Tolerance=0.01, On=toggle)  # -> I, V, O
item = ListItem(List=solver.O, Index=1, Wrap=True)
wbloop_2 = WeaverbirdsLoopSubdivision(MeshCurves=item, Level=2, SmoothNakedEdges=1)
preview = CustomPreview(
    Geometry=wbloop_2,
    Shader={ambient=RGB(128, 128, 128), diffuse=RGB(108, 44, 10), emission=RGB(64, 0, 0), shine=0.5, specular=RGB(255, 255, 255), transparency=0})
