# Grasshopper definition Simple-Tent-JH.ghx (Grasshopper 0.9.76)
# plug-ins: Kangaroo2 Components

number_slider = Slider(85, range=0..100)
number_slider_2 = Slider(50, range=0..100)
md_slider = MDSlider(
    slider_value=Point(0.5549878376, 0.5105732243, 0.5),
    SliderMode=0,
    x_domain=Domain(0, 1),
    y_domain=Domain(0, 1),
    z_domain=Domain(0, 1))
rectangle = Rectangle(Plane=PlaneXY(0, 0, 0), XSize=number_slider, YSize=number_slider, Radius=0)  # -> Rectangle, Length
mplane = MeshPlane(Boundary=rectangle.Rectangle, WidthCount=number_slider_2, HeightCount=number_slider_2)  # -> Mesh, Area
boundary = BoundarySurfaces(Edges=rectangle.Rectangle)
explode = Explode(Curve=rectangle.Rectangle, Recursive=True)  # -> Segments, Vertices
srf = Surface(reparameterize(boundary))
panel = Panel(explode.Vertices)

# ---- group: center
number_slider_3 = Slider(50, range=0..50)

# ----
viewer = ParamViewer(explode.Vertices)
cull_i = CullIndex(List=explode.Vertices, Indices="0", Wrap=True)
panel_2 = Panel(cull_i)
duppt = RemoveDuplicatePts(Points=explode.Vertices, Tolerance=0.01)
panel_3 = Panel(duppt)
evalsrf = EvaluateSurface(Surface=srf, Point=md_slider)  # -> Point, Normal, Frame
merge = Merge(
    Data1=Slider(19.28, range=0..50),
    Data2=Slider(34.64, range=0..50),
    Data3=Slider(19.28, range=0..50),
    Data4=Slider(38.8, range=0..50),
    Data5=number_slider_3)
demesh = DeconstructMesh(Mesh=mplane.Mesh)  # -> Vertices, Faces, Colours, Normals
panel_4 = Panel(evalsrf.Point)
Z = UnitZ(Factor=merge)
pt = Point(flatten(duppt))
cp = ClosestPoint(Point=evalsrf.Point, Cloud=demesh.Vertices)  # -> flatten(ClosestPoint), CPIndex, Distance
panel_5 = Panel(cp.ClosestPoint)
merge_2 = Merge(Data1=pt, Data2=cp.ClosestPoint)
medges = MeshEdges(Mesh=mplane.Mesh)  # -> NakedEdges, InteriorEdges, NonManifoldEdges
neg = Negative(Value=Slider(0.01, range=0..1))
merge_3 = Merge(Data1=medges.NakedEdges, Data2=medges.InteriorEdges, Data3=medges.NonManifoldEdges)

# ---- group: anchor
move = Move(Geometry=merge_2, Motion=Z)  # -> Geometry, Transform

# ----
Z_2 = UnitZ(Factor=neg)
len = Length(Curve=merge_3)
geo = Geometry(mplane.Mesh)
multiplication = Multiplication(A=len, B=Slider(1, range=0..1.5))
panel_6 = Panel("すべての点に下向きベクター")
anchor = Anchor(Point=merge_2, Target=move.Geometry, Strength=10000)
length_line = LengthLine(Line=merge_3, Length=multiplication, Strength=10)
load = Load(Point=demesh.Vertices, ForceVector=Z_2)
show = Show(G=geo)
pt_2 = Point(demesh.Vertices)
ln = Line(StartPoint=merge_2, EndPoint=move.Geometry)
pipe = Pipe(Curve=ln, Radius=Slider(0.5, range=0..10), Caps=0)
merge_4 = Merge(Data1=flatten(show), Data2=flatten(anchor), Data3=flatten(length_line), Data4=flatten(load))
solver = Solver(
    GoalObjects=merge_4,
    Reset=Button(),
    Restart=False,
    Parallel=True,
    Threshold=1e-15,
    Tolerance=0.01,
    AddCurrent=False,
    On=Toggle(False))  # -> V, O
item = ListItem(List=solver.O, Index=0, Wrap=True)
mesh = Mesh(item)
preview = CustomPreview(Geometry=pipe, Shader=ColourSwatch(SwatchColor=RGB(240, 70, 70)))
preview_2 = CustomPreview(Geometry=item, Shader=ColourSwatch(SwatchColor=RGBA(107, 235, 255, 200)))
