# Grasshopper definition SplitAtCorners.ghx (Grasshopper 0.9.76)
# plug-ins: Kangaroo2 Components

# Note that the angle is between consecutive segments in the same direction. So 0 is a straight line
B = Boundary({Plane=PlaneXY(0, 0, 0), Size=Domain2(u=-10..10, v=-10..10)})
mplane = MeshPlane(Boundary=B, WidthCount=10, HeightCount=10)  # -> Mesh, Area
mc = MeshCorners(Mesh=mplane.Mesh, Angle=2.35619449)
crv = Curve(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)
medges = MeshEdges(Mesh=mplane.Mesh)  # -> NakedEdges, InteriorEdges, NonManifoldEdges
join = JoinCurves(Curves=medges.NakedEdges, Preserve=False)
disc = Discontinuity(Curve=crv, Level=1)  # -> Points, Parameters
splitatcorners = SplitAtCorners(Poly=crv, Angle=Slider(1.039, range=0..3.141))  # -> Corners, Parts
disc_2 = Discontinuity(Curve=join, Level=1)  # -> Points, Parameters
splitatcorners_2 = SplitAtCorners(Poly=join, Angle=1)  # -> Corners, Parts
pt = Point(splitatcorners.Corners)
viewer = ParamViewer(pt)
viewer_2 = ParamViewer(disc.Points)
item = ListItem(List=splitatcorners_2.Parts, Index=0, Wrap=True)
pt_2 = Point(splitatcorners_2.Corners)
pipe = Pipe(Curve=item, Radius=1, Caps=0)
panel = Panel(pt)
panel_2 = Panel(disc.Points)
panel_3 = Panel(pt_2)
panel_4 = Panel(mc)
panel_5 = Panel(disc_2.Points)
