# Grasshopper definition Tensegrity-1-2.ghx (Grasshopper 0.9.76)
# plug-ins: Kangaroo Components, Kangaroo2 Components

pt = Point(Point(0, 0, 10))
sph = Sphere(Base=pt, Radius=1)

# ---- group: Cable
cables = Curve([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])

# ----
struts = Curve([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])

# ---- group: Gravity
slider = Slider(-100, range=-100..900)

# ----
mesh = Mesh(sph)

# ---- group: Cable
cables_2 = Curve([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])

# ----
struts_2 = Curve([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])
div = DivideDomain(Domain=Domain(0, 1), Count=10)

# ---- group: Cable pre-tension
slider_2 = Slider(0.644, range=0..1)

# ---- group: Gravity
slider_3 = Slider(-100, range=-100..900)

# ----
Z = UnitZ(Factor=1)
div_2 = DivideDomain(Domain=Domain(0, 1), Count=10)
Z_2 = UnitZ(Factor=slider)

# ---- group: Cable pre-tension
slider_4 = Slider(0.644, range=0..1)

# ----
subcrv = SubCurve(BaseCurve=reparameterize(graft(cables)), Domain=div)
end = EndPoints(Curve=struts)  # -> Start, End
neg = Negative(Value=Z)
Z_3 = UnitZ(Factor=slider_3)
subcrv_2 = SubCurve(BaseCurve=reparameterize(graft(cables_2)), Domain=div_2)
end_2 = EndPoints(Curve=struts_2)  # -> Start, End
len = Length(Curve=subcrv)
springs = SpringsFromLine(
    Connection=struts,
    Stiffness=5000,
    Damping=10,
    RestLength=struts,
    Cutoff=0,
    CompressionFail=0,
    TensileFail=0,
    Plasticity=0)
uforce = UnaryForce(Point=[end.Start, end.End], Force=Z_2)
rigidbody = RigidBody(Part=mesh, Strength=10)  # -> RigidBody, Planes
floor = Floor(Strength=1)
kangaroo_settings = KangarooSettings(
    Tolerance=0.001,
    TimeStep=0.01,
    SubIterations=20,
    Floor=True,
    Drag=1,
    Restitution=0.7,
    StaticFriction=10,
    KineticFriction=10,
    Settle=2,
    Tumble=1,
    Sound=False,
    Solver=0)
multiplication = Multiplication(A=len, B=slider_2)
len_2 = Length(Curve=subcrv_2)
line = Line([subcrv, struts])
load = Load(ForceVector=neg)
springs_2 = SpringsFromLine(
    Connection=struts_2,
    Stiffness=5000,
    Damping=10,
    RestLength=struts_2,
    Cutoff=0,
    CompressionFail=0,
    TensileFail=0,
    Plasticity=0)
show = Show(G=mesh)
kangaroo_settings_2 = KangarooSettings(
    Tolerance=0.001,
    TimeStep=0.01,
    SubIterations=20,
    Floor=True,
    Drag=1,
    Restitution=0.7,
    StaticFriction=10,
    KineticFriction=10,
    Settle=2,
    Tumble=1,
    Sound=False,
    Solver=0)
multiplication_2 = Multiplication(A=len_2, B=slider_4)
uforce_2 = UnaryForce(Point=[end_2.Start, end_2.End], Force=Z_3)
line_2 = Line([subcrv_2, struts_2])
springs_3 = SpringsFromLine(
    Connection=subcrv,
    Stiffness=1000,
    Damping=10,
    RestLength=multiplication,
    Cutoff=0,
    CompressionFail=0,
    TensileFail=0,
    Plasticity=0)
springs_4 = SpringsFromLine(
    Connection=subcrv_2,
    Stiffness=1000,
    Damping=10,
    RestLength=multiplication_2,
    Cutoff=0,
    CompressionFail=0,
    TensileFail=0,
    Plasticity=0)

timer = Timer(TimerInterval=1, Target=kangaroo)

kangaroo = KangarooPhysics(
    ForceObjects=flatten([springs_3, springs, uforce]),
    Settings=kangaroo_settings,
    Geometry=line,
    SimulationReset=Toggle(False))  # -> Out, Iterations, ParticlesOut, GeometryOut, KE

timer_2 = Timer(TimerInterval=1, Target=kangaroo_2)

bouncysolver = BouncySolver(
    GoalObjects=[floor, rigidbody.RigidBody, load, show],
    Reset=Button(),
    Threshold=1e-15,
    Tolerance=0.01,
    Damping=0.99,
    Iterations=10,
    On=Toggle(False))  # -> I, V, O
kangaroo_2 = KangarooPhysics(
    ForceObjects=flatten([springs_4, springs_2, uforce_2]),
    Settings=kangaroo_settings_2,
    Geometry=line_2,
    SimulationReset=Toggle(False))  # -> Out, Iterations, ParticlesOut, GeometryOut, KE
geo = Geometry(bouncysolver.O)
geo_2 = Geometry(kangaroo.GeometryOut)
panel = Panel(geo_2)
bool = Boolean(True)
branch = TreeBranch(Tree=geo_2, Path="{0}", MaintainPaths=False)
geo_3 = Geometry(kangaroo_2.GeometryOut)
simplify = SimplifyTree(Tree=geo_2, Front=bool)
viewer = ParamViewer(geo_2)
panel_2 = Panel(geo_3)
bool_2 = Boolean(True)
pipe = Pipe(Curve=branch, Radius=1, Caps=0)
branch_2 = TreeBranch(Tree=geo_3, Path="{0}", MaintainPaths=False)
simplify_2 = SimplifyTree(Tree=geo_3, Front=bool_2)
viewer_2 = ParamViewer(geo_3)
pipe_2 = Pipe(Curve=branch_2, Radius=1, Caps=0)
viewer_3 = ParamViewer(simplify)
viewer_4 = ParamViewer(branch)
viewer_5 = ParamViewer(simplify_2)
viewer_6 = ParamViewer(branch_2)
