# Grasshopper definition Tensegrity-1.ghx (Grasshopper 0.9.76)
# plug-ins: Kangaroo Components

# ---- group: Cable
cables = Curve([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])

# ----
struts = Curve([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])

# ---- group: Gravity
slider = Slider(-100, range=-100..900)

# ----
div = DivideDomain(Domain=Domain(0, 1), Count=10)

# ---- group: Cable pre-tension
slider_2 = Slider(0.644, range=0..1)

# ----
subcrv = SubCurve(BaseCurve=reparameterize(graft(cables)), Domain=div)
end = EndPoints(Curve=struts)  # -> Start, End
Z = UnitZ(Factor=slider)
len = Length(Curve=subcrv)
springs = SpringsFromLine(
    Connection=struts,
    Stiffness=5000,
    Damping=10,
    RestLength=struts,
    Cutoff=0,
    CompressionFail=0,
    TensileFail=0,
    Plasticity=0)
kangaroo_settings = KangarooSettings(
    Tolerance=0.001,
    TimeStep=0.01,
    SubIterations=20,
    Floor=True,
    Drag=1,
    Restitution=0.7,
    StaticFriction=10,
    KineticFriction=10,
    Settle=2,
    Tumble=1,
    Sound=False,
    Solver=0)
multiplication = Multiplication(A=len, B=slider_2)
line = Line([subcrv, struts])
uforce = UnaryForce(Point=[end.Start, end.End], Force=Z)
springs_2 = SpringsFromLine(
    Connection=subcrv,
    Stiffness=1000,
    Damping=10,
    RestLength=multiplication,
    Cutoff=0,
    CompressionFail=0,
    TensileFail=0,
    Plasticity=0)

timer = Timer(TimerInterval=1, Target=kangaroo)

kangaroo = KangarooPhysics(
    ForceObjects=flatten([springs_2, springs, uforce]),
    Settings=kangaroo_settings,
    Geometry=line,
    SimulationReset=Toggle(False))  # -> Out, Iterations, ParticlesOut, GeometryOut, KE
geo = Geometry(kangaroo.GeometryOut)
panel = Panel(geo)
bool = Boolean(True)
branch = TreeBranch(Tree=geo, Path="{0}", MaintainPaths=False)
simplify = SimplifyTree(Tree=geo, Front=bool)
viewer = ParamViewer(geo)
pipe = Pipe(Curve=branch, Radius=1, Caps=0)
viewer_2 = ParamViewer(simplify)
viewer_3 = ParamViewer(branch)
