# Grasshopper definition Tensile-Ridge-Beam.ghx (Grasshopper 0.9.76)
# plug-ins: Kangaroo2 Components

mesh = Mesh(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)
medges = MeshEdges(Mesh=mesh)  # -> NakedEdges, InteriorEdges, NonManifoldEdges
xy = XYPlane(Origin=Point(0, 0, 0))
mc = MeshCorners(Mesh=mesh, Angle=2.35619449)
demesh = DeconstructMesh(Mesh=mesh)  # -> Vertices, Faces, Colours, Normals
crv = Curve(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)
pt = Point([Point(5, 15, 0), Point(35, 15, 0)])
mirror = Mirror(Geometry=crv, Plane=xy)  # -> Geometry, Transform
pt_2 = Point([Point(35, 15, 0), Point(34, 15, 0), Point(33, 15, 0), Point(32, 15, 0), Point(31, 15, 0), Point(30, 15, 0), Point(29, 15, 0), Point(28, 15, 0), Point(27, 15, 0), Point(26, 15, 0)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])
anchor = Anchor(Point=pt, Strength=10000)
anchor_2 = Anchor(Point=mc, Strength=10000)
length_line = LengthLine(Line=medges.NakedEdges, Length=0, Strength=10)
length_line_2 = LengthLine(Line=medges.InteriorEdges, Length=0, Strength=Slider(0.77, range=0..1))
show = Show(G=mesh)
oncurve = OnCurve(Points=pt_2, Curve=mirror.Geometry, Strength=10)
pipe = Pipe(Curve=mirror.Geometry, Radius=Slider(0.2, range=0..1), Caps=0)
panel = Panel(oncurve)
button = Button()
toggle = BooleanToggle(True)
entwine = Entwine(Branch00=show, Branch01=[anchor_2, length_line_2, length_line, anchor, oncurve], FlattenInputs=True)  # -> flatten(Result)
panel_2 = Panel(entwine)
bouncysolver = BouncySolver(GoalObjects=entwine, Reset=button, Threshold=1e-15, Tolerance=0.01, Damping=0.99, Iterations=10, On=toggle)  # -> I, V, O
solver = Solver(GoalObjects=entwine, Reset=button, Threshold=1e-15, Tolerance=0.01, On=toggle)  # -> I, V, O
item = ListItem(List=solver.O, Index=0, Wrap=True)
item_2 = ListItem(List=bouncysolver.O, Index=0, Wrap=True)
mesh_2 = Mesh(item)
mesh_3 = Mesh(item_2)
