# Grasshopper definition Tensile-SoapFilm.ghx (Grasshopper 0.9.76)
# plug-ins: Kangaroo Components, Kangaroo2 Components

mesh = Mesh(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)
tri = Triangulate(Mesh=mesh)  # -> Mesh, Count
faceb = FaceBoundaries(Mesh=tri.Mesh)  # -> graft(Boundaries)
nv = NakedVertices(Mesh=mesh)  # -> ClothedIndex, NakedIndex, ClothedPts, NakedPts
explode = Explode(Curve=faceb, Recursive=True)  # -> Segments, Vertices
pt = Point(nv.NakedPts)
end = EndPoints(Curve=explode.Segments)  # -> Start, End
anchor = Anchor(Point=nv.NakedPts, Strength=10000)
anchor_2 = Anchor(Point=nv.NakedPts, Strength=1000)
sg = SoapFilm(Pts=end.Start, Strength=1)
tsmooth = TangentialSmooth(M=mesh, Strength=10)
show = Show(G=tri.Mesh)
merge = Merge(Data1=show, Data2=anchor, Data3=sg, Data4=tsmooth)  # -> flatten(Result)
solver = Solver(GoalObjects=merge, Reset=Button(), Threshold=1e-15, Tolerance=0.01, On=Toggle(False))  # -> I, V, O
data = Data(solver.O)
mesh_2 = Mesh(solver.O)
