# Grasshopper definition Tensile-Tunnels.ghx (Grasshopper 0.9.76)
# plug-ins: Kangaroo Components, Kangaroo2 Components

mesh = Mesh(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)
refine = Refine(Mesh=mesh, Level=3)
medges = MeshEdges(Mesh=refine)  # -> NakedEdges, InteriorEdges, NonManifoldEdges
clean = CombineClean(Meshes=refine)
medges_2 = MeshEdges(Mesh=clean)  # -> NakedEdges, InteriorEdges, NonManifoldEdges
join = JoinCurves(Curves=medges_2.NakedEdges, Preserve=False)
item = ListItem(List=join, Index=0, Wrap=True)  # -> Item, Item1, Item2
explode = Explode(Curve=item.Item, Recursive=True)  # -> Segments, Vertices
explode_2 = Explode(Curve=item.Item1, Recursive=True)  # -> Segments, Vertices
explode_3 = Explode(Curve=item.Item2, Recursive=True)  # -> Segments, Vertices
end = EndPoints(Curve=explode.Segments)  # -> Start, End
end_2 = EndPoints(Curve=explode_2.Segments)  # -> Start, End
end_3 = EndPoints(Curve=explode_3.Segments)  # -> Start, End
merge = Merge(Data1=end.End, Data2=end_2.End, Data3=end_3.End)
pt = Point(merge)
crv = Curve(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)
crv_2 = Curve(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)
crv_3 = Curve(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)
length_line = LengthLine(Line=[medges_2.NakedEdges, medges_2.InteriorEdges], Length="0", Strength=1)
show = Show(G=clean)
oncurve = OnCurve(Points=end.End, Curve=crv, Strength="100")
oncurve_2 = OnCurve(Points=end_2.End, Curve=crv_2, Strength="100")
oncurve_3 = OnCurve(Points=end_3.End, Curve=crv_3, Strength="100")
merge_2 = Merge(Data1=crv, Data2=crv_2, Data3=crv_3)
pipe = Pipe(Curve=merge_2, Radius=Slider(0.2, range=0..1), Caps=0)
merge_3 = Merge(Data1=show, Data2=length_line, Data3=oncurve, Data4=oncurve_2, Data5=oncurve_3)  # -> flatten(Result)
toggle = BooleanToggle(False)
button = Button()
bouncysolver = BouncySolver(GoalObjects=merge_3, Reset=button, Threshold=1e-15, Tolerance=0.01, Damping=0.99, Iterations=10, On=toggle)  # -> I, V, O
solver = Solver(GoalObjects=merge_3, Reset=button, Threshold=1e-15, Tolerance=0.01, On=toggle)  # -> I, V, O
item_2 = ListItem(List=solver.O, Index=0, Wrap=True)
mesh_2 = Mesh(item_2)
